# Dynamo graph AutoUIForm2.0.dyn (Dynamo 2.16.2.5624)

string = StringInput("""we need this
zfer
zegezr
regzerz
""")  # graph input
number_slider = DoubleSlider(38, range=0..100 step 0.1)  # graph input
boolean = BoolSelector(false)
number = DoubleInput(10)  # graph input
a_very_very_very_very_very_very = Filename("No file selected.")  # "A very very very very very very very very very long item title"; graph input
boolean_2 = BoolSelector(false)  # graph input
directory_path = Directory("No file selected.")  # graph input
custom_selection = CustomSelection("One", items={One: "1", Two: "2", Three: "3"})  # graph input
list_create = List.Create(item0=string, item1=number_slider, item2=boolean, item3=number, item4=a_very_very_very_very_very_very, item5=boolean_2, item6=directory_path, item7=custom_selection)
watch = Watch(list_create)  # graph output
code_block = CodeBlock(x=watch) { x; }
