# Dynamo graph Home.dyn (Dynamo 2.13.1.3887)

string = StringInput("")  # graph input
number_slider = DoubleSlider(1, range=0..100 step 0.1)  # graph input
# note: *Orkestra*
# this is some information
select_model_element = DSModelElementSelection()  # nothing selected; graph input
list_create = List.Create(item0=string, item1=number_slider, item2=select_model_element)  # graph output
