# Dynamo graph LineC3D_UIForm.dyn (Dynamo 2.10.1.3976)

byCoordinates = Point.ByCoordinates()
number_slider = DoubleSlider(1, range=0..100 step 0.1)  # graph input
number_slider_2 = DoubleSlider(100, range=0..100 step 0.1)  # graph input
byCoordinates_2 = Point.ByCoordinates(x=number_slider, y=number_slider_2)
code_block = CodeBlock { 0..10000..10; }
translate = Geometry.Translate(geometry=byCoordinates_2, zTranslation=code_block)
code_block_2 = CodeBlock { "0"; }
current = Autodesk.AutoCAD.DynamoNodes.Document.Current()
blocks = Autodesk.AutoCAD.DynamoNodes.Document.Blocks(document=current)
code_block_3 = CodeBlock(x=blocks) { x[0]; }
byTwoPoints = Autodesk.AutoCAD.DynamoNodes.Line.ByTwoPoints(startPoint=byCoordinates, endPoint=translate, layer=code_block_2, block=code_block_3)  # graph output
watch = Watch(byTwoPoints)  # graph output
translate_2 = Geometry.Translate(geometry=byCoordinates, zTranslation=code_block)
