# Dynamo graph Rename Keys in schedule.dyn (Dynamo 2.6.1.8786)

file_path = Filename("..\..\..\DATA SHAPES\DATA SHAPES - Documents\014 - Nouvelle AOM\001 - Tour Main Montparnasse\Production\FICHES PROGRAMME\Fiches Locaux - Liste des typologies et propriétés associées_V3.xlsx")
file_from_path = FileObject(path=file_path)
code_block = CodeBlock { "Codes Typologies"; true; }
importExcel = Data.ImportExcel(file=file_from_path, sheetName=code_block.out0, readAsStrings=code_block.out1)
transpose = List.Transpose(lists=importExcel)
code_block_2 = CodeBlock(x=transpose) { x[5]; }
code_block_3 = CodeBlock { 3; }
dropItems = List.DropItems(list=code_block_2, amount=code_block_3)
python_script = Python(IN[0]=dropItems)
# ---------- python_script.python (36 lines) ----------
# Load the Python Standard and DesignScript Libraries
import sys
import clr
clr.AddReference('RevitAPI')
from Autodesk.Revit.DB import *

clr.AddReference('RevitServices')
from RevitServices.Persistence import DocumentManager
from RevitServices.Transactions import TransactionManager


doc = DocumentManager.Instance.CurrentDBDocument
viewSchedule = doc.ActiveView
fec = FilteredElementCollector(doc,viewSchedule.Id).ToElements()


names = IN[0]


TransactionManager.Instance.EnsureInTransaction(doc)
output = []


for name,key in zip(names,fec):
	key.LookupParameter("Key Name").Set(name)	


TransactionManager.Instance.TransactionTaskDone

doc.Regenerate()





OUT = "ok"
# ----------------------------------------
