# Dynamo graph 03_Data_Management.dyn "03_Data_Management_Definition" (Dynamo 2.0.2.6826)

# group: Number Range
# note: DesignScript syntax
code_block = CodeBlock { 2..6; }
watch = Watch(code_block)
number = DoubleInput(0)  # graph input
number_2 = DoubleInput(10)  # graph input
number_3 = DoubleInput(2)  # graph input
# note: Nodal composition
range = Range(start=number, end=number_2, step=number_3, lacing=Longest)
watch_2 = Watch(range)

# group: Number Sequence
# note: DesignScript syntax
code_block_2 = CodeBlock { 2..#6..10; }
watch_3 = Watch(code_block_2)
number_4 = DoubleInput(0)  # graph input
number_5 = DoubleInput(10)  # graph input
number_6 = DoubleInput(2)  # graph input
# note: Nodal composition
sequence = Sequence(start=number_4, amount=number_5, step=number_6, lacing=Longest)
watch_4 = Watch(sequence)

# group: Input
integer_slider = IntegerSlider(35, range=0..100 step 1)  # graph input

# group: Dynamo Creation
code_block_3 = CodeBlock(a=integer_slider)
# ---------- code_block_3.designscript (3 lines) ----------
// DesignScript syntax:
// Start..End..#amount;
0..20..#a;
# ----------------------------------------
watch_5 = Watch(code_block_3)
radiansToDegrees = Math.RadiansToDegrees(radians=watch_5)
sin = Math.Sin(angle=radiansToDegrees)
number_7 = DoubleInput(0)  # graph input
byCoordinates = Point.ByCoordinates(x=watch_5, y=sin, z=number_7, lacing=Longest)
number_8 = DoubleInput(0)  # graph input
number_9 = DoubleInput(10)  # graph input
byCoordinates_2 = Point.ByCoordinates(x=watch_5, y=number_8, z=number_9, lacing=Longest)
byStartPointEndPoint = Line.ByStartPointEndPoint(startPoint=byCoordinates, endPoint=byCoordinates_2, lacing=Longest)
