# Dynamo graph All-RVT-DynamoTemplate_2020.dyn (Dynamo 2.10.1.3976)
# {'1.office': 'London','2.author': 'Matthew Pearce','3.email': 'matthew.pearce@mottmac.com','4.version': '','5.tested on': '2018/03/07','6.category': 'Structure','7.rating': '5','8.keywords': 'data revit creation','9.user': 'markt'}

# group: FUNCTION
# note: data manipulation on dynamo objects

# group: GET
# note: Get parameter values from Revit objects

# group: INPUT
# note: Data input and preparation

# group: SET
# note: Set parameter values of Revit objects

# group: OUTPUT
# note: Object creation in Revit, Final output

# group: DEBUG
# note: Nodes used to debug the graph logic

# group: WIP
# note: Notes not considered part of the final package

# group: Mott MacDonald Template
# note: GRAPH INFO
# Copyright: Mott MacDonald
# Company: Mott MacDonald
# Graph Version: 0.0.3
# Tested on:
# Dynamo 2.X.X
# Revit 201X.X
# Packages Required:
# note: DESCRIPTION
# note: NOTE: ALWAYS RUN GRAPH IN MANUAL MODE
useful_links_ctrl_click_the_link = CodeBlock()  # "Useful Links | CTRL + Click the link below"
# ---------- useful_links_ctrl_click_the_link.designscript (4 lines) ----------
"https://mottmac.sharepoint.com/sites/cs-00003/Wiki/Dynamo.aspx";
"https://mottmac.sharepoint.com/sites/cs-00003/Wiki/Mott%20MacDonald%20Dynamo%20Template.aspx";
"https://mottmac.sharepoint.com/sites/cs-00003/Wiki/Dynamo%20Guidance.aspx";
"https://mottmac.sharepoint.com/sites/cs-00003/Wiki/Dynamo%20Training.aspx";
# ----------------------------------------
# note: INPUTS
# IN[0] = Walls
# IN[1] = Height
# OUPUT
# OUT = Data
# note: Write Input and Output Notes for Python Scripts and group the note with the Python Scipt node.
# Note: Node contains boilerplate code for use in projects.
python_script = Python()  # IronPython2; frozen; unwired: IN[0], IN[1]
# ---------- python_script.python (30 lines) ----------
import clr
clr.AddReference('ProtoGeometry')
from Autodesk.DesignScript.Geometry import *

# import revit API
clr.AddReference("RevitAPI")
import Autodesk
from Autodesk.Revit.DB import *
#import document manager and transacetion 
clr.AddReference("RevitServices")
import RevitServices
from RevitServices.Persistence import DocumentManager
from RevitServices.Transactions import TransactionManager
#import ToDSType bool extension method
clr.AddReference("RevitNodes")
import Revit
clr.ImportExtensions(Revit.Elements)
clr.ImportExtensions(Revit.GeometryConversion)

doc = DocumentManager.Instance.CurrentDBDocument

#Create transaction
TransactionManager.Instance.EnsureInTransaction(doc)

#Put script code here


TransactionManager.Instance.TransactionTaskDone()
#Assign your output to the OUT variable.
OUT = 0
# ----------------------------------------
# note: KNOWN ISSUES & LIMITATIONS
# note: GUIDELINES
# Read the instructions.
# Add Notes (Ctrl + W) and Comments to the graph.
# Use the Cleanup Node Layout command (Ctrl + L) on the graph and inside Groups to enhance legibility.
# Use Node Groups and the Standard Color Coding.
# Rename Nodes: <OriginalName> | <Description>.
# note: FURTHER DEVELOPMENT AND IDEAS
boolean_toggle_on_off = BoolSelector(false)  # graph input; frozen
# note: INSTRUCTIONS
# 1. During graph development please keep PostMetricsToHums node frozen
# note: NAMING CONVENTION
# [DISCIPLINE]-[SOFTWARE]-[FUNCTION]_[SOFTWARE VERSION].
# Example:
# M-RVT-ExportCategoryParameters_2019
# note: Inputs
# Equivalent manual effort (minutes) (integer)
# Description of metric to be measured (string)
# Script name (string)
# Script action (string, ALL UPPER CASE)
# Script version (string, format 0.0.0)
code_block_metricinputs = CodeBlock { 30; "EquivalentManualEffort(mins)"; "XXXXXX-MMD-TM-ZZ-DY-Z-000000-DynamoTemplate"; "TEMPLATE"; "0.0.2"; }
# note: This node sends metrics to the Hums metric server.
postMetricsToHums = PostMetricsToHums(value=code_block_metricinputs.out0, description=code_block_metricinputs.out1, scriptName=code_block_metricinputs.out2, applicationAction=code_block_metricinputs.out3, scriptVersion=code_block_metricinputs.out4)  # frozen
watch = Watch(postMetricsToHums)

byCenterPointRadius = Circle.ByCenterPointRadius()
number_slider = DoubleSlider(23.8, range=0..100 step 0.1)
number_slider_2 = DoubleSlider(20.2, range=0..100 step 0.1)
number_slider_3 = DoubleSlider(27, range=0..100 step 0.1)
byCoordinates = Point.ByCoordinates(x=number_slider, y=number_slider_2, z=number_slider_3)
number_slider_4 = DoubleSlider(43.3, range=0..100 step 0.1)
number_slider_5 = DoubleSlider(0, range=0..100 step 0.1)
number_slider_6 = DoubleSlider(14.1, range=0..100 step 0.1)
byCoordinates_2 = Point.ByCoordinates(x=number_slider_4, y=number_slider_5, z=number_slider_6)
byStartPointEndPoint = Line.ByStartPointEndPoint(startPoint=byCoordinates, endPoint=byCoordinates_2)
number_slider_7 = DoubleSlider(77.1, range=0..100 step 0.1)
number_slider_8 = DoubleSlider(31.2, range=0..100 step 0.1)
number_slider_9 = DoubleSlider(27, range=0..100 step 0.1)
byCoordinates_3 = Point.ByCoordinates(x=number_slider_7, y=number_slider_8, z=number_slider_9)
number_slider_10 = DoubleSlider(44.3, range=0..100 step 0.1)
number_slider_11 = DoubleSlider(0, range=0..100 step 0.1)
number_slider_12 = DoubleSlider(14.1, range=0..100 step 0.1)
byCoordinates_4 = Point.ByCoordinates(x=number_slider_10, y=number_slider_11, z=number_slider_12)
code_block = CodeBlock(point1=byCoordinates_3, point2=byCoordinates_4) { line1 = Line.ByStartPointEndPoint(point1, point2); }
