# Dynamo graph Angle libre v1.0.DYN.dyn (Dynamo 1.3.3.4111)

# group: Infos
# note: _____________________DATA SHAPES____________________
# Script : Angle Libre
# Version : 1.3
# Développé pour : Dynamo 1.3 et Revit 2018/2019
# Packages utilisés : Data Shapes (version 2018.9.12)
# Description : Ce script calcule l'angle libre ainsi que la distance minimale pour une fenêtre par rapport à une voirie. Il créée et renseigne les paramètres.

# group: UI - fichier lié ou actif
code_block = CodeBlock { "Calcul de l'angle libre"; }
code_block_2 = CodeBlock { "Continuer"; "Annuler"; }
code_block_3 = CodeBlock { "La voie à prendre en compte est :"; }
code_block_4 = CodeBlock { {"Dans un Fichier lié","Dans le Document actif"}; {true,false}; }
ui_radiobuttons_data = Custom[UI.RadioButtons Data](InputName=code_block_3, Keys=code_block_4.out0, Values=code_block_4.out1)  # Create radio buttons input for UI.MultipleInputForm ++ .
boolean = BoolSelector(true)
ui_multipleinputform = Custom[UI.MultipleInputForm ++](Description_optional=code_block, ButtonText_optional=code_block_2.out0, Inputs=ui_radiobuttons_data, Toggle=boolean, CancelButtonText_optional=code_block_2.out1)  # Create a form with multiple inputs. see www.data-shapes.net for tutorials and infos!
code_block_5 = CodeBlock(x=ui_multipleinputform.User_Inputs) { x[0]; }
code_block_6 = CodeBlock { "Sélectionner la voie sur le fichier lié"; "Sélectionner"; }
code_block_7 = CodeBlock { false; }
ui_selectlinkedelement_s_data = Custom[UI.SelectLinkedElement(s) Data](InputName=code_block_6.out0, ButtonText=code_block_6.out1, SelectSingleElement=code_block_7)  # Create a button input for UI.MultipleInputForm++ that allows to select elements in à linked document. See www.data-shapes.net for more infos!
code_block_8 = CodeBlock { "Sélectionner la voie"; }
ui_selectmodelelements_data = Custom[UI.SelectModelElements Data](InputName=code_block_8, ButtonText=code_block_6.out1, SelectSingleElement=code_block_7)  # Creates a Revit element selection input for UI.MultipleInputForm++ . Check out www.data-shapes.net for more infos!
code_block_9 = CodeBlock(test=code_block_5, link=ui_selectlinkedelement_s_data, host=ui_selectmodelelements_data) { linked = test? link : host; }

# group: UI
code_block_10 = CodeBlock { "Lancer le calcul"; "Annuler"; }
code_block_11 = CodeBlock { "Sélectionner les fenêtre à analyser"; "Sélectionner"; }
categories = Categories("Windows")
ui_selectmodelelements_data_2 = Custom[UI.SelectModelElements Data](InputName=code_block_11.out0, CategoryFilter=categories)
code_block_12 = CodeBlock { "Sélectionner la vue 3D contenant tous les éléments à prendre en compte"; }
python_script = Python()
# ---------- python_script.python (13 lines) ----------
import clr
clr.AddReference('RevitAPI')
from Autodesk.Revit.DB import *

clr.AddReference('RevitServices')
from RevitServices.Persistence import DocumentManager

doc = DocumentManager.Instance.CurrentDBDocument

vs = FilteredElementCollector(doc).OfClass(View).ToElements()
vt = [v for v in vs if v.ViewType == ViewType.ThreeD and not v.IsTemplate]

OUT = vt
# ----------------------------------------
viewName = Prorubim.Common.Revit.Elements.View.ViewName(python_script)
ui_dropdown_data = Custom[UI.DropDown Data](InputName=code_block_12, Keys=viewName, Values=python_script)  # Create data for DropDown input in UI.MultiInputForm ++ . Check out www.data-shapes.net for more infos.
code_block_13 = CodeBlock { "Angle Libre : Nom du paramètre à renseigner"; "Angle voie A"; }
ui_textbox_data = Custom[UI.TextBox Data](InputName=code_block_13.out0, DefaultText=code_block_13.out1)  # Create Data for TextBox input in UI.MultipleInputForm ++ . Check out www.data-shapes.net for more informations
code_block_14 = CodeBlock { "Distance Minimiale: Nom du paramètre à reseigner"; "Distance Minimiale voie A"; }
ui_textbox_data_2 = Custom[UI.TextBox Data](InputName=code_block_14.out0, DefaultText=code_block_14.out1)
code_block_15 = CodeBlock { "Sélectionner la façade (pour orientation de l'analyse)"; }
ui_selectfaces_data = Custom[UI.SelectFaces Data](ButtonText=code_block_15)  # Creates a Revit face selection input for UI.MultipleInputForm++. Check out www.data-shapes.net for more infos!
create = List.Create(ui_selectmodelelements_data_2, code_block_9, ui_dropdown_data, ui_textbox_data, ui_textbox_data_2, ui_selectfaces_data)
ui_multipleinputform_2 = Custom[UI.MultipleInputForm ++](Description_optional=code_block, ButtonText_optional=code_block_10.out0, Inputs=create, Toggle=ui_multipleinputform.Was_Run, CancelButtonText_optional=code_block_10.out1)
code_block_16 = CodeBlock(x=ui_multipleinputform_2.User_Inputs) { x[0]; x[1]; x[2]; x[3]; x[4]; x[5]; }

# group: Analyse de la géométrie de la voie
code_block_17 = CodeBlock()
# ---------- code_block_17.designscript (49 lines) ----------
def orient(c)
{
return = c.StartPoint.Z>c.EndPoint.Z? c.Reverse() : c;
}

def placepts(curve,dist)
{
l = curve.Length;
range = Flatten({0..l..dist,l});
pts = curve.PointAtSegmentLength(range);
return = pts;
};

def topc(s)
{
pcs = Flatten(s.PerimeterCurves());
test1 = Math.Abs(pcs.TangentAtParameter(0).Z) == 1;
firsttrue = IndexOf(test1,true);
shifted = DSCore.List.ShiftIndices(pcs,(-firsttrue-1));
test2 = Math.Abs(shifted.TangentAtParameter(0).Z) == 1;
splittrue = IndexOf(test2,true);
cvgr1 = shifted[0..(splittrue-1)];
cvgr2 = shifted[(splittrue+1)..Count(shifted)-2];
av1 = Math.Average(cvgr1.PointAtParameter(0.5).Z);
av2 = Math.Average(cvgr2.PointAtParameter(0.5).Z);
pc1 = PolyCurve.ByJoinedCurves(cvgr1);
pc2 = PolyCurve.ByJoinedCurves(cvgr2);
return = av1>av2?pc1:pc2;
}

def getCurve(e : var[],v,p)
{
g = e.Geometry();
s = Flatten(g.Explode());
vs = s.NormalAtParameter(0.5,0.5);
test = v.Dot(vs) > 0.1;
ss = DSCore.List.FilterByBoolMask(s,test)["in"];
topcvs = topc(ss);
testlength = topcvs.Length > 0.1;
topcv = DSCore.List.FilterByBoolMask(topcvs,testlength)["in"];
sps = Autodesk.Point.PruneDuplicates(Flatten(placepts(topcv,5)),0.1);
vref = v.Cross(Vector.ZAxis());
sortingvs = Vector.ByTwoPoints(p,sps);
angs = vref.AngleAboutAxis(sortingvs,Vector.ZAxis());
is = SortIndexByValue(angs);
sortedpts = sps[is];
pcfin = PolyCurve.ByPoints(sortedpts,false);
return = pcfin;
};
# ----------------------------------------
code_block_18 = CodeBlock(e=code_block_16.out0, facade=code_block_16.out5)
# ---------- code_block_18.designscript (4 lines) ----------
wloc = e.Location;
or = e.FacingOrientation;
gtr = wloc.Translate(or,0.5);
facadeOrientation = facade[0].NormalAtParameter(0.5,0.5);
# ----------------------------------------
code_block_19 = CodeBlock(e=code_block_16.out1, f=code_block_18.facadeOrientation, p=code_block_18.wloc) { cv = getCurve(e,f,p[0]); range = Flatten({0..cv.Length..0.5,cv.Length}); pts = cv.PointAtSegmentLength(range); }

# group: Gestion paramètres
categories_2 = Categories("Windows")
code_block_20 = CodeBlock(cats=categories_2, paramnameAngle=code_block_16.out3, paramnameDist=code_block_16.out4) { cats; paramnameAngle; paramnameDist; }
boolean_2 = BoolSelector(false)
python_script_2 = Python(IN[0]=code_block_20.cats, IN[1]=code_block_20.paramnameAngle, IN[2]=boolean_2)
# ---------- python_script_2.python (88 lines) ----------
import clr
import System
clr.AddReference('RevitAPI')
from Autodesk.Revit.DB import*
clr.AddReference('RevitServices')
from RevitServices.Persistence import DocumentManager
from RevitServices.Transactions import TransactionManager
clr.AddReference('RevitAPIUI')
from Autodesk.Revit.UI import *
from Autodesk.Revit import Creation
import sys
pyt_path = r'C:\Program Files (x86)\IronPython 2.7\Lib'
sys.path.append(pyt_path)

import System
import os
import tempfile


doc = DocumentManager.Instance.CurrentDBDocument
uidoc = DocumentManager.Instance.CurrentUIDocument
app = doc.Application

def tolist(input):
	if isinstance(input,list):
		return UnwrapElement(input)
	else:
		return [UnwrapElement(input)]
		
categories = tolist(IN[0])

#Vérification de l'existance du paramètre
paramname = IN[1]
iterator = doc.ParameterBindings.ForwardIterator()
testval = 0
while iterator.MoveNext():
	if categories[0].Name in [c.Name for c in iterator.Current.Categories] and paramname == iterator.Key.Name:
		testval+=1
	else:
		pass

if testval==0:
	#Creation d'une référence externe temporaire
	tempfolder = tempfile.gettempdir()
	tempfile = tempfolder +'\\'+'DATASHAPESTEMP.txt'
	f = open(tempfile,'w')
	f.write('')
	f.close()
		
	#creation d'un set de categories
	catset = app.Create.NewCategorySet()
	[catset.Insert(j) for j in categories]
	
	#recuperation du fichier de paramètres partagés pour remplacement temporaire
	orig = True
	try:
		originalFile = app.SharedParametersFilename
	except:
		pass
	
	#remplacement temporaire du fichier de paramètres partagés
	app.SharedParametersFilename = tempfile
	
	#Creation du paramètre dans le fichier externe temporaire
	groups = app.OpenSharedParameterFile().Groups
	tempgroup = groups.Create('TempParams')
	tempparam = ExternalDefinitionCreationOptions(paramname,ParameterType.Text)
	tempparam.UserModifiable = False
	tempdef = tempgroup.Definitions.Create(tempparam)
	
	paramgroup = [a for a in System.Enum.GetValues(BuiltInParameterGroup) if str(a) == "PG_IDENTITY_DATA"][0]
	
	#Ajout du paramètre au projet
	TransactionManager.Instance.EnsureInTransaction(doc)
	bind = app.Create.NewInstanceBinding(catset)
	bindmap = doc.ParameterBindings
	bindmap.Insert(tempdef, bind, paramgroup)
	
	#Rétablissement du fichier de paramètres partagés initial
	if orig:
		app.SharedParametersFilename = originalFile
	else:
		pass
	TransactionManager.Instance.TransactionTaskDone
else:
	pass

OUT = "ok"
# ----------------------------------------
python_script_3 = Python(IN[0]=code_block_20.cats, IN[1]=code_block_20.paramnameDist, IN[2]=boolean_2)  # same code as python_script_2
code_block_21 = CodeBlock(waitfor=python_script_2, pass=code_block_16.out3, waitfor2=python_script_3, passDist=code_block_16.out4) { {waitfor,pass}[1]; {waitfor2,passDist}[1]; }

# group: Calcul des angles libres
boolean_3 = BoolSelector(true)
python_script_4 = Python(IN[0]=code_block_18.gtr, IN[1]=code_block_19.pts, IN[2]=code_block_16.out2, IN[3]=boolean_3)
# ---------- python_script_4.python (121 lines) ----------
#Copyright (c) Alpha & Omega , 2018
#Ecrit par Mostafa El Ayoubi mostafa.elayoubi@data-shapes.net

import clr
clr.AddReference('RevitAPI')
from Autodesk.Revit.DB import*
from Autodesk.Revit.DB import Line as Li
clr.AddReference('ProtoGeometry')
from Autodesk.DesignScript.Geometry import *

clr.AddReference('RevitServices')
from RevitServices.Persistence import DocumentManager

clr.AddReference('RevitNodes')
import Revit
clr.ImportExtensions(Revit.GeometryConversion)

import sys
pyt_path = r'C:\Program Files (x86)\IronPython 2.7\Lib'
sys.path.append(pyt_path)
import math

doc = DocumentManager.Instance.CurrentDBDocument

#Document UI Units


UIunit = Document.GetUnits(doc).GetFormatOptions(UnitType.UT_Length).DisplayUnits

#Inputs : Points, Direction, 3D View

def tolist(input):
	if isinstance(input,list):
		return input
	else:
		return [input]
		
def trueRanges(l):
	out = []
	sub = []
	max = len(l)
	for e,i in enumerate(l):
		if i == True and e < max-1:
			if e == 0  and l[e+1] == False:
				out.append([e])
			elif e == 0 and l[e+1] == True:
				sub.append(e)
			elif e<max and l[e-1] == False and l[e+1] == False:
				out.append([e])
			elif  l[e-1] == False and l[e+1] == True:
				sub.append(e)
			elif  l[e-1] == True and l[e+1] == True:	
				continue
			elif  l[e-1] == True and l[e+1] == False:	
				sub.append(e)
				out.append(sub)
				sub = []
		elif i == True and e == max-1:
			if l[e-1] == False:
				out.append([e])
			elif l[e-1] == True:
				sub.append(e)
				out.append(sub)
				sub = []
		else:
			continue		
					
	return out


pts = tolist(IN[0])
points = [p.ToRevitType() for p in pts]

drs = tolist(IN[1])
direction = [d.ToRevitType() for d in drs]

view = UnwrapElement(IN[2])

ptss = []
test = []
angs = []
locxyz = []
rangewatch = []

ri = ReferenceIntersector(view)
ri.FindReferencesInRevitLinks = True

for p in points:
	ang = 0
	locp = []
	loct = []
	ranges = []
	locxyz = []
	for d in direction:
		try:
			ref = ri.FindNearest(p,d-p)
			refp = ref.GetReference().GlobalPoint
			loct.append(refp.IsAlmostEqualTo(d,0.02))
			locxyz.append(refp)
		except:
			pass
	#for verif
	ptss.append([l.ToPoint() for l,z in zip(locxyz,loct) if z])
	#
	ranges = trueRanges(loct)
	for r in ranges:
		if len(r) < 2:
			continue
		else:
			ang += (locxyz[r[1]]-p).AngleOnPlaneTo(locxyz[r[0]]-p,XYZ(0,0,1))
	if math.fabs(ang) >= math.pi:
		ang = 2*math.pi - ang%(2*math.pi)
	else:
		pass
	angs.append(ang)
	#for verif
	rangewatch.append(ranges)
	test.append(loct)
	#

OUT = angs , ptss , test , rangewatch
# ----------------------------------------
code_block_22 = CodeBlock(x=python_script_4) { x[0]; }
code_block_23 = CodeBlock(x=code_block_22) { x*180/Math.PI; }
code_block_24 = CodeBlock { 2; }
round = Math.Round(number=code_block_23, digits=code_block_24)

# group: Renseignement du paramètre Angles
string_from_object = FromObject(round)
code_block_25 = CodeBlock(d=string_from_object) { d + "°"; }
setParameterByName = Element.SetParameterByName(element=code_block_16.out0, parameterName=code_block_21.out0, value=code_block_25)

# group: Visualisation
code_block_26 = CodeBlock(x=python_script_4, y=code_block_18.wloc) { x[1][0]; y[0]; }
byStartPointEndPoint = Line.ByStartPointEndPoint(startPoint=code_block_26.out1, endPoint=code_block_26.out0)

# group: Renseignement du paramètre Distance
distanceTo = Geometry.DistanceTo(geometry=code_block_18.wloc, other=code_block_19.cv)
string_from_object_2 = FromObject(distanceTo)
setParameterByName_2 = Element.SetParameterByName(element=code_block_16.out0, parameterName=code_block_21.out1, value=string_from_object_2)

code_block_27 = CodeBlock(x=code_block_19.cv) { x; }
