# Dynamo graph Appartment Lyt By Lvl.dyn (Dynamo 2.12.1.8246)
# packages: Data-Shapes 2021.2.7, archi-lab.net 2020.23.13, Data-Shapes 2021.2.9, Clockwork for Dynamo 2.x 2.3.0, Rhythm 2020.2.13

boolean = BoolSelector(true)

# group: UI
code_block = CodeBlock { "Appartement Layout By Level"; }
code_block_2 = CodeBlock { "Select Level"; }
code_block_3 = CodeBlock { "Levels"; }
categorie_s_by_enu_name_s = Custom[Categorie(s) by ENU Name(s)](CategoryNameInEnglish=code_block_3)  # package Data-Shapes; Gets categorie(s) in the current UI language by it's english name
all_elements_of_category = ElementsOfCategory(Category=categorie_s_by_enu_name_s.Categorie_s)
name = Element.Name(element=all_elements_of_category)
dropdown_data = Custom[DropDown Data](InputName=code_block_2, Keys=name, Values=name)  # package Data-Shapes; Create data for DropDown input in UI.MultiInputForm ++ . Check out www.data-shapes.net for more infos.
code_block_4 = CodeBlock { "Select Reference View"; }
python_script = Python()  # IronPython2
# ---------- python_script.python (19 lines) ----------
import sys
import clr
clr.AddReference('RevitAPI')
from System.Collections.Generic import*
from Autodesk.Revit.DB import *

clr.AddReference('RevitServices')
from RevitServices.Persistence import DocumentManager

doc = DocumentManager.Instance.CurrentDBDocument

catfilters = []


plans = FilteredElementCollector(doc).OfClass(View).WhereElementIsNotElementType()
fplans = [v for v in plans if v.IsTemplate == False and v.ViewType == ViewType.FloorPlan]


OUT = fplans 
# ----------------------------------------
name_2 = Element.Name(element=python_script)
dropdown_data_2 = Custom[DropDown Data](InputName=code_block_4, Keys=name_2, Values=python_script)
code_block_5 = CodeBlock { "Select Title Block"; }
python_script_2 = Python()  # IronPython2
# ---------- python_script_2.python (21 lines) ----------
import sys
import clr
clr.AddReference('RevitAPI')
from System.Collections.Generic import*
from Autodesk.Revit.DB import *

clr.AddReference('RevitServices')
from RevitServices.Persistence import DocumentManager

doc = DocumentManager.Instance.CurrentDBDocument

catfilters = []

catfilters.append(ElementCategoryFilter(BuiltInCategory.OST_TitleBlocks))
catfilterlist = List[ElementFilter](catfilters)
filter = LogicalOrFilter(catfilterlist)

families = FilteredElementCollector(doc).OfClass(FamilySymbol).WherePasses(filter).ToElements()


OUT = families 
# ----------------------------------------
name_3 = Element.Name(element=python_script_2)
dropdown_data_3 = Custom[DropDown Data](InputName=code_block_5, Keys=name_3, Values=python_script_2)
code_block_6 = CodeBlock { "Select View Scale"; ["50","100","200"]; [50,100,200]; }
dropdown_data_4 = Custom[DropDown Data](InputName=code_block_6.out0, Keys=code_block_6.out1, Values=code_block_6.out2)
list_create = List.Create(item0=dropdown_data, item1=dropdown_data_2, item2=dropdown_data_3, item3=dropdown_data_4)
multipleinputform = Custom[MultipleInputForm ++](Description_optional=code_block, Inputs=list_create, Toggle=boolean)  # package Data-Shapes; Create a form with multiple inputs. see www.data-shapes.net for tutorials and infos!

code_block_7 = CodeBlock(x=multipleinputform.User_Inputs) { x[0]; x[1]; x[2]; x[3]; }
code_block_8 = CodeBlock { "Rooms"; }
categorie_s_by_enu_name_s_2 = Custom[Categorie(s) by ENU Name(s)](CategoryNameInEnglish=code_block_8)
all_elements_of_category_2 = ElementsOfCategory(Category=categorie_s_by_enu_name_s_2.Categorie_s)

# group: Filter by level
level = Custom[Element.Level](element=all_elements_of_category_2)  # package Clockwork for Dynamo 2.x; Gets an element's level
name_4 = Element.Name(element=level)
eq = name_4 == code_block_7.out0

filterByBoolMask = List.FilterByBoolMask(list=all_elements_of_category_2, mask=eq)

# group: Filtrage des pièces non placées et non fermées
data_shapes_room_status = Custom[Data-Shapes_Room Status](Rooms=filterByBoolMask.in)  # package Data-Shapes; Sorts a list of room into three categories: unplaced, PlacedAndBounded and unbounded

# group: Régroupement des pièces par valeur de paramètre "N° Appartement"
code_block_9 = CodeBlock { "N° Appartement"; }

code_block_10 = CodeBlock { 0.1; }
room_Group_Outline = Custom[Room_Group_Outline](Rooms=data_shapes_room_status.PlacedAndBounded, GroupingParameter=code_block_9, Offset=code_block_10)  # package Data-Shapes; Returns the outline of the inpu rooms, grouped by the value of the "Grouping Parameter"
count = List.Count(list=room_Group_Outline.GroupingValues)
ofRepeatedItem = List.OfRepeatedItem(item=code_block_7.out1, amount=count)
duplicate_options = DuplicateOptionsUi("Duplicate")
duplicate = archilab.Revit.Views.Views.Duplicate(view=ofRepeatedItem, name=room_Group_Outline.GroupingValues, options=duplicate_options)
setCropRegion = Custom[SetCropRegion](view=duplicate, CurvesAsList=room_Group_Outline.CurveLists)  # package Data-Shapes; Sets the crop region of a view to a closed polycurve.
python_script_3 = Python(IN[0]=code_block_7.out2, IN[1]=duplicate, IN[2]=room_Group_Outline.GroupingValues, IN[3]=room_Group_Outline.GroupingValues)  # IronPython2
# ---------- python_script_3.python (39 lines) ----------
# Activer la prise en charge de Python et charger la bibliothèque DesignScript
import clr
clr.AddReference('RevitAPI')
from Autodesk.Revit.DB import *
clr.AddReference('RevitServices')
from RevitServices.Persistence import DocumentManager
from RevitServices.Transactions import TransactionManager
clr.AddReference('RevitNodes')
import Revit
clr.ImportExtensions(Revit.Elements)

doc = DocumentManager.Instance.CurrentDBDocument

titleBlockType = UnwrapElement(IN[0])
areaViews = UnwrapElement(IN[1])
sheetNumbers = IN[2]
sheetNames = IN[3]



TransactionManager.Instance.EnsureInTransaction(doc)
output = []
for areaView,sheetNumber_,sheetName_ in zip(areaViews,sheetNumbers,sheetNames):
	try:
		sheetNumber = sheetNumber_
		sheetName = sheetName_
		vs = ViewSheet.Create(doc,titleBlockType.Id)
		vs.SheetNumber = sheetNumber
		vs.Name = sheetName
		Viewport.Create(doc,vs.Id,areaView.Id,XYZ(0,0,0))
		output.append(vs)
	except:
		pass
	
TransactionManager.Instance.TransactionTaskDone

"this is a new line"

OUT = output
# ----------------------------------------
end = Revit.Transaction.Transaction.End(input=python_script_3)
start = Revit.Transaction.Transaction.Start(input=end)
viewports = archilab.Revit.Views.Sheets.Viewports(sheet=start)
sheet_Titleblock = Custom[Sheet_Titleblock](Sheet=python_script_3)  # package Data-Shapes; Gets the titleblock used in a Sheet
python_script_4 = Python(IN[0]=sheet_Titleblock.TitleBlock_FamilyInstance, IN[1]=python_script_3)  # IronPython2
# ---------- python_script_4.python (34 lines) ----------
# Load the Python Standard and DesignScript Libraries
import sys
import clr
clr.AddReference('RevitAPI')
clr.AddReference('ProtoGeometry')
from Autodesk.Revit.DB import *
clr.AddReference('RevitNodes')
import Revit
from Autodesk.DesignScript.Geometry import Point as dsPt

clr.ImportExtensions(Revit.GeometryConversion)


def toList(input):
	if isinstance(input,list):
		return UnwrapElement(input)
	else:
		return [UnwrapElement(input)]

vplist = toList(IN[0])
sheets = toList(IN[1])
bbCorrners = []

for vp,sheet in zip(vplist,sheets):
	bb = UnwrapElement(vp).get_BoundingBox(sheet)
	dsmin = bb.Min.ToPoint()
	dsmax = bb.Max.ToPoint()
	corners = []
	corners.append(dsPt.ByCoordinates(dsmin.X,dsmin.Y,0))
	corners.append(dsPt.ByCoordinates(dsmax.X,dsmin.Y,0))
	corners.append(dsPt.ByCoordinates(dsmax.X,dsmax.Y,0))
	corners.append(dsPt.ByCoordinates(dsmin.X,dsmax.Y,0))
	bbCorrners.append(corners)
OUT = bbCorrners
# ----------------------------------------
byPoints = Polygon.ByPoints(points=python_script_4)
center = Polygon.Center(polygon=byPoints)
ʳʰʸᵗʰᵐ_viewport_setboxcenter = Rhythm.Revit.Elements.Viewport.SetBoxCenter(viewport=viewports, point=center)
code_block_11 = CodeBlock(d=start) { d; }
