# Dynamo graph Excel Interop - Import v1.0.dyn (Dynamo 1.3.3.4111)

# group: Infos
# note: _____________________DATA SHAPES____________________
# Script : WindowData
# Version : 1.0
# Développé pour : Dynamo 1.3 et Revit 2018/2019
# Packages utilisés : Data Shapes (version 2018.9.12)
# Ce script lit les informations calulées dans le fichier Excel et permet de les importer dans Revit. Il Permet la création et le renseignement des paramètres correspondant à ces valeurs calculées.

code_block = CodeBlock { "Valider"; "Annuler"; }

# group: UI Data-Shapes
code_block_2 = CodeBlock { "Import de valeurs depuis Excel"; }
code_block_3 = CodeBlock { "Sélectionner le fichier Excel"; }
ui_filepath_data = Custom[UI.FilePath Data](InputName=code_block_3)  # Create filepath input for UI.MultipleInputForm ++ . Check out www.data-shapes.net for more infos !
boolean = BoolSelector(true)
code_block_4 = CodeBlock { 500; }
ui_multipleinputform = Custom[UI.MultipleInputForm ++](Description_optional=code_block_2, ButtonText_optional=code_block.out0, Inputs=ui_filepath_data, Toggle=boolean, CancelButtonText_optional=code_block.out1, Width_optional=code_block_4)  # Create a form with multiple inputs. see www.data-shapes.net for tutorials and infos!

code_block_5 = CodeBlock(x=ui_multipleinputform.User_Inputs) { x[0]; }
fromPath = FileObject(code_block_5)  # "File.FromPath"
code_block_6 = CodeBlock { "Valider"; "Annuler"; }
worksheets = Custom[Excel.Worksheets](FilePath=code_block_5)  # Gets worksheet names from specified Excel workbook.

# group: UI Data-Shapes
code_block_7 = CodeBlock { "Import de valeurs depuis Excel"; }
code_block_8 = CodeBlock { "Sélectionner la feuille à utiliser"; }
ui_dropdown_data = Custom[UI.DropDown Data](InputName=code_block_8, Keys=worksheets, Values=worksheets)  # Create data for DropDown input in UI.MultiInputForm ++ . Check out www.data-shapes.net for more infos.
code_block_9 = CodeBlock { 500; }
ui_multipleinputform_2 = Custom[UI.MultipleInputForm ++](Description_optional=code_block_7, ButtonText_optional=code_block_6.out0, Inputs=ui_dropdown_data, Toggle=ui_multipleinputform.Was_Run, CancelButtonText_optional=code_block_6.out1, Width_optional=code_block_9)

code_block_10 = CodeBlock(x=ui_multipleinputform_2.User_Inputs) { x[0]; }
readFromFile = Excel.ReadFromFile(file=fromPath, sheetName=code_block_10)
transpose = List.Transpose(readFromFile)
code_block_11 = CodeBlock { 1; }
getItemAtIndex = List.GetItemAtIndex(list=transpose, index=code_block_11)
isNull = Object.IsNull(getItemAtIndex)
filterByBoolMask = List.FilterByBoolMask(list=getItemAtIndex, mask=isNull)
code_block_12 = CodeBlock { 1; }
dropItems = List.DropItems(list=filterByBoolMask.out, amount=code_block_12)
code_block_13 = CodeBlock(guid=dropItems) { Revit.ElementSelector.ByUniqueId(guid); }
removeItemAtIndex = List.RemoveItemAtIndex(list=transpose, indices=code_block_11)
code_block_14 = CodeBlock { 6; }
getItemAtIndex_2 = List.GetItemAtIndex(list=transpose, index=code_block_14, lacing=Longest)
removeItemAtIndex_2 = List.RemoveItemAtIndex(list=getItemAtIndex_2, indices=code_block_11)
isNull_2 = Object.IsNull(removeItemAtIndex_2)
filterByBoolMask_2 = List.FilterByBoolMask(list=removeItemAtIndex_2, mask=isNull_2)
code_block_15 = CodeBlock { "_"; }
startsWith = String.StartsWith(str=filterByBoolMask_2.out, searchFor=code_block_15)
filterByBoolMask_3 = List.FilterByBoolMask(list=filterByBoolMask_2.out, mask=startsWith)
filterByBoolMask_4 = List.FilterByBoolMask(list=filterByBoolMask_3.out, mask=isNull)
code_block_16 = CodeBlock(l=removeItemAtIndex_2) { 0..(Count(l)-1); }
filterByBoolMask_5 = List.FilterByBoolMask(list=code_block_16, mask=isNull_2)
filterByBoolMask_6 = List.FilterByBoolMask(list=filterByBoolMask_5.out, mask=startsWith)
filterByBoolMask_7 = List.FilterByBoolMask(list=filterByBoolMask_6.out, mask=isNull)
code_block_17 = CodeBlock { 500; }

# group: UI Data Shapes 3
code_block_18 = CodeBlock { "Valider"; "Annuler"; }
code_block_19 = CodeBlock { "Sélectionner les valeurs à importer dans Revit"; }
ui_listview_data = Custom[UI.Listview Data](InputName=code_block_19, Keys=filterByBoolMask_4.out, Values=filterByBoolMask_7.out)  # Create data for ListView input in UI.MultiInputForm ++ . Check out www.data-shapes.net for more infos.
ui_multipleinputform_3 = Custom[UI.MultipleInputForm ++](Description_optional=code_block_7, ButtonText_optional=code_block_18.out0, Inputs=ui_listview_data, Toggle=ui_multipleinputform_2.Was_Run, CancelButtonText_optional=code_block_18.out1, Width_optional=code_block_17)

code_block_20 = CodeBlock(x=ui_multipleinputform_3.User_Inputs) { x; }
getItemAtIndex_3 = List.GetItemAtIndex(list=removeItemAtIndex, index=code_block_20)
filterByBoolMask_8 = List.FilterByBoolMask(list=getItemAtIndex_3@L2, mask=isNull)
code_block_21 = CodeBlock(x=filterByBoolMask_8.out) { x; }
deconstruct = List.Deconstruct(list=code_block_21, lacing=Longest)

# group: Création des paramètres non existants
categories = Categories("Windows")
code_block_22 = CodeBlock(cats=categories, paramname=deconstruct.first) { cats; paramname; }
boolean_2 = BoolSelector(false)
python_script = Python(IN[0]=code_block_22.cats, IN[1]=code_block_22.paramname, IN[2]=boolean_2)
# ---------- python_script.python (101 lines) ----------
import clr
import System
clr.AddReference('RevitAPI')
from Autodesk.Revit.DB import*
clr.AddReference('RevitServices')
from RevitServices.Persistence import DocumentManager
from RevitServices.Transactions import TransactionManager
clr.AddReference('RevitAPIUI')
from Autodesk.Revit.UI import *
from Autodesk.Revit import Creation
import sys
pyt_path = r'C:\Program Files (x86)\IronPython 2.7\Lib'
sys.path.append(pyt_path)

import System
import os
import tempfile


doc = DocumentManager.Instance.CurrentDBDocument
uidoc = DocumentManager.Instance.CurrentUIDocument
app = doc.Application

def tolist(input):
	if isinstance(input,list):
		return UnwrapElement(input)
	else:
		return [UnwrapElement(input)]
		
categories = tolist(IN[0])

#Vérification de l'existance du paramètre


def listing(input):
	if isinstance(input,list):
		return input
	else:
		return [input]
		
paramnames = listing(IN[1])


#Creation d'une référence externe temporaire
tempfolder = tempfile.gettempdir()
tempfile = tempfolder +'\\'+'DATASHAPESTEMP.txt'
f = open(tempfile,'w')
f.write('')
f.close()

TransactionManager.Instance.EnsureInTransaction(doc)

#recuperation du fichier de paramètres partagés pour remplacement temporaire
orig = True
try:
	originalFile = app.SharedParametersFilename
except:
	orig = False

#remplacement du fichier de paramètres partagés et création des paramètres de projet
app.SharedParametersFilename = tempfile
groups = app.OpenSharedParameterFile().Groups
tempgroup = groups.Create('TempParams')

for paramname in paramnames:
	iterator = doc.ParameterBindings.ForwardIterator()
	testval = 0
	while iterator.MoveNext():
		if categories[0].Name in [c.Name for c in iterator.Current.Categories] and paramname == iterator.Key.Name:
			testval=1
		else:
			pass	
	if testval==0:			
		#creation d'un set de categories
		catset = app.Create.NewCategorySet()
		[catset.Insert(j) for j in categories]
		
		#Creation du paramètre dans le fichier externe temporaire
		tempparam = ExternalDefinitionCreationOptions(paramname,ParameterType.Text)
		tempparam.UserModifiable = False
		tempdef = tempgroup.Definitions.Create(tempparam)		
		paramgroup = [a for a in System.Enum.GetValues(BuiltInParameterGroup) if str(a) == "PG_IDENTITY_DATA"][0]
		
		#Ajout du paramètre au projet	
		bind = app.Create.NewInstanceBinding(catset)
		bindmap = doc.ParameterBindings
		bindmap.Insert(tempdef, bind, paramgroup)
		
		

		
	else:
		pass
#Rétablissement du fichier de paramètres partagés initial
if orig:
	app.SharedParametersFilename = originalFile
else:
	pass
TransactionManager.Instance.TransactionTaskDone

OUT = "ok"
# ----------------------------------------

code_block_23 = CodeBlock(x=deconstruct.rest) { x; }
transpose_2 = List.Transpose(code_block_23)
string_from_object = FromObject(transpose_2)

# group: Renseignement des paramètres
code_block_24 = CodeBlock(waitfor=python_script, pass=deconstruct.first) { {waitfor,pass}[1]; }
setParameterByName = Element.SetParameterByName(element=code_block_13@L1, parameterName=code_block_24@L2, value=string_from_object@L2, lacing=Longest)

code_block_25 = CodeBlock(x=filterByBoolMask_5.out) { x; }
