# Dynamo graph ExcelInterop v0.1.dyn (Dynamo 1.3.3.4111)

# group: UI Data Shapes
code_block = CodeBlock { "Export à partir d'un gabarit Excel"; "Exporter"; "Annuler"; }
code_block_2 = CodeBlock { "Sélectionner le gabarit Excel"; }
ui_filepath_data = Custom[UI.FilePath Data](ButtonText=code_block_2)  # Create filepath input for UI.MultipleInputForm ++ . Check out www.data-shapes.net for more infos !
code_block_3 = CodeBlock { "Repetroire de création de l'export"; }
ui_directorypath_data = Custom[UI.DirectoryPath Data](ButtonText=code_block_3)  # Creates a DirectoryPath input for UI.MultipleInputForm ++ . Check out www.data-shapes.net for more infos!
code_block_4 = CodeBlock { "Nom du fichier d'export"; "AlphaOmega"; }
ui_textbox_data = Custom[UI.TextBox Data](InputName=code_block_4.out0, DefaultText=code_block_4.out1)  # Create Data for TextBox input in UI.MultipleInputForm ++ . Check out www.data-shapes.net for more informations
create = List.Create(ui_filepath_data, ui_directorypath_data, ui_textbox_data)
boolean = BoolSelector(true)
ui_multipleinputform = Custom[UI.MultipleInputForm ++](Description_optional=code_block.out0, ButtonText_optional=code_block.out1, Inputs=create, Toggle=boolean, CancelButtonText_optional=code_block.out2)  # Create a form with multiple inputs. see www.data-shapes.net for tutorials and infos!
code_block_5 = CodeBlock(x=ui_multipleinputform.User_Inputs) { x[0]; x[1]; x[2]; }

# group: Création du fichier d'export
code_block_6 = CodeBlock(dir=code_block_5.out1, fname=code_block_5.out2) { dir+fname+".xlsx"; }
python_script = Python(IN[0]=code_block_5.out0, IN[1]=code_block_6)
# ---------- python_script.python (14 lines) ----------
import clr
import sys
pyt_path = r'C:\Program Files (x86)\IronPython 2.7\Lib'
sys.path.append(pyt_path)
import os

from shutil import copyfile

source = IN[0]
dest = IN[1]

copyfile(source,dest)

OUT = dest
# ----------------------------------------

# group: Récupération des informations de la maquette
categories = Categories("Windows")
all_elements_of_category = ElementsOfCategory(categories)
code_block_7 = CodeBlock()
# ---------- code_block_7.designscript (15 lines) ----------
params = {"Numéro de la pièce",
"Surface",
"Volume",
"Nombre de fenêtres",
"Nom de la pièse",
"Identifiant de la pièce",
"Nom de l'appartement",
"Etage",
"Type des voiles de façade",
"Surface des menuiseries dans la pièce",
"Identifiant de toutes les menuiseries dans la pièce",
"Surface de murs liés à la facade",
"Surface totale des voiles de facade",
"GUID"
};
# ----------------------------------------
getParameterValueByName = Element.GetParameterValueByName(element=all_elements_of_category@L1, parameterName=code_block_7)
transpose = List.Transpose(getParameterValueByName)
code_block_8 = CodeBlock(x=transpose) { x[4]; x[5]; x[6]; x[7]; x[1]; x[2]; x[3]; x[10]; x[9]; x[8]; x[12]; x[11]; x[13]; }
id = Element.Id(all_elements_of_category)
type = FamilyInstance.Type(all_elements_of_category)
name = FamilyType.Name(type)
family = FamilyType.Family(type)
name_2 = Family.Name(family)
code_block_9 = CodeBlock { ","; "."; }
replace = String.Replace(str=code_block_8.out8, searchFor=code_block_9.out0, replaceWith=code_block_9.out1)
create_2 = List.Create(code_block_8.out6, code_block_8.out7)
replace_2 = String.Replace(str=code_block_8.out4, searchFor=code_block_9.out0, replaceWith=code_block_9.out1)
replace_3 = String.Replace(str=code_block_8.out5, searchFor=code_block_9.out0, replaceWith=code_block_9.out1)
code_block_10 = CodeBlock { ""; }
count = Count(all_elements_of_category)
ofRepeatedItem = List.OfRepeatedItem(item=code_block_10, amount=count)
replace_4 = String.Replace(str=code_block_8.out11, searchFor=code_block_9.out0, replaceWith=code_block_9.out1)
replace_5 = String.Replace(str=code_block_8.out10, searchFor=code_block_9.out0, replaceWith=code_block_9.out1)

# group: Information sur la menuiserie
create_3 = List.Create(code_block_8.out12, id, name, name_2)

# group: Informations sur la pièce
create_4 = List.Create(code_block_8.out0, code_block_8.out1, code_block_8.out2, code_block_8.out3, replace_2, replace_3)

# group: Infos sur les ouvrages de façade associés à la pièce _ 1
create_5 = List.Create(code_block_8.out6, code_block_8.out7, ofRepeatedItem, ofRepeatedItem, ofRepeatedItem, code_block_8.out8)

# group: Informations sur les transmissions latérales
create_6 = List.Create(replace_4)

# group: Infos sur les ouvrages de façade associés à la pièce _ 2
create_7 = List.Create(code_block_8.out9, replace_5, ofRepeatedItem)

# group: Export dans gabarit excel
code_block_11 = CodeBlock { "caractéristiques menuiseries"; }
code_block_12 = CodeBlock { 7; 1; }
transpose_2 = List.Transpose(create_3)
string_from_object = FromObject(transpose_2)
boolean_2 = BoolSelector(false)
writeToFile = Excel.WriteToFile(filePath=python_script, sheetName=code_block_11, startRow=code_block_12.out0, startCol=code_block_12.out1, data=string_from_object, overWrite=boolean_2)
code_block_13 = CodeBlock { "caractéristiques menuiseries"; }
code_block_14 = CodeBlock { 7; 6; }
transpose_3 = List.Transpose(create_4)
string_from_object_2 = FromObject(transpose_3)
boolean_3 = BoolSelector(false)
writeToFile_2 = Excel.WriteToFile(filePath=python_script, sheetName=code_block_13, startRow=code_block_14.out0, startCol=code_block_14.out1, data=string_from_object_2, overWrite=boolean_3)
code_block_15 = CodeBlock { "caractéristiques menuiseries"; }
code_block_16 = CodeBlock { 7; 13; }
transpose_4 = List.Transpose(create_5)
string_from_object_3 = FromObject(transpose_4)
boolean_4 = BoolSelector(false)
writeToFile_3 = Excel.WriteToFile(filePath=python_script, sheetName=code_block_15, startRow=code_block_16.out0, startCol=code_block_16.out1, data=string_from_object_3, overWrite=boolean_4)
code_block_17 = CodeBlock { "caractéristiques menuiseries"; }
code_block_18 = CodeBlock { 7; 24; }
transpose_5 = List.Transpose(create_6)
string_from_object_4 = FromObject(transpose_5)
boolean_5 = BoolSelector(false)
writeToFile_4 = Excel.WriteToFile(filePath=python_script, sheetName=code_block_17, startRow=code_block_18.out0, startCol=code_block_18.out1, data=string_from_object_4, overWrite=boolean_5)
code_block_19 = CodeBlock { "caractéristiques menuiseries"; }
code_block_20 = CodeBlock { 7; 20; }
transpose_6 = List.Transpose(create_7)
string_from_object_5 = FromObject(transpose_6)
boolean_6 = BoolSelector(false)
writeToFile_5 = Excel.WriteToFile(filePath=python_script, sheetName=code_block_19, startRow=code_block_20.out0, startCol=code_block_20.out1, data=string_from_object_5, overWrite=boolean_6)
