# Dynamo graph HideInternalOrigin.dyn (Dynamo 2.3.0.5885)
# packages: archi-lab.net 2019.2.27

view_type = ViewTypesUi("FloorPlan")
view_type_2 = ViewTypesUi("Section")
list_create = List.Create(item0=view_type, item1=view_type_2)

# group: Include viewtemplates
boolean = BoolSelector(true)

python_script = Python(IN[0]=list_create, IN[1]=boolean)
# ---------- python_script.python (31 lines) ----------
# Load the Python Standard and DesignScript Libraries
import sys
pyt_path = r'C:\Program Files (x86)\IronPython 2.7\Lib'
sys.path.append(pyt_path)
import clr
clr.AddReference('RevitAPI')
from Autodesk.Revit.DB import *
clr.AddReference('RevitServices')
from RevitServices.Persistence  import DocumentManager
from RevitServices.Transactions import TransactionManager
import System


doc = DocumentManager.Instance.CurrentDBDocument

fec = FilteredElementCollector(doc).OfClass(View)

selection = [v for v in fec if str(v.ViewType) in IN[0]]

intOriCatId = [c for c in Category.GetCategory(doc,BuiltInCategory.OST_Site).SubCategories if c.Name == "Internal Origin"][0].Id

if IN[1] == False:
	selection = [v for v in selection if v.IsTemplate == False]


TransactionManager.Instance.EnsureInTransaction(doc)
for s in selection:
	s.SetCategoryHidden(intOriCatId,True)
TransactionManager.Instance.TransactionTaskDone

OUT = True
# ----------------------------------------
