# Dynamo graph HideInternalOrigin_list_v2.dyn (Dynamo 2.5.0.7460)

code_block = CodeBlock { "ThreeD"; }
list_create = List.Create(item0=code_block)

# group: Include viewtemplates
boolean = BoolSelector(true)

python_script = Python(IN[0]=list_create, IN[1]=boolean)
# ---------- python_script.python (35 lines) ----------
# Load the Python Standard and DesignScript Libraries
import sys
pyt_path = r'C:\Program Files (x86)\IronPython 2.7\Lib'
sys.path.append(pyt_path)
import clr
clr.AddReference('RevitAPI')
from Autodesk.Revit.DB import *
clr.AddReference('RevitServices')
from RevitServices.Persistence  import DocumentManager
from RevitServices.Transactions import TransactionManager
import System


doc = DocumentManager.Instance.CurrentDBDocument

fec = FilteredElementCollector(doc).OfClass(View)

selection = [v for v in fec if str(v.ViewType) in IN[0]]

intOriCatId = [c for c in Category.GetCategory(doc,BuiltInCategory.OST_Site).SubCategories if "origin" in c.Name.lower() and "intern" in c.Name.lower()][0].Id

if IN[1] == False:
	selection = [v for v in selection if v.IsTemplate == False]


TransactionManager.Instance.EnsureInTransaction(doc)
for s in selection:
	try:
		s.SetCategoryHidden(intOriCatId,True)
	except:
		pass
TransactionManager.Instance.TransactionTaskDone


OUT = intOriCatId
# ----------------------------------------
