# Dynamo graph Liste de livrables - NDoc par Numéro de feuilles.dyn (Dynamo 2.6.1.8786)
# packages: spring nodes 204.1.0, Data-Shapes 2022.2.103, archi-lab.net 2021.25.2521

boolean = BoolSelector(true)
get_all_revisions = Custom[Get All Revisions](runIt=boolean)  # package archi-lab.net; This node will return all Revisions currently defined in the mode.
revisionDate = Revision.RevisionDate(revision=get_all_revisions)
reverse = List.Reverse(list=get_all_revisions)
code_block = CodeBlock { 2; }
takeItems = List.TakeItems(list=reverse, amount=code_block)
reverse_2 = List.Reverse(list=takeItems)
code_block_2 = CodeBlock { "Sheets"; }
categorie_s_by_enu_name_s = Custom[Categorie(s) by ENU Name(s)](CategoryNameInEnglish=code_block_2)  # package Data-Shapes; Gets categorie(s) in the current UI language by it's english name
all_elements_of_category = ElementsOfCategory(Category=categorie_s_by_enu_name_s.Categorie_s)
sélectionner_excel_liste_de = Filename("..\..\..\..\ACCDocs\Data Shapes\TMM\Projet\00_Revit\Architecture\Documents Naom\Liste des Pièces_PRO_Avril2022.xlsx")  # "Sélectionner Excel liste de livrables"; graph input
file_from_path = FileObject(path=sélectionner_excel_liste_de)
code_block_3 = CodeBlock { "Liste Feuilles PRO FEVRIER 28"; true; false; }
importExcel = Data.ImportExcel(file=file_from_path, sheetName=code_block_3.out0, readAsStrings=code_block_3.out1, showExcel=code_block_3.out2)
transpose = List.Transpose(lists=importExcel)
code_block_4 = CodeBlock(x=transpose) { x[18]; }
code_block_5 = CodeBlock(x=transpose) { x[9]; }
isNull = Object.IsNull(obj=code_block_5)
filterByBoolMask = List.FilterByBoolMask(list=code_block_4, mask=isNull)
filterByBoolMask_2 = List.FilterByBoolMask(list=code_block_5, mask=isNull)
sheetNumber = Sheet.SheetNumber(sheet=all_elements_of_category)
ꟿ_dictionary_bykeysvalues = Custom[ꟿ Dictionary.ByKeysValues](keys=filterByBoolMask.out, values=filterByBoolMask_2.out, searchKeys=sheetNumber)  # package spring nodes; Dictionaries are an incredibly powerful tool for making associative sets between two equal length lists. The first list must be of unique strings (or numbers) and will be the key and the second list will be the matching values (it can be made up of geometry, elements, even other lists) The search keys list will provide the corresponding value to the input key.
isNull_2 = Object.IsNull(obj=ꟿ_dictionary_bykeysvalues)
filterByBoolMask_3 = List.FilterByBoolMask(list=all_elements_of_category, mask=isNull_2)
code_block_6 = CodeBlock { "N_DOC"; }
filterByBoolMask_4 = List.FilterByBoolMask(list=ꟿ_dictionary_bykeysvalues, mask=isNull_2)
setParameterByName = Element.SetParameterByName(element=filterByBoolMask_3.out, parameterName=code_block_6, value=filterByBoolMask_4.out)
boolean_2 = BoolSelector(true)
remove_revision_from_sheet = Custom[Remove Revision from Sheet](sheet=setParameterByName, revision=reverse, runIt=boolean_2, lacing=CrossProduct)  # package archi-lab.net; This node will remove specified Revisions from a sheet.
firstItem = List.FirstItem(list=remove_revision_from_sheet, lacing=Longest)
flatten = List.Flatten(list=firstItem)
code_block_7 = CodeBlock { [1,2,3]; }
code_block_8 = CodeBlock(x=reverse) { [x[0],x[1],[x[0],x[1]]]; }
code_block_9 = CodeBlock(x=transpose)
# ---------- code_block_9.designscript (2 lines) ----------
//Indice
x[12];
# ----------------------------------------
filterByBoolMask_5 = List.FilterByBoolMask(list=code_block_9, mask=isNull)
code_block_10 = CodeBlock(x=filterByBoolMask_5.out) { x; }
code_block_11 = CodeBlock(x=transpose)
# ---------- code_block_11.designscript (2 lines) ----------
//Date
x[15];
# ----------------------------------------
filterByBoolMask_6 = List.FilterByBoolMask(list=code_block_11, mask=isNull)
code_block_12 = CodeBlock(x=filterByBoolMask_6.out) { x; }
code_block_13 = CodeBlock(x=code_block_10, y=code_block_12) { x=="A"?y=="18/03/2022"?1:2:3; }
code_block_14 = CodeBlock { ""; }
ꟿ_dictionary_bykeysvalues_2 = Custom[ꟿ Dictionary.ByKeysValues](keys=code_block_7, values=code_block_8, searchKeys=code_block_13, defaultValue=code_block_14)
ꟿ_dictionary_bykeysvalues_3 = Custom[ꟿ Dictionary.ByKeysValues](keys=filterByBoolMask_2.out, values=ꟿ_dictionary_bykeysvalues_2, searchKeys=filterByBoolMask_4.out, defaultValue=code_block_14)
python_script = Python(IN[0]=flatten, IN[1]=ꟿ_dictionary_bykeysvalues_3, IN[2]=boolean_2)
# ---------- python_script.python (76 lines) ----------
# Copyright(c) 2015, Konrad K Sobon
# @arch_laboratory, http://archi-lab.net

import clr
# Import Element wrapper extension methods
clr.AddReference("RevitNodes")
import Revit
clr.ImportExtensions(Revit.Elements)

# Import DocumentManager and TransactionManager
clr.AddReference("RevitServices")
import RevitServices
from RevitServices.Persistence import DocumentManager
from RevitServices.Transactions import TransactionManager
doc = DocumentManager.Instance.CurrentDBDocument

# Import RevitAPI
clr.AddReference("RevitAPI")
import Autodesk
from Autodesk.Revit.DB import *

import sys
pyt_path = r'C:\Program Files (x86)\IronPython 2.7\Lib'
sys.path.append(pyt_path)

import System
from System import Array
from System.Collections.Generic import *

#The inputs to this node will be stored as a list in the IN variable.
dataEnteringNode = IN


def tolist(input):
	if isinstance(input,list):	
		return UnwrapElement(input)
	else:
		return [UnwrapElement(input)]
		
sheets = tolist(IN[0])
revs = IN[1]

relists = []
for i in revs:
	relists.append(tolist(i))
	

RunIt = IN[2]

if RunIt:
	try:
		errorReport = None
		for sheet,revl in zip(sheets,relists):
			revisionsOnSheet = sheet.GetAdditionalRevisionIds()
			for r in revl:
				if r.Id not in revisionsOnSheet:
					revisionsOnSheet.Add(r.Id)
				else:
					continue
			TransactionManager.Instance.EnsureInTransaction(doc)
			sheet.SetAdditionalRevisionIds(revisionsOnSheet)
			TransactionManager.Instance.TransactionTaskDone()
			
	except:
		# if error accurs anywhere in the process catch it
		import traceback
		errorReport = traceback.format_exc()
else:
	errorReport = "Set RunIt to True."


#Assign your output to the OUT variable
if errorReport == None:
	OUT = IN[0]
else:
	OUT = errorReport
# ----------------------------------------
