# Dynamo graph PrzemysławStępień.dyn (Dynamo 2.6.1.8786)

number_slider = DoubleSlider(1, range=0..100 step 0.1)  # graph input
watch = Watch(number_slider)  # graph output
watch_2 = Watch(number_slider)  # graph output
