# Dynamo graph Randomize Panels.dyn (Dynamo 2.3.0.5885)

sélection_des_toitures_à = DSModelElementsByCategorySelection(index=469)  # "Sélection des toitures à randomiser"; 2 picked in the model; graph input
byElement = CurtainPanel.ByElement(hostingElement=sélection_des_toitures_à)
shuffle = List.Shuffle(list=byElement, lacing=Longest)
pourcentage_de_vide = IntegerSlider(76, range=0..100 step 1)  # graph input
count = List.Count(list=byElement, lacing=Longest)
code_block = CodeBlock(percentage=pourcentage_de_vide, count=count) { percentage*count/100; }
takeItems = List.TakeItems(list=shuffle@L2, amount=code_block@L1)
code_block_2 = CodeBlock { "Type"; }
type_de_panneau_vide = FamilyTypes("AW2_Empty Panel:AW2_Empty Panel")  # graph input
setParameterByName = Element.SetParameterByName(element=takeItems, parameterName=code_block_2, value=type_de_panneau_vide)
dropItems = List.DropItems(list=shuffle@L2, amount=code_block@L1)
type_de_panneau_plein = FamilyTypes("AW2_Full Panel:AW2_Full Panel")  # graph input
setParameterByName_2 = Element.SetParameterByName(element=dropItems, parameterName=code_block_2, value=type_de_panneau_plein)
code_block_3 = CodeBlock { c; }  # unwired: c
