# Dynamo graph WindowData v1.0.dyn (Dynamo 1.3.3.4111)

# group: Infos
# note: _____________________DATA SHAPES____________________
# Script : WindowData
# Version : 1.0
# Développé pour : Dynamo 1.3 et Revit 2018/2019
# Packages utilisés : Data Shapes (version 2018.9.12)
# Description : Ce script renseigne, pour chaque fenêtre du projet, les informations suivantes :
# - Surface de la pièce de la fenêtre
# - Volume de la pièce de la fenêtre
# - Nombre de fenêtres dans la pièce
# - Nom de la pièce
# - Identifiant de la pièce
# - Nom de l'appartement (à créer et renseigner en amont)
# - Etage
# -Type des voiles de façade de la pièce de la fenêtre
# - Surface des menuiseries dans la pièce
# - Identifiant de toutes les menuiseries de la pièce
# - Surface des murs liés à la façade (refends)
# - Surface totale des voiles de façade (dont est déduite la surface des fenêtres)
# - le GUID de la fenêtre
# Il créée et renseigne les paramètres.

# group: UI Data-Shapes
code_block = CodeBlock { "Liste des paramètres à récupérer depuis les pièces"; }
code_block_2 = CodeBlock()
# ---------- code_block_2.designscript (16 lines) ----------
params = {"Numéro de la pièce",
"Surface",
"Volume",
"Nombre de fenêtres",
"Nom de la pièce",
"Identifiant de la pièce",
"Nom de l'appartement",
"Etage",
"Type des voiles de façade",
"Surface des menuiseries dans la pièce",
"Identifiant de toutes les menuiseries dans la pièce",
"Surface de murs liés à la facade",
"Surface totale des voiles de facade",
"GUID"
};
0..(Count(params)-1);
# ----------------------------------------
boolean = BoolSelector(false)
ui_listview_data = Custom[UI.Listview Data](Keys=code_block_2.params, Values=code_block_2.out1, SortItems_optionnal=boolean)  # Create data for ListView input in UI.MultiInputForm ++ . Check out www.data-shapes.net for more infos.
code_block_3 = CodeBlock { "Epaisseur à partir de laquel un mur est considéré comme structurel (refends)"; "0.15"; true; }
ui_textbox_data = Custom[UI.TextBox Data](InputName=code_block_3.out0, DefaultText=code_block_3.out1, IsNumberEntry=code_block_3.out2)  # Create Data for TextBox input in UI.MultipleInputForm ++ . Check out www.data-shapes.net for more informations
create = List.Create(ui_listview_data, ui_textbox_data)
boolean_2 = BoolSelector(true)
code_block_4 = CodeBlock { 500; }
ui_multipleinputform = Custom[UI.MultipleInputForm ++](Description_optional=code_block, Inputs=create, Toggle=boolean_2, Width_optional=code_block_4)  # Create a form with multiple inputs. see www.data-shapes.net for tutorials and infos!

code_block_5 = CodeBlock(x=ui_multipleinputform.User_Inputs) { x[0]; x[1]; }

# group: Room Data
python_script = Python(IN[0]=code_block_5.out1)
# ---------- python_script.python (93 lines) ----------
import clr
clr.AddReference('RevitAPI')
from Autodesk.Revit.DB import *
clr.AddReference('RevitServices')
from RevitServices.Persistence import DocumentManager
clr.AddReference('RevitNodes')
import Revit
clr.ImportExtensions(Revit.Elements)

def trans(pt,vect):
	return  pt + vect*1

doc = DocumentManager.Instance.CurrentDBDocument
rms = [e for e in FilteredElementCollector(doc).OfClass(SpatialElement) if SpatialElementGeometryCalculator.IsRoomOrSpace(e)]
unitsurf = Document.GetUnits(doc).GetFormatOptions(UnitType.UT_Area).DisplayUnits
unitvol = Document.GetUnits(doc).GetFormatOptions(UnitType.UT_Volume).DisplayUnits


UIunit = Document.GetUnits(doc).GetFormatOptions(UnitType.UT_Length).DisplayUnits
def getFacadeAndInnerStrSurf(rm,minWRefend):
	rmheight = UnitUtils.ConvertFromInternalUnits(rm.UnboundedHeight,UIunit)
	opt = SpatialElementBoundaryOptions()
	bndries = rm.GetBoundarySegments(opt)
	extlength = []
	intlength = []
	FacTypes = []
	for boundlist in bndries:
		for bound in boundlist:	
			try:
				wallId = bound.ElementId
				wall = doc.GetElement(wallId)
				wallTypeId = wall.GetTypeId()
				wallType = doc.GetElement(wallTypeId)
				funcparam = BuiltInParameter.FUNCTION_PARAM
				func = wallType.get_Parameter(funcparam).AsInteger()
				if func == 1:
					cv = bound.GetCurve().Length
					extlength.append(cv)
					FacTypes.append(wallType.ToDSType(True).ToString())
				elif func == 0:
					widthparam = BuiltInParameter.WALL_ATTR_WIDTH_PARAM
					if float(wallType.get_Parameter(widthparam).AsDouble()) >= UnitUtils.ConvertToInternalUnits(minWRefend,UIunit)-0.01:
						cv = bound.GetCurve().Length			
						intlength.append(cv)
					else:
						pass
			except:
				pass
	totext = UnitUtils.ConvertFromInternalUnits(sum(extlength),UIunit)
	totint = UnitUtils.ConvertFromInternalUnits(sum(intlength),UIunit)
	extsurf = totext*rmheight
	intsurf = totint*rmheight
	return extsurf,intsurf,FacTypes

def windowRoomAnalysis(rm,minWRefend):
	wnds = FilteredElementCollector(doc).OfClass(FamilyInstance).OfCategory(BuiltInCategory.OST_Windows)
	rmsAssctn = []
	for wnd in wnds:
		loc = wnd.Location.Point
		ort = wnd.FacingOrientation
		transd = trans(loc,ort)
		transdOp = trans(loc,-ort)
		if rm.IsPointInRoom(transd) or rm.IsPointInRoom(transdOp):
			rmsAssctn.append(wnd)
	drs = FilteredElementCollector(doc).OfClass(FamilyInstance).OfCategory(BuiltInCategory.OST_Doors)
	rmsAssctndrs = []
	for dr in drs:
		locd = dr.Location.Point
		ortd = dr.FacingOrientation
		transdr = trans(locd,ortd)
		transdOpd = trans(locd,-ortd)
		if rm.IsPointInRoom(transdr) or rm.IsPointInRoom(transdOpd):
			rmsAssctndrs.append(dr.Id)
			
	_area = UnitUtils.ConvertFromInternalUnits(rm.Area,unitsurf)
	_volume = UnitUtils.ConvertFromInternalUnits(_area * rm.Area,unitvol)
	FacRefSurf = getFacadeAndInnerStrSurf(rm,minWRefend)
	facSurf = FacRefSurf[0]
	refSurf = FacRefSurf[1]
	facadeType = ','.join(FacRefSurf[2])
	if len(rmsAssctn) == 0:
		return None
	else:
		return  rmsAssctn, rm.Number, _area, _volume, len(rmsAssctn) , rmsAssctndrs ,[wn.Id for wn in rmsAssctn] ,rm.ToDSType(True).Name, rm.Id, "AppartName" , UnwrapElement(rm.Level).Name,facadeType, facSurf  , refSurf 


minWidthRefend = IN[0]

watch = []
for r in rms:
	watch.append(windowRoomAnalysis(r,minWidthRefend))
	
OUT = [w for w in watch if not w == None]
# ----------------------------------------
transpose = List.Transpose(python_script)
deconstruct = List.Deconstruct(list=transpose)

getItemAtIndex = List.GetItemAtIndex(list=code_block_2.params, index=code_block_5.out0)

# group: Création des paramètres non existants
categories = Categories("Windows")
code_block_6 = CodeBlock(cats=categories, paramname=getItemAtIndex) { cats; paramname; }
boolean_3 = BoolSelector(false)
python_script_2 = Python(IN[0]=code_block_6.cats, IN[1]=code_block_6.paramname, IN[2]=boolean_3)
# ---------- python_script_2.python (101 lines) ----------
import clr
import System
clr.AddReference('RevitAPI')
from Autodesk.Revit.DB import*
clr.AddReference('RevitServices')
from RevitServices.Persistence import DocumentManager
from RevitServices.Transactions import TransactionManager
clr.AddReference('RevitAPIUI')
from Autodesk.Revit.UI import *
from Autodesk.Revit import Creation
import sys
pyt_path = r'C:\Program Files (x86)\IronPython 2.7\Lib'
sys.path.append(pyt_path)

import System
import os
import tempfile


doc = DocumentManager.Instance.CurrentDBDocument
uidoc = DocumentManager.Instance.CurrentUIDocument
app = doc.Application

def tolist(input):
	if isinstance(input,list):
		return UnwrapElement(input)
	else:
		return [UnwrapElement(input)]
		
categories = tolist(IN[0])

#Vérification de l'existance du paramètre


def listing(input):
	if isinstance(input,list):
		return input
	else:
		return [input]
		
paramnames = listing(IN[1])


#Creation d'une référence externe temporaire
tempfolder = tempfile.gettempdir()
tempfile = tempfolder +'\\'+'DATASHAPESTEMP.txt'
f = open(tempfile,'w')
f.write('')
f.close()

TransactionManager.Instance.EnsureInTransaction(doc)

#recuperation du fichier de paramètres partagés pour remplacement temporaire
orig = True
try:
	originalFile = app.SharedParametersFilename
except:
	orig = False

#remplacement du fichier de paramètres partagés et création des paramètres de projet
app.SharedParametersFilename = tempfile
groups = app.OpenSharedParameterFile().Groups
tempgroup = groups.Create('TempParams')

for paramname in paramnames:
	iterator = doc.ParameterBindings.ForwardIterator()
	testval = 0
	while iterator.MoveNext():
		if categories[0].Name in [c.Name for c in iterator.Current.Categories] and paramname == iterator.Key.Name:
			testval=1
		else:
			pass	
	if testval==0:			
		#creation d'un set de categories
		catset = app.Create.NewCategorySet()
		[catset.Insert(j) for j in categories]
		
		#Creation du paramètre dans le fichier externe temporaire
		tempparam = ExternalDefinitionCreationOptions(paramname,ParameterType.Text)
		tempparam.UserModifiable = False
		tempdef = tempgroup.Definitions.Create(tempparam)		
		paramgroup = [a for a in System.Enum.GetValues(BuiltInParameterGroup) if str(a) == "PG_IDENTITY_DATA"][0]
		
		#Ajout du paramètre au projet	
		bind = app.Create.NewInstanceBinding(catset)
		bindmap = doc.ParameterBindings
		bindmap.Insert(tempdef, bind, paramgroup)
		
		

		
	else:
		pass
#Rétablissement du fichier de paramètres partagés initial
if orig:
	app.SharedParametersFilename = originalFile
else:
	pass
TransactionManager.Instance.TransactionTaskDone

OUT = "ok"
# ----------------------------------------

code_block_7 = CodeBlock { {4,5}; }
removeItemAtIndex = List.RemoveItemAtIndex(list=deconstruct.rest, indices=code_block_7)
code_block_8 = CodeBlock { 9; }
takeItems = List.TakeItems(list=removeItemAtIndex, amount=code_block_8)
getItemAtIndex_2 = List.GetItemAtIndex(list=deconstruct.rest, index=code_block_7)
code_block_9 = CodeBlock(x=getItemAtIndex_2) { x[0]; x[1]; }

# group: Surface de toutes portes/fenetres associées a l'id
python_script_3 = Python()
# ---------- python_script_3.python (40 lines) ----------
import clr
clr.AddReference('RevitAPI')
from Autodesk.Revit.DB import *
clr.AddReference('RevitServices')
from RevitServices.Persistence import DocumentManager
from RevitServices.Transactions import TransactionManager
import System
from System.Collections.Generic import*

doc = DocumentManager.Instance.CurrentDBDocument

unitsurf = Document.GetUnits(doc).GetFormatOptions(UnitType.UT_Area).DisplayUnits

wnds = list(FilteredElementCollector(doc).OfClass(FamilyInstance).OfCategory(BuiltInCategory.OST_Windows))
drs = list(FilteredElementCollector(doc).OfClass(FamilyInstance).OfCategory(BuiltInCategory.OST_Doors))

def getAreaOfInsert(faminst):
	id = faminst.Id
	TransactionManager.Instance.ForceCloseTransaction()
	trans = Transaction(doc)
	host = faminst.Host
	mat = host.GetMaterialIds(False)[0]
	area = host.GetMaterialArea(mat,False)
	trans.Start("temp")
	doc.Delete(id)
	doc.Regenerate()
	tarea = host.GetMaterialArea(mat,False)
	famArea = UnitUtils.ConvertFromInternalUnits(tarea - area,unitsurf)
	trans.RollBack()
	return id , famArea


watch = []
for fam in wnds + drs:
	watch.append(getAreaOfInsert(fam))
	
OUT =  watch


	
# ----------------------------------------

transpose_2 = List.Transpose(python_script_3)

# group: Dictionnaire des surfaces - calcul des surfaces totales de portes par pièces
code_block_10 = CodeBlock(x=transpose_2) { x[0]; x[1]; }
python_script_4 = Python(IN[0]=code_block_9.out0, IN[1]=code_block_10.out0, IN[2]=code_block_10.out1)
# ---------- python_script_4.python (19 lines) ----------
elems = IN[0]
dict = {}

for id,surf in zip(IN[1],IN[2]):
	dict[id] = surf


totsurfs = []

for i in elems:
	templ = []
	for id in i:
		templ.append(dict[id])
	somme = sum(templ)
	totsurfs.append(somme)
	
OUT = [totsurfs]
	
		
# ----------------------------------------

flatten = Flatten(python_script_4)

# group: Dictionnaire des surfaces - calcul des surfaces totales de fenêtres par pièces
code_block_11 = CodeBlock(x=transpose_2) { x[0]; x[1]; }
python_script_5 = Python(IN[0]=code_block_9.out1, IN[1]=code_block_11.out0, IN[2]=code_block_11.out1)  # same code as python_script_4

flatten_2 = Flatten(python_script_5)
create_2 = List.Create(flatten, flatten_2)
transpose_3 = List.Transpose(create_2)
sum = Math.Sum(transpose_3, lacing=Longest)
create_3 = List.Create(sum)
transpose_4 = List.Transpose(getItemAtIndex_2)
flatten_3 = Flatten(transpose_4, lacing=Longest)

# group: Concaténation des identifiants de menuiseries par pièce
python_script_6 = Python(IN[0]=flatten_3)
# ---------- python_script_6.python (11 lines) ----------
l = IN[0]
concats = []
for i in l:
	conc = []
	for j in i:
		conc.append(str(j))
	concats.append(",".join(conc))
		
	
OUT = [concats]
	
# ----------------------------------------

# group: Séparation des Facades et refends pour soustraction des surfaces de menuiseries
dropItems = List.DropItems(list=removeItemAtIndex, amount=code_block_8)
code_block_12 = CodeBlock(x=dropItems) { x[0]; x[1]; }

# group: Soustraction des surfaces de portes/fenetres aux surfaces de facades/refends
code_block_13 = CodeBlock(refends=code_block_12.out1, drs=flatten, facades=code_block_12.out0, wnds=flatten_2) { refends - drs<0?0:refends - drs; facades - wnds; }

create_4 = List.Create(code_block_13.out0)
create_5 = List.Create(code_block_13.out1)
join = List.Join(takeItems, create_3, python_script_6, create_4, create_5)
string_from_object = FromObject(join)

# group: Renseignement des paramètres
code_block_14 = CodeBlock(waitfor=python_script_2, pass=getItemAtIndex) { {waitfor,pass}[1]; }
setParameterByName = Element.SetParameterByName(element=deconstruct.first@L3, parameterName=code_block_14@L1, value=string_from_object@L2, lacing=Longest)

code_block_15 = CodeBlock(x=deconstruct.first) { x; }

# group: Renseignement des GUIDs
all_elements_of_category = ElementsOfCategory(categories)
code_block_16 = CodeBlock(waitfor=python_script_2) { {waitfor,"GUID"}[1]; }
uniqueId = Element.UniqueId(all_elements_of_category)
setParameterByName_2 = Element.SetParameterByName(element=all_elements_of_category@L3, parameterName=code_block_16@L1, value=uniqueId@L2, lacing=Longest)
