# Dynamo graph Remove Mark Values Warnings.dyn (Dynamo 2.0.3.8810)

# group: Warnings list
getWarnings = archilab.Revit.Elements.Warning.GetWarnings()
errorMessage = archilab.Revit.Elements.Warning.ErrorMessage(warning=getWarnings)
code_block = CodeBlock { "Elements have duplicate \"Mark\" values."; "Les éléments ont des valeurs \"Identifiant\" dupliquées."; }
multilanguage_io = Custom[MultiLanguage IO](ENU=code_block.out0, FRA=code_block.out1)  # Takes inputs in different languages and returns the version that corresponds to the active Revit application language settings.
eq = errorMessage == multilanguage_io
filterByBoolMask = List.FilterByBoolMask(list=getWarnings, mask=eq)

# group: Get all relevant warnings
elements = archilab.Revit.Elements.Warning.Elements(warning=filterByBoolMask.in)
firstItem = List.FirstItem(list=elements@L2)
id = archilab.Revit.Elements.WarningElement.Id(warningElement=firstItem)
byElementId = archilab.Revit.Selection.Select.ByElementId(id=id)

# group: Writing new value
code_block_2 = CodeBlock { "Mark"; "Identifiant"; }
multilanguage_io_2 = Custom[MultiLanguage IO](ENU=code_block_2.out0, FRA=code_block_2.out1)
code_block_3 = CodeBlock { ""; }
setParameterByName = Element.SetParameterByName(element=byElementId, parameterName=multilanguage_io_2, value=code_block_3)

# group: Report UI
code_block_4 = CodeBlock { "Report"; "Rapport"; }
multilanguage_io_3 = Custom[MultiLanguage IO](ENU=code_block_4.out0, FRA=code_block_4.out1)
code_block_5 = CodeBlock { "Thanks for fixing the warnings for me :)"; "Merci de corriger les avertissements pour moi :)"; }
multilanguage_io_4 = Custom[MultiLanguage IO](ENU=code_block_5.out0, FRA=code_block_5.out1)
code_block_6 = CodeBlock { "Result"; "Résultat"; }
multilanguage_io_5 = Custom[MultiLanguage IO](ENU=code_block_6.out0, FRA=code_block_6.out1)
code_block_7 = CodeBlock(elem=setParameterByName) { x = DSCore.List.Count(elem); x + " elements value has been reset"; x + " éléments ont vu leur valeur mise à jour"; }
multilanguage_io_6 = Custom[MultiLanguage IO](ENU=code_block_7.out1, FRA=code_block_7.out2)
ui_textnote_data = Custom[UI.TextNote Data](Title=multilanguage_io_5, TextNote=multilanguage_io_6)  # Create Data for TextNote input in UI.MultipleInputForm ++ . Check out www.data-shapes.net for more informations
boolean = BoolSelector(true)  # graph input
code_block_8 = CodeBlock { 500; }
ui_multipleinputform = Custom[UI.MultipleInputForm ++](Description_optional=multilanguage_io_3, ButtonText_optional=multilanguage_io_4, Inputs=ui_textnote_data, Toggle=boolean, Width_optional=code_block_8)  # Create a form with multiple inputs. see www.data-shapes.net for tutorials and infos!
