# Dynamo graph revitAutoUITestWithInputs.dyn (Dynamo 2.12.1.8246)

code_block = CodeBlock { 0; 5; 10; 15; }
position = DoubleSlider(1.3, range=0..5 step 0.1)  # graph input
byCoordinates = Point.ByCoordinates(x=code_block.out0, y=position)
byCoordinates_2 = Point.ByCoordinates(x=code_block.out3, y=position)
byStartPointEndPoint = Line.ByStartPointEndPoint(startPoint=byCoordinates, endPoint=byCoordinates_2)
# note: *Orkestra*
# notynote
height = DoubleInput(4)  # graph input
# note: *Orkestra*
# notynote 2
levels = Levels("Level 1")  # graph input
wall_types = WallTypes("Exterior - CMU Insulated")  # graph input
byCurveAndHeight = Wall.ByCurveAndHeight(curve=byStartPointEndPoint, height=height, level=levels, wallType=wall_types)
code_block_2 = CodeBlock(x=byCurveAndHeight) { x; }
code_block_3 = CodeBlock(x=byCurveAndHeight) { x; }
