# Dynamo graph versionning.dyn (Dynamo 2.0.3.8810)

code_block = CodeBlock { "v2"; }
python_script = Python(IN[0]=code_block)
# ---------- python_script.python (13 lines) ----------
# Enable Python support and load DesignScript library
import clr
clr.AddReference('RevitAPI')
from Autodesk.Revit.DB import *
clr.AddReference('RevitAPIUI')
from Autodesk.Revit.UI import *


td = TaskDialog(IN[0])
td.Show()


OUT = 0
# ----------------------------------------
