# Dynamo graph Model checker workflow -parameter changes Revit2016 or previous.dyn (Dynamo 1.2.1.3083)

code_block = CodeBlock { "Modification tracker between two indices"; }
code_block_2 = CodeBlock { "Select linked model to run comparison against"; }

# group: Archi-lab
get_documents = Custom[Get Documents]()  # Queries all linked Revit files and retrieves their Name, LinkInstance and Document properties.

ui_dropdown_data = Custom[UI.DropDown Data](InputName=code_block_2, Keys=get_documents.Link_Name, Values=get_documents.Link_Doc)  # Create data for DropDown input in UI.MultiInputForm
code_block_3 = CodeBlock { "Select categories"; }
categories_list = Custom[Categories list]()  # Gives list of all Revit categories and a matching list of their names
ui_listview_data = Custom[UI.Listview Data](InutName=code_block_3, Keys=categories_list.Category_name_s, Values=categories_list.Revit_Categories)  # Create data for ListView input in UI.MultiInputForm
create = List.Create(ui_dropdown_data, ui_listview_data)
boolean = BoolSelector(true)
ui_multipleinputform = Custom[UI.MultipleInputForm ++](Description_optional=code_block, Inputs=create, Toggle=boolean)  # Create a form with multiple inputs. InputType codification: -strings : "s" -booleans : "bool" -filepaths : "fp" -directorypath : "dp" -revit element section : "se" -revit face selection : "sf" -revit edge selection : "sed" -dropdown lists : UI.DropDown Data node -listview : UI.ListView Data node see www.data-shapes.net for more infos

# group: ClockWork
green = Custom[Color.Green]()  # Returns the colour green.
purple = Custom[Color.Purple]()  # Returns the colour purple.
navy = Custom[Color.Navy]()  # Returns the colour navy.

code_block_4 = CodeBlock(x=ui_multipleinputform.User_Inputs, samegeometrtycolor=green, changedgeometrycolor=purple, newelementcolor=navy)
# ---------- code_block_4.designscript (10 lines) ----------
// linked doc to compare to
x[0];
// categories to check
x[1];
// color override for unchanged geometry
samegeometrtycolor;
// color override for changed geometry
changedgeometrycolor;
// color override for new elements
newelementcolor;
# ----------------------------------------
modelComparison = Custom[ModificationTracker.ModelComparison](PreviousVersionDocument=code_block_4.out0, Categories=code_block_4.out1)  # Compares elements from documents A and B (A is the current document by default) and returns existing elements data, new elements, deleted elements and a report. Check out www.Data-Shapes.net for more infos.
parameterChanges = Custom[ModificationTracker.ParameterChanges](ExistingElements_Data=modelComparison.ExistingElements_Data)  # takes ExistingElements Data as input and outputs elements with same parameter values and elements with changed parameter values. Check out www.Data-Shapes.net for more infos.
create_2 = List.Create(parameterChanges.Elements_with_same_parameter_values, parameterChanges.Elements_with_changed_parameter_values, modelComparison.New_elements)
isEmpty = List.IsEmpty(create_2, lacing=Longest)
filterByBoolMask = List.FilterByBoolMask(list=create_2, mask=isEmpty)
create_3 = List.Create(code_block_4.samegeometrtycolor, code_block_4.changedgeometrycolor, code_block_4.newelementcolor)

# group: Clockwork
toDynamoColor = Custom[RevitColor.ToDynamoColor](RevitColor=create_3)  # Converts Revit colors into Dynamo colors

filterByBoolMask_2 = List.FilterByBoolMask(list=toDynamoColor, mask=isEmpty)
overrideColorInView = Element.OverrideColorInView(element=filterByBoolMask.out, color=filterByBoolMask_2.out)
