# Dynamo graph hidden in view.dyn (Dynamo 2.3.0.5885)
# packages: Data-Shapes 2021.2.94, spring nodes 204.1.0

# group: Sript TimeStamp
# note: Script Name: Prefixage des Sous-Projets.dyn
# Packages used in this script:
# Data-Shapes version: 2021.2.91
# TimeStamp : 2020/7/6 15:27

# group: UI 1 : Description et saisie des informations
code_block = CodeBlock { "Prefixage des Sous-Projets"; }
code_block_2 = CodeBlock()  # frozen
# ---------- code_block_2.designscript (2 lines) ----------
"Description";
"Cet outil permet d'ajouter un prefix aux sous projets. Le prefix doit correspondre au code de l'emetteur de la maquette. Si un sous-projet contient déjà le préfix, il sera ignoré.";
# ----------------------------------------
textnote_data = Custom[TextNote Data](Title=code_block_2.out0, TextNote=code_block_2.out1)  # package Data-Shapes; Create Data for TextNote input in UI.MultipleInputForm ++ . Check out www.data-shapes.net for more informations
code_block_3 = CodeBlock { "Prefix à ajouter"; }
textbox_data = Custom[TextBox Data](InputName=code_block_3)  # package Data-Shapes; Create Data for TextBox input in UI.MultipleInputForm ++ . Check out www.data-shapes.net for more informations
list_create = List.Create(item0=textnote_data, item1=textbox_data)
boolean = BoolSelector(true)
multipleinputform = Custom[MultipleInputForm ++](Description_optional=code_block, Inputs=list_create, Toggle=boolean)  # package Data-Shapes; Create a form with multiple inputs. see www.data-shapes.net for tutorials and infos!

code_block_4 = CodeBlock(x=multipleinputform.User_Inputs) { x[0]; }

# group: Fonction
boolean_2 = BoolSelector(false)
python_script = Python(IN[0]=code_block_4, IN[1]=boolean_2)
# ---------- python_script.python (38 lines) ----------
#Copyright (c) Data-Shapes , 2020

import clr
clr.AddReference('RevitAPI')
from Autodesk.Revit.DB import *
import Autodesk

clr.AddReference("RevitServices")
import RevitServices
from RevitServices.Persistence import DocumentManager
from RevitServices.Transactions import TransactionManager

prefix = IN[0]

doc = DocumentManager.Instance.CurrentDBDocument

collector = FilteredWorksetCollector(doc).ToWorksets()
worksets = [i for i in collector if i.Kind == WorksetKind.UserWorkset]

nonPrefixed = []
report = "Les sous projets suivants ont été renommés: \n"

for ws in worksets:
	if ws.Name.split("_")[0] != prefix:
		nonPrefixed.append(ws)

wst = doc.GetWorksetTable()
TransactionManager.Instance.EnsureInTransaction(doc)

for np in nonPrefixed:
	wst.RenameWorkset(doc,np.Id,prefix + "_" + np.Name)
	#np.Name = prefix + "_" + np.Name
	report += np.Name + "\n"
	

TransactionManager.Instance.TransactionTaskDone()

OUT = report
# ----------------------------------------

# group: UI 2 : Rapport d'execution
code_block_5 = CodeBlock { "Rapport"; }
textnote_data_2 = Custom[TextNote Data](Title=code_block_5, TextNote=python_script)
multipleinputform_2 = Custom[MultipleInputForm ++](Description_optional=code_block, Inputs=textnote_data_2, Toggle=multipleinputform.Was_Run)

boolean_3 = BoolSelector(true)
ꟿ_selectfaces = Custom[ꟿ SelectFaces+](refresh=boolean_3)  # package spring nodes; Select multiple faces from inside the Revit UI. Be sure to press "Finish" once done. Unlike the built-in node, face references of instances will be added sucessfully and you'l get the pick points. You can use a Boolean toggle to refresh your selection.
