# Dynamo graph Model checker workflow - All changes Revit 2016 or previous.dyn (Dynamo 1.2.1.3083)

code_block = CodeBlock { "Modification tracker between two indices"; }
code_block_2 = CodeBlock { "Select linked model to run comparison against"; }

# group: Archi-lab
get_documents = Custom[Get Documents]()  # Queries all linked Revit files and retrieves their Name, LinkInstance and Document properties.

ui_dropdown_data = Custom[UI.DropDown Data](InputName=code_block_2, Keys=get_documents.Link_Name, Values=get_documents.Link_Doc)  # Create data for DropDown input in UI.MultiInputForm ++ . Check out www.data-shapes.net for more infos.
code_block_3 = CodeBlock { "Select categories"; }
categories_list = Custom[Categories list]()  # Gives list of all Revit categories and a matching list of their names
ui_listview_data = Custom[UI.Listview Data](InutName=code_block_3, Keys=categories_list.Category_name_s, Values=categories_list.Revit_Categories)  # Create data for ListView input in UI.MultiInputForm ++ . Check out www.data-shapes.net for more infos.
create = List.Create(ui_dropdown_data, ui_listview_data)
boolean = BoolSelector(true)
ui_multipleinputform = Custom[UI.MultipleInputForm ++](Description_optional=code_block, Inputs=create, Toggle=boolean)  # Create a form with multiple inputs. InputType codification: -strings : "s" -booleans : "bool" -filepaths : "fp" -directorypath : "dp" -revit element section : "se" -revit face selection : "sf" -revit edge selection : "sed" -dropdown lists : UI.DropDown Data node -listview : UI.ListView Data node see www.data-shapes.net for more infos

# group: ClockWork
green = Custom[Color.Green]()  # Returns the colour green.
lime = Custom[Color.Lime]()  # Returns the colour lime.
purple = Custom[Color.Purple]()  # Returns the colour purple.
red = Custom[Color.Red]()  # Returns the colour red.
navy = Custom[Color.Navy]()  # Returns the colour navy.

code_block_4 = CodeBlock(x=ui_multipleinputform.User_Inputs, samegeometrysameparametercolor=green, samegeometrydifferentparametercolor=lime, differentgeometrysameparametercolor=purple, differentgeometrydifferentparametercolor=red, newelementscolor=navy)
# ---------- code_block_4.designscript (14 lines) ----------
// linked doc to compare to
x[0];
// categories to check
x[1];
// color override for unchanged geometry and parameter values
samegeometrysameparametercolor;
// color override for unchanged geometry, changed parameter values
samegeometrydifferentparametercolor;
// color override for changed geometry, unchanged parameter values
differentgeometrysameparametercolor;
// color override for changed geometry and parameter values
differentgeometrydifferentparametercolor;
// color override for new elements
newelementscolor;
# ----------------------------------------
modelComparison = Custom[ModificationTracker.ModelComparison](PreviousVersionDocument=code_block_4.out0, Categories=code_block_4.out1)  # Compares elements from documents A and B (A is the current document by default) and returns existing elements data, new elements, deleted elements and a report. Check out www.Data-Shapes.net for more infos.
allChanges = Custom[ModificationTracker.AllChanges](ExistingElements_Data=modelComparison.ExistingElements_Data)  # Takes ExistingElements Data as input and outputs lists with all geometry/parameter values change combinations . Check out www.Data-Shapes.net for more informations .
create_2 = List.Create(allChanges.Same_geometry_and_parameter_values, allChanges.Same_geometry_different_parameter_values, allChanges.Different_geometry_same_parameter_values, allChanges.Different_geometry_and_parameter_values, modelComparison.New_elements)
isEmpty = List.IsEmpty(create_2, lacing=Longest)
filterByBoolMask = List.FilterByBoolMask(list=create_2, mask=isEmpty)
create_3 = List.Create(code_block_4.samegeometrysameparametercolor, code_block_4.samegeometrydifferentparametercolor, code_block_4.differentgeometrysameparametercolor, code_block_4.differentgeometrydifferentparametercolor, code_block_4.newelementscolor)

# group: Clockwork
toDynamoColor = Custom[RevitColor.ToDynamoColor](RevitColor=create_3)  # Converts Revit colors into Dynamo colors

filterByBoolMask_2 = List.FilterByBoolMask(list=toDynamoColor, mask=isEmpty)
overrideColorInView = Element.OverrideColorInView(element=filterByBoolMask.out, color=filterByBoolMask_2.out)
