# Dynamo graph c3line with inputs.dyn (Dynamo 2.5.2.7915)

byCoordinates = Point.ByCoordinates()
number_slider = DoubleSlider(100, range=0..100 step 0.1)  # graph input
number_slider_2 = DoubleSlider(58.5, range=0..100 step 0.1)  # graph input
byCoordinates_2 = Point.ByCoordinates(x=number_slider, y=number_slider_2)
current = Autodesk.AutoCAD.DynamoNodes.Document.Current()
layers = Autodesk.AutoCAD.DynamoNodes.Document.Layers(document=current)
code_block = CodeBlock(x=layers) { x[0]; }
blocks = Autodesk.AutoCAD.DynamoNodes.Document.Blocks(document=current)
code_block_2 = CodeBlock(x=blocks) { x[0]; }
byTwoPoints = Autodesk.AutoCAD.DynamoNodes.Line.ByTwoPoints(startPoint=byCoordinates, endPoint=byCoordinates_2, layer=code_block, block=code_block_2)
