# Dynamo graph dropDownInputl.dyn (Dynamo 2.6.2.15705)

ze_unit = UnitTypes("Length")  # graph input
watch = Watch(ze_unit)
an_input_string = StringInput("azse")  # graph input
watch_2 = Watch(an_input_string)
a_hard_coded_string = StringInput("azeerrrt")
watch_3 = Watch(a_hard_coded_string)
mydouble_slider = DoubleSlider(50.3, range=0..100 step 0.1)  # graph input
myinteger_slider = IntegerSlider(32, range=0..100 step 1)  # graph input
a_double_input = DoubleInput(0)  # graph input
boolean = BoolSelector(true)  # graph input
file_path = Filename(".\Homeupdateval.dyn")  # graph input
directory_path = Directory("C:\Users\jumy_\OneDrive\Bureau")  # graph input
code_block = CodeBlock(x=directory_path) { x; }
code_block_2 = CodeBlock(x=a_hard_coded_string) { x; }
