# Dynamo graph outputs multiple_savedAs.dyn (Dynamo 2.13.1.3887)
# packages: Data-Shapes 2022.2.97

# note: *Orkestra*
# A little header note
number_slider_with_a_title_so = DoubleSlider(35.5, range=0..100 step 0.1)  # "Number Slider with a title so long we need to wrap it at least two or three times. No let's see if the border keeps it centered vertically and if everything is layed out nicely§"; graph input
# note: *Orkestra*
# Attention:
# This is an easy way for the creator of this definition to give more directions and informaiton to their users. It also gets placed accordingly with it's location on the graph ! :)
slid = DoubleSlider(57.7, range=0..100 step 0.1)  # graph input
number_slider = DoubleSlider(11.2, range=0..100 step 0.1)  # graph input
number_slider_2 = DoubleSlider(59.7, range=0..100 step 0.1)  # graph input
number_slider_3 = DoubleSlider(1, range=0..100 step 0.1)  # graph output
list_create = List.Create(item0=number_slider_with_a_title_so, item1=slid, item2=number_slider, item3=number_slider_2, item4=number_slider_3)
code_block = CodeBlock(x=list_create) { x>5; }
countTrue = List.CountTrue(list=code_block)
code_block_2 = CodeBlock(n=countTrue) { "there are " + n +" values above 5"; }
watch_2 = Watch(code_block_2)  # graph output
list_create_2 = List.Create()  # unwired: item0, item1
list_create_3 = List.Create(item1=list_create_2)  # unwired: item0
list_create_4 = List.Create(item1=list_create_3)  # unwired: item0, item2, item3
list_create_oo = List.Create(item0=list_create_4, item1=list_create_2)  # graph output
watchnode_1 = Watch(list_create_oo)  # graph output
code_block_3 = CodeBlock { 23.90; }
list_create_5 = List.Create(item0=code_block_2, item1=code_block, item2=countTrue, item3=code_block_3)  # graph output
other_watchnods = Watch(list_create_5)  # graph output
code_block_4 = CodeBlock { x[0]; }  # unwired: x
watch = Watch(code_block_4)
string_from_object = FromObject()  # graph output; unwired: obj
code_block_5 = CodeBlock { "8"; }
startsWith = String.StartsWith(string=string_from_object, searchFor=code_block_5)
testingDicts = List.FilterByBoolMask(mask=startsWith)  # graph output; unwired: list
geomPreview = GeomPreviewNodeModel(SliderValue=255, rValue="100", gValue="100", bValue="100")  # unwired: Geometry
python_script = Python()  # IronPython2; unwired: IN[0]; starter script, not edited (OUT = 0)
multipleinputform = Custom[MultipleInputForm ++]()  # package Data-Shapes; Create a form with multiple inputs. see www.data-shapes.net for tutorials and infos!; unwired: Inputs
multipleinputform_2 = Custom[MultipleInputForm ++]()  # unwired: Inputs
python_script_2 = Python()  # CPython3; graph output; unwired: IN[0]; starter script, not edited (OUT = 0)
filepath_inut_with_a_very_long = Filename("..\#Wiki\RevitAddin\AddLocalWorkspacergichclick.gif")  # "filepath inut with a very long title to see if it gets laid out nicely"; graph input
