# Dynamo graph outputs.dyn (Dynamo 2.3.0.5885)

categories = Categories("OST_Doors")  # graph input
all_elements_of_category = ElementsOfCategory(Category=categories)
list_create = List.Create(item0=all_elements_of_category, item1=all_elements_of_category)
list_create_2 = List.Create(item0=all_elements_of_category, item1=list_create)
list_create_3 = List.Create(item0=all_elements_of_category, item1=list_create_2, item2=all_elements_of_category, item3=all_elements_of_category)
list_create_4 = List.Create(item0=list_create_3, item1=list_create)
watchnode_1 = Watch(list_create_4)  # graph output
number_slider = DoubleSlider(35.5, range=0..100 step 0.1)  # graph input
slid = DoubleSlider(57.7, range=0..100 step 0.1)  # graph input
number_slider_2 = DoubleSlider(11.2, range=0..100 step 0.1)  # graph input
number_slider_3 = DoubleSlider(59.7, range=0..100 step 0.1)  # graph input
number_slider_4 = DoubleSlider(1, range=0..100 step 0.1)
list_create_5 = List.Create(item0=number_slider, item1=slid, item2=number_slider_2, item3=number_slider_3, item4=number_slider_4)
code_block = CodeBlock(x=list_create_5) { x>5; }
countTrue = List.CountTrue(list=code_block)
code_block_2 = CodeBlock(n=countTrue) { "there are " + n +" values above 5"; }
code_block_3 = CodeBlock { 23.90; }
list_create_6 = List.Create(item0=code_block_2, item1=code_block, item2=countTrue, item3=code_block_3)
other_watchnods = Watch(list_create_6)  # graph output
code_block_4 = CodeBlock(x=all_elements_of_category) { x[0]; }
watch = Watch(code_block_4)  # graph output
watch_2 = Watch(code_block_2)  # graph output
list_create_7 = List.Create(item0=watch, item1=watch_2)
watch_3 = Watch(list_create_7)  # graph output
