# Dynamo graph revitAutoUITestNoInputs.dyn (Dynamo 2.3.0.5885)

code_block = CodeBlock { 0; 5; 10; 15; }
pt2 = DoubleSlider(1.3, range=0..5 step 0.1)
byCoordinates = Point.ByCoordinates(x=code_block.out0, y=pt2)
pt1 = DoubleSlider(3.9, range=0..5 step 0.1)
byCoordinates_2 = Point.ByCoordinates(x=code_block.out1, y=pt1)
pt3 = DoubleSlider(0.9, range=0..5 step 0.1)
byCoordinates_3 = Point.ByCoordinates(x=code_block.out2, y=pt3)
pt4 = DoubleSlider(5, range=0..5 step 0.1)  # graph input
byCoordinates_4 = Point.ByCoordinates(x=code_block.out3, y=pt4)
list_create = List.Create(item0=byCoordinates, item1=byCoordinates_2, item2=byCoordinates_3, item3=byCoordinates_4)
byBestFitThroughPoints = Arc.ByBestFitThroughPoints(points=list_create)
number = DoubleInput(4)
levels = Levels("Level 1")
wall_types = WallTypes("Exterior - CMU Insulated")
byCurveAndHeight = Wall.ByCurveAndHeight(curve=byBestFitThroughPoints, height=number, level=levels, wallType=wall_types)
