# Dynamo graph revitInputsTesting.dyn (Dynamo 2.3.0.5885)

select_walls = DSModelElementsSelection()  # 2 picked in the model; graph input
code_block = CodeBlock { "Unconnected Height"; }
wall_height = DoubleSlider(15.2, range=0..20 step 0.1)  # graph input
setParameterByName = Element.SetParameterByName(element=select_walls, parameterName=code_block, value=wall_height)
