# Dynamo graph rvtInputs.dyn (Dynamo 2.6.2.15705)

select_model_element = DSModelElementSelection()  # 1 picked in the model; graph input
select_model_elements = DSModelElementsSelection()  # 2 picked in the model; graph input
select_edge = DSEdgeSelection()  # 1 picked in the model; graph input
select_edges = SelectEdges()  # 3 picked in the model; graph input
select_point_on_face = DSPointOnElementSelection()  # 1 picked in the model; graph input
select_uv_on_face = DSUvOnElementSelection()  # 1 picked in the model; graph input
select_face = DSFaceSelection()  # 1 picked in the model; graph input
code_block = CodeBlock(x=select_face) { x; }
code_block_2 = CodeBlock(x=select_face) { x; }
