# Dynamo graph changement de repère.dyn (Dynamo 2.6.1.8786)
# packages: Data-Shapes 2021.2.91

# group: Elements à numéroter
code_block = CodeBlock { "Structural Columns"; }
categorie_s_by_enu_name_s = Custom[Categorie(s) by ENU Name(s)](CategoryNameInEnglish=code_block)  # package Data-Shapes; Gets categorie(s) in the current UI language by it's english name
all_elements_of_category = ElementsOfCategory(Category=categorie_s_by_enu_name_s.Categorie_s)

# group: Paramètre à renseigner
code_block_2 = CodeBlock { "Comments"; }

# group: Traitement des quadrillages
code_block_3 = CodeBlock { "Grids"; }
categorie_s_by_enu_name_s_2 = Custom[Categorie(s) by ENU Name(s)](CategoryNameInEnglish=code_block_3)
all_elements_of_category_2 = ElementsOfCategory(Category=categorie_s_by_enu_name_s_2.Categorie_s)
curve = Grid.Curve(grid=all_elements_of_category_2)
direction = Line.Direction(line=curve)
XAxis = Vector.XAxis()
dot = Vector.Dot(vector=direction, vec=XAxis)
code_block_4 = CodeBlock { 5; }
code_block_5 = CodeBlock(x=dot, prec=code_block_4) { Math.Abs(Math.Floor(x/prec)*prec); }
groupByKey = List.GroupByKey(list=all_elements_of_category_2, keys=code_block_5)
code_block_6 = CodeBlock(x=groupByKey.groups) { x[0]; x[1]; }

# group: Y
curve_2 = Grid.Curve(grid=code_block_6.out0)
startPoint = Curve.StartPoint(curve=curve_2)

# group: Axes donnant le repère du projet
select_model_element = DSModelElementSelection()  # 1 picked in the model
select_model_element_2 = DSModelElementSelection()  # 1 picked in the model

# group: Création du repère du projet
curve_3 = Grid.Curve(grid=select_model_element)
curve_4 = Grid.Curve(grid=select_model_element_2)
intersect = Geometry.Intersect(geometry=curve_3, other=curve_4)
direction_2 = Line.Direction(line=curve_3)
XAxis_2 = Vector.XAxis()
dot_2 = Vector.Dot(vector=direction_2, vec=XAxis_2)
code_block_7 = CodeBlock(d=dot_2) { d<0; }
reverse = Vector.Reverse(vector=direction_2)
if_ = If(test=code_block_7, true=reverse, false=direction_2)
direction_3 = Line.Direction(line=curve_4)
YAxis = Vector.YAxis()
dot_3 = Vector.Dot(vector=direction_3, vec=YAxis)
code_block_8 = CodeBlock(d=dot_3) { d<0; }
reverse_2 = Vector.Reverse(vector=direction_3)
if_2 = If(test=code_block_8, true=reverse_2, false=direction_3)
byOriginVectors = CoordinateSystem.ByOriginVectors(origin=intersect, xAxis=if_, yAxis=if_2)
identity = CoordinateSystem.Identity()

getLocation = Element.GetLocation(element=all_elements_of_category)

# group: Positions des éléments ramenées au repère général
transform = Geometry.Transform(geometry=getLocation, fromCoordinateSystem=byOriginVectors, contextCoordinateSystem=identity, lacing=Longest)

X = Point.X(point=transform)

# group: X
curve_5 = Grid.Curve(grid=code_block_6.out1)
startPoint_2 = Curve.StartPoint(curve=curve_5)

# group: Quadrillages rangés et ramenés au repère général
transform_2 = Geometry.Transform(geometry=startPoint, fromCoordinateSystem=byOriginVectors, contextCoordinateSystem=identity, lacing=Longest)
X_2 = Point.X(point=transform_2)
sortByKey = List.SortByKey(list=code_block_6.out0, keys=X_2)
transform_3 = Geometry.Transform(geometry=startPoint_2, fromCoordinateSystem=byOriginVectors, contextCoordinateSystem=identity, lacing=Longest)
Y = Point.Y(point=transform_3)
sortByKey_2 = List.SortByKey(list=code_block_6.out1, keys=Y)

sub = X@L1 - sortByKey.sorted_keys@L2  # lacing=Longest
code_block_9 = CodeBlock(x=sub) { x>0; }
countTrue = List.CountTrue(list=code_block_9, lacing=Longest)
code_block_10 = CodeBlock(i=countTrue) { i-1; }
getItemAtIndex = List.GetItemAtIndex(list=sortByKey.sorted_list, index=code_block_10)
name = Element.Name(element=getItemAtIndex)
Y_2 = Point.Y(point=transform)
sub_2 = Y_2@L1 - sortByKey_2.sorted_keys@L2  # lacing=Longest
code_block_11 = CodeBlock(x=sub_2) { x>0; }
countTrue_2 = List.CountTrue(list=code_block_11, lacing=Longest)
code_block_12 = CodeBlock(i=countTrue_2) { i-1; }
getItemAtIndex_2 = List.GetItemAtIndex(list=sortByKey_2.sorted_list, index=code_block_12)
name_2 = Element.Name(element=getItemAtIndex_2)

# group: Formatage de l'information à inscrire dans le paramètre
code_block_13 = CodeBlock(x=name, yo=name_2)
# ---------- code_block_13.designscript (2 lines) ----------
x+"_"+yo;
//this is new info
# ----------------------------------------

setParameterByName = Element.SetParameterByName(element=all_elements_of_category, parameterName=code_block_2, value=code_block_13)
code_block_14 = CodeBlock(watch=setParameterByName) { watch; }
