# Dynamo graph testingBindingAndDropdowns.dyn (Dynamo 2.13.1.3887)

select_face = DSFaceSelection()  # 1 picked in the model; graph input
code_block = CodeBlock { 0..1..#5; }
pointAtParameter = Surface.PointAtParameter(surface=select_face, u=code_block, v=code_block, lacing=CrossProduct)
code_block_2 = CodeBlock { 0.5; }
byLengths = Cuboid.ByLengths(origin=pointAtParameter, width=code_block_2, length=code_block_2, height=code_block_2)
categories = Categories("OST_GenericModel")  # graph input
byGeometry = DirectShape.ByGeometry(geometry=byLengths, category=categories)
code_block_3 = CodeBlock(x=byGeometry) { x; }
code_block_4 = CodeBlock(x=code_block_3) { x; }
