# Dynamo graph 07_MTH_Découpe de parts pour calepinage.dyn (Dynamo 2.6.1.8786)
# packages: Data-Shapes 2022.2.96, Data-Shapes 2021.2.94

# group: Récupération de tous les types de familles dans le projet
python_script = Python()
# ---------- python_script.python (19 lines) ----------
# Load the Python Standard and DesignScript Libraries
import sys
import clr
clr.AddReference('RevitAPI')
from Autodesk.Revit.DB import *

clr.AddReference('RevitServices')
clr.AddReference('RevitNodes')
import Revit
clr.ImportExtensions(Revit.Elements)

from RevitServices.Persistence import DocumentManager

doc = DocumentManager.Instance.CurrentDBDocument

fec = FilteredElementCollector(doc).OfClass(FamilySymbol).WhereElementIsElementType().ToElements()


OUT = [f.Family.Name + " : " + f.ToDSType(True).Name for f in fec] , fec
# ----------------------------------------

code_block = CodeBlock { ["Executer sur l'ensemble des Parts","Executer sur une sélection"]; [false,true]; }
radiobuttons_data = Custom[RadioButtons Data](Keys=code_block.out0, Values=code_block.out1)  # package Data-Shapes; Create radio buttons input for UI.MultipleInputForm ++ .
code_block_2 = CodeBlock { 200; 600; }

# group: UI
code_block_3 = CodeBlock { "MTH_Couper les Hôtes avec les Banches"; }
code_block_4 = CodeBlock { "Familles à utiliser pour les découpes"; }
code_block_5 = CodeBlock(x=python_script) { x[0]; x[1]; }
listview_data = Custom[Listview Data](InputName=code_block_4, Keys=code_block_5.out0, Values=code_block_5.out1)  # package Data-Shapes; Create data for ListView input in UI.MultiInputForm ++ . Check out www.data-shapes.net for more infos.
boolean = BoolSelector(true)

list_create = List.Create(item0=listview_data, item1=radiobuttons_data)

# group (continued): UI
multipleinputform = Custom[MultipleInputForm ++](Description_optional=code_block_3, Inputs=list_create, Toggle=boolean, Width_optional=code_block_2.out1, LabelWidth_optional=code_block_2.out0)  # package Data-Shapes; Create a form with multiple inputs. see www.data-shapes.net for tutorials and infos!

code_block_6 = CodeBlock(x=multipleinputform.User_Inputs) { x[0]; x[1]; }
code_block_7 = CodeBlock { "LEG_Etage"; "MET_JCCycle"; }
code_block_8 = CodeBlock { "Sélectionner les Parts"; }
code_block_9 = CodeBlock { "Parts"; }
categorie_s_by_enu_name_s = Custom[Categorie(s) by ENU Name(s)](CategoryNameInEnglish=code_block_9)  # package Data-Shapes; Gets categorie(s) in the current UI language by it's english name
selectmodelelements_data = Custom[SelectModelElements Data](ButtonText=code_block_8, CategoryFilter=categorie_s_by_enu_name_s.Categorie_s)  # package Data-Shapes; Creates a Revit element selection input for UI.MultipleInputForm++ . Check out www.data-shapes.net for more infos!
multipleinputform_2 = Custom[MultipleInputForm ++](Inputs=selectmodelelements_data, Toggle=code_block_6.out1)
code_block_10 = CodeBlock(x=multipleinputform_2.User_Inputs) { x[0]; }

# group: Récupération de tous les parts issus de murs
python_script_2 = Python(IN[0]=code_block_6.out1, IN[1]=code_block_10)
# ---------- python_script_2.python (17 lines) ----------
import clr
clr.AddReference('RevitAPI')
clr.AddReference('RevitServices')

from Autodesk.Revit.DB import*
from RevitServices.Persistence import DocumentManager

doc = DocumentManager.Instance.CurrentDBDocument

selection = IN[0]



if selection:
	OUT = IN[1]
else:
	OUT =  [i.Id for i in FilteredElementCollector(doc).OfCategory(BuiltInCategory.OST_Parts).ToElements()]
# ----------------------------------------

boolean_2 = BoolSelector(false)
python_script_3 = Python(IN[0]=code_block_6.out0, IN[1]=code_block_7.out0, IN[2]=code_block_7.out1, IN[3]=python_script_2, IN[4]=boolean_2)
# ---------- python_script_3.python (72 lines) ----------
# Load the Python Standard and DesignScript Libraries
import sys
import clr
clr.AddReference('RevitAPI')
from Autodesk.Revit.DB import *

clr.AddReference('RevitServices')
clr.AddReference('RevitNodes')
import Revit
clr.ImportExtensions(Revit.Elements)

from RevitServices.Persistence import DocumentManager
from RevitServices.Transactions import TransactionManager

doc = DocumentManager.Instance.CurrentDBDocument

fec = FilteredElementCollector(doc).OfClass(FamilyInstance).WhereElementIsNotElementType().ToElements()

def toList(input):
	if isinstance(input,list):
		return UnwrapElement(input)
	else:
		return [UnwrapElement(input)]


types = toList(IN[0])
legEtageParamName = IN[1]
cycleParamName = IN[2]


instances = []

for type in types:
	for f in fec:
		if str(f.Symbol.Id) == str(type.Id):
			instances.append(f)
			

failed = [] 
leg =[]
cyc = []
watch = []


TransactionManager.Instance.EnsureInTransaction(doc)

for instance in instances:
	bb = instance.get_BoundingBox(None) 
	bbFilter = BoundingBoxIntersectsFilter(Outline(bb.Min,bb.Max))
	touchingParts = [p for p in FilteredElementCollector(doc).OfCategory(BuiltInCategory.OST_Parts).WherePasses(bbFilter) if p.Id in IN[3]]
	for t in touchingParts:
		#watch.append(t.LookupParameter(legEtageParamName).AsString() == instance.LookupParameter(legEtageParamName).AsString()) 
		test1 = t.LookupParameter(cycleParamName).AsDouble() == instance.LookupParameter(cycleParamName).AsDouble()
		test2 = t.LookupParameter(legEtageParamName).AsString() == instance.LookupParameter(legEtageParamName).AsString()
		watch.append([test1,test2])
		if test1 and test2:
			leg.append([t.LookupParameter(legEtageParamName).AsString(),instance.LookupParameter(legEtageParamName).AsString()])
			cyc.append([t.LookupParameter(cycleParamName).AsValueString(),instance.LookupParameter(cycleParamName).AsValueString()])
			try:
				pinnedState = t.Pinned
				if pinnedState == True:
					t.Pinned = False
				InstanceVoidCutUtils.AddInstanceVoidCut(doc,t,instance)
				if pinnedState == True:
					t.Pinned = True
			except:
				failed.append(instance)
		

TransactionManager.Instance.TransactionTaskDone()

OUT = instances , failed
# ----------------------------------------
