# Dynamo graph Pièces - Centrer le point de référence des pièces.dyn (Dynamo 2.6.1.8786)

# note: Move the center of the Room
setLocation = Element.SetLocation()  # unwired: element, geometry
python_script = Python()
# ---------- python_script.python (15 lines) ----------
# Load the Python Standard and DesignScript Libraries
import sys
import clr
clr.AddReference('RevitAPI')
from Autodesk.Revit.DB import *

clr.AddReference('RevitServices')
from RevitServices.Persistence import DocumentManager
doc = DocumentManager.Instance.CurrentDBDocument

rooms = FilteredElementCollector(doc).OfCategory(BuiltInCategory.OST_Rooms).ToElements()

closedRooms = [room for room in rooms if room.Area !=0]

OUT = closedRooms
# ----------------------------------------
code_block = CodeBlock(e=python_script) { geo = e.Geometry(); c = geo.Centroid(); }
setLocation_2 = Element.SetLocation(element=python_script, geometry=code_block.c)
