# Dynamo graph Rendre Feuilles Nomenclaturables.dyn (Dynamo 2.6.1.8786)

python_script = Python()  # unwired: IN[0]
# ---------- python_script.python (23 lines) ----------
# Load the Python Standard and DesignScript Libraries
import sys
import clr
clr.AddReference('RevitAPI')
from Autodesk.Revit.DB import *

clr.AddReference('RevitServices')

from RevitServices.Persistence import DocumentManager
from RevitServices.Transactions import TransactionManager

doc = DocumentManager.Instance.CurrentDBDocument
sheets = FilteredElementCollector(doc).OfClass(ViewSheet).ToElements()

TransactionManager.Instance.EnsureInTransaction(doc)

for sheet in sheets:
	sheet.get_Parameter(BuiltInParameter.SHEET_SCHEDULED).Set(True)
	
TransactionManager.Instance.TransactionTaskDone()


OUT = sheets
# ----------------------------------------
