# Dynamo graph Typologies de pièces et légendes.dyn (Dynamo 2.10.1.3976)

code_block = CodeBlock()
# ---------- code_block.designscript (19 lines) ----------
["ENTRANCE",
"LIVING ROOM",
"DINING ROOM",
"STUDY/FAMILY ROOM",
"SPA",
"MASTER BEDROOM",
"BEDROOM",
"BATHROOM",
"GUEST TOILET",
"CLOAKROOM",
"KITCHEN/SERVICE",
"PATIO",
"CIRCULATION",
"TERRACE",
"POOL",
"GARDEN",
"OUTDOOR LIVING",
"OUTOOR DINING",
"FIRE PIT"];
# ----------------------------------------
boolean = BoolSelector(true)

# group: MAJ de la nomenclature de clé de valeurs
python_script = Python(IN[0]=code_block, IN[1]=boolean)  # IronPython2
# ---------- python_script.python (105 lines) ----------
# Load the Python Standard and DesignScript Libraries
import sys
import clr
clr.AddReference('RevitAPI')
from Autodesk.Revit.DB import *

clr.AddReference('RevitServices')
from RevitServices.Persistence import DocumentManager
from RevitServices.Transactions import TransactionManager
clr.AddReference('RevitNodes')
import Revit
clr.ImportExtensions(Revit.Elements)


doc = DocumentManager.Instance.CurrentDBDocument

TransactionManager.Instance.EnsureInTransaction(doc)
#FIND OR CREATE KEY KEYSCHEDULE
numer  = 0 
try:
	viewSchedule = [v for v in FilteredElementCollector(doc).OfClass(ViewSchedule) if v.Name == "TABLE DE VALEURS"][0]
except:
	viewSchedule = ViewSchedule.CreateKeySchedule(doc,ElementId(BuiltInCategory.OST_Rooms))
	viewSchedule.Name = "TABLE DE VALEURS"
	schedDef = viewSchedule.Definition
	field = SchedulableField(ScheduleFieldType.Instance,ElementId(BuiltInParameter.ROOM_NAME))
	schedDef.AddField(field)
	field_ = SchedulableField(ScheduleFieldType.Instance,ElementId(BuiltInParameter.ALL_MODEL_INSTANCE_COMMENTS))
	schedDef.AddField(field_)


	keyNames  = IN[0]
	
	#Creations
	for keyName in keyNames:
		tableData = viewSchedule.GetTableData()
		tsd = tableData.GetSectionData(SectionType.Body)
		tsd.InsertRow(tsd.FirstRowNumber)
		
	doc.Regenerate()
	
	newKeyItmes = [i for i in FilteredElementCollector(doc,viewSchedule.Id)]
	
	for item,keyName in zip(newKeyItmes,keyNames):
		#try:
		item.get_Parameter(BuiltInParameter.REF_TABLE_ELEM_NAME).Set(keyName)
		item.get_Parameter(BuiltInParameter.ROOM_NAME).Set(keyName)
		item.get_Parameter(BuiltInParameter.ALL_MODEL_INSTANCE_COMMENTS).Set(str(numer))
		numer+=1
		#except:
			#pass


tableStyleOverride = TableCellStyleOverrideOptions()
tableStyleOverride.HorizontalAlignment = True
tableStyleOverride.Underline = True
style1 = TableCellStyle()
style1.SetCellStyleOverrideOptions(tableStyleOverride)
style1.FontHorizontalAlignment = HorizontalAlignmentStyle.Center
style1.IsFontUnderline = False



watch = []
#CREATE LEGEND SCHEDULE
ttId = [t.Id for t in FilteredElementCollector(doc).OfClass(TextNoteType)  if t.ToDSType(True).Name == "AW2_Black_2.0mm"][0]
try:
	viewSchedule = [v for v in FilteredElementCollector(doc).OfClass(ViewSchedule) if v.Name == "LEGEND"][0]
except:
	legendSchedule = ViewSchedule.CreateSchedule(doc,ElementId(BuiltInCategory.OST_Rooms))
	legendSchedule.Name = "LEGEND"
	legendDef = legendSchedule.Definition
	fieldNum = SchedulableField(ScheduleFieldType.Instance,ElementId(BuiltInParameter.ROOM_NUMBER))
	fieldNam = SchedulableField(ScheduleFieldType.Instance,ElementId(BuiltInParameter.ROOM_NAME))
	legendDef.AddField(fieldNum)
	legendDef.AddField(fieldNam)
	doc.Regenerate()
	tableData_ = legendSchedule.GetTableData()
	tsd_ = tableData_.GetSectionData(SectionType.Body)
	watch.append(tsd_.AllowOverrideCellStyle(0,0)) 
	doc.Regenerate()
	tss = TableCellStyle()
	tss.FontName = "AW2_Black_2.0mm"
	f = legendDef.GetField(0)
	f.SetStyle(tss)
	sortGroupField = ScheduleSortGroupField(f.FieldId, ScheduleSortOrder.Ascending)
	legendSchedule.Definition.AddSortGroupField(sortGroupField)
	legendSchedule.Definition.IsItemized = False
	legendDef.GetField(1).SetStyle(tss)
	legendSchedule.BodyTextTypeId = ttId
	legendSchedule.HeaderTextTypeId = ttId
	legendSchedule.TitleTextTypeId = ttId
	tsdHeaders_ = tableData_.GetSectionData(SectionType.Header)
	watch.append(tsd_.SetCellStyle(0,style1))
	watch.append(tsd_.SetCellStyle(1,style1))


#Updates
doc.Regenerate()

TransactionManager.Instance.TransactionTaskDone



OUT = watch
# ----------------------------------------
