# Dynamo graph TestingDevops.dyn "vizDemoB" (Dynamo 2.13.1.3887)

code_block = CodeBlock()  # unwired: x
# ---------- code_block.designscript (3 lines) ----------
//This is a Comment
x;
// Another comment
# ----------------------------------------
number_slider = DoubleSlider(55.5, range=0..100 step 0.1)
python_script = Python()  # CPython3; unwired: IN[0]
# ---------- python_script.python (10 lines) ----------
# Load the Python Standard and DesignScript Libraries
import sys
import clr
clr.AddReference('RevitAPI')
from Autodesk.Revit.DB import *
clr.AddReference('RevitServices')
from RevitServices.Persistence import DocumentManager


OUT = 0
# ----------------------------------------
string = StringInput("new string")
list_create = List.Create(item0=code_block, item2=number_slider, item3=python_script, item4=string)  # unwired: item1
watch = Watch(list_create)
