# Dynamo custom node All Lines of LineStyle.dyf (Dynamo 1.2.1.3083)
# category: Data-Shapes.Revit.Lines
# Gets all lines in a project with a giver LineStyle

LineStyleName = Input(LineStyleName : string)
python_script = Python(IN[0]=LineStyleName)
# ---------- python_script.python (26 lines) ----------
#Copyright (c) mostafa el ayoubi
#Data-Shapes 2016 elayoub.mostafa@gmail.com

import clr
clr.AddReference('RevitServices')
import RevitServices
from RevitServices.Persistence import DocumentManager
clr.AddReference('RevitAPI')
from Autodesk.Revit.DB import *


doc = DocumentManager.Instance.CurrentDBDocument

if isinstance(IN[0],list):
	names = UnwrapElement(IN[0])
else:
	names = [UnwrapElement(IN[0])]
	
alllines = FilteredElementCollector(doc).OfCategory(BuiltInCategory.OST_Lines)

lines = []

for n in names:
	lines.append([x for x in alllines if x.LineStyle.Name == n ])

OUT = lines
# ----------------------------------------
Line_s = Output(python_script)  # "Line(s)"
