# Dynamo custom node Document.LengthDisplayUnit.dyf (Dynamo 1.3.3.4111)
# category: Data-Shapes.Revit.Document
# Returns diplay units for lengths in current document.

python_script = Python()
# ---------- python_script.python (23 lines) ----------
#Copyright (c) Data Shapes,  2018
#Data-Shapes www.data-shapes.net , elayoubi.mostafa@data-shapes.io @data_shapes

import clr
clr.AddReference('RevitAPI')
from Autodesk.Revit.DB import*
clr.AddReference('RevitServices')
from RevitServices.Persistence import DocumentManager

doc = DocumentManager.Instance.CurrentDBDocument
FOptions = Document.GetUnits(doc).GetFormatOptions(UnitType.UT_Length)
UIunit = FOptions.DisplayUnits
Show = UIunit.ToString().split('_')
del Show[0]
Show = ' '.join([s.title() for s in Show])

UISymbol = FOptions.UnitSymbol 
ShowSymb = UISymbol.ToString().split('_')
del ShowSymb[0]
ShowSymb = ' '.join([s.lower() for s in ShowSymb])


OUT = Show , ShowSymb
# ----------------------------------------
code_block = CodeBlock(x=python_script) { x[0]; x[1]; }
LengthDisplayUnits = Output(code_block.out0)
LengthDisplayUnitsSymbol = Output(code_block.out1)
