# Dynamo custom node Export Views to NavisWorks.dyf (Dynamo 1.2.1.3083)
# category: Data-Shapes.Export
# exports 3d views to NavisWorks

Views = Input(Views : var[])
Directory_path = Input(Directory path : String)
Prefix = Input(Prefix : String)
python_script = Python(IN[0]=Views, IN[1]=Directory_path, IN[2]=Prefix)
# ---------- python_script.python (22 lines) ----------
import clr
clr.AddReference('RevitAPI')
from Autodesk.Revit.DB import*

clr.AddReference('RevitServices')
from RevitServices.Persistence import DocumentManager

doc = DocumentManager.Instance.CurrentDBDocument

if isinstance(IN[0],list):
	views = UnwrapElement(IN[0])
else: 
	views = [UnwrapElement(IN[0])]

prefix = IN[2]
for v in views:
	nop = NavisworksExportOptions()
	nop.ExportScope = NavisworksExportScope.View
	nop.ViewId = v.Id
	doc.Export(IN[1],prefix + v.Name,nop)

OUT = views
# ----------------------------------------
OUT = Output(python_script)
