# Dynamo custom node Export to FBX.dyf (Dynamo 1.2.1.3083)
# category: Data-Shapes.Export
# Exports 3D views to FBX format

ExportFolderPath = Input(ExportFolderPath : string)
ExportName_s = Input(ExportName(s) : string)
n3DView_s = Input(3DView(s))
python_script = Python(IN[0]=ExportFolderPath, IN[1]=ExportName_s, IN[2]=n3DView_s)
# ---------- python_script.python (30 lines) ----------
#Copyright (c) mostafa el ayoubi, 2016 elayoub.mostafa@gmail.com
#Data-Shapes www.data-shapes.net

import clr
clr.AddReference('RevitAPI')
from Autodesk.Revit.DB import*
clr.AddReference('RevitServices')
from RevitServices.Persistence import DocumentManager
from RevitServices.Transactions import TransactionManager

doc = DocumentManager.Instance.CurrentDBDocument

t = Transaction(doc,'export')
t.Start()


folder = IN[0]
name = IN[1]
views = IN[2]
result = []
vset = ViewSet()


for n,v in zip(name,views):

    vset.Insert(UnwrapElement(v))
    result.append(doc.Export(folder,n,vset,FBXExportOptions()))

t.Commit()
OUT = 'You Have successfully exported %d 3D views to FBX format' %(result.count(True))
# ----------------------------------------
OUT = Output(python_script)
