# Dynamo custom node Get All Linked Docs infos.dyf (Dynamo 1.2.1.3083)
# category: Data-Shapes.Revit.Document
# Get all linked documents names and paths

Doc_FilePath = Input(Doc_FilePath : var = false)
Refresh = Input(Refresh : bool = false)
python_script = Python(IN[0]=Doc_FilePath, IN[1]=Refresh)
# ---------- python_script.python (39 lines) ----------
import clr
clr.AddReference('RevitAPI')
from Autodesk.Revit.DB import*
clr.AddReference('RevitServices')
from RevitServices.Persistence import DocumentManager
import sys
pyt_path = r'C:\Program Files (x86)\IronPython 2.7\Lib'
sys.path.append(pyt_path)
import os

doc = DocumentManager.Instance.CurrentDBDocument
if IN[0] :
	fp =  ModelPathUtils.ConvertUserVisiblePathToModelPath(IN[0])
else : 
	fp =  ModelPathUtils.ConvertUserVisiblePathToModelPath(doc.PathName)
transdata = TransmissionData.ReadTransmissionData(fp)
extref = transdata.GetAllExternalFileReferenceIds()
eref  = [transdata.GetLastSavedReferenceData(i) for i in extref]

paths = [ModelPathUtils.ConvertModelPathToUserVisiblePath(e.GetAbsolutePath()) for e in eref]

rvtpaths = [p for p in paths if p.endswith('.rvt')]
rvtnames = []
rvtsize = [str(os.path.getsize(p)) + " Kb" for p in rvtpaths]
for p in rvtpaths:
	if '/' in p:
		rvtnames.append(p.rsplit('/', 1)[-1])
	else:
		rvtnames.append(p.rsplit('\\', 1)[-1])
cadpaths = [p for p in paths if p.endswith('.dwg')]
cadnames = []
cadsize = [str(os.path.getsize(p)) + " Kb" for p in cadpaths]
for p in cadpaths:
	if '/' in p:
		cadnames.append(p.rsplit('/', 1)[-1])
	else:
		cadnames.append(p.rsplit('\\', 1)[-1])

OUT = [rvtnames,rvtpaths,rvtsize] , [cadnames,cadpaths,cadsize] 
# ----------------------------------------
code_block = CodeBlock(out=python_script)
# ---------- code_block.designscript (12 lines) ----------
//Rvt links names
out[0][0];
//Rvt links paths
out[0][1];
//Rvt links size
out[0][2];
//Dwg links names
out[1][0];
//Dwg links paths
out[1][1];
//Dwg links size
out[1][2];
# ----------------------------------------
Rvt_links_names = Output(code_block.out0)
Rvt_links_paths = Output(code_block.out1)
Rvt_links_size = Output(code_block.out2)
Dwg_links_names = Output(code_block.out3)
Dwg_links_paths = Output(code_block.out4)
Dwg_links_size = Output(code_block.out5)
