# Dynamo custom node GetLinkedElements.ByHostView.dyf (Dynamo 1.2.2.91)
# category: Data-Shapes.Revit.Elements
# Get all linked elements in host view, following visibility setting of host view

Views_s = Input()  # "Views(s)"
Linked_Document = Input()
Refresh = Input(Refresh : bool = true)
python_script = Python(IN[0]=Views_s, IN[1]=Linked_Document, IN[2]=Refresh)
# ---------- python_script.python (78 lines) ----------
#Copyright (c) mostafa el ayoubi ,  2017
#Data-Shapes www.data-shapes.net , elayoubi.mostafa@gmail.com

import clr
clr.AddReference('RevitAPI')
from Autodesk.Revit.DB import*
clr.AddReference('RevitServices')
from RevitServices.Persistence import DocumentManager
doc = DocumentManager.Instance.CurrentDBDocument
import System
from System.Collections.Generic import *

clr.AddReference('ProtoGeometry')
from Autodesk.DesignScript.Geometry import*
doc = DocumentManager.Instance.CurrentDBDocument

#Inputs

linkdoc = IN[1]
if isinstance(IN[0],list):
	views = UnwrapElement(IN[0])
else:
	views = [UnwrapElement(IN[0])]

collector = []

#getting project base point elevation
basepointfilter = ElementCategoryFilter(BuiltInCategory.OST_ProjectBasePoint)
basepoint = FilteredElementCollector(doc).WherePasses(basepointfilter).ToElements()
bpelevation = [b.ParametersMap.get_Item('Elev').AsDouble() for b in basepoint]

cats = doc.Settings.Categories
cids = [c.Id for c in cats]

UIunit = Document.GetUnits(doc).GetFormatOptions(UnitType.UT_Length).DisplayUnits
level = []
for v in views:

	filtercatids = filter(lambda x: not v.GetCategoryHidden(x),cids)
	catfilters = []
	for i in filtercatids:
		catfilters.append(ElementCategoryFilter(System.Enum.ToObject(BuiltInCategory, int(str(i)))))
	catfilterlist = List[ElementFilter](catfilters)
	catfilter = LogicalOrFilter(catfilterlist)
	#creating a boundingbox for each view from it's crop box and view range
	bb = v.CropBox
	vr = v.GetViewRange()
	topclip = PlanViewPlane.TopClipPlane
	bottomclip = PlanViewPlane.BottomClipPlane
	cutclip = PlanViewPlane.CutPlane
	toplevel = (doc.GetElement(vr.GetLevelId(topclip)))
	topoffset = vr.GetOffset(topclip)
	cutlevel = (doc.GetElement(vr.GetLevelId(cutclip)))
	cutoffset = vr.GetOffset(cutclip)
	try:
		topZ = toplevel.Elevation + topoffset - bpelevation[0]
	except:
		topZ = cutlevel.Elevation + cutoffset - bpelevation[0]
	bottomlevel = (doc.GetElement(vr.GetLevelId(bottomclip)))
	bottomoffset = vr.GetOffset(bottomclip)
	try:
		bottomZ = bottomlevel.Elevation + bottomoffset - bpelevation[0]
	except :
		bottomZ = cutlevel.Elevation - bpelevation[0]
	min = bb.Min
	max = bb.Max
	newmin = XYZ(min.X,min.Y,bottomZ)
	newmax = XYZ(max.X,max.Y,topZ)
	ol = Outline(newmin,newmax)

	#combining boundingbox and category filters
	bbfilter = BoundingBoxIntersectsFilter(ol)
	andfilter = LogicalAndFilter(catfilter,bbfilter)

	#collecting elements
	collector.append(FilteredElementCollector(linkdoc).WherePasses(andfilter).ToElements())

OUT = collector
# ----------------------------------------
Elements = Output(python_script)
