# Dynamo custom node Grid.SetVerticalExtents.dyf (Dynamo 1.2.0.2690)
# category: Data-Shapes.Revit.Grids
# Set the vertical extents of all project grids

Bottom_extent = Input()
Top_extent = Input()
python_script = Python(IN[0]=Bottom_extent, IN[1]=Top_extent)
# ---------- python_script.python (24 lines) ----------
#Copyright (c) mostafa el ayoubi
#Node-mode www.data-shapes.net 2016 elayoub.mostafa@gmail.com

import clr
clr.AddReference('RevitAPI')
from Autodesk.Revit.DB import*
clr.AddReference('RevitServices')
from RevitServices.Persistence import DocumentManager
from RevitServices.Transactions import TransactionManager

doc = DocumentManager.Instance.CurrentDBDocument
UIunit = Document.GetUnits(doc).GetFormatOptions(UnitType.UT_Length).DisplayUnits

def convunit(x):
	return UnitUtils.ConvertToInternalUnits(x,UIunit)

grids = [UnwrapElement(i) for i in FilteredElementCollector(doc).OfClass(Grid)]

TransactionManager.Instance.EnsureInTransaction(doc)
for g in grids:
	g.SetVerticalExtents(convunit(IN[0]),convunit(IN[1]))
TransactionManager.Instance.TransactionTaskDone()

OUT = grids
# ----------------------------------------
OUT = Output(python_script)
