# Dynamo custom node RayBounce On Linked Model.dyf (Dynamo 1.2.1.3083)
# category: Data-Shapes.Revit.RayBounce
# Same functionality as raybounce but takes linked model elements into account

Points = Input(Points : Point[])
Direction = Input(Direction : Vector)
n3D_View = Input(3D View : View3D)
python_script = Python(IN[0]=Points, IN[1]=Direction, IN[2]=n3D_View)
# ---------- python_script.python (46 lines) ----------
#Copyright (c) mostafa el ayoubi
#Node-mode www.data-shapes.net 2016 elayoub.mostafa@gmail.com

import clr
clr.AddReference('RevitAPI')
from Autodesk.Revit.DB import*

clr.AddReference('ProtoGeometry')
from Autodesk.DesignScript.Geometry import *

clr.AddReference('RevitServices')
from RevitServices.Persistence import DocumentManager


doc = DocumentManager.Instance.CurrentDBDocument

#Document UI Units


UIunit = Document.GetUnits(doc).GetFormatOptions(UnitType.UT_Length).DisplayUnits

#Inputs : Points, Direction, 3D View
if isinstance(IN[0],list):
	points = [XYZ(UnitUtils.ConvertToInternalUnits(i.X,UIunit),UnitUtils.ConvertToInternalUnits(i.Y,UIunit),UnitUtils.ConvertToInternalUnits(i.Z,UIunit)) for i in IN[0]]
else:
	points = [XYZ(UnitUtils.ConvertToInternalUnits(IN[0].X,UIunit),UnitUtils.ConvertToInternalUnits(IN[0].Y,UIunit),UnitUtils.ConvertToInternalUnits(IN[0].Z,UIunit))]

direction = XYZ(IN[1].X,IN[1].Y,IN[1].Z)
view = UnwrapElement(IN[2])

ex = []
pts = []

ri = ReferenceIntersector(view)
ri.FindReferencesInRevitLinks = True

for p in points:
	ref = ri.FindNearest(p,direction)
	if ref == None:
		pts.append(None)
	else:
		refp = ref.GetReference().GlobalPoint
		pts.append(Point.ByCoordinates(UnitUtils.ConvertFromInternalUnits(refp.X,UIunit),UnitUtils.ConvertFromInternalUnits(refp.Y,UIunit),UnitUtils.ConvertFromInternalUnits(refp.Z,UIunit)))


OUT = pts
# ----------------------------------------
OUT = Output(python_script)
