# Dynamo custom node Room Status.dyf (Dynamo 1.3.2.2480)
# category: Data-Shapes.Revit.Rooms
# Sorts a list of room into three categories: unplaced, PlacedAndBounded and  unbounded

Room_s = Input()  # "Room(s)"
python_script = Python(IN[0]=Room_s)
# ---------- python_script.python (34 lines) ----------
import clr
clr.AddReference('RevitAPI')
from Autodesk.Revit.DB import*

def tolist(input):
	if isinstance(input,list):
		return UnwrapElement(input)
	else:
		return [UnwrapElement(input)]

rooms = tolist(IN[0])

#initiating the three output lists

unplaced = []
unbounded = []
placedAndBounded = []

#test if room is placed

for room in rooms:
	if room.Location is None:
		#room is unplaced
		unplaced.append(room)
	else:
		#room is placed, test for areas
		if room.Area == 0:
			unbounded.append(room)
		else:
		#room is bounded
			placedAndBounded.append(room)


OUT = unplaced,unbounded,placedAndBounded
# ----------------------------------------
code_block = CodeBlock(x=python_script)
# ---------- code_block.designscript (6 lines) ----------
//Unplaced
x[0];
//Unbounded
x[1];
//PlacedAndBounded
x[2];
# ----------------------------------------
Unplaced = Output(code_block.out0)
Unbounded = Output(code_block.out1)
PlacedAndBounded = Output(code_block.out2)
