# Dynamo custom node Room.Height.dyf (Dynamo 1.3.3.4111)
# category: Data-Shapes.Revit.Rooms
# Returns room height.

Room_s = Input()  # "Room(s)"
room_height = Python(IN[0]=Room_s)
# ---------- room_height.python (19 lines) ----------
import clr
clr.AddReference('RevitAPI')
from Autodesk.Revit.DB import *
clr.AddReference('RevitServices')
from RevitServices.Transactions import TransactionManager
from RevitServices.Persistence import DocumentManager
clr.AddReference('RevitNodes')
import Revit
clr.ImportExtensions(Revit.GeometryConversion)

doc = DocumentManager.Instance.CurrentDBDocument

def ToList(input):
	if isinstance(input,list):
		return input
	else:
		return [input]
rooms = ToList(IN[0])
OUT =  [(r.BoundingBox.MaxPoint.Z - r.BoundingBox.MinPoint.Z) for r in rooms]
# ----------------------------------------
Height_s = Output(room_height)  # "Height(s)"
