# Dynamo custom node SlabShape.AddPoints.dyf (Dynamo 1.2.2.91)
# category: Data-Shapes.Revit.Floors
# Add points to slab shape

Floor_element = Input()
Points = Input()
python_script = Python(IN[0]=Floor_element, IN[1]=Points)
# ---------- python_script.python (29 lines) ----------
#Copyright (c) mostafa el ayoubi ,  2017
#Data-Shapes www.data-shapes.net , elayoubi.mostafa@gmail.com

import clr
clr.AddReference('RevitAPI')
from Autodesk.Revit.DB import*

clr.AddReference('RevitServices')
from RevitServices.Persistence import DocumentManager
from RevitServices.Transactions import TransactionManager

doc = DocumentManager.Instance.CurrentDBDocument

slab = UnwrapElement(IN[0])
sshape = slab.SlabShapeEditor
pts = IN[1]

UIunit = Document.GetUnits(doc).GetFormatOptions(UnitType.UT_Length).DisplayUnits

TransactionManager.Instance.EnsureInTransaction(doc)
watch = []
sshape.ResetSlabShape()
for i in pts:
	watch.append(sshape.DrawPoint(XYZ(UnitUtils.ConvertToInternalUnits(i.X,UIunit),UnitUtils.ConvertToInternalUnits(i.Y,UIunit),UnitUtils.ConvertToInternalUnits(i.Z,UIunit))))

TransactionManager.Instance.TransactionTaskDone()


OUT = slab
# ----------------------------------------
OUT = Output(python_script)
