# Dynamo custom node SlabShape.AddSplitLine.dyf (Dynamo 1.3.2.2480)
# category: Data-Shapes.Revit.Floors
# Adds split lines to Revit Floors

Floor_element = Input()
Curve_s = Input()  # "Curve(s)"
python_script = Python(IN[0]=Floor_element, IN[1]=Curve_s)
# ---------- python_script.python (41 lines) ----------
#Copyright (c) mostafa el ayoubi ,  2017
#Data-Shapes www.data-shapes.net , mostafa.elayoubi@data-shapes.net

import clr
clr.AddReference('RevitAPI')
from Autodesk.Revit.DB import*
clr.AddReference('RevitServices')
from RevitServices.Persistence import DocumentManager
from RevitServices.Transactions import TransactionManager


doc = DocumentManager.Instance.CurrentDBDocument
floor = UnwrapElement(IN[0])
sshpe = floor.SlabShapeEditor

def tolist(input):
	if isinstance(input,list):
		return UnwrapElement(input)
	else:
		return [UnwrapElement(input)]

def dscurvevertices(curve):
	rvtline = list(curve.get_Geometry(Options()))[0]
	return rvtline.GetEndPoint(0) , rvtline.GetEndPoint(1)

def drawline(slabshape,line):
	sp = slabshape.DrawPoint(dscurvevertices(line)[0])
	ep = slabshape.DrawPoint(dscurvevertices(line)[1])
	slabshape.DrawSplitLine(sp,ep)
	return  slabshape

curves = tolist(IN[1])

TransactionManager.Instance.EnsureInTransaction(doc)

for c in curves:
	drawline(sshpe,c)

TransactionManager.Instance.TransactionTaskDone()

OUT = floor
# ----------------------------------------
Floor = Output(python_script)
