# Dynamo custom node UI.Boolean Data.dyf "UI.Boolean input" (Dynamo 1.2.1.3083)
# category: Data-Shapes.UI
# Creates a boolean input for UI.MultipleInputForm ++ . Check out www.data-shapes.net for more infos!

InputName = Input(InputName : string = "Input")
DefaultValue = Input(DefaultValue : bool = false)
SideText = Input(SideText : string = "Yes/No")
python_script = Python(IN[0]=InputName, IN[1]=DefaultValue, IN[2]=SideText)
# ---------- python_script.python (17 lines) ----------
#Copyright (c) mostafa el ayoubi ,  2016
#Data-Shapes www.data-shapes.net , elayoubi.mostafa@gmail.com

class uibool():

    def __init__(self,inputname,defaultvalue,booltext):
        self.inputname = inputname
        self.defaultvalue = defaultvalue
        self.booltext = booltext
    def __repr__(self):
        return 'UI.Boolean input'
        
      
x = uibool(IN[0],IN[1],IN[2])


OUT = x
# ----------------------------------------
Boolean_input = Output(python_script)
