# Dynamo custom node UI.ColorInput Data.dyf (Dynamo 1.2.1.3083)
# category: Data-Shapes.UI
# Create a color selection input for UI.MultiInputForm++ . Check out www.data-shapes.net for more infos! Warning : Only works with Revit 2017

InputName = Input(InputName : string = "Input")
ButtonText = Input(ButtonText : string = "Select Color")
python_script = Python(IN[0]=InputName, IN[1]=ButtonText)
# ---------- python_script.python (17 lines) ----------
#Copyright (c) mostafa el ayoubi ,  2016
#Data-Shapes www.data-shapes.net , elayoubi.mostafa@gmail.com
#This input was inspired by Adrien_P and John Pierson @60secondrevit 

class uicolorpick():

    def __init__(self,inputname,buttontext):
        self.inputname = inputname
        self.buttontext = buttontext

    def __repr__(self):
        return 'UI.ColorPick input'

x = uicolorpick(IN[0],IN[1])


OUT = x
# ----------------------------------------
ColorSelection_Input = Output(python_script)
