# Dynamo custom node UI.ConditionalInput Data.dyf (Dynamo 1.3.3.4111)
# category: Data-Shapes.UI
# Allows to create inputs that are enabled/disabled by a condition dor UI.MultipleInputForm++.

Options = Input(Options : var[])
Inputs_Groupes_by_Option = Input(Inputs Groupes by Option : var[][])
Default_Option_Index = Input()
python_script = Python(IN[0]=Options, IN[1]=Inputs_Groupes_by_Option, IN[2]=Default_Option_Index)
# ---------- python_script.python (18 lines) ----------
#Copyright (c) mostafa el ayoubi ,  2017
#Data-Shapes www.data-shapes.net , elayoubi.mostafa@gmail.com

class uiconditional():

    def __init__(self,inputname,_Conditions,_GroupedInputs,_defaultOptionIndex):
    	self.inputname = inputname
        self._Conditions = _Conditions
        self._GroupedInputs = _GroupedInputs
        self._defaultOptionIndex = _defaultOptionIndex

    def __repr__(self):
        return 'UI.Conditional input'
        
x = uiconditional("",IN[0],IN[1],IN[2])


OUT = x
# ----------------------------------------
OUT = Output(python_script)
