# Dynamo custom node UI.DataTable input.dyf (Dynamo 1.3.2.2480)
# category: Data-Shapes.UI
# Create a DataTable view input for UI.MultipleInputForm ++

InputName = Input(InputName : string = "Table Title")
Data = Input()
FirstRowIsTitles = Input(FirstRowIsTitles : bool = false)
OpenExcelAtExport = Input(OpenExcelAtExport : bool = false)
python_script = Python(IN[0]=InputName, IN[1]=Data, IN[2]=FirstRowIsTitles, IN[3]=OpenExcelAtExport)
# ---------- python_script.python (19 lines) ----------
#Copyright (c) mostafa el ayoubi ,  2016
#Data-Shapes www.data-shapes.net , elayoubi.mostafa@gmail.com

class tableview():

    def __init__(self,inputname,_tabletitle,dataList,_hasTitle,_openExcel):
    	self.inputname = inputname
        self._tabletitle = _tabletitle
        self.dataList = dataList
        self._hasTitle = _hasTitle
        self._openExcel = _openExcel

    def __repr__(self):
        return 'UI.TableView input'
        
x = tableview("",IN[0],IN[1],IN[2],IN[3])


OUT = x
# ----------------------------------------
TableView_input = Output(python_script)
