# Dynamo custom node UI.DirectoryPath Data.dyf (Dynamo 1.3.0.875)
# category: Data-Shapes.UI
# Creates a DirectoryPath input for UI.MultipleInputForm ++ . Check out www.data-shapes.net for more infos!

InputName = Input(InputName : string = "Input")
DefaultPath = Input(DefaultPath : string = "DirectoryPath")
ButtonText = Input(ButtonText : string = "DirectoryPath")  # Is ignored if a default path is given
python_script = Python(IN[0]=InputName, IN[1]=DefaultPath, IN[2]=ButtonText)
# ---------- python_script.python (17 lines) ----------
#Copyright (c) mostafa el ayoubi ,  2016
#Data-Shapes www.data-shapes.net , elayoubi.mostafa@gmail.com

class uidirectorypath():

    def __init__(self,inputname,defaultvalue,buttontext):
        self.inputname = inputname
        self.defaultvalue = defaultvalue
        self.buttontext = buttontext
        
    def __repr__(self):
        return 'UI.DirectoryPath input'
        
x = uidirectorypath(IN[0],IN[1],IN[2])


OUT = x
# ----------------------------------------
DirectoryPath_input = Output(python_script)
