# Dynamo custom node UI.FilePath Data.dyf (Dynamo 1.3.0.875)
# category: Data-Shapes.UI
# Create filepath input for UI.MultipleInputForm ++ . Check out www.data-shapes.net for more infos !

InputName = Input(InputName : string = "Input")
DefaulPath = Input(DefaulPath : string = "FilePath")
ButtonText = Input(ButtonText : string = "FilePath")  # Is ignored if a default path is given
python_script = Python(IN[0]=InputName, IN[1]=DefaulPath, IN[2]=ButtonText)
# ---------- python_script.python (17 lines) ----------
#Copyright (c) mostafa el ayoubi ,  2016
#Data-Shapes www.data-shapes.net , elayoubi.mostafa@gmail.com

class uifilepath():

    def __init__(self,inputname,defaultvalue,buttontext):
        self.inputname = inputname
        self.defaultvalue = defaultvalue
        self.buttontext = buttontext

    def __repr__(self):
        return 'UI.FilePath input'

x = uifilepath(IN[0],IN[1],IN[2])


OUT = x
# ----------------------------------------
FilePath_input = Output(python_script)
