# Dynamo custom node UI.Image Data.dyf (Dynamo 1.2.1.3083)
# category: Data-Shapes.UI
# Places an image on UI.MultipleInutForm ++ .

ImageTitle = Input(ImageTitle : string = "")
Image = Input()
python_script = Python(IN[0]=ImageTitle, IN[1]=Image)
# ---------- python_script.python (16 lines) ----------
#Copyright (c) mostafa el ayoubi ,  2017
#Data-Shapes www.data-shapes.net , elayoubi.mostafa@gmail.com

class uiimage():

    def __init__(self,inputname,image):
        self.inputname = inputname    
        self.image = image

    def __repr__(self):
        return 'UI.Image input'
        
x = uiimage(IN[0],IN[1])


OUT = x
# ----------------------------------------
Image_input = Output(python_script)
