# Dynamo custom node UI.Listview Data.dyf (Dynamo 1.3.2.2480)
# category: Data-Shapes.UI
# Create data for ListView input in UI.MultiInputForm ++ . Check out www.data-shapes.net for more infos.

InputName = Input(InputName : string = "")
Keys = Input()  # "Keys : []"
Values = Input()  # "Values : []"
Height_optionnal = Input(Height_optionnal : int = 200)
HighlightInView_optionnal = Input(HighlightInView_optionnal : bool = false)  # If set to true, clicking elements of the listview will highlight them in a view like Dynamo's watch node
DisplayModeOnly_optionnal = Input(DisplayModeOnly_optionnal : bool = false)  # Turns off ability to select elements. Form will not output any data for this element.
ShowElementCount_optionnal = Input(ShowElementCount_optionnal : bool = false)  # Will display the number of elements underneath the input name
DefaultValueIndices_optionnal = Input(DefaultValueIndices_optionnal : int[] = DSCore.List.Empty)
SortItems_optionnal = Input(SortItems_optionnal : bool = true)  # Determines wether the ListView items are sorted or not
ShowId_optionnal = Input(ShowId_optionnal : bool = true)  # Warning: disabling this will cause the listview input creation to fail in case there are elements with the same name
python_script = Python(IN[0]=InputName, IN[1]=Keys, IN[2]=Values, IN[3]=Height_optionnal, IN[4]=HighlightInView_optionnal, IN[5]=DisplayModeOnly_optionnal, IN[6]=ShowElementCount_optionnal, IN[7]=DefaultValueIndices_optionnal, IN[8]=SortItems_optionnal, IN[9]=ShowId_optionnal)
# ---------- python_script.python (74 lines) ----------
#Copyright (c) mostafa el ayoubi ,  2016
#Data-Shapes www.data-shapes.net , elayoubi.mostafa@gmail.com

class listview():

    def __init__(self,inputname,height,highlight,display_mode,element_count,default_values,sorted,showId):
        self.inputname = inputname
        self.height = height
        self.highlight = highlight
        self.display_mode = display_mode
        self.element_count = element_count
        self.default_values = default_values
        self.sorted = sorted
        self.showId = showId

    def __setitem__(self, key, item):
        self.__dict__[key] = item

    def __getitem__(self, key):
        return self.__dict__[key]

    def __iter__(self):
        return iter(self.__dict__)

    def values(self):
        return self.__dict__.values()

    def keys(self):
        return self.__dict__.keys()

    def __repr__(self):
        return 'UI.ListView input'

if isinstance(IN[1],list):
	in1 = IN[1]
else:
	in1 = [IN[1]]

if isinstance(IN[2],list):
	in2 = IN[2]
else:
	in2 = [IN[2]]

if IN[6]:
	element_count = len(in1)
else:
	element_count = 0

x = listview(IN[0],IN[3],IN[4],IN[5],element_count,IN[7],IN[8],IN[9])

for k,v in zip(in1,in2):
	if x.showId :
		try:
			try:
				x[str(k)+ '  -  id: ' + str(v.Id)] = v
			except:
				x[k.encode('utf-8').decode('utf-8') + '  -  id: ' + str(v.Id)] = v
		except:
			try:
				x[str(k)] = v
			except:
				x[k.encode('utf-8').decode('utf-8')] = v
	else:
		try:
			try:
				x[str(k)] = v
			except:
				x[k.encode('utf-8').decode('utf-8')] = v
		except:
			try:
				x[str(k)] = v
			except:
				x[k.encode('utf-8').decode('utf-8')] = v
OUT = x
# ----------------------------------------
ListView_input = Output(python_script)
