# Dynamo custom node UI.RadioButtons Data.dyf (Dynamo 1.2.1.3083)
# category: Data-Shapes.UI
# Create radio buttons input for UI.MultipleInputForm ++ .

InputName = Input(InputName : string = "Input")
Keys = Input()
Values = Input()
python_script = Python(IN[0]=InputName, IN[1]=Keys, IN[2]=Values)
# ---------- python_script.python (47 lines) ----------
#Copyright (c) mostafa el ayoubi ,  2017
#Data-Shapes www.data-shapes.net , elayoubi.mostafa@gmail.com


class uiradio():

    def __init__(self,inputname):
        self.inputname = inputname

    def __setitem__(self, key, item):
        self.__dict__[key] = item

    def __getitem__(self, key):
        return self.__dict__[key]

    def __iter__(self):
        return iter(self.__dict__)

    def values(self):
        return self.__dict__.values()

    def keys(self):
        return self.__dict__.keys()

    def __repr__(self):
        return 'UI.Radio input'
        
x = uiradio(IN[0])

if isinstance(IN[1],list):
	in1 = IN[1]
else:
	in1 = [IN[1]]
if isinstance(IN[2],list):
	in2 = IN[2]
else:
	in2 = [IN[2]]
	

for k,v in zip(in1,in2):
	try:
		x[str(k)] = v
	except:
		x[k.encode('utf-8').decode('utf-8')] = v


OUT = x
# ----------------------------------------
RadioButton_input = Output(python_script)
