# Dynamo custom node UI.SelectEdges Data.dyf (Dynamo 1.2.1.3083)
# category: Data-Shapes.UI
# Creates a Revit edge selection input for UI.MultipleInputForm++ . Check out www.data-shapes.net for more infos!

InputName = Input(InputName : string = "Input")
ButtonText = Input(ButtonText : string = "Select Edge(s)")
python_script = Python(IN[0]=InputName, IN[1]=ButtonText)
# ---------- python_script.python (16 lines) ----------
#Copyright (c) mostafa el ayoubi ,  2016
#Data-Shapes www.data-shapes.net , elayoubi.mostafa@gmail.com

class uiselectedges():

    def __init__(self,inputname,buttontext):
        self.inputname = inputname
        self.buttontext = buttontext

    def __repr__(self):
        return 'UI.SelectEdges input'
        
x = uiselectedges(IN[0],IN[1])


OUT = x
# ----------------------------------------
SelectEdges_input = Output(python_script)
