# Dynamo custom node UI.SelectLinkedElement(s) Data.dyf (Dynamo 1.2.1.3083)
# category: Data-Shapes.UI
# Create a button input for UI.MultipleInputForm++ that allows to select elements in à linked document. See www.data-shapes.net for more infos!

InputName = Input(InputName : string = "Input")
ButtonText = Input(ButtonText : string = "Select Linked Element(s)")
SelectSingleElement = Input(SelectSingleElement : bool = false)
python_script = Python(IN[0]=InputName, IN[1]=ButtonText, IN[2]=SelectSingleElement)
# ---------- python_script.python (20 lines) ----------
#Copyright (c) mostafa el ayoubi ,  2017
#Data-Shapes www.data-shapes.net , elayoubi.mostafa@gmail.com
#This node was inspired by @DanielHurtubise

class uiselectlinkedelements():

    def __init__(self,inputname,buttontext,multi):
        self.inputname = inputname
        self.buttontext = buttontext
        self.multi = multi

    def __repr__(self):
        return 'UI.SelectLinkedElements input'



x = uiselectlinkedelements(IN[0],IN[1],IN[2])


OUT = x
# ----------------------------------------
SelectLinkedElements_input = Output(python_script)
