# Dynamo custom node UI.TextBox Data.dyf (Dynamo 1.3.3.4111)
# category: Data-Shapes.UI
# Create Data for TextBox input in UI.MultipleInputForm ++ . Check out www.data-shapes.net for more informations

InputName = Input(InputName : string = "")
DefaultText = Input(DefaultText: string = "")
IsNumberEntry = Input(IsNumberEntry: bool = false)
python_script = Python(IN[0]=InputName, IN[1]=DefaultText, IN[2]=IsNumberEntry)
# ---------- python_script.python (17 lines) ----------
#Copyright (c) mostafa el ayoubi ,  2018
#Data-Shapes www.data-shapes.net , elayoubi.mostafa@gmail.com

class uitext():

    def __init__(self,inputname,defaultvalue,_isnum):
        self.inputname = inputname
        self.defaultvalue = defaultvalue
        self._isnum = _isnum

    def __repr__(self):
        return 'UI.Textbox input'
        
x = uitext(IN[0],IN[1],IN[2])


OUT = x
# ----------------------------------------
TextBox_input = Output(python_script)
