# Dynamo custom node UI.TreeView input.dyf (Dynamo 1.3.2.2480)
# category: Data-Shapes.UI
# Create a TreeView input for UI.MultipleInputForm ++ . Check out www.data-shapes.net for more infos and tips!

InputName = Input(InputName : string = "")
Data = Input()
FirstItemIsTitle = Input(FirstItemIsTitle : bool = false)
python_script = Python(IN[0]=InputName, IN[1]=Data, IN[2]=FirstItemIsTitle)
# ---------- python_script.python (17 lines) ----------
#Copyright (c) mostafa el ayoubi ,  2016
#Data-Shapes www.data-shapes.net , elayoubi.mostafa@gmail.com

class uitreeview():

    def __init__(self,inputname,datalist,_hastitles):
        self.inputname = inputname
        self.datalist = datalist
        self._hastitles = _hastitles

    def __repr__(self):
        return 'UI.TreeView input'
        
x = uitreeview(IN[0],IN[1],IN[2])


OUT = x
# ----------------------------------------
UI_TreeView_Data = Output(python_script)  # "UI.TreeView Data"
