# Dynamo custom node ViewSection.ByLine.dyf (Dynamo 1.3.3.4111)
# category: Data-Shapes.Revit.View
# Create ViewSections in current document from DS Lines.

Curve_s = Input()  # "Curve(s)"
ViewFamilyType = Input()
ViewSection_Height = Input()
Offset_from_Line = Input()
python_script = Python(IN[0]=Curve_s, IN[1]=ViewFamilyType, IN[2]=ViewSection_Height, IN[3]=Offset_from_Line)
# ---------- python_script.python (56 lines) ----------
import clr
clr.AddReference('RevitAPI')
from Autodesk.Revit.DB import *
clr.AddReference('RevitServices')
from RevitServices.Transactions import TransactionManager
from RevitServices.Persistence import DocumentManager
clr.AddReference('RevitNodes')
import Revit
clr.ImportExtensions(Revit.GeometryConversion)


doc = DocumentManager.Instance.CurrentDBDocument


curves = IN[0]
ViewFamilyType = IN[1]
height = IN[2]
offsetFromWall = IN[3]

watch = []

def DSCurveToVewSection(c,vft,offset,doc,height):
	locC = c.ToRevitType()
	sp = locC.GetEndPoint(0)
	ep = locC.GetEndPoint(1)
	v = ep-sp
	w = v.GetLength()
	h = 10
	#ViewSectionBoundingBox
	vsBBmin = XYZ(-w/2-4,sp.Z-1,-offset)
	vsBBmax = XYZ(w/2+4,height + 7,offset)
	midpoint = sp + 0.5*v
	lineDir = v.Normalize()
	up = XYZ.BasisZ
	viewdir = lineDir.CrossProduct(up)
	
	t = Transform.Identity
	t.Origin = midpoint
	t.BasisX = lineDir
	t.BasisY = up
	t.BasisZ = viewdir
	
	vsBB = BoundingBoxXYZ()
	vsBB.Transform = t
	vsBB.Min = vsBBmin
	vsBB.Max = vsBBmax
	
	section = ViewSection.CreateSection(doc,ElementId(vft.Id),vsBB)
	
	return section
	
TransactionManager.Instance.EnsureInTransaction(doc)
watch = [DSCurveToVewSection(c,ViewFamilyType,offsetFromWall,doc,height) for c in curves]
TransactionManager.Instance.TransactionTaskDone

OUT = watch
# ----------------------------------------
ViewSection_s = Output(python_script)  # "ViewSection(s)"
