# Dynamo graph Add shared params to families.dyn (Dynamo 2.3.0.5885)
# packages: Data-Shapes 2021.2.91

# group: Prompt user to select shared parameter .txt file
code_block = CodeBlock { "Batch add shared parameters to families in project"; }
code_block_2 = CodeBlock { "Open .txt"; }
code_block_3 = CodeBlock { "Shared parameters .txt"; }
filepath_data = Custom[FilePath Data](InputName=code_block_3)  # package Data-Shapes; Create filepath input for UI.MultipleInputForm ++ . Check out www.data-shapes.net for more infos !
boolean = BoolSelector(true)  # graph input
multipleinputform = Custom[MultipleInputForm ++](Description_optional=code_block, ButtonText_optional=code_block_2, Inputs=filepath_data, Toggle=boolean)  # package Data-Shapes; Create a form with multiple inputs. InputType codification: -strings : "s" -booleans : "bool" -filepaths : "fp" -directorypath : "dp" -revit element section : "se" -revit face selection : "sf" -revit edge selection : "sed" -dropdown lists : UI.DropDown Data node -listview : UI.ListView Data node see www.data-shapes.net for more infos
code_block_4 = CodeBlock(x=multipleinputform.User_Inputs) { x[0]; }

# group: Getting all families in project
code_block_5 = CodeBlock()
# ---------- code_block_5.designscript (11 lines) ----------
"
import clr
clr.AddReference('RevitAPI')
from Autodesk.Revit.DB import*
clr.AddReference('RevitServices')
from RevitServices.Persistence import DocumentManager

doc = DocumentManager.Instance.CurrentDBDocument

OUT = [i for i in FilteredElementCollector(doc).OfClass(Family)]
";
# ----------------------------------------
python_script_from_string = PythonStringNode(script=code_block_5)

name = Family.Name(family=python_script_from_string)
parametergroup_list = Custom[ParameterGroup list]()  # package Data-Shapes; List of all parameter groups
string_from_object = FromObject(obj=parametergroup_list)

# group: Getting sahred parameters from txt and preparing data for UI.MultipleInputNode++
code_block_6 = CodeBlock { "Families"; }
listview_data = Custom[Listview Data](InputName=code_block_6, Keys=name, Values=python_script_from_string)  # package Data-Shapes; Create data for ListView input in UI.MultiInputForm
code_block_7 = CodeBlock { "Shared parameters"; }
sharedparameters_from_txt_file = Custom[SharedParameters from txt file](FilePath=code_block_4)  # package Data-Shapes; Gets parameters from SharedParameter .txt file
code_block_8 = CodeBlock { 150; }
listview_data_2 = Custom[Listview Data](InputName=code_block_7, Keys=sharedparameters_from_txt_file.Parameter_Names, Values=sharedparameters_from_txt_file.Revit_Parameters, Height_optionnal=code_block_8)
code_block_9 = CodeBlock { "Parameter group"; }
dropdown_data = Custom[DropDown Data](InputName=code_block_9, Keys=string_from_object, Values=parametergroup_list)  # package Data-Shapes; Create data for DropDown input in UI.MultiInputForm
code_block_10 = CodeBlock { "Instance parameters?"; }
boolean_input = Custom[Boolean input](InputName=code_block_10)  # package Data-Shapes; Creates a boolean input for UI.MultipleInputForm ++ . Check out www.data-shapes.net for more infos!
create = List.Create(item0=listview_data, item1=listview_data_2, item2=dropdown_data, item3=boolean_input)

# group: Prompt user to select categories, parameters, parameter group and Instance/Type
code_block_11 = CodeBlock { "Add Shared parameters"; }
multipleinputform_2 = Custom[MultipleInputForm ++](Description_optional=code_block, ButtonText_optional=code_block_11, Inputs=create, Toggle=multipleinputform.Was_Run)

code_block_12 = CodeBlock(x=multipleinputform_2.User_Inputs) { x[0]; x[1]; x[2]; x[3]; }

# group: Adding shared parameters to families and reloading them
code_block_13 = CodeBlock()
# ---------- code_block_13.designscript (45 lines) ----------
"
#Code largely inspired by Dimitar Venkov
import clr

clr.AddReference('RevitServices')
from RevitServices.Persistence import DocumentManager
from RevitServices.Transactions import TransactionManager
doc = DocumentManager.Instance.CurrentDBDocument

clr.AddReference('RevitAPI')
from Autodesk.Revit.DB import *

parameters = IN[0]
paramgroup = IN[1]
inst_or_typ = IN[2]
families = UnwrapElement(IN[3])

# class for overwriting loaded families in the project
class FamOpt1(IFamilyLoadOptions):
    def __init__(self): pass
    def OnFamilyFound(self,familyInUse, overwriteParameterValues): return True
    def OnSharedFamilyFound(self,familyInUse, source, overwriteParameterValues): return True

trans1 = TransactionManager.Instance
trans1.ForceCloseTransaction() #just to make sure everything is closed down
# Dynamo's transaction handling is pretty poor for
# multiple documents, so we'll need to force close
# every single transaction we open
result = []

for f1 in families:

    famdoc = doc.EditFamily(f1)

    trans1.EnsureInTransaction(famdoc)
    for p in parameters:
        famdoc.FamilyManager.AddParameter(p, paramgroup, inst_or_typ)
    trans1.ForceCloseTransaction()
    famdoc.LoadFamily(doc, FamOpt1())
    result.append(True)



OUT = 'Successfully added %d shared parameters to %d families' %(len(parameters),len(result))
";
# ----------------------------------------
python_script_from_string_2 = PythonStringNode(script=code_block_13, IN[0]=code_block_12.out1, IN[1]=code_block_12.out2, IN[2]=code_block_12.out3, IN[3]=code_block_12.out0)
