# Dynamo graph Gabarits - Importation séléctive de Gabarit (et ses filtres) depuis Lien v1.0.dyn (Dynamo 2.6.1.8786)
# packages: Data-Shapes 2019.2.42

code_block = CodeBlock { "Fichier d'origine"; }
python_script = Python()
# ---------- python_script.python (17 lines) ----------
# Charger les bibliothèques DesignScript et Standard Python
import sys
import clr
clr.AddReference('RevitAPI')
from Autodesk.Revit.DB import *
clr.AddReference('RevitServices')

from RevitServices.Persistence import DocumentManager

doc = DocumentManager.Instance.CurrentDBDocument

links = FilteredElementCollector(doc).OfClass(RevitLinkInstance).ToElements()




OUT = links
# ----------------------------------------
name = Element.Name(element=python_script)
ui_dropdown_data = Custom[UI.DropDown Data](InputName=code_block, Keys=name, Values=python_script)  # package Data-Shapes; Create data for DropDown input in UI.MultiInputForm ++ . Check out www.data-shapes.net for more infos.

# group: Selection fichier source
code_block_2 = CodeBlock { "Importation de Gabarits de Vue Depuis un Fichier Source"; }
code_block_3 = CodeBlock { "Afficher la liste de gabarits du fichier source"; }
boolean = BoolSelector(true)  # graph input
code_block_4 = CodeBlock { 450; }
ui_multipleinputform = Custom[UI.MultipleInputForm ++](Description_optional=code_block_2, ButtonText_optional=code_block_3, Inputs=ui_dropdown_data, Toggle=boolean, Width_optional=code_block_4)  # package Data-Shapes; Create a form with multiple inputs. see www.data-shapes.net for tutorials and infos!
code_block_5 = CodeBlock(x=ui_multipleinputform.User_Inputs) { x[0]; }

# group: Liste de filtres du fichier source + background open
python_script_2 = Python(IN[0]=code_block_5)
# ---------- python_script_2.python (20 lines) ----------
import clr
clr.AddReference('RevitAPI')
from Autodesk.Revit.DB import*
clr.AddReference('RevitServices')
from RevitServices.Persistence import DocumentManager
from RevitServices.Transactions import TransactionManager
import System
from System.Collections.Generic import*

uiapp = DocumentManager.Instance.CurrentUIApplication
app = uiapp.Application

doc = UnwrapElement(IN[0])

mats = [v for v in FilteredElementCollector(doc.GetLinkDocument()).OfClass(View) if v.IsTemplate]




OUT = [mat.Name for mat in mats] , [mat.Id for mat in mats]
# ----------------------------------------

code_block_6 = CodeBlock(x=python_script_2) { x[0]; x[1]; }

# group: Sélection filtres
code_block_7 = CodeBlock { "Sélectionner les Gabarits de Vue à Importer"; "Importer les Gabarits"; }
ui_listview_data = Custom[UI.Listview Data](Keys=code_block_6.out0, Values=code_block_6.out1)  # package Data-Shapes; Create data for ListView input in UI.MultiInputForm ++ . Check out www.data-shapes.net for more infos.
ui_multipleinputform_2 = Custom[UI.MultipleInputForm ++](Description_optional=code_block_7.out0, ButtonText_optional=code_block_7.out1, Inputs=ui_listview_data, Toggle=ui_multipleinputform.Was_Run, Width_optional=code_block_4)
code_block_8 = CodeBlock(x=ui_multipleinputform_2.User_Inputs) { x[0]; }

# group: Copie des filtres
python_script_3 = Python(IN[0]=code_block_8, IN[1]=code_block_5)
# ---------- python_script_3.python (37 lines) ----------
import clr
clr.AddReference('RevitAPI')
from Autodesk.Revit.DB import*
clr.AddReference('RevitServices')
from RevitServices.Persistence import DocumentManager
from RevitServices.Transactions import TransactionManager
import System
from System.Collections.Generic import*

uiapp = DocumentManager.Instance.CurrentUIApplication
app = uiapp.Application

matsIds = IN[0]
doc = UnwrapElement(IN[1]).GetLinkDocument()

activedoc = DocumentManager.Instance.CurrentDBDocument

"""
class handler(IDuplicateTypeNamesHandler):
    def __init__(self): pass
    def OnDuplicateTypeNamesFound(self): return DuplicateTypeAction.
"""

cp = CopyPasteOptions()
#cp.SetDuplicateTypeNamesHandler(handler())

eId = List[ElementId]()
for id in matsIds:
	eId.Add(id)
tr = Transform.Identity

TransactionManager.Instance.EnsureInTransaction(activedoc)
ElementTransformUtils.CopyElements(doc,eId,activedoc,tr,cp)
TransactionManager.Instance.TransactionTaskDone()


OUT = "okay"
# ----------------------------------------

element_types = ElementTypes("FilterElement")  # graph input
all_elements_of_type = ElementsOfType(element_type=element_types)
