# Dynamo graph Initiate Cloud Worksharing.dyn "saveUIDoc" (Dynamo 2.10.1.3976)

code_block = CodeBlock { "f7bb3024-413d-4f05-a456-751acd39cc99"; }
code_block_2 = CodeBlock { "0e5e1437-8d14-4963-9f01-c394aab97e1e"; }
code_block_3 = CodeBlock { "urn:adsk.wipprod:fs.folder:co.qzQykZIpRvSMzZJACPvKHA"; }
code_block_4 = CodeBlock { "Testos"; }
python_script = Python(IN[0]=code_block, IN[1]=code_block_2, IN[2]=code_block_3, IN[3]=code_block_4)  # IronPython2
# ---------- python_script.python (35 lines) ----------
import clr
import System

clr.AddReference('RevitAPI')
from Autodesk.Revit.DB import *

clr.AddReference('RevitServices')
from RevitServices.Persistence import DocumentManager

doc = DocumentManager.Instance.CurrentDBDocument
app = doc.Application

uiDoc = DocumentManager.Instance.CurrentUIApplication.ActiveUIDocument
uiApp = uiDoc.Application

from System import Guid


accId = list(Guid.TryParse(IN[0]))[1]
projId = list(Guid.TryParse(IN[1]))[1]
folderId = IN[2]
modelName = IN[3]

doc.SaveAsCloudModel(accId,projId,folderId,modelName)

#cloudPath = doc.GetCloudModelPath()

if doc.CanEnableCloudWorksharing():
	doc.EnableCloudWorksharing()

#doc.Close();
##uiapp.OpenAndActivateDocument(cloudPath, OpenOptions(), false );


OUT =  uiApp
# ----------------------------------------
