# Dynamo graph Reiseignement SU Appartement.dyn (Dynamo 2.6.1.8786)
# packages: Data-Shapes 2019.2.42, Data-Shapes 2021.2.92

code_block = CodeBlock { "Rooms"; }
categorie_s_by_enu_name_s = Custom[Categorie(s) by ENU Name(s)](CategoryNameInEnglish=code_block)  # package Data-Shapes; Gets categorie(s) in the current UI language by it's english name
all_elements_of_category = ElementsOfCategory(Category=categorie_s_by_enu_name_s.Categorie_s)
code_block_2 = CodeBlock { "Area"; "Surface"; }
multilanguage_io = Custom[MultiLanguage IO](ENU=code_block_2.out0, FRA=code_block_2.out1)  # package Data-Shapes; Takes inputs in different languages and returns the version that corresponds to the active Revit application language settings.
code_block_3 = CodeBlock { "Calcul surfaces appartements"; "Valider"; }
code_block_4 = CodeBlock()
# ---------- code_block_4.designscript (4 lines) ----------
"Nom du paramètre de regroupement";
"Nom du paramètre à renseigner";
"Orde de pièce a partir duquel filtrer";
"Paramètre Ordre de pièce";
# ----------------------------------------
code_block_5 = CodeBlock(x=all_elements_of_category) { x[0]; }
parameters = Element.Parameters(element=code_block_5)
name = Parameter.Name(parameter=parameters)
dropdown_data = Custom[DropDown Data](InputName=code_block_4.out0, Keys=name, Values=name)  # package Data-Shapes; Create data for DropDown input in UI.MultiInputForm ++ . Check out www.data-shapes.net for more infos.
dropdown_data_2 = Custom[DropDown Data](InputName=code_block_4.out1, Keys=name, Values=name)
dropdown_data_3 = Custom[DropDown Data](InputName=code_block_4.out3, Keys=name, Values=name)
textbox_data = Custom[TextBox Data](InputName=code_block_4.out2)  # package Data-Shapes; Create Data for TextBox input in UI.MultipleInputForm ++ . Check out www.data-shapes.net for more informations
list_create = List.Create(item0=dropdown_data, item1=dropdown_data_2, item2=dropdown_data_3, item3=textbox_data)
boolean = BoolSelector(true)
code_block_6 = CodeBlock { 500; }
code_block_7 = CodeBlock { 230; }
multipleinputform = Custom[MultipleInputForm ++](Description_optional=code_block_3.out0, ButtonText_optional=code_block_3.out1, Inputs=list_create, Toggle=boolean, Width_optional=code_block_6, LabelWidth_optional=code_block_7)  # package Data-Shapes; Create a form with multiple inputs. see www.data-shapes.net for tutorials and infos!
code_block_8 = CodeBlock(x=multipleinputform.User_Inputs) { x[0]; x[1]; x[2]; x[3]; }
toNumber = String.ToNumber(str=code_block_8.out3)
code_block_9 = CodeBlock(e=all_elements_of_category, surfParam=multilanguage_io, param=code_block_8.out2, min=toNumber)
# ---------- code_block_9.designscript (13 lines) ----------
ss = Element.GetParameterValueByName(e,surfParam);
test = ss == "";
r = DSCore.List.FilterByBoolMask(e,test)["out"];

//Filtrage espaces ext
ordres = Element.GetParameterValueByName(r,param);
testOrdre = ordres>min;
testnull = isnull(testOrdre);

outn = DSCore.List.FilterByBoolMask(r,testnull)["out"];
outf = DSCore.List.FilterByBoolMask(testOrdre,testnull)["out"];

out = DSCore.List.FilterByBoolMask(outn,outf)["out"];
# ----------------------------------------
code_block_10 = CodeBlock(r=code_block_9.out, par=code_block_8.out0, surfParam=multilanguage_io)
# ---------- code_block_10.designscript (6 lines) ----------
nums = Element.GetParameterValueByName(r,par);
grouped = DSCore.List.GroupByKey(r,nums)["groups"];
surfs = Element.GetParameterValueByName(grouped,surfParam);
round = Math.Floor(surfs*100)/100;
tots = Math.Sum(round<1>);
rounded = Math.Round(tots,2);
# ----------------------------------------
setParameterByName = Element.SetParameterByName(element=code_block_10.grouped@L2, parameterName=code_block_8.out1, value=code_block_10.rounded@L1)
code_block_11 = CodeBlock()
# ---------- code_block_11.designscript (5 lines) ----------
def isnull(i)
{
val = i == null ? true : false;
return = val;
};
# ----------------------------------------
code_block_12 = CodeBlock(x=code_block_9.testOrdre) { x; }
