# Dynamo graph RemoveUnplacedRooms.dyn "bradPyt" (Dynamo 2.3.0.5885)

python_script = Python()  # unwired: IN[0]
# ---------- python_script.python (6 lines) ----------
# Enable Python support and load DesignScript library
import clr
clr.AddReference('ProtoGeometry')


newwwSTYYYIDGUGBD
# ----------------------------------------
