# Dynamo graph Remplacement d'un type d'étiquette par type de vue.dyn (Dynamo 2.3.0.5885)
# packages: Data-Shapes 2022.2.96

boolean = BoolSelector(false)

# group: ViewType selection
python_script = Python()
# ---------- python_script.python (23 lines) ----------
# Load the Python Standard and DesignScript Libraries
import sys
import clr
clr.AddReference('RevitAPI')
from Autodesk.Revit.DB import *
clr.AddReference('RevitServices')
from RevitServices.Persistence import DocumentManager
from RevitServices.Transactions import TransactionManager
import itertools
from itertools import groupby
clr.AddReference('RevitNodes')
import Revit
clr.ImportExtensions(Revit.GeometryConversion)
import System
from System.Collections.Generic import*

doc = DocumentManager.Instance.CurrentDBDocument

rooms = FilteredElementCollector(doc).OfCategory(BuiltInCategory.OST_Rooms).ToElements()



OUT = rooms
# ----------------------------------------
code_block = CodeBlock { "Title"; }
code_block_2 = CodeBlock { "Type de vues à traiter"; "Etiquette à remplacer"; "Etiquette à utiliser"; }
python_script_2 = Python(IN[0]=boolean)
# ---------- python_script_2.python (23 lines) ----------
# Load the Python Standard and DesignScript Libraries
import sys
import clr
clr.AddReference('RevitAPI')
from Autodesk.Revit.DB import *
clr.AddReference('RevitServices')
from RevitServices.Persistence import DocumentManager
from RevitServices.Transactions import TransactionManager
import itertools
from itertools import groupby
clr.AddReference('RevitNodes')
import Revit
clr.ImportExtensions(Revit.GeometryConversion)
import System
from System.Collections.Generic import*

doc = DocumentManager.Instance.CurrentDBDocument

views = [ v for v in FilteredElementCollector(doc).OfClass(ViewFamilyType) ]



OUT = views
# ----------------------------------------
name = Element.Name(element=[python_script_2, python_script_2, python_script_2])
dropdown_data = Custom[DropDown Data](InputName=[code_block_2.out0, code_block_2.out0, code_block_2.out0], Keys=[name, name, name], Values=[python_script_2, python_script_2, python_script_2])  # package Data-Shapes; Create data for DropDown input in UI.MultiInputForm ++ . Check out www.data-shapes.net for more infos.
boolean_2 = BoolSelector(true)
code_block_3 = CodeBlock { 700; 350; }

python_script_3 = Python(IN[0]=boolean)
# ---------- python_script_3.python (23 lines) ----------
# Load the Python Standard and DesignScript Libraries
import sys
import clr
clr.AddReference('RevitAPI')
from Autodesk.Revit.DB import *
clr.AddReference('RevitServices')
from RevitServices.Persistence import DocumentManager
from RevitServices.Transactions import TransactionManager
import itertools
from itertools import groupby
clr.AddReference('RevitNodes')
import Revit
clr.ImportExtensions(Revit.GeometryConversion)
import System
from System.Collections.Generic import*

doc = DocumentManager.Instance.CurrentDBDocument

tagTypes = [ v for v in FilteredElementCollector(doc).OfClass(FamilySymbol).WhereElementIsElementType() if (v.Category.Name == Category.GetCategory(doc,BuiltInCategory.OST_DoorTags).Name or  v.Category.Name == Category.GetCategory(doc,BuiltInCategory.OST_RoomTags).Name or  v.Category.Name == Category.GetCategory(doc,BuiltInCategory.OST_WindowTags).Name)]



OUT = tagTypes
# ----------------------------------------
name_2 = Element.Name(element=python_script_3)
dropdown_data_2 = Custom[DropDown Data](InputName=code_block_2.out1, Keys=name_2, Values=python_script_3)
python_script_4 = Python(IN[0]=boolean)  # same code as python_script_3
name_3 = Element.Name(element=python_script_4)
dropdown_data_3 = Custom[DropDown Data](InputName=code_block_2.out2, Keys=name_3, Values=python_script_4)
list_create = List.Create(item0=dropdown_data, item1=dropdown_data_2, item2=dropdown_data_3)

# group (continued): ViewType selection
multipleinputform = Custom[MultipleInputForm ++](Description_optional=[code_block, code_block], Inputs=[dropdown_data, dropdown_data, list_create], Toggle=[boolean_2, boolean_2, boolean_2], Width_optional=[code_block_3.out0, code_block_3.out0, code_block_3.out0], LabelWidth_optional=code_block_3.out1)  # package Data-Shapes; Create a form with multiple inputs. see www.data-shapes.net for tutorials and infos!
code_block_4 = CodeBlock(x=multipleinputform.User_Inputs) { x[0]; x[1]; x[2]; }

# group: Views of Viewtype selection
python_script_5 = Python(IN[0]=code_block_4.out0, IN[1]=code_block_4.out1, IN[2]=code_block_4.out2)
# ---------- python_script_5.python (34 lines) ----------
# Load the Python Standard and DesignScript Libraries
import sys
import clr
clr.AddReference('RevitAPI')
from Autodesk.Revit.DB import *
clr.AddReference('RevitServices')
from RevitServices.Persistence import DocumentManager
from RevitServices.Transactions import TransactionManager
import itertools
from itertools import groupby
clr.AddReference('RevitNodes')
import Revit
clr.ImportExtensions(Revit.GeometryConversion)
import System
from System.Collections.Generic import*

doc = DocumentManager.Instance.CurrentDBDocument



views = [ str(v.Id) for v in FilteredElementCollector(doc).OfClass(View) if v.IsTemplate == False and v.GetTypeId() == UnwrapElement(IN[0]).Id]


TagsToReplace = []
[TagsToReplace.append(v) for v in FilteredElementCollector(doc).OfCategory(BuiltInCategory.OST_RoomTags).WhereElementIsNotElementType() if str(v.GetTypeId()) == str(UnwrapElement(IN[1]).Id) and str(v.OwnerViewId) in views] 
[TagsToReplace.append(v) for v in FilteredElementCollector(doc).OfCategory(BuiltInCategory.OST_DoorTags).WhereElementIsNotElementType() if str(v.GetTypeId()) == str(UnwrapElement(IN[1]).Id) and str(v.OwnerViewId) in views] 
[TagsToReplace.append(v) for v in FilteredElementCollector(doc).OfCategory(BuiltInCategory.OST_WindowTags).WhereElementIsNotElementType() if str(v.GetTypeId()) == str(UnwrapElement(IN[1]).Id) and str(v.OwnerViewId) in views] 

TransactionManager.Instance.EnsureInTransaction(doc)
for tag in TagsToReplace:
	tag.ChangeTypeId(UnwrapElement(IN[2]).Id)
TransactionManager.Instance.TransactionTaskDone()

OUT = TagsToReplace 
# ----------------------------------------
