# Dynamo graph RoomBoundingElements.dyn (Dynamo 2.6.1.8786)
# packages: Data-Shapes 2022.2.98

select_model_element = DSModelElementSelection()  # 1 picked in the model
python_script = Python(IN[0]=select_model_element)
# ---------- python_script.python (31 lines) ----------
# Load the Python Standard and DesignScript Libraries
import sys
import clr
clr.AddReference('ProtoGeometry')
from Autodesk.DesignScript.Geometry import *
clr.AddReference('RevitAPI')
from Autodesk.Revit.DB import *

clr.AddReference('RevitNodes')
import Revit
clr.ImportExtensions(Revit.Elements)
clr.ImportExtensions(Revit.GeometryConversion)

clr.AddReference('RevitServices')
from RevitServices.Persistence import DocumentManager
doc = DocumentManager.Instance.CurrentDBDocument

room = UnwrapElement(IN[0])

options = SpatialElementBoundaryOptions()
options.SpatialElementBoundaryLocation = SpatialElementBoundaryLocation.Finish

bound = room.GetBoundarySegments(options)

out = []

for loop in bound:
	for l in loop:
		out.append([l.GetCurve().ToProtoType(),doc.GetElement(l.ElementId)])

OUT = out
# ----------------------------------------
transpose = List.Transpose(lists=python_script)
code_block = CodeBlock(x=transpose) { x[0]; }
number_slider = DoubleSlider(31.8, range=0..100 step 0.1)
getItemAtIndex = List.GetItemAtIndex(list=code_block, index=number_slider)
geomPreview = GeomPreviewNodeModel(Geometry=getItemAtIndex, SliderValue=255, rValue="255", gValue="60", bValue="43")
geomPreview_2 = GeomPreviewNodeModel(Geometry=code_block, SliderValue=99.07, rValue="100", gValue="100", bValue="100")
code_block_2 = CodeBlock(x=transpose) { x[1]; }
getItemAtIndex_2 = List.GetItemAtIndex(list=code_block_2, index=number_slider)
name = Element.Name(element=getItemAtIndex_2)
