# Dynamo graph Suppression pièces non placées.dyn (Dynamo 2.6.1.8786)
# packages: Data-Shapes 2022.2.96, archi-lab.net 2021.25.2521

code_block = CodeBlock { "Rooms"; }
categorie_s_by_enu_name_s = Custom[Categorie(s) by ENU Name(s)](CategoryNameInEnglish=code_block)  # package Data-Shapes; Gets categorie(s) in the current UI language by it's english name
all_elements_of_category = ElementsOfCategory(Category=categorie_s_by_enu_name_s.Categorie_s)
room_status = Custom[Room Status](Rooms=all_elements_of_category)  # package Data-Shapes; Sorts a list of room into three categories: unplaced, PlacedAndBounded and unbounded
delete = archilab.Revit.Elements.Elements.Delete(element=room_status.Unplaced)
