# Dynamo graph WindowLegendImages.dyn (Dynamo 2.3.0.5885)

current = Document.Current()
activeView = Document.ActiveView(document=current)
boolean = BoolSelector(false)

# group: Création des paramètres non existants
python_script = Python(IN[0]=boolean)
# ---------- python_script.python (101 lines) ----------
import clr
import System
clr.AddReference('RevitAPI')
from Autodesk.Revit.DB import*
clr.AddReference('RevitServices')
from RevitServices.Persistence import DocumentManager
from RevitServices.Transactions import TransactionManager
clr.AddReference('RevitAPIUI')
from Autodesk.Revit.UI import *
from Autodesk.Revit import Creation
import sys
pyt_path = r'C:\Program Files (x86)\IronPython 2.7\Lib'
sys.path.append(pyt_path)

import System
import os
import tempfile


doc = DocumentManager.Instance.CurrentDBDocument
uidoc = DocumentManager.Instance.CurrentUIDocument
app = doc.Application

def tolist(input):
	if isinstance(input,list):
		return UnwrapElement(input)
	else:
		return [UnwrapElement(input)]
		
categories = tolist(Category.GetCategory(doc,BuiltInCategory.OST_Doors))
categories.append(Category.GetCategory(doc,BuiltInCategory.OST_Windows))

#Vérification de l'existance du paramètre


def listing(input):
	if isinstance(input,list):
		return input
	else:
		return [input]
		
paramnames = ["leg_Pla","leg_Ele","leg_3D","leg_NombreParNiveau"]
paramtypes = [ParameterType.Image,ParameterType.Image,ParameterType.Image,ParameterType.MultilineText]


#Creation d'une référence externe temporaire
tempfolder = tempfile.gettempdir()
tempfile = tempfolder +'\\'+'DATASHAPESTEMP.txt'
f = open(tempfile,'w')
f.write('')
f.close()

TransactionManager.Instance.EnsureInTransaction(doc)

#recuperation du fichier de paramètres partagés pour remplacement temporaire
orig = True
try:
	originalFile = app.SharedParametersFilename
except:
	orig = False

#remplacement du fichier de paramètres partagés et création des paramètres de projet
app.SharedParametersFilename = tempfile
groups = app.OpenSharedParameterFile().Groups
tempgroup = groups.Create('TempParams')

for paramname,paramtype in zip(paramnames,paramtypes):
	iterator = doc.ParameterBindings.ForwardIterator()
	testval = 0
	while iterator.MoveNext():
		if categories[0].Name in [c.Name for c in iterator.Current.Categories] and paramname == iterator.Key.Name:
			testval=1
		else:
			pass	
	if testval==0:			
		#creation d'un set de categories
		catset = app.Create.NewCategorySet()
		[catset.Insert(j) for j in categories]	
		#Creation du paramètre dans le fichier externe temporaire
		tempparam = ExternalDefinitionCreationOptions(paramname,paramtype)
		tempparam.UserModifiable = True
		tempdef = tempgroup.Definitions.Create(tempparam)		
		paramgroup = [a for a in System.Enum.GetValues(BuiltInParameterGroup) if str(a) == "PG_IDENTITY_DATA"][0]		
		#Ajout du paramètre au projet	
		bind = app.Create.NewTypeBinding(catset)
		bindmap = doc.ParameterBindings
		bindmap.Insert(tempdef, bind, paramgroup)
		
		

		
	else:
		pass
#Rétablissement du fichier de paramètres partagés initial
if orig:
	app.SharedParametersFilename = originalFile
else:
	pass
TransactionManager.Instance.TransactionTaskDone

OUT = "ok"
# ----------------------------------------

python_script_2 = Python(IN[0]=activeView, IN[1]=python_script)
# ---------- python_script_2.python (92 lines) ----------
# Load the Python Standard and DesignScript Libraries
import clr
clr.AddReference('RevitAPI')
from Autodesk.Revit.DB import*
clr.AddReference('RevitServices')
import time
import datetime
from RevitServices.Transactions import TransactionManager
from RevitServices.Persistence import DocumentManager
clr.AddReference('RevitNodes')
import Revit
clr.ImportExtensions(Revit.Elements)
import datetime
from System.Collections.Generic import *
import tempfile

doc = DocumentManager.Instance.CurrentDBDocument
uiapp = DocumentManager.Instance.CurrentUIApplication
app = uiapp.Application
uidoc = uiapp.ActiveUIDocument

uiviews = uidoc.GetOpenUIViews()
activeviewid = doc.ActiveView.Id
activeUIView = [v for v in uiviews if v.ViewId == activeviewid][0]
lgdView = UnwrapElement(IN[0])

#Get legend components
elem = FilteredElementCollector(doc,lgdView.Id).OfCategory(BuiltInCategory.OST_LegendComponents).ToElements()[0]
imageTypes = FilteredElementCollector(doc).OfClass(ImageType).ToElements()
imageNames = [i.ToDSType(True).Name for i in  imageTypes]

doors = FilteredElementCollector(doc).OfCategory(BuiltInCategory.OST_Windows).WhereElementIsNotElementType()
levels = FilteredElementCollector(doc).OfClass(Level).WhereElementIsNotElementType()
doorTypes = FilteredElementCollector(doc).OfCategory(BuiltInCategory.OST_Windows).WhereElementIsElementType().ToElements()

TransactionManager.Instance.ForceCloseTransaction()

counts = []


def meth(doorType,viewType_,suffix,zoom):
	#PREVIEWS
	trans = Transaction(doc)
	TransactionManager.Instance.ForceCloseTransaction()
	trans.Start(str(doorType.Id))
	elem.get_Parameter(BuiltInParameter.LEGEND_COMPONENT).Set(doorType.Id)
	elem.get_Parameter(BuiltInParameter.LEGEND_COMPONENT_VIEW).Set(viewType_)
	if suffix == "Pla":
		elem.get_Parameter(BuiltInParameter.LEGEND_COMPONENT_LENGTH).Set(7)
	optsPlan = ImageExportOptions()
	pathToImage = tempfile.gettempdir()+"\\"+str(doorType.Id)+suffix
	optsPlan.FilePath = pathToImage		
	optsPlan.PixelSize = 2048
	optsPlan.ImageResolution = ImageResolution.DPI_300
	lgdView.CropBox = elem.get_BoundingBox(lgdView)
	optsPlan.ExportRange = ExportRange.VisibleRegionOfCurrentView
	#activeUIView.ZoomAndCenterRectangle(elem.get_BoundingBox(lgdView).Min,elem.get_BoundingBox(lgdView).Max)
	activeUIView.ZoomToFit()
	activeUIView.Zoom(zoom)
	uidoc.RefreshActiveView()
	trans.Commit()
	trans1 = Transaction(doc)
	trans1.Start(str(doorType.Id)+"export")
	doc.ExportImage(optsPlan)
	if str(doorType.Id)+suffix+".jpg" in imageNames:
		try:
			toDel = [i for i in imageTypes if str(doorType.Id)+suffix+".jpg"== i.ToDSType(True).Name][0]		
			doc.Delete(toDel.Id)
		except:
			pass
	imageType = ImageType.Create(doc, pathToImage+".jpg");		
	doorType.LookupParameter("leg_"+suffix).Set(imageType.Id)
	trans1.Commit()
	

for fType in doorTypes:		
	meth(fType,-8,"Pla",0.9)
	meth(fType,-7,"Ele",0.9)
	meth(fType,-3,"3D",0.7)
	#COUNT
	paramString = ""
	doorsOfType = [d for d in doors if d.GetTypeId() == fType.Id]
	for l in levels:
		doorsAtLevel = [d for d in doorsOfType if d.LevelId == l.Id]
		if len(doorsAtLevel) != 0:
			paramString += l.Name + " : " + str(len(doorsAtLevel)) + "\n"
	TransactionManager.Instance.EnsureInTransaction(doc)
	fType.LookupParameter("leg_NombreParNiveau").Set(paramString)
	TransactionManager.Instance.TransactionTaskDone


OUT = doorTypes,counts
# ----------------------------------------

# group: cleanImages
boolean_2 = BoolSelector(false)
python_script_3 = Python(IN[0]=boolean_2)  # frozen
# ---------- python_script_3.python (36 lines) ----------
# Load the Python Standard and DesignScript Libraries
import clr
clr.AddReference('RevitAPI')
from Autodesk.Revit.DB import*
clr.AddReference('RevitServices')
import time
import datetime
from RevitServices.Transactions import TransactionManager
from RevitServices.Persistence import DocumentManager
clr.AddReference('RevitNodes')
import Revit
clr.ImportExtensions(Revit.Elements)
import datetime
from System.Collections.Generic import *

doc = DocumentManager.Instance.CurrentDBDocument
uiapp = DocumentManager.Instance.CurrentUIApplication
app = uiapp.Application
uidoc = uiapp.ActiveUIDocument

uiviews = uidoc.GetOpenUIViews()
activeviewid = doc.ActiveView.Id
activeUIView = [v for v in uiviews if v.ViewId == activeviewid][0]
lgdView = UnwrapElement(IN[0])

#Get legend components
elem = FilteredElementCollector(doc).OfClass(ImageType).ToElements()


TransactionManager.Instance.EnsureInTransaction(doc)	
for e in elem:
	doc.Delete(e.Id)
TransactionManager.Instance.TransactionTaskDone()	


OUT = "ok"
# ----------------------------------------
