# Dynamo graph création du fichier export ifc personnalisé.dyn (Dynamo 2.6.1.8786)
# packages: spring nodes 204.1.0, Data-Shapes 2021.2.94

file_path = Filename("..\Pièces écrites\Refs\veritas.png")
code_block = CodeBlock { "Créer le réglage d'export"; "Annuler"; }
code_block_2 = CodeBlock { "Sélectionner un élément de la catégorie à traiter"; }
boolean = BoolSelector(true)
selectmodelelements_data = Custom[SelectModelElements Data](ButtonText=code_block_2, SelectSingleElement=boolean)  # package Data-Shapes; Creates a Revit element selection input for UI.MultipleInputForm++ . Check out www.data-shapes.net for more infos!
multipleinputform = Custom[MultipleInputForm ++](Inputs=selectmodelelements_data, Toggle=boolean)  # package Data-Shapes; Create a form with multiple inputs. see www.data-shapes.net for tutorials and infos!
code_block_3 = CodeBlock(x=multipleinputform.User_Inputs) { x[0]; }

# group: Récupération de tous les paramètres de la catégorie
parameters = Element.Parameters(element=code_block_3)

name = Parameter.Name(parameter=parameters)

# group: Récupération du type de stockage du paramètre Revit
storageType = Parameter.StorageType(parameter=parameters)

# group: Conversion du typ de stockage Rvt => Ifc
code_block_4 = CodeBlock { ["Text","Real","Integer","Integer"]; ["String","Double","Integer","ElementId"]; }
byKeysValues = Custom[Springs.Dictionary.ByKeysValues](keys=code_block_4.out1, values=code_block_4.out0, searchKeys=storageType)  # package spring nodes; Dictionaries are an incredibly powerful tool for making associative sets between two equal length lists. The first list must be of unique strings (or numbers) and will be the key and the second list will be the matching values (it can be made up of geometry, elements, even other lists) The search keys list will provide the corresponding value to the input key.

code_block_5 = CodeBlock(parname=name, partype=byKeysValues) { l = String.Join("	",DSCore.List.Transpose([parname,partype])); "	"+l; }
code_block_6 = CodeBlock { "Nom du fichier .txt"; }
code_block_7 = CodeBlock { 350; }

# group: Interface Utilisateur Data Shapes
boolean_2 = BoolSelector(true)  # graph input
code_block_8 = CodeBlock { "Nom de l'onglet Ifc"; }
ui_textbox_data = Custom[UI.TextBox Data](InputName=code_block_8)  # package Data-Shapes; Create Data for TextBox input in UI.MultipleInputForm ++ . Check out www.data-shapes.net for more informations
ui_listview_data = Custom[UI.Listview Data](Keys=name, Values=code_block_5.out1)  # package Data-Shapes; Create data for ListView input in UI.MultiInputForm ++ . Check out www.data-shapes.net for more infos.
ui_textbox_data_2 = Custom[UI.TextBox Data](InputName=code_block_6)
code_block_9 = CodeBlock { "Exporter le .txt vers"; }
ui_directorypath_data = Custom[UI.DirectoryPath Data](DefaultPath=code_block_9, ButtonText=code_block_9)  # package Data-Shapes; Creates a DirectoryPath input for UI.MultipleInputForm ++ . Check out www.data-shapes.net for more infos!
create = List.Create(item0=ui_textbox_data, item1=ui_listview_data, item2=ui_textbox_data_2, item3=ui_directorypath_data)
ui_multipleinputform = Custom[UI.MultipleInputForm ++](Logo_optional=file_path, ButtonText_optional=code_block.out0, Inputs=create, Toggle=multipleinputform.Was_Run, CancelButtonText_optional=code_block.out1, Width_optional=code_block_7)  # package Data-Shapes; Create a form with multiple inputs. see www.data-shapes.net for tutorials and infos!

code_block_10 = CodeBlock(x=ui_multipleinputform.User_Inputs) { x[0]; DSCore.String.Join("\n",x[1]); x[3] + "\\" +x[2] + ".txt"; }
code_block_11 = CodeBlock { "\n"; }
code_block_12 = CodeBlock { "	"; }
code_block_13 = CodeBlock(NomDeLonglet=code_block_10.out0) { "PropertySet:"; NomDeLonglet; "I"; "IfcWall"; }
join = String.Join(separator=code_block_12, string0=code_block_13.out0, string1=code_block_13.NomDeLonglet, string2=code_block_13.out2, string3=code_block_13.out3)
join_2 = String.Join(separator=code_block_11, string0=join, string1=code_block_10.out1)
writeText = FileSystem.WriteText(filePath=code_block_10.out2, text=join_2)
