# Dynamo graph renameByReplacement.dyn (Dynamo 2.10.1.3976)

element_types = ElementTypes("ViewFamilyType")
all_elements_of_type = ElementsOfType(element_type=element_types)
name = Element.Name(element=all_elements_of_type)
code_block = CodeBlock { "COO"; "SHA"; }
startsWith = String.StartsWith(str=name, searchFor=code_block.out0)
filterByBoolMask = List.FilterByBoolMask(list=all_elements_of_type, mask=startsWith)
name_2 = Element.Name(element=filterByBoolMask.in)
replace = String.Replace(string=name_2, searchFor=code_block.out0, replaceWith=code_block.out1)
python_script = Python(IN[0]=filterByBoolMask.in, IN[1]=replace)  # IronPython2
# ---------- python_script.python (20 lines) ----------
# Load the Python Standard and DesignScript Libraries
import sys
import clr
clr.AddReference('RevitAPI')
from Autodesk.Revit.DB import *
clr.AddReference('RevitServices')
from RevitServices.Transactions import TransactionManager
from RevitServices.Persistence import DocumentManager

doc  = DocumentManager.Instance.CurrentDBDocument

TransactionManager.Instance.EnsureInTransaction(doc)

for i,n in zip(UnwrapElement(IN[0]),IN[1]):
	i.Name = n
	
TransactionManager.Instance.TransactionTaskDone()


OUT = 0
# ----------------------------------------
