# Dynamo graph Home.dyn (Dynamo 2.3.0.5885)

# note: *Orkestra*
# This is an informational note
yes_no = BoolSelector(true)  # graph input
number_slider = DoubleSlider(91.6, range=0..100 step 0.1)  # graph input
file_path = Filename("No file selected.")
my_input = DSModelElementSelection()  # 1 picked in the model; graph input
list_create = List.Create(item0=yes_no, item1=number_slider, item2=file_path, item3=my_input)  # graph output
