# Dynamo graph Pong.dyn (Dynamo 2.6.1.8786)

file_path = Filename(".\buffer.csv")
now = DateTime.Now()
components = DateTime.Components(dateTime=now)
code_block = CodeBlock(sec=components.second) { [0,sec]; }
code_block_2 = CodeBlock(wait=code_block, pass=file_path) { [wait,pass][1]; }
importCSV = Data.ImportCSV(filePath=code_block_2)
flatten = List.Flatten(list=importCSV)

# group: Field
code_block_3 = CodeBlock { [0,20,20,0]; [0,0,30,30]; }
byCoordinates = Point.ByCoordinates(x=code_block_3.out0, y=code_block_3.out1)
byCornerPoints = Rectangle.ByCornerPoints(points=byCoordinates)

explode = Geometry.Explode(geometry=byCornerPoints)
code_block_4 = CodeBlock(x=explode) { x[1]; x[2]; x[3]; x[0]; }

# group: Controller
slider = DoubleSlider(15.4, range=0..16 step 0.1)

# group: Bar
code_block_5 = CodeBlock(x=slider) { [x,x+4,x+4,x]; [0,0,1,1]; }
byCoordinates_2 = Point.ByCoordinates(x=code_block_5.out0, y=code_block_5.out1)
byPerimeterPoints = Surface.ByPerimeterPoints(points=byCoordinates_2)

code_block_6 = CodeBlock(x=flatten, right=code_block_4.out0, left=code_block_4.out2, top=code_block_4.out1, bar=byPerimeterPoints, bottom=code_block_4.out3)
# ---------- code_block_6.designscript (15 lines) ----------
ptx = x[0];
pty = x[1];
vecx = x[2];
vecy = x[3];

pt = Point.ByCoordinates(ptx,pty);
vx = pt.DoesIntersect(right)?-1:pt.DoesIntersect(left)?1:vecx;
vy = pt.DoesIntersect(top)?-1:pt.DoesIntersect(bar)?1:pt.DoesIntersect(bottom)?0:vecy;

color = pt.DoesIntersect(bottom)?DSCore.Color.ByARGB(255,255,0,0):DSCore.Color.ByARGB(255,0,0,0);

nptx = ptx + vx;
npty = pty + vy;

viz = Point.ByCoordinates(nptx,npty);
# ----------------------------------------
list_create = List.Create(item0=code_block_6.nptx, item1=code_block_6.npty, item2=code_block_6.vx, item3=code_block_6.vy)
code_block_7 = CodeBlock(wait=code_block_6.npty, pass=list_create) { [[wait,pass][1]]; }
exportCSV = Data.ExportCSV(filePath=file_path, data=code_block_7)

# group: Viz
code_block_8 = CodeBlock(x=code_block_6.viz) { x; }
byGeometryColor = Modifiers.GeometryColor.ByGeometryColor(geometry=byPerimeterPoints, color=code_block_6.color)
byGeometryColor_2 = Modifiers.GeometryColor.ByGeometryColor(geometry=byCornerPoints, color=code_block_6.color)

code_block_9 = CodeBlock(x=byGeometryColor) { x; }
code_block_10 = CodeBlock(x=byGeometryColor_2) { x; }
code_block_11 = CodeBlock(c=code_block_10) { c; }
