# Dynamo graph Surface totale par appartement.dyn (Dynamo 2.0.3.8810)

# group: Récupération de toutes les pièces du projet
categories = Categories(index=394)
all_elements_of_category = ElementsOfCategory(Category=categories)

boolean = BoolSelector(true)

# group: UI
code_block = CodeBlock { "Calcul de surface totale par appartement"; }
code_block_2 = CodeBlock { "Choix du paramètre de numéro d'appartement"; }
code_block_3 = CodeBlock(x=all_elements_of_category) { x[0]; }
parameters = Element.Parameters(element=code_block_3)
name = Parameter.Name(parameter=parameters)
ui_dropdown_data = Custom[UI.DropDown Data](InputName=code_block_2, Keys=name, Values=name)  # Create data for DropDown input in UI.MultiInputForm ++ . Check out www.data-shapes.net for more infos.
code_block_4 = CodeBlock { "Choix du paramètre de surface à renseigner"; }
ui_dropdown_data_2 = Custom[UI.DropDown Data](InputName=code_block_4, Keys=name, Values=name)
list_create = List.Create(item0=ui_dropdown_data, item1=ui_dropdown_data_2)
ui_multipleinputform = Custom[UI.MultipleInputForm ++](Description_optional=code_block, Inputs=list_create, Toggle=boolean)  # Create a form with multiple inputs. see www.data-shapes.net for tutorials and infos!

code_block_5 = CodeBlock(c=ui_multipleinputform.User_Inputs) { c[0]; c[1]; }

# group: Regroupement par appartement
getParameterValueByName = Element.GetParameterValueByName(element=all_elements_of_category, parameterName=code_block_5.out0)
groupByKey = List.GroupByKey(list=all_elements_of_category, keys=getParameterValueByName)

# group: Calcul des totaux
area = Room.Area(room=groupByKey.groups)
sum = Math.Sum(values=area, lacing=Longest)

# group: Renseignement du paramètres
setParameterByName = Element.SetParameterByName(element=groupByKey.groups, parameterName=code_block_5.out1, value=sum)
