# Dynamo graph orkestraTestOnline.dyn (Dynamo 2.3.0.5885)
# packages: Data-Shapes 2019.2.60

boolean = BoolSelector(true)
code_block = CodeBlock { 0; 10; }
slider = Custom[UI.Slider](Minimum=code_block.out0, Maximum=code_block.out1)  # package Data-Shapes; Creates slider input for UI.MultipleInputForm ++ . Set the step to decimal value if you want a double slider, or to a integer value if you want an integer slider.
list_create = List.Create(item0=slider, item1=slider, item2=slider, item3=slider)
UI = Custom[UI++](Toggle=boolean, Inputs=list_create)  # package Data-Shapes; testForOrkestraDemo
code_block_2 = CodeBlock(x=UI.User_Inputs) { x[0]; x[1]; x[2]; x[3]; }
byCoordinates = Point.ByCoordinates(y=code_block_2.out0)
code_block_3 = CodeBlock { 1; 2; 3; }
byCoordinates_2 = Point.ByCoordinates(x=code_block_3.out0, y=code_block_2.out1)
byCoordinates_3 = Point.ByCoordinates(x=code_block_3.out1, y=code_block_2.out2)
byCoordinates_4 = Point.ByCoordinates(x=code_block_3.out2, y=code_block_2.out3)
list_create_2 = List.Create(item0=byCoordinates, item1=byCoordinates_2, item2=byCoordinates_3, item3=byCoordinates_4)
byControlPoints = NurbsCurve.ByControlPoints(points=list_create_2)
byJoinedCurves = PolyCurve.ByJoinedCurves(curves=byControlPoints)
curves = PolyCurve.Curves(polyCurve=byJoinedCurves)
approximateWithArcAndLineSegments = Curve.ApproximateWithArcAndLineSegments(curve=curves)
code_block_4 = CodeBlock { 8; }
code_block_5 = CodeBlock { "Levels"; }
categorie_s_by_enu_name_s = Custom[Categorie(s) by ENU Name(s)](CategoryNameInEnglish=code_block_5)  # package Data-Shapes; Gets categorie(s) in the current UI language by it's english name
all_elements_of_category = ElementsOfCategory(Category=categorie_s_by_enu_name_s.Categorie_s)
code_block_6 = CodeBlock(x=all_elements_of_category) { x[0]; }
python_script = Python()
# ---------- python_script.python (12 lines) ----------
# Load the Python Standard and DesignScript Libraries
import sys
import clr
clr.AddReference('RevitAPI')
from Autodesk.Revit.DB import *

clr.AddReference('RevitServices')
from RevitServices.Persistence import DocumentManager

doc = DocumentManager.Instance.CurrentDBDocument

OUT = FilteredElementCollector(doc).OfClass(WallType).ToElements()
# ----------------------------------------
code_block_7 = CodeBlock(x=python_script) { x[0]; }
byCurveAndHeight = Wall.ByCurveAndHeight(curve=approximateWithArcAndLineSegments, height=code_block_4, level=code_block_6, wallType=code_block_7)
