# Dynamo graph orkestraTestOnlineOpenClose.dyn (Dynamo 2.0.3.8810)

byCoordinates = Point.ByCoordinates()
code_block = CodeBlock { 100; 200; 300; }
byCoordinates_2 = Point.ByCoordinates(x=code_block.out0)
byCoordinates_3 = Point.ByCoordinates(x=code_block.out1)
byCoordinates_4 = Point.ByCoordinates(x=code_block.out2)
list_create = List.Create(item0=byCoordinates, item1=byCoordinates_2, item2=byCoordinates_3, item3=byCoordinates_4)
byControlPoints = NurbsCurve.ByControlPoints(points=list_create)
byJoinedCurves = PolyCurve.ByJoinedCurves(curves=byControlPoints)
curves = PolyCurve.Curves(polyCurve=byJoinedCurves)
approximateWithArcAndLineSegments = Curve.ApproximateWithArcAndLineSegments(curve=curves)
code_block_2 = CodeBlock { 100; }
categories = Categories(index=248)
all_elements_of_category = ElementsOfCategory(Category=categories)
code_block_3 = CodeBlock(x=all_elements_of_category) { x[0]; }
element_types = ElementTypes(index=345)
all_elements_of_type = ElementsOfType(element_type=element_types)
code_block_4 = CodeBlock(x=all_elements_of_type) { x[0]; }
byCurveAndHeight = Wall.ByCurveAndHeight(curve=approximateWithArcAndLineSegments, height=code_block_2, level=code_block_3, wallType=code_block_4)
