# Dynamo graph orkestraTestOnlinesas.dyn (Dynamo 2.0.3.8810)

code_block = CodeBlock { 0; 10; }
slider = Custom[UI.Slider](Minimum=code_block.out0, Maximum=code_block.out1)  # Creates slider input for UI.MultipleInputForm ++ . Set the step to decimal value if you want a double slider, or to a integer value if you want an integer slider.
list_create = List.Create(item0=slider, item1=slider, item2=slider, item3=slider)
boolean = BoolSelector(true)
ui_multipleinputform = Custom[UI.MultipleInputForm ++](Inputs=list_create, Toggle=boolean)  # Create a form with multiple inputs. see www.data-shapes.net for tutorials and infos!
code_block_2 = CodeBlock(x=ui_multipleinputform.User_Inputs) { x[0]; x[1]; x[2]; x[3]; }
byCoordinates = Point.ByCoordinates(y=code_block_2.out0)
code_block_3 = CodeBlock { 10; 20; 30; }
byCoordinates_2 = Point.ByCoordinates(x=code_block_3.out0, y=code_block_2.out1)
byCoordinates_3 = Point.ByCoordinates(x=code_block_3.out1, y=code_block_2.out2)
byCoordinates_4 = Point.ByCoordinates(x=code_block_3.out2, y=code_block_2.out3)
list_create_2 = List.Create(item0=byCoordinates, item1=byCoordinates_2, item2=byCoordinates_3, item3=byCoordinates_4)
byControlPoints = NurbsCurve.ByControlPoints(points=list_create_2)
byJoinedCurves = PolyCurve.ByJoinedCurves(curves=byControlPoints)
curves = PolyCurve.Curves(polyCurve=byJoinedCurves)
approximateWithArcAndLineSegments = Curve.ApproximateWithArcAndLineSegments(curve=curves)
code_block_4 = CodeBlock { 10; }
categories = Categories(index=367)
all_elements_of_category = ElementsOfCategory(Category=categories)
code_block_5 = CodeBlock(x=all_elements_of_category) { x[0]; }
element_types = ElementTypes(index=345)
all_elements_of_type = ElementsOfType(element_type=element_types)
code_block_6 = CodeBlock(x=all_elements_of_type) { x[0]; }
byCurveAndHeight = Wall.ByCurveAndHeight(curve=approximateWithArcAndLineSegments, height=code_block_4, level=code_block_5, wallType=code_block_6)
