# Dynamo graph pushactivation.dyn (Dynamo 2.3.0.5885)
# packages: Data-Shapes 2021.2.91

number_slider = DoubleSlider(38.8, range=0..100 step 0.1)
number_slider_2 = DoubleSlider(29.1, range=0..100 step 0.1)
number_slider_3 = DoubleSlider(51.7, range=0..100 step 0.1)
byLengths = Cuboid.ByLengths(width=number_slider, length=number_slider_2, height=number_slider_3)
geomPreview = GeomPreviewNodeModel(Geometry=byLengths, SliderValue=255, rValue="255", gValue="67", bValue="89")
code_block = CodeBlock(nex=byLengths) { nex; }
