# Dynamo graph set param values in Keys in schedule.dyn (Dynamo 2.1.0.7500)

categories = Categories("OST_Walls")
all_elements_of_category = ElementsOfCategory(Category=categories)

# group: Get Excel File
file_path = Filename("..\..\..\DATA SHAPES\DATA SHAPES - Documents\014 - Nouvelle AOM\001 - Tour Main Montparnasse\Production\FICHES PROGRAMME\Fiches Locaux - Liste des typologies et propriétés associées_V3.xlsx")  # graph input
file_from_path = FileObject(path=file_path)
# note: Description of the definition in a textnote
code_block = CodeBlock { "Codes Typologies"; true; }
importExcel = Data.ImportExcel(file=file_from_path, sheetName=code_block.out0, readAsStrings=code_block.out1, lacing=Longest)

transpose = List.Transpose(lists=importExcel)
code_block_2 = CodeBlock(x=transpose) { x[3]; }
code_block_3 = CodeBlock { 3; }
dropItems = List.DropItems(list=code_block_2@L2, amount=code_block_3)
code_block_4 = CodeBlock { "k_Code Sous Categorie"; }
python_script = Python(IN[0]=dropItems, IN[1]=code_block_4)
# ---------- python_script.python (37 lines) ----------
# Load the Python Standard and DesignScript Libraries
import sys
import clr
clr.AddReference('RevitAPI')
from Autodesk.Revit.DB import *

clr.AddReference('RevitServices')
from RevitServices.Persistence import DocumentManager
from RevitServices.Transactions import TransactionManager


doc = DocumentManager.Instance.CurrentDBDocument
viewSchedule = doc.ActiveView
fec = FilteredElementCollector(doc,viewSchedule.Id).ToElements()


values = IN[0]
paramName = IN[1]


TransactionManager.Instance.EnsureInTransaction(doc)
output = []


for value,key in zip(values,fec):
	key.LookupParameter(paramName).Set(value)	


TransactionManager.Instance.TransactionTaskDone

doc.Regenerate()





OUT = "ok"
# ----------------------------------------

# group: Ouput Values
watch = Watch(python_script)  # graph output

endList = List.Create(item0=all_elements_of_category, item1=watch)
boolean_input = Custom[Boolean input](lacing=Shortest)
multipleinputform = Custom[MultipleInputForm ++](Inputs=boolean_input, lacing=CrossProduct)
flatten = List.Flatten(list=transpose)
boolean = BoolSelector(false)
clean = List.Clean(list=flatten, preserveIndices=boolean)
code_block_5 = CodeBlock { "BUR"; }
boolean_2 = BoolSelector(true)
startsWith = String.StartsWith(str=clean, searchFor=code_block_5, ignoreCase=boolean_2)
filterByBoolMask = List.FilterByBoolMask(list=clean, mask=startsWith)
watch_2 = Watch(filterByBoolMask.in)
watch_3 = Watch(filterByBoolMask.out)
code_block_6 = CodeBlock { "a".."b"; }
code_block_7 = CodeBlock { "a".."c"; 0..2; }
byKeysValues = DesignScript.Builtin.Dictionary.ByKeysValues(keys=code_block_7.out0, values=code_block_7.out1)
code_block_8 = CodeBlock { "f".."h"; 5..7; }
byKeysValues_2 = DesignScript.Builtin.Dictionary.ByKeysValues(keys=code_block_8.out0, values=code_block_8.out1)
list_create = List.Create(item0=byKeysValues, item1=byKeysValues_2)
byKeysValues_3 = DesignScript.Builtin.Dictionary.ByKeysValues(keys=code_block_6, values=list_create)
