# Dynamo graph vizDemo.dyn (Dynamo 2.3.0.5885)

code_block = CodeBlock { 3; }
byLengths = Cuboid.ByLengths(width=code_block, length=code_block, height=code_block)
code_block_2 = CodeBlock { 0..20..5; }
translate = Geometry.Translate(geometry=byLengths, xTranslation=code_block_2, yTranslation=code_block_2, zTranslation=code_block_2, lacing=CrossProduct)
code_block_3 = CodeBlock { 10; }
code_block_4 = CodeBlock(l=translate, A=code_block, B=code_block_3) { 0..1..#DSCore.List.Count(l<1>); A + B; }
color_range = ColorRange(value=code_block_4.out0)  # unwired: colors, indices
byGeometryColor = Modifiers.GeometryColor.ByGeometryColor(geometry=translate, color=color_range)
code_block_5 = CodeBlock(y=byGeometryColor) { y; }
