# Dynamo graph CMed_Batch_Exporter_DWG_PDF.dyn (Dynamo 2.12.1.8246)
# packages: archi-lab.net 2022.212.2722, Data-Shapes 2022.2.100

boolean_input = Custom[Boolean input]()  # package Data-Shapes; Creates a boolean input for UI.MultipleInputForm ++ . Check out www.data-shapes.net for more infos!
code_block = CodeBlock { "Suivant..."; }
code_block_2 = CodeBlock { "Liens à traiter"; }
getDocuments = archilab.Revit.Selection.Select.GetDocuments()
listview_data = Custom[Listview Data](InputName=code_block_2, Keys=getDocuments.Link_Name, Values=getDocuments.Link_Doc)  # package Data-Shapes; Create data for ListView input in UI.MultiInputForm ++ . Check out www.data-shapes.net for more infos.
code_block_3 = CodeBlock { "Exemple de prefix : AW2.AKTVV.ARC"; }
textnote_data = Custom[TextNote Data](TextNote=code_block_3)  # package Data-Shapes; Create Data for TextNote input in UI.MultipleInputForm ++ . Check out www.data-shapes.net for more informations
code_block_4 = CodeBlock { "Prefix"; }
textbox_data = Custom[TextBox Data](InputName=code_block_4)  # package Data-Shapes; Create Data for TextBox input in UI.MultipleInputForm ++ . Check out www.data-shapes.net for more informations
list_create = List.Create(item0=listview_data, item1=textnote_data, item2=textbox_data)
boolean = BoolSelector(true)
code_block_5 = CodeBlock { 700; 600; 200; }
multipleinputform = Custom[MultipleInputForm ++](ButtonText_optional=code_block, Inputs=list_create, Toggle=boolean, MaxHeight_optional=code_block_5.out0, Width_optional=code_block_5.out1, LabelWidth_optional=code_block_5.out2)  # package Data-Shapes; Create a form with multiple inputs. see www.data-shapes.net for tutorials and infos!
code_block_6 = CodeBlock(x=multipleinputform.User_Inputs) { x[0]; x[1]; }
code_block_7 = CodeBlock { "Lancer l'export"; }
code_block_8 = CodeBlock()
# ---------- code_block_8.designscript (5 lines) ----------
"Emplacement des exports";
"Sélectionner...";
"Export";
["Exporter les feuilles (PDF) et les vues (dwg)","Exporter seulement les feuilles (PDF)"];
[true,false];
# ----------------------------------------
directorypath_data = Custom[DirectoryPath Data](InputName=code_block_8.out0, ButtonText=code_block_8.out1)  # package Data-Shapes; Creates a DirectoryPath input for UI.MultipleInputForm ++ . Check out www.data-shapes.net for more infos!
code_block_9 = CodeBlock { 0; }
radiobuttons_data = Custom[RadioButtons Data](InputName=code_block_8.out2, Keys=code_block_8.out3, Values=code_block_8.out4, DefaultValueIndex=code_block_9)  # package Data-Shapes; Create radio buttons input for UI.MultipleInputForm ++ .
list_create_2 = List.Create(item0=directorypath_data, item1=radiobuttons_data)
code_block_10 = CodeBlock { "Suivant..."; }
python_script = Python(IN[0]=code_block_6.out0)  # IronPython2
# ---------- python_script.python (49 lines) ----------
# Charger les bibliothèques DesignScript et Standard Python
import sys
import clr,System
clr.AddReference('ProtoGeometry')
from Autodesk.DesignScript.Geometry import *
clr.AddReference('RevitAPI')
from Autodesk.Revit.DB import *
clr.AddReference('RevitServices')
from RevitServices.Persistence import DocumentManager
from RevitServices.Transactions import TransactionManager
clr.AddReference('RevitNodes')
import Revit
clr.ImportExtensions(Revit.GeometryConversion)
clr.AddReference('System')
from System.Collections.Generic import List
import os

doc = DocumentManager.Instance.CurrentDBDocument
uiapp = DocumentManager.Instance.CurrentUIApplication
app = uiapp.Application
	
def toList(elt):
	if isinstance(elt,list):
		return UnwrapElement(elt)
	else:
		return [UnwrapElement(elt)]
  
linkDocs = toList(IN[0])
sheetSets_ = []
sheetSetNames_ = []
viewSets_ = []
viewNames_ = []
res = []

for linkDoc in linkDocs:
	sheetSets = FilteredElementCollector(linkDoc).OfClass(ViewSheetSet).ToElements()
	sheetSets_.append(sheetSets)
	sheetSetNames_.append(set.Name for set in sheetSets)
	"""viewSets = [sheetSet.Views for sheetSet in sheetSets]
	viewSets_.append(viewSets)
	views = []
	for v in viewSets:
		iterador = v.ForwardIterator()
		while iterador.MoveNext():
			views.append(iterador.Current)
	viewNames_.append(views)"""


OUT = sheetSetNames_,sheetSets_,[d.PathName.split("\\")[-1] for d in linkDocs]
# ----------------------------------------
code_block_11 = CodeBlock(x=python_script) { x[0]; x[1]; x[2]; }
code_block_12 = CodeBlock { 100; }
listview_data_2 = Custom[Listview Data](InputName=code_block_11.out2, Keys=code_block_11.out0, Values=code_block_11.out0, Height_optionnal=code_block_12)
code_block_13 = CodeBlock { 700; 700; 400; }
multipleinputform_2 = Custom[MultipleInputForm ++](ButtonText_optional=code_block_10, Inputs=listview_data_2, Toggle=multipleinputform.Was_Run, MaxHeight_optional=code_block_13.out0, Width_optional=code_block_13.out1, LabelWidth_optional=code_block_13.out2)
code_block_14 = CodeBlock { 700; 700; 200; }
multipleinputform_3 = Custom[MultipleInputForm ++](ButtonText_optional=code_block_7, Inputs=list_create_2, Toggle=multipleinputform_2.Was_Run, MaxHeight_optional=code_block_14.out0, Width_optional=code_block_14.out1, LabelWidth_optional=code_block_14.out2)
code_block_15 = CodeBlock(x=multipleinputform_3.User_Inputs) { x[0]; x[1]; }
python_script_2 = Python(IN[0]=code_block_6.out0, IN[1]=code_block_15.out0, IN[2]=code_block_15.out1, IN[3]=multipleinputform_2.User_Inputs, IN[4]=code_block_6.out1)  # IronPython2
# ---------- python_script_2.python (172 lines) ----------
# Charger les bibliothèques DesignScript et Standard Python
import sys
import clr,System
clr.AddReference('ProtoGeometry')
from Autodesk.DesignScript.Geometry import *
clr.AddReference('RevitAPI')
from Autodesk.Revit.DB import *
clr.AddReference('RevitServices')
from RevitServices.Persistence import DocumentManager
from RevitServices.Transactions import TransactionManager
clr.AddReference('RevitNodes')
import Revit
clr.ImportExtensions(Revit.GeometryConversion)
clr.AddReference('System')
from System.Collections.Generic import List
import os

doc = DocumentManager.Instance.CurrentDBDocument
uiapp = DocumentManager.Instance.CurrentUIApplication
app = uiapp.Application
	
def toList(elt):
	if isinstance(elt,list):
		return UnwrapElement(elt)
	else:
		return [UnwrapElement(elt)]
  
#Set naming rule




table = List[TableCellCombinedParameterData]()

opts = PDFExportOptions()
opts.ColorDepth = ColorDepthType.Color
opts.Combine = False
opts.ExportQuality = PDFExportQualityType.DPI600
opts.HideCropBoundaries = True
opts.HideReferencePlane = True
opts.HideScopeBoxes = True
opts.HideUnreferencedViewTags = True
opts.MaskCoincidentLines = True
#Don't think of this as a "continue" but rather as a silent mode
opts.StopOnError = False
opts.ViewLinksInBlue = False
opts.PaperFormat = ExportPaperFormat.Default
		
linkDocs = toList(IN[0])
Folder = IN[1]

dwgOpts = DWGExportOptions()
dwgOpts.Colors = ExportColorMode.TrueColorPerView
dwgOpts.MergedViews = True
dwgOpts.SharedCoords = True

result = []
sheets = []
sheetNames = []
watch = []
sets = IN[3]
viewSets_ = []
viewNames_ = []
control = []
printprefix = IN[4]

for linkDoc,set in zip(linkDocs,sets):
	series = [p.Id for p in FilteredElementCollector(doc).OfClass(ParameterElement).ToElements() if p.Name == "AW2_Serie"][0]
	projParams = FilteredElementCollector(linkDoc).OfCategory(BuiltInCategory.OST_ProjectInformation).ToElements()[0]
	if IN[2] == True:
		#Create separate directories if dwg and pdf are created
		directory1 = "PDF"
		directory2 = "DWG"
		if projParams.LookupParameter("AW2_Building_Batiment").HasValue:
			path1 = os.path.join(Folder + "\\" + projParams.LookupParameter("AW2_Building_Batiment").AsValueString() +"\\", directory1)
		else:
			path1 = os.path.join(Folder + "\\" + linkDoc.PathName.split("\\")[-1] +"\\", directory1)
		try:
			os.mkdir(path1)
		except:
			pass
		if projParams.LookupParameter("AW2_Building_Batiment").HasValue:
			path2 = os.path.join(Folder + "\\" + projParams.LookupParameter("AW2_Building_Batiment").AsValueString() +"\\", directory2)
		else:
			path2 = os.path.join(Folder + "\\" + linkDoc.PathName.split("\\")[-1] +"\\", directory2)
		try:
			os.mkdir(path2)
		except:
			pass
	else:
		if projParams.LookupParameter("AW2_Building_Batiment").HasValue:
			path1 = os.path.join(Folder + "\\" + projParams.LookupParameter("AW2_Building_Batiment").AsValueString() +"\\", "PDF")
		else:
			path1 = os.path.join(Folder + "\\" + linkDoc.PathName.split("\\")[-1] +"\\", "PDF")
	DWGsettings = [e.GetDWGExportOptions() for e in FilteredElementCollector(doc).WherePasses(ElementClassFilter(ExportDWGSettings)) if e.Name == "AW2_Autocad 10-20-30"][0]
	opts.Combine = False
	sheetSets = FilteredElementCollector(linkDoc).OfClass(ViewSheetSet).ToElements()
	_aw2prefix_ = printprefix+"."
	for s in sheetSets:
		if s.Name in set:
			#SheetList = List[ElementId]()
			ViewList = List[ElementId]()
			iterador = s.Views.ForwardIterator()
			while iterador.MoveNext():	
				SheetList = List[ElementId]()			
				if iterador.Current.Category.Id == Category.GetCategory(linkDoc,Category.GetBuiltInCategory(Category.GetBuiltInCategoryTypeId(BuiltInCategory.OST_Sheets))).Id:
					SheetList.Add(iterador.Current.Id)
					table.Clear()
					r1 = TableCellCombinedParameterData.Create()
					r1.ParamId = series
					revision = ".Rev"+str(len(linkDoc.GetElement(iterador.Current.Id).GetAllRevisionIds()))
					try:
						if linkDoc.GetElement(iterador.Current.Id).LookupParameter("AW2_Zone").HasValue:
							aw2prefix = _aw2prefix_+ projParams.LookupParameter("AW2_Code Phase").AsValueString()+"."+ linkDoc.GetElement(iterador.Current.Id).LookupParameter("AW2_Zone").AsValueString()
						else:
							aw2prefix = _aw2prefix_+ projParams.LookupParameter("AW2_Code Phase").AsValueString()+"."
					except:
						pass
					"""try:
						aw2prefix = "AW2_AKTVV_ARC_"+ projParams.LookupParameter("AW2_Code Phase").AsValueString() +"_"+ linkDoc.GetElement(iterador.Current.Id).LookupParameter("AW2_Zone").AsValueString() + "_"
					except:
						pass"""
					r1.Prefix = aw2prefix +"."
					r1.Separator = ""
					r1.Suffix = revision
					table.Add(r1)
					#table.Add(r2)
					opts.SetNamingRule(table)
				else:
					ViewList.Add(iterador.Current.Id)
				try:					
					watch.append(aw2prefix)
					result.append(linkDoc.Export(path1,SheetList,opts))
				except:
					pass
			
			if IN[2] == True and len(ViewList) != 0:
				for viewL in ViewList:
					ViewListSingle = List[ElementId]()
					ViewListSingle.Add(viewL)
					serie = "--"+ "_" + linkDoc.GetElement(viewL).Name
					if linkDoc.GetElement(viewL).LookupParameter("AW2_Serie").HasValue:
						serie = linkDoc.GetElement(viewL).LookupParameter("AW2_Serie").AsValueString()
					"""try:
						#serie = linkDoc.GetElement(viewL).LookupParameter("AW2_Serie").AsValueString()
					except:
						pass"""
					control.append(serie)
					pref = _aw2prefix_+projParams.LookupParameter("AW2_Code Phase").AsValueString()+ "."+ serie	
					try:
						if linkDoc.GetElement(viewL).LookupParameter("AW2_Zone").HasValue:
							pref = _aw2prefix_+ projParams.LookupParameter("AW2_Code Phase").AsValueString()+"."+ linkDoc.GetElement(viewL).LookupParameter("AW2_Zone").AsValueString()+"."+ serie
						else:
							pref = _aw2prefix_+ projParams.LookupParameter("AW2_Code Phase").AsValueString()+"."+ serie
					except:
						pass
					linkDoc.Export(path2,pref,ViewListSingle,DWGsettings)

	viewSets = [sheetSet.Views for sheetSet in sheetSets]
	viewSets_.append(viewSets)
	views = []
	for v in viewSets:
		iterador = v.ForwardIterator()
		while iterador.MoveNext():
			views.append(iterador.Current)
	viewNames_.append(views)
	
	
	


OUT = result,watch,control
# ----------------------------------------
