# Dynamo graph DrawLinesFromDwg.dyn (Dynamo 2.0.3.8810)

select_model_element = DSModelElementSelection()  # 1 picked in the model
geometry = Element.Geometry(element=select_model_element)
explode = Geometry.Explode(geometry=geometry)
flatten = List.Flatten(list=explode)
byCurve = ModelCurve.ByCurve(curve=flatten)
select_model_element_2 = DSModelElementSelection()  # 1 picked in the model
geometry_2 = Element.Geometry(element=select_model_element_2)
string_from_object = FromObject(obj=geometry_2)
code_block = CodeBlock { "Cir"; }
startsWith = String.StartsWith(str=string_from_object, searchFor=code_block)
filterByBoolMask = List.FilterByBoolMask(list=geometry_2, mask=startsWith)
code_block_2 = CodeBlock(x=filterByBoolMask.out) { x; }
length = Curve.Length(curve=code_block_2)
code_block_3 = CodeBlock(l=length) { l<10; }
filterByBoolMask_2 = List.FilterByBoolMask(list=filterByBoolMask.out, mask=code_block_3)
code_block_4 = CodeBlock(x=filterByBoolMask_2.out) { x; }
code_block_5 = CodeBlock { 21; }
removeItemAtIndex = List.RemoveItemAtIndex(list=code_block_4, indices=code_block_5)
explode_2 = Geometry.Explode(geometry=removeItemAtIndex)
flatten_2 = List.Flatten(list=explode_2)
byCurve_2 = ModelCurve.ByCurve(curve=flatten_2)
