# Dynamo graph Model checker workflow -Parameter changes.dyn (Dynamo 1.2.1.3083)

code_block = CodeBlock { "Modification tracker between two indices"; }
code_block_2 = CodeBlock { "Select linked model to run comparison against"; }

# group: Archi-lab
get_documents = Custom[Get Documents]()  # Queries all linked Revit files and retrieves their Name, LinkInstance and Document properties.

ui_dropdown_data = Custom[UI.DropDown Data](InputName=code_block_2, Keys=get_documents.Link_Name, Values=get_documents.Link_Doc)  # Create data for DropDown input in UI.MultiInputForm
code_block_3 = CodeBlock { "Select categories"; }
categories_list = Custom[Categories list]()  # Gives list of all Revit categories and a matching list of their names
ui_listview_data = Custom[UI.Listview Data](InutName=code_block_3, Keys=categories_list.Category_name_s, Values=categories_list.Revit_Categories)  # Create data for ListView input in UI.MultiInputForm
code_block_4 = CodeBlock { "Color override for elements with unchanged parameter values"; }
ui_colorinput_data = Custom[UI.ColorInput Data](InputName=code_block_4)  # Create a color celection input for UI.MultiInputForm++ . Check out www.data-shapes.net for more infos!
code_block_5 = CodeBlock { "Color override for elements with changed parameter valuesy"; }
ui_colorinput_data_2 = Custom[UI.ColorInput Data](InputName=code_block_5)
code_block_6 = CodeBlock { "Color override for new elements"; }
ui_colorinput_data_3 = Custom[UI.ColorInput Data](InputName=code_block_6)
create = List.Create(ui_dropdown_data, ui_listview_data, ui_colorinput_data, ui_colorinput_data_2, ui_colorinput_data_3)
boolean = BoolSelector(true)
ui_multipleinputform = Custom[UI.MultipleInputForm ++](Description_optional=code_block, Inputs=create, Toggle=boolean)  # Create a form with multiple inputs. InputType codification: -strings : "s" -booleans : "bool" -filepaths : "fp" -directorypath : "dp" -revit element section : "se" -revit face selection : "sf" -revit edge selection : "sed" -dropdown lists : UI.DropDown Data node -listview : UI.ListView Data node see www.data-shapes.net for more infos
code_block_7 = CodeBlock(x=ui_multipleinputform.User_Inputs)
# ---------- code_block_7.designscript (10 lines) ----------
// linked doc to compare to
x[0];
// categories to check
x[1];
// color override for unchanged parameter values
x[2];
// color override for changed parameter values
x[3];
// color override for new elements
x[4];
# ----------------------------------------
modelComparison = Custom[ModificationTracker.ModelComparison](PreviousVersionDocument=code_block_7.out0, Categories=code_block_7.out1)  # Compares elements from documents A and B (A is the current document by default) and returns existing elements data, new elements, deleted elements and a report. Check out www.Data-Shapes.net for more infos.
parameterChanges = Custom[ModificationTracker.ParameterChanges](ExistingElements_Data=modelComparison.ExistingElements_Data)  # takes ExistingElements Data as input and outputs elements with same parameter values and elements with changed parameter values. Check out www.Data-Shapes.net for more infos.
create_2 = List.Create(parameterChanges.Elements_with_same_parameter_values, parameterChanges.Elements_with_changed_parameter_values, modelComparison.New_elements)
isEmpty = List.IsEmpty(create_2, lacing=Longest)
filterByBoolMask = List.FilterByBoolMask(list=create_2, mask=isEmpty)
create_3 = List.Create(code_block_7.out2, code_block_7.out3, code_block_7.out4)

# group: Clockwork
toDynamoColor = Custom[RevitColor.ToDynamoColor](RevitColor=create_3)  # Converts Revit colors into Dynamo colors

filterByBoolMask_2 = List.FilterByBoolMask(list=toDynamoColor, mask=isEmpty)
overrideColorInView = Element.OverrideColorInView(element=filterByBoolMask.out, color=filterByBoolMask_2.out)
