# Dynamo graph batch add shared parameters from txt.dyn (Dynamo 1.2.1.3083)

code_block = CodeBlock { {"Categories","Parameters","ParameterGroup"}; }
code_block_2 = CodeBlock { "SharedParameters file"; }
code_block_3 = CodeBlock { "fp"; }
boolean = BoolSelector(true)

# group: Prompt user to select shared parameters .txt file
ui_multipleinputform = Custom[UI.MultipleInputForm ++](InputNames=code_block_2, InputTypes_see_description=code_block_3, Toggle=boolean)  # Create a form with multiple inputs. InputType codification: -strings : "s" -booleans : "bool" -filepaths : "fp" -directorypath : "dp" -revit element section : "se" -revit face selection : "sf" -revit edge selection : "sed" -dropdown lists : UI.DropDown Data node -listview : UI.ListView Data node see www.data-shapes.net for more infos

# group: Getting shared parameters from .txt and preparing data for UI.MultipleInputFrom ++
categories_list = Custom[Categories list]()  # Gives list of all Revit categories and a matching list of their names
ui_listview_data = Custom[UI.Listview Data](Keys=categories_list.Category_name_s, Values=categories_list.Revit_Categories)  # Create data for ListView input in UI.MultiInputForm
code_block_4 = CodeBlock(x=ui_multipleinputform.User_Inputs) { x[0]; }
sharedparameters_from_txt_file = Custom[SharedParameters from txt file](FilePath=code_block_4)  # Gets parameters from SharedParameter .txt file
ui_listview_data_2 = Custom[UI.Listview Data](Keys=sharedparameters_from_txt_file.Parameter_Names, Values=sharedparameters_from_txt_file.Revit_Parameters)
parameter_group = Custom[Parameter Group]()  # This node will return all available Parameter Groups
string_from_object = FromObject(parameter_group)
ui_dropdown_data = Custom[UI.DropDown Data](Keys=string_from_object, Values=parameter_group)  # Create data for DropDown input in UI.MultiInputForm
create = List.Create(ui_listview_data, ui_listview_data_2, ui_dropdown_data)

# group: prompt user to select categories, parameters and parameter group
ui_multipleinputform_2 = Custom[UI.MultipleInputForm ++](InputNames=code_block, InputTypes_see_description=create, Toggle=ui_multipleinputform.Was_Ran)

code_block_5 = CodeBlock(x=ui_multipleinputform_2.User_Inputs) { x[0]; x[1]; x[2]; }

# group: Adding the parameters
add_shared_parameter_s_from_txt = Custom[Add Shared Parameter(s) from txt](Category=code_block_5.out0, Parameters_s=code_block_5.out1, ParameterGroup=code_block_5.out2)  # Add shared parameters to project from SharedParameter .txt file
