# Dynamo custom node ActiveDocument.FileSize.dyf (Dynamo 3.3.0.6316)
# category: Data-Shapes.Revit.Document
# Gets the file size of the ative document, even if it is a BIM360 Design workshared project.

python_script = Python()  # CPython3; graph input
# ---------- python_script.python (31 lines) ----------
# Copyright (c) Data Shapes, 2025
# Data-Shapes www.data-shapes.io, elayoubi.mostafa@data-shapes.io @data_shapes

import clr
import os

clr.AddReference('RevitAPI')
from Autodesk.Revit.DB import *

clr.AddReference('RevitServices')
from RevitServices.Persistence import DocumentManager

import System
from System.IO import SearchOption
from System import Environment

doc = DocumentManager.Instance.CurrentDBDocument

pn = doc.PathName
try:
    guid = doc.WorksharingCentralGUID
    AppDataList = Environment.GetFolderPath(Environment.SpecialFolder.ApplicationData).split("\\")
    AppDataList.pop(-1)
    AppData = "\\".join(AppDataList)
    location = AppData + "\\Local\\Autodesk\\Revit"
    cachedFile = System.IO.Directory.GetFiles(location, str(guid) + ".rvt", SearchOption.AllDirectories)
    size = os.path.getsize(cachedFile[0])
except:
    size = os.path.getsize(pn)

OUT = str(size / 1000000) + " mb"
# ----------------------------------------
FileSize = Output(python_script)
