# Dynamo custom node ActiveDocument.Name.dyf (Dynamo 3.3.0.6316)
# category: Data-Shapes.Revit.Document
# Gets the name of the active document

python_script = Python()  # CPython3
# ---------- python_script.python (16 lines) ----------
# Copyright (c) Data Shapes, 2025
# Data-Shapes www.data-shapes.io, elayoubi.mostafa@data-shapes.io @data_shapes

import clr

clr.AddReference('RevitAPI')
clr.AddReference('RevitServices')

from Autodesk.Revit.DB import Document
from RevitServices.Persistence import DocumentManager

doc = DocumentManager.Instance.CurrentDBDocument

document_name = doc.Title

OUT = document_name
# ----------------------------------------
DocumentName = Output(python_script)
