# Dynamo custom node Add Shared Parameter(s) from txt.dyf (Dynamo 3.3.0.6316)
# category: Data-Shapes.Revit.SharedParameters
# Add shared parameters to project from SharedParameter .txt file

Categories = Input(Categories_: var[]..[])
Parameters = Input(Parameters_: var[]..[])
ParameterGroup = Input(ParameterGroup_: var[]..[])
IsInstanceParameter = Input(IsInstanceParameter: var[]..[])
python_script = Python(IN[0]=Categories, IN[1]=Parameters, IN[2]=ParameterGroup, IN[3]=IsInstanceParameter)  # CPython3
# ---------- python_script.python (136 lines) ----------
# Copyright (c) Data Shapes, 2025
# Data-Shapes www.data-shapes.io, elayoubi.mostafa@data-shapes.io

import clr

clr.AddReference('RevitAPI')
from Autodesk.Revit.DB import BuiltInCategory, ForgeTypeId

clr.AddReference('RevitServices')
from RevitServices.Persistence import DocumentManager
from RevitServices.Transactions import TransactionManager

clr.AddReference('RevitAPIUI')
from Autodesk.Revit.UI import *

doc = DocumentManager.Instance.CurrentDBDocument
uidoc = DocumentManager.Instance.CurrentUIDocument
app = doc.Application


def tolist(obj):
    if isinstance(obj, list):
        return obj
    return [obj]


USE_FORGE_TYPE_ID = False
try:
    from Autodesk.Revit.DB import GroupTypeId
    USE_FORGE_TYPE_ID = True
except ImportError:
    from Autodesk.Revit.DB import BuiltInParameterGroup

category_input = tolist(IN[0])

categories = []
for cat in category_input:
    try:
        if hasattr(cat, 'Id'):
            bic_id = cat.Id
            revit_cat = doc.Settings.Categories.get_Item(BuiltInCategory(bic_id))
            if revit_cat:
                categories.append(revit_cat)
        else:
            unwrapped = UnwrapElement(cat)
            categories.append(unwrapped)
    except:
        try:
            unwrapped = UnwrapElement(cat)
            categories.append(unwrapped)
        except:
            pass

catset = app.Create.NewCategorySet()
for cat in categories:
    catset.Insert(cat)

parameters = tolist(IN[1])

group_input = IN[2]


def get_parameter_group(group_input):
    if USE_FORGE_TYPE_ID:
        if isinstance(group_input, ForgeTypeId):
            return group_input
        
        group_str = str(group_input)
        
        for name in dir(GroupTypeId):
            if name.startswith('_'):
                continue
            if name in ('Equals', 'GetHashCode', 'GetType', 'ToString', 
                        'ReferenceEquals', 'MemberwiseClone'):
                continue
            try:
                val = getattr(GroupTypeId, name)
                if isinstance(val, ForgeTypeId):
                    if name == group_str or group_str in str(val.TypeId):
                        return val
                    if group_str.startswith('PG_'):
                        old_name = group_str[3:].replace('_', '')
                        if name.upper().replace('_', '') == old_name:
                            return val
            except:
                pass
        
        return GroupTypeId.Data
    else:
        if isinstance(group_input, BuiltInParameterGroup):
            return group_input
        
        group_str = str(group_input)
        
        for name in dir(BuiltInParameterGroup):
            if name.startswith('_'):
                continue
            if name in ('value__', 'Equals', 'GetHashCode', 'GetType', 'ToString', 
                        'CompareTo', 'GetTypeCode', 'HasFlag', 'Format', 'Parse',
                        'TryParse', 'IsDefined', 'GetName', 'GetNames', 'GetValues',
                        'GetUnderlyingType', 'ToObject'):
                continue
            try:
                val = getattr(BuiltInParameterGroup, name)
                if isinstance(val, BuiltInParameterGroup):
                    if val == group_input or str(val) == group_str or name == group_str:
                        return val
            except:
                pass
        
        return BuiltInParameterGroup.PG_DATA


group = get_parameter_group(group_input)

success_count = 0

TransactionManager.Instance.EnsureInTransaction(doc)

try:
    if IN[3]:
        bind = app.Create.NewInstanceBinding(catset)
    else:
        bind = app.Create.NewTypeBinding(catset)
    
    bindmap = doc.ParameterBindings
    for p in parameters:
        try:
            bindmap.Insert(p, bind, group)
            success_count += 1
        except:
            continue
finally:
    TransactionManager.Instance.TransactionTaskDone()

OUT = '%d shared parameters added to project' % success_count
# ----------------------------------------
OUT = Output(python_script)
