# Dynamo custom node All Elements In View(s).dyf (Dynamo 3.3.0.6316)
# category: Data-Shapes.Revit.Elements
# Retrieves all visible element in a view or a set of views

Views = Input(Views_: var[])
python_script = Python(IN[0]=Views)  # CPython3
# ---------- python_script.python (68 lines) ----------
# Copyright (c) Data Shapes, 2025
# Data-Shapes www.data-shapes.io, elayoubi.mostafa@data-shapes.io

import clr

clr.AddReference('RevitAPI')
from Autodesk.Revit.DB import (
    FilteredElementCollector,
    SectionType,
    ViewType,
    SubTransaction
)

clr.AddReference('RevitServices')
from RevitServices.Persistence import DocumentManager
from RevitServices.Transactions import TransactionManager

doc = DocumentManager.Instance.CurrentDBDocument


def tolist(input):
    if isinstance(input, list):
        return input
    return [input]


def elementsInScheduleView(doc, viewSchedule):
    initialList = FilteredElementCollector(doc, viewSchedule.Id).ToElementIds()
    
    table_data = viewSchedule.GetTableData()
    section_data = table_data.GetSectionData(SectionType.Body)
    no_of_rows = section_data.NumberOfRows
    
    itemInScheduleRowId = []
    ScheduleDef = viewSchedule.Definition
    itemized = ScheduleDef.IsItemized
    
    for i in range(no_of_rows):
        TransactionManager.Instance.EnsureInTransaction(doc)
        st = SubTransaction(doc)
        st.Start()
        try:
            section_data.RemoveRow(i)
            remaining = FilteredElementCollector(doc, viewSchedule.Id).ToElementIds()
            remaining = list(remaining)
            if itemized:
                deleted = [eid for eid in initialList if eid not in remaining]
                if deleted:
                    itemInScheduleRowId.append(deleted[0])
            else:
                deleted = [eid for eid in initialList if eid not in remaining]
                itemInScheduleRowId.extend(deleted)
            st.RollBack()
        except:
            st.RollBack()
        TransactionManager.Instance.ForceCloseTransaction()
    
    return [doc.GetElement(eid) for eid in itemInScheduleRowId]


views = tolist(UnwrapElement(IN[0]))

OUT = []
for v in views:
    if v.ViewType == ViewType.Schedule:
        OUT.append(elementsInScheduleView(doc, v))
    else:
        OUT.append(FilteredElementCollector(doc, v.Id).ToElements())
# ----------------------------------------
Element_s = Output(python_script)  # "Element(s)"
