# Dynamo custom node All Elements Of Categories in View.dyf (Dynamo 3.3.0.6316)
# category: Data-Shapes.Revit.Elements
# Retrieves all elements of the given categories in the given view

Views = Input(Views_: var[]..[])
Categories = Input(Categories_: var[]..[])
python_script = Python(IN[0]=Views, IN[1]=Categories)  # CPython3
# ---------- python_script.python (42 lines) ----------
# Copyright (c) Data Shapes, 2025
# Data-Shapes www.data-shapes.io, elayoubi.mostafa@data-shapes.io

import clr

clr.AddReference('RevitAPI')
from Autodesk.Revit.DB import (
    FilteredElementCollector,
    ElementCategoryFilter,
    LogicalOrFilter,
    ElementFilter,
    ElementId
)

clr.AddReference('RevitServices')
from RevitServices.Persistence import DocumentManager

from System.Collections.Generic import List

doc = DocumentManager.Instance.CurrentDBDocument


def tolist(input):
    if isinstance(input, list):
        return input
    return [input]


view = UnwrapElement(IN[0])
categories = tolist(IN[1])

catfilters = []
for i in categories:
    cat_id = ElementId(int(str(i.Id)))
    catfilters.append(ElementCategoryFilter(cat_id))

catfilterlist = List[ElementFilter](catfilters)
filter = LogicalOrFilter(catfilterlist)

elems = FilteredElementCollector(doc, view.Id).WherePasses(filter).ToElements()

OUT = elems
# ----------------------------------------
Element_s = Output(python_script)  # "Element(s)"
