# Dynamo custom node All Lines of LineStyle.dyf (Dynamo 3.3.0.6316)
# category: Data-Shapes.Revit.Lines
# Gets all lines in a project with a giver LineStyle

LineStyleName = Input(LineStyleName: string)
python_script = Python(IN[0]=LineStyleName)  # CPython3
# ---------- python_script.python (30 lines) ----------
# Copyright (c) Data Shapes, 2025
# Data-Shapes www.data-shapes.io, elayoubi.mostafa@data-shapes.io

import clr

clr.AddReference('RevitServices')
from RevitServices.Persistence import DocumentManager

clr.AddReference('RevitAPI')
from Autodesk.Revit.DB import FilteredElementCollector, BuiltInCategory

doc = DocumentManager.Instance.CurrentDBDocument


def tolist(input):
    if isinstance(input, list):
        return input
    return [input]


names = tolist(UnwrapElement(IN[0]))

alllines = FilteredElementCollector(doc).OfCategory(BuiltInCategory.OST_Lines)

lines = []

for n in names:
    lines.append([x for x in alllines if x.LineStyle.Name == n])

OUT = lines
# ----------------------------------------
Line_s = Output(python_script)  # "Line(s)"
