# Dynamo custom node BarChart.dyf (Dynamo 3.3.0.6316)
# category: Data-Shapes.UI.Charts
# BarChart

Chart_name = Input(Chart_name_: string = "Chart")
Series_names = Input(Series_names_: var[]..[])
X_values = Input(X_values_: var[]..[])
Y_values = Input(Y_values_: var[]..[])
Chart_colors_optionnal = Input(Chart_colors_optionnal_: var[] = null)
Is_Horizontal_optionnal = Input(Is_Horizontal_optionnal_: bool = false)
X_Axis_Label_optionnal = Input(X_Axis_Label_optionnal_: string = "")
Y_Axis_Label_optionnal = Input(Y_Axis_Label_optionnal_: string = "")
python_script = Python(IN[0]=Chart_name, IN[1]=Series_names, IN[2]=X_values, IN[3]=Y_values, IN[4]=Chart_colors_optionnal, IN[5]=Is_Horizontal_optionnal, IN[6]=X_Axis_Label_optionnal, IN[7]=Y_Axis_Label_optionnal)  # CPython3
# ---------- python_script.python (557 lines) ----------
# Copyright (c) Data Shapes, 2025
# Data-Shapes www.data-shapes.io

import clr

Panel = None
PictureBox = None
PictureBoxSizeMode = None
CheckBox = None
Button = None
SaveFileDialog = None
DialogResult = None
AnchorStyles = None
Point = None
Size = None
Bitmap = None
Graphics = None
Pen = None
SolidBrush = None
Color = None
Font = None
FontStyle = None
StringFormat = None
StringFormatFlags = None
StringAlignment = None
PointF = None
RectangleF = None
SmoothingMode = None
ImageFormat = None

_import_error = None

try:
    clr.AddReference("System.Windows.Forms")
    from System.Windows.Forms import (
        Panel,
        PictureBox,
        PictureBoxSizeMode,
        CheckBox,
        Button,
        SaveFileDialog,
        DialogResult,
        AnchorStyles,
    )
except Exception as ex:
    _import_error = "WinForms: " + str(ex)


try:
    clr.AddReference("System.Drawing")
    from System.Drawing import (
        Point,
        Size,
        Bitmap,
        Graphics,
        Pen,
        SolidBrush,
        Color,
        Font,
        FontStyle,
        StringFormat,
        StringFormatFlags,
        StringAlignment,
        PointF,
        RectangleF,
    )
except Exception as ex:
    _import_error = (_import_error or "") + " | Drawing: " + str(ex)

try:
    from System.Drawing.Drawing2D import SmoothingMode
except Exception as ex:
    _import_error = (_import_error or "") + " | Drawing2D: " + str(ex)

try:
    from System.Drawing.Imaging import ImageFormat
except Exception as ex:
    _import_error = (_import_error or "") + " | Imaging: " + str(ex)

try:
    from System.Windows.Forms import AutoSizeMode
except:
    AutoSizeMode = None


class uibarchart(object):

    def __init__(
        self,
        inputname="",
        chartname="",
        labels=None,
        xseries=None,
        yseries=None,
        inputcolors=None,
        ishorizontal=False,
        xaxislabel="",
        yaxislabel="",
    ):
        self._input_type = "uibarchart"
        self.inputname = inputname if inputname is not None else ""
        self.chartname = chartname if chartname is not None else ""
        self.labels = labels if labels is not None else []
        self.xseries = xseries if xseries is not None else []
        self.yseries = yseries if yseries is not None else []
        self.inputcolors = inputcolors if inputcolors is not None else []
        self.ishorizontal = bool(ishorizontal)
        self.xaxislabel = xaxislabel if xaxislabel is not None else ""
        self.yaxislabel = yaxislabel if yaxislabel is not None else ""

    def __repr__(self):
        return "UI.BarChart input"

    def _is_nested(self, obj):
        if obj is None:
            return False
        try:
            lst = self._to_list(obj)
            if len(lst) == 0:
                return False
            first = lst[0]
            if isinstance(first, str):
                return False
            if isinstance(first, (list, tuple)):
                return True
            if hasattr(first, '__iter__') and hasattr(first, '__len__'):
                return True
            if hasattr(first, 'Count') and hasattr(first, '__getitem__'):
                return True
            return False
        except:
            return False

    def _to_list(self, obj):
        if obj is None:
            return []
        if isinstance(obj, list):
            return obj
        if isinstance(obj, str):
            return [obj]
        try:
            return [x for x in obj]
        except:
            return [obj]

    def _to_nested_list(self, obj):
        if obj is None:
            return []
        outer = self._to_list(obj)
        result = []
        for item in outer:
            if isinstance(item, str):
                result.append(item)
            elif isinstance(item, (list, tuple)):
                result.append(list(item))
            elif hasattr(item, '__iter__'):
                try:
                    result.append([x for x in item])
                except:
                    result.append(item)
            else:
                result.append(item)
        return result

    def _to_number(self, val):
        if val is None:
            return 0.0
        if isinstance(val, (int, float)):
            return float(val)
        try:
            return float(val)
        except:
            pass
        try:
            return float(str(val))
        except:
            pass
        return 0.0

    def _get_default_colors(self):
        if Color is None:
            return []
        return [
            Color.FromArgb(70, 130, 180),
            Color.FromArgb(205, 92, 92),
            Color.FromArgb(60, 179, 113),
            Color.FromArgb(255, 165, 0),
            Color.FromArgb(147, 112, 219),
            Color.FromArgb(64, 224, 208),
            Color.FromArgb(255, 105, 180),
            Color.FromArgb(154, 205, 50),
        ]

    def _to_color(self, c, idx=0):
        if Color is None:
            return None
        try:
            if c is None:
                colors = self._get_default_colors()
                return colors[idx % len(colors)] if colors else None
            if isinstance(c, Color):
                return c
            if hasattr(c, "Red") and hasattr(c, "Green") and hasattr(c, "Blue"):
                return Color.FromArgb(int(c.Red), int(c.Green), int(c.Blue))
            if hasattr(c, "R") and hasattr(c, "G") and hasattr(c, "B"):
                a = getattr(c, "A", 255)
                return Color.FromArgb(int(a), int(c.R), int(c.G), int(c.B))
        except:
            pass
        colors = self._get_default_colors()
        return colors[idx % len(colors)] if colors else None

    def _prepare_series_data(self):
        labels = self._to_list(self.labels)
        if len(labels) == 0:
            labels = ["Series 1"]
        
        xseries_raw = self._to_nested_list(self.xseries)
        yseries_raw = self._to_nested_list(self.yseries)
        
        x_is_nested = self._is_nested(self.xseries)
        y_is_nested = self._is_nested(self.yseries)
        
        if x_is_nested and y_is_nested:
            nbOfSeries = len(xseries_raw)
            xseries = xseries_raw
            yseries = yseries_raw
        elif not x_is_nested and y_is_nested:
            nbOfSeries = len(yseries_raw)
            xseries = [xseries_raw for _ in range(nbOfSeries)]
            yseries = yseries_raw
        elif not y_is_nested and x_is_nested:
            nbOfSeries = len(xseries_raw)
            yseries = [yseries_raw for _ in range(nbOfSeries)]
            xseries = xseries_raw
        else:
            xseries = [xseries_raw]
            yseries = [yseries_raw]
            nbOfSeries = 1
        
        while len(labels) < nbOfSeries:
            labels.append("Series {}".format(len(labels) + 1))
        
        series_list = []
        for i in range(nbOfSeries):
            xs = self._to_list(xseries[i]) if i < len(xseries) else []
            ys = self._to_list(yseries[i]) if i < len(yseries) else []
            ys = [self._to_number(v) for v in ys]
            points = list(zip(xs, ys))
            series_list.append(points)
        
        return labels[:nbOfSeries], series_list

    def _render_bar_chart(self, width, height, state):
        if Bitmap is None or Graphics is None:
            return None, "Bitmap or Graphics is None"
        if Color is None or Pen is None or SolidBrush is None:
            return None, "Color, Pen, or SolidBrush is None"

        try:
            series_labels, series_list = self._prepare_series_data()
            colors = self._to_list(self.inputcolors)
            
            all_x_categories = []
            all_y_values = []
            for points in series_list:
                for x, y in points:
                    if x not in all_x_categories:
                        all_x_categories.append(x)
                    all_y_values.append(y)
            
            if not all_x_categories:
                all_x_categories = [""]
            if not all_y_values:
                all_y_values = [0]
            
            y_min = 0
            y_max = max(all_y_values) * 1.1 if max(all_y_values) > 0 else 1.0
            if y_max <= y_min:
                y_max = 1.0
            
            margin = {"left": 65, "right": 120, "top": 50, "bottom": 55}
            
            bmp = Bitmap(width, height)
            g = Graphics.FromImage(bmp)
            
            if SmoothingMode is not None:
                try:
                    g.SmoothingMode = SmoothingMode.AntiAlias
                except:
                    pass
            g.Clear(Color.White)
            
            plot_x = margin["left"]
            plot_y = margin["top"]
            plot_w = width - margin["left"] - margin["right"]
            plot_h = height - margin["top"] - margin["bottom"]
            
            if self.chartname:
                try:
                    title_font = Font("Segoe UI", 11, FontStyle.Bold)
                    g.DrawString(self.chartname, title_font, SolidBrush(Color.FromArgb(50, 50, 50)), 
                                PointF(plot_x, 10))
                except:
                    pass
            
            axis_pen = Pen(Color.FromArgb(80, 80, 80), 1)
            g.DrawLine(axis_pen, plot_x, plot_y + plot_h, plot_x + plot_w, plot_y + plot_h)
            g.DrawLine(axis_pen, plot_x, plot_y, plot_x, plot_y + plot_h)
            
            label_font = Font("Segoe UI", 8)
            label_brush = SolidBrush(Color.FromArgb(80, 80, 80))
            
            y_steps = 5
            grid_pen = Pen(Color.FromArgb(220, 220, 220), 1)
            fmt_right = StringFormat()
            fmt_right.Alignment = StringAlignment.Far
            
            for i in range(y_steps + 1):
                y_val = y_min + (y_max - y_min) * i / y_steps
                y_pos = plot_y + plot_h - (plot_h * i / y_steps)
                
                if state.get("grid", True) and i > 0:
                    g.DrawLine(grid_pen, plot_x, int(y_pos), plot_x + plot_w, int(y_pos))
                
                label_text = "{:.4g}".format(y_val)
                g.DrawString(label_text, label_font, label_brush, 
                            PointF(plot_x - 5, y_pos - 6), fmt_right)
            
            n_categories = len(all_x_categories)
            category_width = plot_w / max(n_categories, 1)
            fmt_center = StringFormat()
            fmt_center.Alignment = StringAlignment.Center
            
            for i, cat in enumerate(all_x_categories):
                x_pos = plot_x + category_width * (i + 0.5)
                g.DrawString(str(cat), label_font, label_brush,
                            PointF(x_pos, plot_y + plot_h + 8), fmt_center)
            
            n_series = len(series_list)
            bar_group_width = category_width * 0.8
            bar_width = bar_group_width / max(n_series, 1)
            
            for si, points in enumerate(series_list):
                color = self._to_color(colors[si] if si < len(colors) else None, si)
                if color is None:
                    continue
                brush = SolidBrush(color)
                
                for x_cat, y_val in points:
                    try:
                        cat_idx = all_x_categories.index(x_cat)
                    except ValueError:
                        continue
                    
                    group_start = plot_x + cat_idx * category_width + (category_width - bar_group_width) / 2
                    bar_x = group_start + si * bar_width
                    
                    bar_height = int((y_val - y_min) / (y_max - y_min) * plot_h) if y_max > y_min else 0
                    bar_height = max(bar_height, 0)
                    
                    bar_y = plot_y + plot_h - bar_height
                    
                    if bar_height > 0:
                        g.FillRectangle(brush, int(bar_x), int(bar_y), int(bar_width - 2), bar_height)
            
            if state.get("legend", True) and series_labels:
                legend_x = plot_x + plot_w + 10
                legend_y = plot_y + 10
                legend_font = Font("Segoe UI", 9)
                
                for i, name in enumerate(series_labels):
                    color = self._to_color(colors[i] if i < len(colors) else None, i)
                    if color is not None:
                        g.FillRectangle(SolidBrush(color), legend_x, legend_y + i * 22, 14, 14)
                    g.DrawString(str(name), legend_font, SolidBrush(Color.FromArgb(60, 60, 60)),
                                PointF(legend_x + 20, legend_y + i * 22 - 1))
            
            if self.xaxislabel:
                try:
                    axis_font = Font("Segoe UI", 9)
                    x_label_y = plot_y + plot_h + 30
                    g.DrawString(self.xaxislabel, axis_font, label_brush,
                                PointF(plot_x + plot_w / 2, x_label_y), fmt_center)
                except:
                    pass
            
            if self.yaxislabel:
                try:
                    axis_font = Font("Segoe UI", 9)
                    fmt_vert = StringFormat()
                    fmt_vert.Alignment = StringAlignment.Center
                    if StringFormatFlags is not None:
                        fmt_vert.FormatFlags = StringFormatFlags.DirectionVertical
                    text_size = g.MeasureString(self.yaxislabel, axis_font)
                    y_label_x = 2
                    y_label_y = plot_y + (plot_h - text_size.Width) / 2
                    g.DrawString(self.yaxislabel, axis_font, label_brush,
                                PointF(y_label_x, y_label_y), fmt_vert)
                except:
                    pass
            
            g.Dispose()
            return bmp, None
            
        except Exception as ex:
            import traceback
            return None, str(ex) + "\n" + traceback.format_exc()

    def build_chart(self, formbody, xlabel, xinput, y, xRatio, yRatio, form):
        if Panel is None or PictureBox is None or Bitmap is None:
            return None, int(y)

        panel = Panel()
        panel.Location = Point(int(xlabel), int(y))
        panel.Width = max(int(formbody.Width - 25 * xRatio - xlabel), int(200 * xRatio))
        panel.Height = max(int(340 * yRatio), 220)

        pb = PictureBox()
        pb.SizeMode = PictureBoxSizeMode.Normal
        pb.Location = Point(0, 0)
        pb.Width = panel.Width
        pb.Height = int(panel.Height - 40 * yRatio)

        if AnchorStyles is not None:
            pb.Anchor = AnchorStyles.Top | AnchorStyles.Left | AnchorStyles.Right

        panel.Controls.Add(pb)
        
        placeholder = None
        state = {"legend": True, "grid": True}

        def render():
            nonlocal placeholder
            bmp = None
            err_txt = None
            
            try:
                if pb.Width > 0 and pb.Height > 0:
                    bmp, render_err = self._render_bar_chart(pb.Width, pb.Height, state)
                    if render_err:
                        err_txt = render_err
                else:
                    err_txt = "Invalid size"
            except Exception as exc:
                import traceback
                err_txt = str(exc) + "\n" + traceback.format_exc()
            
            try:
                old_img = pb.Image
                pb.Image = bmp
                if old_img is not None and old_img is not bmp:
                    old_img.Dispose()
            except:
                pb.Image = bmp
            
            if bmp is None:
                pb.Visible = False
                if placeholder is None:
                    try:
                        from System.Windows.Forms import Label
                        placeholder = Label()
                        placeholder.AutoSize = True
                        placeholder.MaximumSize = Size(panel.Width - 20, 0)
                        placeholder.Location = Point(10, 10)
                        panel.Controls.Add(placeholder)
                    except:
                        pass
                if placeholder:
                    placeholder.Text = "Chart error: " + (err_txt or "Unknown")
            else:
                pb.Visible = True
                if placeholder:
                    try:
                        panel.Controls.Remove(placeholder)
                    except:
                        pass
                    placeholder = None

        pb.SizeChanged += lambda s, e: render()

        render()

        ctrl_y = pb.Bottom + int(4 * yRatio)

        cb_grid = CheckBox()
        cb_grid.Text = "Grid"
        cb_grid.AutoSize = True
        cb_grid.Checked = True
        cb_grid.Location = Point(int(10 * xRatio), ctrl_y)
        cb_grid.CheckedChanged += lambda s, e: (state.update({"grid": s.Checked}), render())
        panel.Controls.Add(cb_grid)

        cb_legend = CheckBox()
        cb_legend.Text = "Legend"
        cb_legend.AutoSize = True
        cb_legend.Checked = True
        cb_legend.Location = Point(int(80 * xRatio), ctrl_y)
        cb_legend.CheckedChanged += lambda s, e: (state.update({"legend": s.Checked}), render())
        panel.Controls.Add(cb_legend)

        btn_export = Button()
        btn_export.Text = "Export Image"
        btn_export.AutoSize = True
        btn_export.Location = Point(int(panel.Width - 100 * xRatio), ctrl_y)

        if AnchorStyles is not None:
            btn_export.Anchor = AnchorStyles.Top | AnchorStyles.Right
        
        def do_export(sender, args):
            try:
                if pb.Image is None:
                    return
                dlg = SaveFileDialog()
                dlg.Filter = "PNG|*.png|JPEG|*.jpg|BMP|*.bmp"
                dlg.FileName = (self.chartname or "chart") + ".png"
                if dlg.ShowDialog() == DialogResult.OK:
                    fmt = ImageFormat.Png if ImageFormat else None
                    path = dlg.FileName
                    if fmt:
                        if path.lower().endswith(".jpg") or path.lower().endswith(".jpeg"):
                            fmt = ImageFormat.Jpeg
                        elif path.lower().endswith(".bmp"):
                            fmt = ImageFormat.Bmp
                        pb.Image.Save(path, fmt)
                    else:
                        pb.Image.Save(path)
            except:
                pass
        
        btn_export.Click += do_export
        panel.Controls.Add(btn_export)

        next_y = int(y + panel.Height + 10 * yRatio)
        return panel, next_y


chartname = IN[0] if len(IN) > 0 else ""
labels = IN[1] if len(IN) > 1 else []
xseries = IN[2] if len(IN) > 2 else []
yseries = IN[3] if len(IN) > 3 else []
inputcolors = IN[4] if len(IN) > 4 else []
ishorizontal = IN[5] if len(IN) > 5 else False
xaxislabel = IN[6] if len(IN) > 6 else ""
yaxislabel = IN[7] if len(IN) > 7 else ""

OUT = uibarchart(
    "",
    chartname,
    labels,
    xseries,
    yseries,
    inputcolors,
    ishorizontal,
    xaxislabel,
    yaxislabel,
)
# ----------------------------------------
UI_BarChartData = Output(python_script)  # "UI.BarChartData"
