# Dynamo custom node Boolean Data.dyf "Boolean input" (Dynamo 3.3.0.6316)
# category: Data-Shapes.UI.Input
# Creates a boolean input for UI.MultipleInputForm ++ . Check out www.data-shapes.net for more infos!

InputName = Input(InputName_: string = "")
DefaultValue = Input(DefaultValue_: bool = false)
SideText = Input(SideText_: string = "Yes/No")
python_script = Python(IN[0]=InputName, IN[1]=DefaultValue, IN[2]=SideText)  # CPython3
# ---------- python_script.python (21 lines) ----------
# Copyright (c) Data Shapes, 2025
# Data-Shapes www.data-shapes.io, elayoubi.mostafa@data-shapes.io @data_shapes


class uibool(object):

    def __init__(self, inputname="", defaultvalue=False, booltext=""):
        self.inputname = inputname if inputname is not None else ""
        self.defaultvalue = defaultvalue if defaultvalue is not None else False
        self.booltext = booltext if booltext is not None else ""
        self._input_type = 'uibool'

    def __repr__(self):
        return 'UI.Boolean input'


inputname = IN[0] if len(IN) > 0 else ""
defaultvalue = IN[1] if len(IN) > 1 else False
booltext = IN[2] if len(IN) > 2 else ""

OUT = uibool(inputname, defaultvalue, booltext)
# ----------------------------------------
Boolean_input = Output(python_script)
