# Dynamo custom node Categories list.dyf (Dynamo 3.3.0.6316)
# category: Data-Shapes.Revit.Lists
# Gives list of all Revit categories and a matching list of their names

python_script = Python()  # CPython3; graph input
# ---------- python_script.python (14 lines) ----------
# Copyright (c) Data Shapes, 2025
# Data-Shapes www.data-shapes.io, elayoubi.mostafa@data-shapes.io @data_shapes

import clr
clr.AddReference('RevitAPI')
from Autodesk.Revit.DB import *
clr.AddReference('RevitServices')
from RevitServices.Persistence import DocumentManager

doc = DocumentManager.Instance.CurrentDBDocument

cat = doc.Settings.Categories

OUT = cat, [x.Name for x in cat]
# ----------------------------------------
code_block = CodeBlock(x=python_script) { x[0]; x[1]; }
Revit_Categories = Output(code_block.out0)
Category_name_s = Output(code_block.out1)  # "Category name(s)"
