# Dynamo custom node ColorInput Data.dyf (Dynamo 3.3.0.6316)
# category: Data-Shapes.UI.Input
# Create a color selection input for UI.MultiInputForm++ . Check out www.data-shapes.net for more infos! Warning : Only works with Revit 2017

InputName = Input(InputName_: string = "")
ButtonText = Input(ButtonText_: string = "Select Color")
python_script = Python(IN[0]=InputName, IN[1]=ButtonText)  # CPython3
# ---------- python_script.python (48 lines) ----------
# Copyright (c) Data Shapes, 2025
# Data-Shapes www.data-shapes.io, elayoubi.mostafa@data-shapes.io @data_shapes

import clr

clr.AddReference('System.Drawing')
from System.Drawing import Color

try:
    clr.AddReference('RevitAPIUI')
    from Autodesk.Revit.UI import ColorSelectionDialog
    _COLOR_DIALOG_AVAILABLE = True
except:
    _COLOR_DIALOG_AVAILABLE = False


class uicolorpick(object):

    def __init__(self, inputname="", buttontext="Pick Color"):
        self.inputname = inputname if inputname is not None else ""
        self.buttontext = buttontext if buttontext is not None else "Pick Color"
        self._input_type = 'uicolorpick'
        self.color_picker_available = _COLOR_DIALOG_AVAILABLE

    def __repr__(self):
        return 'UI.ColorPick input'

    def pickcolor(self, sender, event):
        if not self.color_picker_available:
            sender.Tag = None
            return
        try:
            dialog = ColorSelectionDialog()
            ColorSelectionDialog.Show(dialog)
            selected = dialog.SelectedColor
            if selected is None:
                return
            sender.Tag = selected
            sender.BackColor = Color.FromArgb(selected.Red, selected.Green, selected.Blue)
            sender.ForeColor = Color.FromArgb(selected.Red, selected.Green, selected.Blue)
        except:
            sender.Tag = None


inputname = IN[0] if len(IN) > 0 else ""
buttontext = IN[1] if len(IN) > 1 else "Pick Color"

OUT = uicolorpick(inputname, buttontext)
# ----------------------------------------
ColorSelection_Input = Output(python_script)
