# Dynamo custom node ConditionalInput Data.dyf (Dynamo 3.3.0.6316)
# category: Data-Shapes.UI.Input
# Allows to create inputs that are enabled/disabled by a condition dor UI.MultipleInputForm++.

Options = Input(Options_: var[])
InputGroups_by_Option = Input(InputGroups_by_Option: var[][])
DefaultOptionIndex = Input(DefaultOptionIndex: int = 0)
python_script = Python(IN[0]=Options, IN[1]=InputGroups_by_Option, IN[2]=DefaultOptionIndex)  # CPython3
# ---------- python_script.python (27 lines) ----------
# Copyright (c) Data Shapes, 2025
# Data-Shapes www.data-shapes.io, elayoubi.mostafa@data-shapes.io @data_shapes


class uiconditional:
    
    def __init__(self, inputname, _Conditions, _GroupedInputs, _defaultOptionIndex):
        self._input_type = 'uiconditional'
        self.inputname = inputname
        self._Conditions = _Conditions
        self._GroupedInputs = _GroupedInputs
        self._defaultOptionIndex = _defaultOptionIndex

    def __repr__(self):
        return 'UI.Conditional input'


def toList(input):
    if isinstance(input, list):
        return input
    else:
        return [input]


x = uiconditional("", toList(IN[0]), toList(IN[1]), IN[2])

OUT = x
# ----------------------------------------
ConditionalInput_Data = Output(python_script)
