# Dynamo custom node DataTable input.dyf (Dynamo 3.3.0.6316)
# category: Data-Shapes.UI.Input
# Create a DataTable view input for UI.MultipleInputForm ++

InputName = Input(InputName_: string = "Table Title")
Data = Input(Data_: var[]..[])
FirstRowIsTitles = Input(FirstRowIsTitles_: bool = false)
OpenExcelAtExport = Input(OpenExcelAtExport_: bool = false)
ShowTitleAndFileInfoInExport = Input(ShowTitleAndFileInfoInExport_: bool = true)
python_script = Python(IN[0]=InputName, IN[1]=Data, IN[2]=FirstRowIsTitles, IN[3]=OpenExcelAtExport, IN[4]=ShowTitleAndFileInfoInExport)  # CPython3
# ---------- python_script.python (540 lines) ----------
# Copyright (c) Data Shapes, 2025
# Data-Shapes www.data-shapes.io, elayoubi.mostafa@data-shapes.io @data_shapes

import clr
import re

clr.AddReference('RevitServices')
from RevitServices.Persistence import DocumentManager
from System import DateTime
clr.AddReference('System.Data')
from System.Data import DataTable as DotNetDataTable, DataRow as DotNetDataRow

clr.AddReference('System.Windows.Forms')
from System.Windows.Forms import FolderBrowserDialog, SaveFileDialog, DialogResult, MessageBox, MessageBoxButtons


def _get_doc_name(path):
    if not path:
        return ""
    try:
        return path.split("\\")[-1]
    except Exception:
        try:
            return path.split("/")[-1]
        except Exception:
            return ""


def _default_file_info():
    try:
        doc = DocumentManager.Instance.CurrentDBDocument
        name = _get_doc_name(doc.PathName)
    except Exception:
        name = ""
    return "{0} , {1}".format(name, DateTime.Now)


def _remove_accents(input_str):
    import unicodedata
    nfkd_form = unicodedata.normalize('NFKD', str(input_str))
    return nfkd_form.encode('ASCII', 'ignore').decode('ASCII')


class tableview(object):

    def __init__(
        self,
        inputname="",
        tabletitle="",
        data_list=None,
        has_title=True,
        open_excel=True,
        show_info=True,
        file_info=None,
    ):
        self.inputname = inputname if inputname is not None else ""
        self._tabletitle = tabletitle if tabletitle is not None else ""
        self.dataList = data_list if data_list is not None else []
        self._hasTitle = bool(has_title)
        self._openExcel = bool(open_excel)
        self._showinfo = bool(show_info)
        self._fileInfo = file_info if file_info is not None else ""
        self._input_type = "tableview"
        if not self._fileInfo:
            self._fileInfo = _default_file_info()

    def __repr__(self):
        return "UI.DataTable input"

    def get_data_list(self):
        dl = self.dataList
        if isinstance(dl, list) and len(dl) == 1 and isinstance(dl[0], list):
            dl = dl[0]
        return dl

    def _cell_val(self, v):
        try:
            if v is None:
                return ""
            if isinstance(v, (int, float, bool, str)):
                return v
            if hasattr(v, "ItemArray"):
                arr = list(v.ItemArray)
                if len(arr) == 1:
                    return self._cell_val(arr[0])
                return "; ".join([str(self._cell_val(x)) for x in arr])
            if hasattr(v, "Value"):
                return self._cell_val(v.Value)
            return str(v)
        except Exception:
            return ""

    def _row_to_list(self, r):
        if r is None:
            return []
        if hasattr(r, "ItemArray"):
            try:
                return [self._cell_val(x) for x in list(r.ItemArray)]
            except Exception:
                pass
        if hasattr(r, "RowData"):
            try:
                rd = r.RowData
                if isinstance(rd, list):
                    return [self._cell_val(x) for x in rd]
                return [self._cell_val(x) for x in list(rd)]
            except Exception:
                pass
        if isinstance(r, (list, tuple)):
            return [self._cell_val(x) for x in r]
        try:
            return [self._cell_val(x) for x in list(r)]
        except Exception:
            return [self._cell_val(r)]
    
    def get_display_row_count(self):
        dl = self.get_data_list()
        return len(dl) if dl else 1

    def _ensure_cell_store(self, sender):
        if not hasattr(self, "_dg_cell_store"):
            self._dg_cell_store = {}
        if sender not in self._dg_cell_store:
            self._dg_cell_store[sender] = ({"X": None, "Y": None}, {"X": None, "Y": None})
        return self._dg_cell_store[sender]

    def _regex_end_num(self, val):
        try:
            m = re.search(r"(\d+)$", str(val))
            return m.group(1) if m else ""
        except Exception:
            return ""

    def _show_message(self, text):
        return

    def _find_export_context(self, sender):
        parent = getattr(sender, "Parent", None)
        if parent is None or not hasattr(parent, "Controls"):
            return None

        dg = None
        filepathtb = None
        titlep = None

        try:
            for c in list(parent.Controls):
                try:
                    ctype = c.GetType().Name if hasattr(c, "GetType") else c.__class__.__name__
                except Exception:
                    ctype = ""
                if dg is None and "DataGridView" in ctype:
                    dg = c
                if filepathtb is None and ctype == "TextBox":
                    filepathtb = c
                if titlep is None and ctype == "Label":
                    titlep = c
                if dg and filepathtb and titlep:
                    break
        except Exception:
            return None

        if dg and filepathtb:
            return (dg, filepathtb, titlep)
        return None

    def start_cell(self, sender, event):
        if event.ColumnIndex < 0 or event.RowIndex < 0:
            return
        startcell, _ = self._ensure_cell_store(sender)
        startcell["X"] = event.ColumnIndex
        startcell["Y"] = event.RowIndex

    def end_cell(self, sender, event):
        try:
            if event.ColumnIndex < 0 or event.RowIndex < 0:
                return
            startcell, endcell = self._ensure_cell_store(sender)
            if startcell["X"] is None or startcell["Y"] is None:
                return
            endcell["X"] = event.ColumnIndex
            endcell["Y"] = event.RowIndex
            startval = sender.Rows[startcell["Y"]].Cells[startcell["X"]].Value
            endNum = self._regex_end_num(startval)
            if endNum != "":
                if endcell["Y"] == startcell["Y"]:
                    for e, i in enumerate(range(startcell["X"], endcell["X"] + 1)):
                        sender.Rows[startcell["Y"]].Cells[i].Value = str(startval)[:-len(endNum)] + str(int(endNum) + e)
                elif endcell["X"] == startcell["X"]:
                    for e, i in enumerate(range(startcell["Y"], endcell["Y"] + 1)):
                        sender.Rows[i].Cells[endcell["X"]].Value = str(startval)[:-len(endNum)] + str(int(endNum) + e)
            else:
                if endcell["Y"] == startcell["Y"]:
                    for i in range(startcell["X"], endcell["X"] + 1):
                        sender.Rows[startcell["Y"]].Cells[i].Value = startval
                elif endcell["X"] == startcell["X"]:
                    for i in range(startcell["Y"], endcell["Y"] + 1):
                        sender.Rows[i].Cells[endcell["X"]].Value = startval
        except Exception:
            pass

    def create_data_table(self):
        dt = DotNetDataTable()

        dl = self.get_data_list()

        if not dl or len(dl) == 0:
            return dt

        if hasattr(dl, "Rows") and hasattr(dl, "Columns"):
            try:
                dl = [list(r.ItemArray) for r in dl.Rows]
            except Exception:
                pass

        if not isinstance(dl, list):
            try:
                dl = list(dl)
            except Exception:
                return dt

        if len(dl) == 0:
            return dt

        header_row = self._row_to_list(dl[0])
        col_count = len(header_row)
        if col_count == 0:
            return dt

        rngstart = 0
        for i in range(col_count):
            if self._hasTitle:
                dt.Columns.Add(_remove_accents(str(header_row[i])))
                rngstart = 1
            else:
                dt.Columns.Add("Column " + str(i))
                rngstart = 0

        for rindex in range(rngstart, len(dl)):
            r_vals = self._row_to_list(dl[rindex])
            values = []
            for i in range(col_count):
                if i < len(r_vals):
                    values.append(self._cell_val(r_vals[i]))
                else:
                    values.append("")
            dt.Rows.Add(*values)

        return dt

    def export_to_excel(self, sender, event):
        tag = getattr(sender, "Tag", None)
        if not tag or not isinstance(tag, tuple) or len(tag) < 3:
            tag = self._find_export_context(sender)
        if not tag or len(tag) < 2:
            self._show_message("Nothing to export: missing DataGrid/metadata.")
            return
        if len(tag) == 2:
            dg, filepathtb = tag
            titlep = None
        else:
            dg, filepathtb, titlep = tag
        data_table = getattr(dg, "DataSource", None)
        if data_table is None:
            self._show_message("Nothing to export: DataGrid is empty.")
            return

        excel_available = True
        app_ctor = None
        TypeMissing = None
        try:
            import System
            excelTypeLibGuid = System.Guid("00020813-0000-0000-C000-000000000046")
            clr.AddReferenceToTypeLibrary(excelTypeLibGuid)
            from Excel import Application, XlYesNoGuess, XlListObjectSourceType
            TypeMissing = System.Type.Missing
            app_ctor = Application
        except Exception:
            excel_available = False
            try:
                import System
                TypeMissing = System.Type.Missing
                excel_type = System.Type.GetTypeFromProgID("Excel.Application")
                if excel_type is not None:

                    def _create_excel_app():
                        try:
                            return System.Activator.CreateInstance(excel_type)
                        except Exception:
                            pass
                        try:
                            return System.Activator.CreateInstance(excel_type, [])
                        except Exception:
                            pass
                        try:
                            from System import RuntimeInteropServices
                            return RuntimeInteropServices.Marshal.GetActiveObject("Excel.Application")
                        except Exception:
                            pass
                        raise Exception("Excel COM activation failed.")

                    app_ctor = _create_excel_app

                    class _YN:
                        xlYes = 1
                        xlNo = 2

                    class _Src:
                        xlSrcRange = 1

                    XlYesNoGuess = _YN
                    XlListObjectSourceType = _Src
                    excel_available = True
            except Exception:
                excel_available = False

        sfd = SaveFileDialog()
        if excel_available:
            sfd.Filter = "Excel Workbook (*.xlsx)|*.xlsx|CSV (Comma delimited) (*.csv)|*.csv|All files (*.*)|*.*"
            default_name = (getattr(filepathtb, "Text", "") or "ExportFileName").strip() or "ExportFileName"
            if not (default_name.lower().endswith(".xlsx") or default_name.lower().endswith(".csv")):
                default_name += ".xlsx"
        else:
            sfd.Filter = "CSV (Comma delimited) (*.csv)|*.csv|All files (*.*)|*.*"
            default_name = (getattr(filepathtb, "Text", "") or "ExportFileName").strip() or "ExportFileName"
            if not default_name.lower().endswith(".csv"):
                default_name += ".csv"
        sfd.FileName = default_name

        dr = sfd.ShowDialog()
        if dr != DialogResult.OK:
            return

        fptext = sfd.FileName

        if (not excel_available) or fptext.lower().endswith(".csv"):
            try:
                import csv
                with open(fptext, "w", newline="", encoding="utf-8") as f:
                    writer = csv.writer(f)
                    frstRwTtle = bool(self._hasTitle)
                    if frstRwTtle:
                        writer.writerow([col.ColumnName for col in data_table.Columns])
                    for i in range(0, data_table.Rows.Count):
                        writer.writerow([data_table.DefaultView[i].Row[j] for j in range(data_table.Columns.Count)])
                if not excel_available:
                    self._show_message("Excel not available; exported CSV instead.")
                else:
                    self._show_message("Exported CSV to {0}".format(fptext))
                return
            except Exception as csv_exc:
                self._show_message("CSV export failed: {0}".format(csv_exc))
                return

        try:
            ex = app_ctor()

            def _col_to_letter(idx):
                letters = ""
                while idx > 0:
                    idx, rem = divmod(idx - 1, 26)
                    letters = chr(65 + rem) + letters
                return letters or "A"

            def _com_get(obj, prop, args=None):
                try:
                    from System.Reflection import BindingFlags
                    return obj.GetType().InvokeMember(prop, BindingFlags.GetProperty, None, obj, args or [])
                except Exception:
                    return None

            def _com_set(obj, prop, value, args=None):
                from System.Reflection import BindingFlags
                params = (args or []) + [value]
                return obj.GetType().InvokeMember(prop, BindingFlags.SetProperty, None, obj, params)

            def _com_call(obj, method, args=None):
                from System.Reflection import BindingFlags
                return obj.GetType().InvokeMember(method, BindingFlags.InvokeMethod, None, obj, args or [])

            typed_excel = hasattr(ex, "Workbooks")

            if not typed_excel:
                try:
                    import System
                    excelTypeLibGuid = System.Guid("00020813-0000-0000-C000-000000000046")
                    clr.AddReferenceToTypeLibrary(excelTypeLibGuid)
                    from Excel import Application as ExcelApp
                    ex = clr.Convert(ex, ExcelApp)
                    typed_excel = hasattr(ex, "Workbooks")
                except Exception:
                    typed_excel = False

            if typed_excel:
                ex.Visible = bool(self._openExcel)
                ex.DisplayAlerts = False

                titletext = getattr(titlep, "Text", "")
                frstRwTtle = bool(self._hasTitle)
                startR = 1
                info_offset = 0

                workbk = ex.Workbooks.Add()
                worksheet = workbk.Worksheets.Add()

                if self._showinfo:
                    worksheet.Cells[1, 1].Value2 = titletext
                    worksheet.Cells[1, 1].Font.Size = 18
                    worksheet.Cells[1, 1].Font.Bold = True
                    worksheet.Cells[2, 1].Value2 = self._fileInfo
                    startR = 3
                    info_offset = 2

                if frstRwTtle:
                    for j, col in enumerate(data_table.Columns):
                        worksheet.Cells[startR, j + 1] = col.ColumnName
                    for i in range(0, data_table.Rows.Count):
                        for j, col in enumerate(data_table.Columns):
                            worksheet.Cells[i + startR + 1, j + 1] = data_table.DefaultView[i].Row[j]
                    xlrange = worksheet.Range[
                        worksheet.Cells[startR, 1],
                        worksheet.Cells[data_table.Rows.Count + info_offset + 1, data_table.Columns.Count],
                    ]
                else:
                    for i in range(0, data_table.Rows.Count):
                        for j, col in enumerate(data_table.Columns):
                            worksheet.Cells[i + startR, j + 1] = data_table.DefaultView[i].Row[j]
                    xlrange = worksheet.Range[
                        worksheet.Cells[startR, 1],
                        worksheet.Cells[data_table.Rows.Count + info_offset, data_table.Columns.Count],
                    ]

                xlrange.Columns.AutoFit()
                worksheet.ListObjects.Add(
                    XlListObjectSourceType.xlSrcRange, xlrange, TypeMissing, XlYesNoGuess.xlYes if frstRwTtle else XlYesNoGuess.xlNo, TypeMissing
                ).Name = "DataShapesTable"
                worksheet.ListObjects["DataShapesTable"].TableStyle = "TableStyleMedium16"

                workbk.SaveAs(fptext)

                if not self._openExcel:
                    workbk.Close()
                    ex.Quit()
                self._show_message("Exported Excel table to {0}".format(fptext))
            else:
                _com_set(ex, "Visible", bool(self._openExcel))
                _com_set(ex, "DisplayAlerts", False)

                wbs = _com_get(ex, "Workbooks")
                if wbs is None:
                    self._show_message("Excel COM available but Workbooks is unreachable.")
                    return
                workbk = _com_call(wbs, "Add")
                if workbk is None:
                    self._show_message("Excel COM available but could not create workbook.")
                    return
                worksheet = _com_get(workbk, "ActiveSheet")
                if worksheet is None:
                    self._show_message("Excel COM available but ActiveSheet is unreachable.")
                    return

                titletext = getattr(titlep, "Text", "") if titlep else ""
                frstRwTtle = bool(self._hasTitle)
                startR = 1
                info_offset = 0

                if self._showinfo:
                    _com_prop = _com_set
                    _com_prop(worksheet, "Cells", titletext, [1, 1])
                    try:
                        cell11 = _com_get(worksheet, "Cells", [1, 1])
                        if cell11:
                            _com_set(cell11, "Value2", titletext)
                            font = _com_get(cell11, "Font")
                            if font:
                                _com_set(font, "Size", 18)
                                _com_set(font, "Bold", True)
                    except Exception:
                        pass
                    _com_set(worksheet, "Cells", self._fileInfo, [2, 1])
                    startR = 3
                    info_offset = 2

                if frstRwTtle:
                    for j, col in enumerate(data_table.Columns):
                        _com_set(worksheet, "Cells", col.ColumnName, [startR, j + 1])
                    for i in range(0, data_table.Rows.Count):
                        for j, col in enumerate(data_table.Columns):
                            _com_set(worksheet, "Cells", data_table.DefaultView[i].Row[j], [i + startR + 1, j + 1])
                    start_addr = "A{0}".format(startR)
                    end_addr = "{0}{1}".format(_col_to_letter(data_table.Columns.Count), data_table.Rows.Count + info_offset + 1)
                else:
                    for i in range(0, data_table.Rows.Count):
                        for j, col in enumerate(data_table.Columns):
                            _com_set(worksheet, "Cells", data_table.DefaultView[i].Row[j], [i + startR, j + 1])
                    start_addr = "A{0}".format(startR)
                    end_addr = "{0}{1}".format(_col_to_letter(data_table.Columns.Count), data_table.Rows.Count + info_offset)

                rng = _com_get(worksheet, "Range", [start_addr, end_addr])
                if rng:
                    cols = _com_get(rng, "Columns")
                    if cols:
                        try:
                            _com_call(cols, "AutoFit")
                        except Exception:
                            pass

                _com_call(workbk, "SaveAs", [fptext])

                if not self._openExcel:
                    _com_call(workbk, "Close", [])
                    _com_call(ex, "Quit", [])

                self._show_message("Exported Excel table to {0}".format(fptext))
        except Exception as excel_exc:
            try:
                if not self._openExcel:
                    ex.Quit()
            except Exception:
                pass
            self._show_message("Excel export failed: {0}".format(excel_exc))


tabletitle = IN[0] if len(IN) > 0 else ""
data_list = IN[1] if len(IN) > 1 else []
has_title = IN[2] if len(IN) > 2 else True
open_excel = IN[3] if len(IN) > 3 else False
show_info = IN[4] if len(IN) > 4 else False
inputname = IN[5] if len(IN) > 5 else ""
file_info = IN[6] if len(IN) > 6 else None

OUT = tableview(
    inputname,
    tabletitle,
    data_list,
    has_title,
    open_excel,
    show_info,
    file_info,
)
# ----------------------------------------
TableView_input = Output(python_script)
