# Dynamo custom node DirectoryPath Data.dyf (Dynamo 3.3.0.6316)
# category: Data-Shapes.UI.Input
# Creates a DirectoryPath input for UI.MultipleInputForm ++ . Check out www.data-shapes.net for more infos!

InputName = Input(InputName_: string = "")
DefaultPath = Input(DefaultPath_: string = "DirectoryPath")
ButtonText = Input(ButtonText_: string = "DirectoryPath")  # Is ignored if a default path is given
python_script = Python(IN[0]=InputName, IN[1]=DefaultPath, IN[2]=ButtonText)  # CPython3
# ---------- python_script.python (44 lines) ----------
# Copyright (c) Data Shapes, 2025
# Data-Shapes www.data-shapes.io, elayoubi.mostafa@data-shapes.io @data_shapes

import clr

clr.AddReference('System.Windows.Forms')
from System.Windows.Forms import FolderBrowserDialog, DialogResult


class uidirectorypath(object):

    def __init__(self, inputname="", defaultvalue="DirectoryPath", buttontext="Select Directory"):
        self.inputname = inputname if inputname is not None else ""
        self.defaultvalue = defaultvalue if defaultvalue is not None else "DirectoryPath"
        self.buttontext = buttontext if buttontext is not None else "Select Directory"
        self._input_type = 'uidirectorypath'

    def __repr__(self):
        return 'UI.DirectoryPath input'

    def opendirectory(self, sender, event):
        try:
            fbd = FolderBrowserDialog()
            start_path = None
            if isinstance(sender.Tag, str) and sender.Tag:
                start_path = sender.Tag
            elif isinstance(self.defaultvalue, str) and self.defaultvalue and self.defaultvalue != "DirectoryPath":
                start_path = self.defaultvalue
            if start_path:
                fbd.SelectedPath = start_path
            dr = fbd.ShowDialog()
            if dr == DialogResult.OK:
                selected_path = fbd.SelectedPath
                sender.Text = selected_path
                sender.Tag = selected_path
        except:
            pass


inputname = IN[0] if len(IN) > 0 else ""
defaultvalue = IN[1] if len(IN) > 1 else "DirectoryPath"
buttontext = IN[2] if len(IN) > 2 else "Select Directory"

OUT = uidirectorypath(inputname, defaultvalue, buttontext)
# ----------------------------------------
DirectoryPath_input = Output(python_script)
