# Dynamo custom node Document.LengthDisplayUnit.dyf (Dynamo 3.3.0.6316)
# category: Data-Shapes.Revit.Document
# Returns diplay units for lengths in current document.

python_script = Python()  # CPython3; graph input
# ---------- python_script.python (41 lines) ----------
# Copyright (c) Data Shapes, 2025
# Data-Shapes www.data-shapes.io, elayoubi.mostafa@data-shapes.io @data_shapes

import clr

clr.AddReference('RevitAPI')
from Autodesk.Revit.DB import Document

clr.AddReference('RevitServices')
from RevitServices.Persistence import DocumentManager

doc = DocumentManager.Instance.CurrentDBDocument

try:
    from Autodesk.Revit.DB import UnitType
    FOptions = Document.GetUnits(doc).GetFormatOptions(UnitType.UT_Length)
    UIunit = FOptions.DisplayUnits
    UISymbol = FOptions.UnitSymbol
    
    Show = UIunit.ToString().split('_')
    del Show[0]
    Show = ' '.join([s.title() for s in Show])
    
    ShowSymb = UISymbol.ToString().split('_')
    del ShowSymb[0]
    ShowSymb = ' '.join([s.lower() for s in ShowSymb])

except:
    from Autodesk.Revit.DB import SpecTypeId, LabelUtils
    FOptions = Document.GetUnits(doc).GetFormatOptions(SpecTypeId.Length)
    UIunit = FOptions.GetUnitTypeId()
    UISymbol = FOptions.GetSymbolTypeId()
    
    Show = LabelUtils.GetLabelForUnit(UIunit)
    
    if UISymbol is None or UISymbol.Empty():
        ShowSymb = ""
    else:
        ShowSymb = LabelUtils.GetLabelForSymbol(UISymbol)

OUT = Show, ShowSymb
# ----------------------------------------
code_block = CodeBlock(x=python_script) { x[0]; x[1]; }
LengthDisplayUnits = Output(code_block.out0)
LengthDisplayUnitsSymbol = Output(code_block.out1)
