# Dynamo custom node DropDown Data.dyf (Dynamo 3.3.0.6316)
# category: Data-Shapes.UI.Input
# Create data for DropDown input in UI.MultiInputForm ++ . Check out www.data-shapes.net for more infos.

InputName = Input(InputName: string = "")
Keys = Input(Keys_: var[])
Values = Input(Values_: var[]..[])
DefaultValueIndex = Input(DefaultValueIndex: int = null)
Sorted_optional = Input(Sorted_optional: bool = true)
python_script = Python(IN[0]=InputName, IN[1]=Keys, IN[2]=Values, IN[3]=DefaultValueIndex, IN[4]=Sorted_optional)  # CPython3
# ---------- python_script.python (41 lines) ----------
# Copyright (c) Data Shapes, 2025
# Data-Shapes www.data-shapes.io, elayoubi.mostafa@data-shapes.io @data_shapes


class dropdown(object):

    def __init__(self, inputname="", entries=None, values=None, defaultvalue=None, sorted_items=False):
        self.inputname = inputname if inputname is not None else ""
        self.defaultvalue = defaultvalue if isinstance(defaultvalue, int) and defaultvalue >= 0 else None
        self._sorted = bool(sorted_items)
        self._input_type = "dropdown"

        labels = self._normalize(entries)
        vals = self._normalize(values)
        if len(vals) < len(labels):
            vals += [None] * (len(labels) - len(vals))
        self.options = {str(lbl): vals[i] for i, lbl in enumerate(labels)}

    def _normalize(self, obj):
        if obj is None:
            return []
        if isinstance(obj, (list, tuple)):
            return list(obj)
        if isinstance(obj, str):
            return [obj]
        try:
            return list(obj)
        except Exception:
            return [obj]

    def __repr__(self):
        return "UI.DropDown input"


inputname = IN[0] if len(IN) > 0 else ""
entries = IN[1] if len(IN) > 1 else []
values = IN[2] if len(IN) > 2 else []
defaultvalue = IN[3] if len(IN) > 3 else None
sorted_items = IN[4] if len(IN) > 4 else False

OUT = dropdown(inputname, entries, values, defaultvalue, sorted_items)
# ----------------------------------------
DropDown_input = Output(python_script)
