# Dynamo custom node Duplicate Element.dyf (Dynamo 3.3.0.6316)
# category: Data-Shapes.Revit.Elements
# Duplicates all types of elements including view templates

Elements = Input(Elements: var[]..[])
python_script = Python(IN[0]=Elements)  # CPython3
# ---------- python_script.python (51 lines) ----------
# Copyright (c) Data Shapes, 2025
# Data-Shapes www.data-shapes.io, elayoubi.mostafa@data-shapes.io @data_shapes

import clr

clr.AddReference('RevitAPI')
from Autodesk.Revit.DB import (
    Transaction,
    ElementId,
    ElementTransformUtils,
    Transform,
    CopyPasteOptions
)

clr.AddReference('RevitServices')
from RevitServices.Persistence import DocumentManager

from System.Collections.Generic import List

doc = DocumentManager.Instance.CurrentDBDocument


def tolist(input):
    if isinstance(input, list):
        return input
    return [input]


elems = [UnwrapElement(v) for v in tolist(IN[0])]

ids = [elem.Id for elem in elems]
elementlist = List[ElementId](ids)

t = Transaction(doc, 'Duplicate Elements')
t.Start()
try:
    copyid = ElementTransformUtils.CopyElements(
        doc,
        elementlist,
        doc,
        Transform.Identity,
        CopyPasteOptions()
    )
    newviews = [doc.GetElement(id) for id in copyid]
    t.Commit()
except Exception as ex:
    if t.HasStarted():
        t.RollBack()
    raise

OUT = newviews
# ----------------------------------------
OUT = Output(python_script)
