# Dynamo custom node Element(s) cut.dyf (Dynamo 3.3.0.6316)
# category: Data-Shapes.Revit.Elements
# Cutting element(s) with element

ElementToBeCut = Input(ElementToBeCut: Revit.Elements.Element)
CuttingElements = Input(CuttingElements: Revit.Elements.Element)
python_script = Python(IN[0]=ElementToBeCut, IN[1]=CuttingElements)  # CPython3
# ---------- python_script.python (56 lines) ----------
# Copyright (c) Data Shapes, 2025
# Data-Shapes www.data-shapes.io, elayoubi.mostafa@data-shapes.io

import clr

clr.AddReference('RevitAPI')
from Autodesk.Revit.DB import Transaction
from Autodesk.Revit.DB.SolidSolidCutUtils import AddCutBetweenSolids

clr.AddReference('RevitServices')
from RevitServices.Persistence import DocumentManager

doc = DocumentManager.Instance.CurrentDBDocument


def tolist(input):
    if isinstance(input, list):
        return input
    return [input]


elements_to_cut = tolist(IN[0])
cutting_element = IN[1]

if not elements_to_cut:
    OUT = "Error: No elements to cut provided"
elif cutting_element is None:
    OUT = "Error: No cutting element provided"
else:
    tobecut = [UnwrapElement(e) for e in elements_to_cut]
    cutting = UnwrapElement(cutting_element)
    
    success_count = 0
    failed_count = 0
    errors = []
    
    t = Transaction(doc, 'Add Cut Between Solids')
    t.Start()
    try:
        for element in tobecut:
            try:
                AddCutBetweenSolids(doc, element, cutting)
                success_count += 1
            except Exception as ex:
                failed_count += 1
                errors.append(str(ex))
        t.Commit()
    except Exception as ex:
        if t.HasStarted():
            t.RollBack()
        raise
    
    if failed_count == 0:
        OUT = '%d element(s) cut successfully' % success_count
    else:
        OUT = '%d element(s) cut successfully, %d failed' % (success_count, failed_count)
# ----------------------------------------
OUT = Output(python_script)
