# Dynamo custom node Excel.Worksheets.dyf (Dynamo 3.3.0.6316)
# category: Data-Shapes.Interop.Excel
# Gets worksheet names from specified Excel workbook.

FilePath = Input(FilePath: var[]..[])
python_script = Python(IN[0]=FilePath)  # CPython3
# ---------- python_script.python (7 lines) ----------
# Copyright (c) Data Shapes, 2025
# Data-Shapes www.data-shapes.io, elayoubi.mostafa@data-shapes.io @data_shapes

from openpyxl import load_workbook

wb = load_workbook(IN[0], read_only=True)
OUT = wb.sheetnames
# ----------------------------------------
Worksheet_Names = Output(python_script)
