# Dynamo custom node Export Views to NavisWorks.dyf (Dynamo 3.3.0.6316)
# category: Data-Shapes.Export
# exports 3d views to NavisWorks

views = Input(views_: var[])
Directorypath = Input(Directorypath_: var[])
prefix = Input(prefix_: var[])
python_script = Python(IN[0]=views, IN[1]=Directorypath, IN[2]=prefix)  # CPython3
# ---------- python_script.python (94 lines) ----------
# Copyright (c) Data Shapes, 2025
# Data-Shapes www.data-shapes.io, elayoubi.mostafa@data-shapes.io @data_shapes

import clr
import os

clr.AddReference('RevitAPI')
from Autodesk.Revit.DB import (
    NavisworksExportOptions, NavisworksExportScope, OptionalFunctionalityUtils
)

clr.AddReference('RevitServices')
from RevitServices.Persistence import DocumentManager


def tolist(input):
    if isinstance(input, list):
        return input
    return [input]


def export_views_to_nwc(folder, prefix, views):
    doc = DocumentManager.Instance.CurrentDBDocument
    
    try:
        if not OptionalFunctionalityUtils.IsNavisworksExporterAvailable():
            return (
                "Navisworks Exporter is not installed. "
                "Please download and install the 'Navisworks NWC Export Utility' from Autodesk website, "
                "then restart Revit.",
                []
            )
    except Exception:
        pass
    
    if not folder or not os.path.isdir(folder):
        return ("Invalid folder path: {}".format(folder), [])
    
    views_list = tolist(views)
    
    if not views_list:
        return ("No views provided for export.", [])
    
    results = []
    errors = []
    
    for v in views_list:
        view = v.InternalElement if hasattr(v, 'InternalElement') else v
        
        nop = NavisworksExportOptions()
        nop.ExportScope = NavisworksExportScope.View
        nop.ViewId = view.Id
        
        export_name = "{}{}".format(prefix, view.Name) if prefix else view.Name
        
        try:
            export_result = doc.Export(folder, export_name, nop)
            results.append({
                'view': view.Name,
                'success': export_result,
                'path': os.path.join(folder, "{}.nwc".format(export_name))
            })
        except Exception as ex:
            error_msg = str(ex)
            if "Navisworks Exporter is not available" in error_msg:
                return (
                    "Navisworks Exporter is not installed. "
                    "Please download and install the 'Navisworks NWC Export Utility' from Autodesk website, "
                    "then restart Revit.",
                    []
                )
            errors.append("Failed to export '{}': {}".format(view.Name, error_msg))
    
    success_count = sum(1 for r in results if r.get('success', False))
    total_count = len(views_list)
    
    if errors:
        message = "Exported {}/{} views. Errors: {}".format(
            success_count, total_count, "; ".join(errors)
        )
    else:
        message = "Successfully exported {} view(s) to NWC.".format(success_count)
    
    return (message, results)


views = IN[0] if len(IN) > 0 else []
folder = IN[1] if len(IN) > 1 else None
prefix = IN[2] if len(IN) > 2 else ""

message, results = export_views_to_nwc(folder, prefix, views)

success_paths = [r['path'] for r in results if r.get('success', False)]
OUT = message, success_paths
# ----------------------------------------
OUT = Output(python_script)
