# Dynamo custom node Export to FBX.dyf (Dynamo 3.3.0.6316)
# category: Data-Shapes.Export
# Exports 3D views to FBX format

ExportFolderPath = Input(ExportFolderPath_: string)
prefix = Input(prefix_: string)
ThreeDView = Input(ThreeDView_: var[])
python_script = Python(IN[0]=ExportFolderPath, IN[1]=prefix, IN[2]=ThreeDView)  # CPython3
# ---------- python_script.python (93 lines) ----------
# Copyright (c) Data Shapes, 2025
# Data-Shapes www.data-shapes.io, elayoubi.mostafa@data-shapes.io @data_shapes

import clr
import os

clr.AddReference('RevitAPI')
from Autodesk.Revit.DB import (
    Transaction, ViewSet, FBXExportOptions, View3D, OptionalFunctionalityUtils
)

clr.AddReference('RevitServices')
from RevitServices.Persistence import DocumentManager


def tolist(input):
    if isinstance(input, list):
        return input
    return [input]


def export_views_to_fbx(folder, prefix, views):
    doc = DocumentManager.Instance.CurrentDBDocument
    
    if not OptionalFunctionalityUtils.IsFBXExportAvailable():
        return ("FBX export functionality is not available in this Revit installation.", [])
    
    if not folder or not os.path.isdir(folder):
        return ("Invalid folder path: {}".format(folder), [])
    
    views_list = tolist(views)
    
    if not views_list:
        return ("No views provided for export.", [])
    
    results = []
    errors = []
    options = FBXExportOptions()
    
    t = Transaction(doc, 'Export Views to FBX')
    t.Start()
    
    try:
        for v in views_list:
            view = v.InternalElement if hasattr(v, 'InternalElement') else v
            
            if not isinstance(view, View3D):
                errors.append("View '{}' is not a 3D view - skipped.".format(view.Name))
                continue
            
            vset = ViewSet()
            vset.Insert(view)
            
            export_name = "{}{}".format(prefix, view.Name) if prefix else view.Name
            
            try:
                export_result = doc.Export(folder, export_name, vset, options)
                results.append({
                    'view': view.Name,
                    'success': export_result,
                    'path': os.path.join(folder, "{}.fbx".format(export_name))
                })
            except Exception as ex:
                errors.append("Failed to export '{}': {}".format(view.Name, str(ex)))
        
        t.Commit()
        
    except Exception as ex:
        if t.HasStarted():
            t.RollBack()
        return ("Export failed: {}".format(str(ex)), [])
    
    success_count = sum(1 for r in results if r.get('success', False))
    total_count = len(views_list)
    
    if errors:
        message = "Exported {}/{} views. Errors: {}".format(
            success_count, total_count, "; ".join(errors)
        )
    else:
        message = "Successfully exported {} view(s) to FBX.".format(success_count)
    
    return (message, results)


folder = IN[0] if len(IN) > 0 else None
prefix = IN[1] if len(IN) > 1 else ""
views = IN[2] if len(IN) > 2 else []

message, results = export_views_to_fbx(folder, prefix, views)

success_paths = [r['path'] for r in results if r.get('success', False)]
OUT = message, success_paths
# ----------------------------------------
OUT = Output(python_script)
