# Dynamo custom node FilePath Data.dyf (Dynamo 3.3.0.6316)
# category: Data-Shapes.UI.Input
# Create filepath input for UI.MultipleInputForm ++ . Check out www.data-shapes.net for more infos !

InputName = Input(InputName: string = "")
DefaulPath = Input(DefaulPath: string = "FilePath")
ButtonText = Input(ButtonText: string = "FilePath")  # Is ignored if a default path is given
python_script = Python(IN[0]=InputName, IN[1]=DefaulPath, IN[2]=ButtonText)  # CPython3
# ---------- python_script.python (53 lines) ----------
# Copyright (c) Data Shapes, 2025
# Data-Shapes www.data-shapes.io, elayoubi.mostafa@data-shapes.io @data_shapes

import os
import clr

clr.AddReference('System.Windows.Forms')
from System.Windows.Forms import OpenFileDialog, DialogResult


class uifilepath(object):

    def __init__(self, inputname="", defaultvalue="FilePath", buttontext="Select File"):
        self.inputname = inputname if inputname is not None else ""
        self.defaultvalue = defaultvalue if defaultvalue is not None else "FilePath"
        self.buttontext = buttontext if buttontext is not None else "Select File"
        self._input_type = 'uifilepath'

    def __repr__(self):
        return 'UI.FilePath input'

    def openfile(self, sender, event):
        try:
            ofd = OpenFileDialog()
            start_path = None
            if isinstance(sender.Tag, str) and sender.Tag:
                start_path = sender.Tag
            elif isinstance(self.defaultvalue, str) and self.defaultvalue and self.defaultvalue != "FilePath":
                start_path = self.defaultvalue

            if start_path:
                if os.path.isdir(start_path):
                    ofd.InitialDirectory = start_path
                elif os.path.isfile(start_path):
                    ofd.InitialDirectory = os.path.dirname(start_path)
                    ofd.FileName = start_path
                else:
                    ofd.FileName = start_path

            dr = ofd.ShowDialog()
            if dr == DialogResult.OK:
                selected_path = ofd.FileName
                sender.Text = selected_path
                sender.Tag = selected_path
        except:
            pass


inputname = IN[0] if len(IN) > 0 else ""
defaultvalue = IN[1] if len(IN) > 1 else "FilePath"
buttontext = IN[2] if len(IN) > 2 else "Select File"

OUT = uifilepath(inputname, defaultvalue, buttontext)
# ----------------------------------------
FilePath_input = Output(python_script)
