# Dynamo custom node Filter.IsApplied.dyf (Dynamo 3.3.0.6316)
# category: Data-Shapes.Revit.Elements
# Returns a boolean values indicating wether a ParameterFilterElement is applied to any view in the project or not.

ParameterFilterElement = Input(ParameterFilterElement_: var[]..[])
isApplied = Python(IN[0]=ParameterFilterElement)  # "Filter.IsApplied"; CPython3
# ---------- isApplied.python (38 lines) ----------
# Copyright (c) Data Shapes, 2025
# Data-Shapes www.data-shapes.io, elayoubi.mostafa@data-shapes.io @data_shapes

import clr

clr.AddReference('RevitAPI')
from Autodesk.Revit.DB import FilteredElementCollector, View

clr.AddReference('RevitServices')
from RevitServices.Persistence import DocumentManager

doc = DocumentManager.Instance.CurrentDBDocument


def tolist(input):
    if isinstance(input, list):
        return input
    return [input]


allViews = [v for v in FilteredElementCollector(doc).OfClass(View).ToElements() if v.IsValidObject]

parameterFilterElements = tolist(UnwrapElement(IN[0]))

appliedFilters = []

for view in allViews:
    try:
        viewFilters = view.GetFilters()
        for viewFilter in viewFilters:
            if viewFilter not in appliedFilters:
                appliedFilters.append(viewFilter)
    except:
        pass

isApplied = [pfe.Id in appliedFilters for pfe in parameterFilterElements]

OUT = isApplied
# ----------------------------------------
bool = Output(isApplied)
