# Dynamo custom node Geometry.PruneDuplicates.dyf (Dynamo 3.3.0.6316)
# category: Data-Shapes.Geometry
# Removes all duplicate geometries from list.

GeometryList = Input(GeometryList: var[]..[])
python_script = Python(IN[0]=GeometryList)  # CPython3
# ---------- python_script.python (52 lines) ----------
# Copyright (c) Data Shapes, 2025
# @data_shapes, www.data-shapes.io, contact@data-shapes.io

import clr

clr.AddReference('ProtoGeometry')
from Autodesk.DesignScript.Geometry import *


def tolist(input):
    if isinstance(input, list):
        return input
    return [input]


def surfsol_to_sorted_vertices(surfsol):
    return ",".join(sorted([str(v) for v in surfsol.Vertices]))


def curve_to_sorted_vertices(cv):
    nbs = cv.ToNurbsCurve()
    return ",".join(sorted([str(p) for p in nbs.ControlPoints()]))


def pt_to_sorted_vertices(pt):
    return str(pt)


unique = []
unique_str = []

g = tolist(IN[0])

for geom in g:
    try:
        key = surfsol_to_sorted_vertices(geom)
        if key not in unique_str:
            unique_str.append(key)
            unique.append(geom)
    except:
        try:
            key = curve_to_sorted_vertices(geom)
            if key not in unique_str:
                unique_str.append(key)
                unique.append(geom)
        except:
            key = pt_to_sorted_vertices(geom)
            if key not in unique_str:
                unique_str.append(key)
                unique.append(geom)

OUT = unique
# ----------------------------------------
UniqueItems = Output(python_script)
