# Dynamo custom node Get All Linked Docs infos.dyf (Dynamo 3.3.0.6316)
# category: Data-Shapes.Revit.Document
# Get all linked documents names and paths

Doc_FilePath = Input(Doc_FilePath_: var = false)
Refresh = Input(Refresh_: bool = false)
python_script = Python(IN[0]=Doc_FilePath, IN[1]=Refresh)  # CPython3
# ---------- python_script.python (143 lines) ----------
# Copyright (c) Data Shapes, 2025
# Data-Shapes www.data-shapes.io, elayoubi.mostafa@data-shapes.io

import clr
import os

clr.AddReference('RevitAPI')
from Autodesk.Revit.DB import (
    ModelPathUtils,
    TransmissionData,
    ExternalFileReferenceType,
    ExternalFileUtils,
    RevitLinkType,
    ImportInstance,
    FilteredElementCollector
)

clr.AddReference('RevitServices')
from RevitServices.Persistence import DocumentManager

doc = DocumentManager.Instance.CurrentDBDocument


def _to_user_path(model_path):
    if model_path is None:
        return ""
    try:
        return ModelPathUtils.ConvertModelPathToUserVisiblePath(model_path) or ""
    except:
        return ""


def _file_size_kb(path_str):
    try:
        if path_str and os.path.exists(path_str):
            kb = os.path.getsize(path_str) / 1024.0
            return "{:.0f} Kb".format(kb)
    except:
        pass
    return "File not found"


def _basename(path_str):
    try:
        return os.path.basename(path_str) if path_str else ""
    except:
        return ""


def _safe_get_external_ref(doc, element_id_or_elemid):
    try:
        return ExternalFileUtils.GetExternalFileReference(doc, element_id_or_elemid)
    except:
        return None


input_path = IN[0] if IN[0] else None
use_offline = False

if input_path:
    try:
        if doc.PathName and os.path.normcase(os.path.abspath(input_path)) != os.path.normcase(os.path.abspath(doc.PathName)):
            use_offline = True
    except:
        use_offline = True

rvtpaths = []
cadpaths = []
cadLinkState = []

if not use_offline:
    rvt_types = FilteredElementCollector(doc).OfClass(RevitLinkType)
    for lt in rvt_types:
        try:
            eref = lt.GetExternalFileReference()
        except:
            eref = _safe_get_external_ref(doc, lt.Id)

        if eref is None:
            continue

        if eref.ExternalFileReferenceType != ExternalFileReferenceType.RevitLink:
            continue

        path_str = _to_user_path(eref.GetAbsolutePath())
        if path_str:
            rvtpaths.append(path_str)

    cad_instances = FilteredElementCollector(doc).OfClass(ImportInstance)

    for ii in cad_instances:
        if ii.IsLinked:
            try:
                t = doc.GetElement(ii.GetTypeId())
                eref = _safe_get_external_ref(doc, t.Id) if t else None
            except:
                eref = None

            path_str = ""
            if eref is not None:
                path_str = _to_user_path(eref.GetAbsolutePath())

            cadpaths.append(path_str)
            cadLinkState.append("Linked")

        else:
            cadpaths.append("")
            cadLinkState.append("Imported")

if use_offline and input_path:
    fp = ModelPathUtils.ConvertUserVisiblePathToModelPath(input_path)
    transdata = TransmissionData.ReadTransmissionData(fp)

    if transdata is not None:
        extref_ids = list(transdata.GetAllExternalFileReferenceIds())

        for ref_id in extref_ids:
            eref = transdata.GetLastSavedReferenceData(ref_id)
            if eref is None:
                continue

            ref_type = eref.ExternalFileReferenceType
            path_str = _to_user_path(eref.GetAbsolutePath())
            if not path_str:
                continue

            if ref_type == ExternalFileReferenceType.RevitLink:
                rvtpaths.append(path_str)

            elif ref_type == ExternalFileReferenceType.CADLink:
                cadpaths.append(path_str)
                cadLinkState.append("Unknown (offline)")

rvtnames = [_basename(p) for p in rvtpaths]
rvtsize = [_file_size_kb(p) for p in rvtpaths]

cadnames = [_basename(p) for p in cadpaths]
cadsize = [_file_size_kb(p) for p in cadpaths]

OUT = (
    [rvtnames, rvtpaths, rvtsize],
    [cadnames, cadpaths, cadsize, cadLinkState]
)
# ----------------------------------------
code_block = CodeBlock(out=python_script)
# ---------- code_block.designscript (14 lines) ----------
//Rvt links names
out[0][0];
//Rvt links paths
out[0][1];
//Rvt links size
out[0][2];
//Dwg links names
out[1][0];
//Dwg links paths
out[1][1];
//Dwg links size
out[1][2];
//Dwg imported
out[1][3];
# ----------------------------------------
Rvt_links_names = Output(code_block.out0)
Rvt_links_paths = Output(code_block.out1)
Rvt_links_size = Output(code_block.out2)
Dwg_links_names = Output(code_block.out3)
Dwg_links_paths = Output(code_block.out4)
Dwg_links_size = Output(code_block.out5)
Dwg_is_imported = Output(code_block.out6)
