# Dynamo custom node GetAllElementsFromLinks++.dyf (Dynamo 3.3.0.6316)
# category: Data-Shapes.Revit.Document
# Get all elements of category or type from given documents

Documents = Input(Documents_: var[]..[])
CategoryOrType = Input(CategoryOrType: var[]..[])
python_script = Python(IN[0]=Documents, IN[1]=CategoryOrType)  # CPython3
# ---------- python_script.python (46 lines) ----------
# Copyright (c) Data Shapes, 2025
# Data-Shapes www.data-shapes.io, elayoubi.mostafa@data-shapes.io @data_shapes

import clr

clr.AddReference('ProtoGeometry')
from Autodesk.DesignScript.Geometry import *

clr.AddReference('RevitAPI')
from Autodesk.Revit.DB import (
    ElementCategoryFilter,
    FilteredElementCollector,
    ElementId
)

import traceback


def tolist(input):
    if isinstance(input, list):
        return input
    return [input]


_linkDocs = tolist(IN[0])
filterInfo = IN[1]
resultList = []
errorReport = None

try:
    for _linkDoc in _linkDocs:
        filter = ElementCategoryFilter(ElementId(filterInfo.Id))
        result = FilteredElementCollector(_linkDoc).WherePasses(filter).WhereElementIsNotElementType().ToElements()
        resultList.append(result)
except:
    try:
        for _linkDoc in _linkDocs:
            result = FilteredElementCollector(_linkDoc).OfClass(filterInfo).ToElements()
            resultList.append(result)
    except:
        errorReport = traceback.format_exc()

if errorReport is None:
    OUT = resultList
else:
    OUT = errorReport
# ----------------------------------------
Elements = Output(python_script)
