# Dynamo custom node GetLinkedElement.InHostView.dyf (Dynamo 3.3.0.6316)
# category: Data-Shapes.Revit.Elements
# Gets linked elements in host view(s).

HostView = Input(HostView: var[]..[])
LinkDoc = Input(LinkDoc: var[]..[])
Refresh = Input(Refresh: bool = true)
python_script = Python(IN[0]=HostView, IN[1]=LinkDoc, IN[2]=Refresh)  # CPython3
# ---------- python_script.python (91 lines) ----------
# Copyright (c) Data Shapes, 2025
# Data-Shapes www.data-shapes.io, elayoubi.mostafa@data-shapes.io

import clr

clr.AddReference('RevitAPI')
from Autodesk.Revit.DB import (
    Document, FilteredElementCollector, ElementCategoryFilter,
    LogicalOrFilter, LogicalAndFilter, BoundingBoxIntersectsFilter,
    Outline, XYZ, PlanViewPlane, BuiltInCategory, ElementFilter
)

clr.AddReference('RevitServices')
from RevitServices.Persistence import DocumentManager

from System.Collections.Generic import List

doc = DocumentManager.Instance.CurrentDBDocument


def tolist(input):
    if isinstance(input, list):
        return input
    return [input]


linkdoc = IN[1]
views = tolist(UnwrapElement(IN[0]))

collector = []

basepointfilter = ElementCategoryFilter(BuiltInCategory.OST_ProjectBasePoint)
basepoint = FilteredElementCollector(doc).WherePasses(basepointfilter).ToElements()
bpelevation = [b.ParametersMap.get_Item('Elev').AsDouble() for b in basepoint]

cats = doc.Settings.Categories
cids = [c.Id for c in cats]

try:
    from Autodesk.Revit.DB import UnitType
    UIunit = Document.GetUnits(doc).GetFormatOptions(UnitType.UT_Length).DisplayUnits
except:
    from Autodesk.Revit.DB import SpecTypeId
    UIunit = Document.GetUnits(doc).GetFormatOptions(SpecTypeId.Length).GetUnitTypeId()

for v in views:
    filtercatids = [x for x in cids if not v.GetCategoryHidden(x)]
    
    catfilters = []
    for i in filtercatids:
        catfilters.append(ElementCategoryFilter(i))
    
    catfilterlist = List[ElementFilter](catfilters)
    catfilter = LogicalOrFilter(catfilterlist)
    
    bb = v.CropBox
    vr = v.GetViewRange()
    topclip = PlanViewPlane.TopClipPlane
    bottomclip = PlanViewPlane.BottomClipPlane
    cutclip = PlanViewPlane.CutPlane
    
    toplevel = doc.GetElement(vr.GetLevelId(topclip))
    topoffset = vr.GetOffset(topclip)
    cutlevel = doc.GetElement(vr.GetLevelId(cutclip))
    cutoffset = vr.GetOffset(cutclip)
    
    try:
        topZ = toplevel.Elevation + topoffset - bpelevation[0]
    except:
        topZ = cutlevel.Elevation + cutoffset - bpelevation[0]
    
    bottomlevel = doc.GetElement(vr.GetLevelId(bottomclip))
    bottomoffset = vr.GetOffset(bottomclip)
    
    try:
        bottomZ = bottomlevel.Elevation + bottomoffset - bpelevation[0]
    except:
        bottomZ = cutlevel.Elevation - bpelevation[0]
    
    min_pt = bb.Min
    max_pt = bb.Max
    newmin = XYZ(min_pt.X, min_pt.Y, bottomZ)
    newmax = XYZ(max_pt.X, max_pt.Y, topZ)
    ol = Outline(newmin, newmax)
    
    bbfilter = BoundingBoxIntersectsFilter(ol)
    andfilter = LogicalAndFilter(catfilter, bbfilter)
    
    collector.append(FilteredElementCollector(linkdoc).WherePasses(andfilter).ToElements())

OUT = collector
# ----------------------------------------
elements = Output(python_script)
