# Dynamo custom node GetLinkedElement.InHostViewAndCategory.dyf (Dynamo 3.3.0.6316)
# category: Data-Shapes.Revit.Elements
# Gets linked elements in host view, filtered by category.

views = Input(views: var[])
LinkDoc = Input(LinkDoc: var[]..[])
Categories = Input(Categories_: var[]..[])
Refresh = Input(Refresh: bool = true)
python_script = Python(IN[0]=views, IN[1]=LinkDoc, IN[2]=Categories, IN[3]=Refresh)  # CPython3
# ---------- python_script.python (100 lines) ----------
# Copyright (c) mostafa el ayoubi, 2017
# Data-Shapes www.data-shapes.net, elayoubi.mostafa@gmail.com
# Ported to CPython + PythonNet 2.5

import clr

clr.AddReference('RevitAPI')
from Autodesk.Revit.DB import (
    Document, FilteredElementCollector, ElementCategoryFilter,
    LogicalOrFilter, LogicalAndFilter, BoundingBoxIntersectsFilter,
    Outline, XYZ, PlanViewPlane, BuiltInCategory, ElementFilter, ElementId
)

clr.AddReference('RevitServices')
from RevitServices.Persistence import DocumentManager

from System.Collections.Generic import List

doc = DocumentManager.Instance.CurrentDBDocument


def tolist(input):
    """Ensure input is a list."""
    if isinstance(input, list):
        return input
    return [input]


# Inputs
views = tolist(UnwrapElement(IN[0]))
linkdoc = IN[1]
categories = tolist(IN[2])

collector = []

# Getting project base point elevation
basepointfilter = ElementCategoryFilter(BuiltInCategory.OST_ProjectBasePoint)
basepoint = FilteredElementCollector(doc).WherePasses(basepointfilter).ToElements()
bpelevation = [b.ParametersMap.get_Item('Elev').AsDouble() for b in basepoint]

# Category filter - use ElementId instead of System.Enum.ToObject (PythonNet 2.5 compatible)
catfilters = []
for i in categories:
    # ElementCategoryFilter accepts ElementId, avoiding enum conversion issues
    cat_id = ElementId(int(str(i.Id)))
    catfilters.append(ElementCategoryFilter(cat_id))

catfilterlist = List[ElementFilter](catfilters)
filter = LogicalOrFilter(catfilterlist)

# Unit handling - 2021+ uses SpecTypeId, older uses UnitType
# Note: UIunit is defined for compatibility but not used in this script
try:
    from Autodesk.Revit.DB import UnitType
    UIunit = Document.GetUnits(doc).GetFormatOptions(UnitType.UT_Length).DisplayUnits
except:
    from Autodesk.Revit.DB import SpecTypeId
    UIunit = Document.GetUnits(doc).GetFormatOptions(SpecTypeId.Length).GetUnitTypeId()

for v in views:
    # Creating a boundingbox for each view from its crop box and view range
    bb = v.CropBox
    vr = v.GetViewRange()
    topclip = PlanViewPlane.TopClipPlane
    bottomclip = PlanViewPlane.BottomClipPlane
    cutclip = PlanViewPlane.CutPlane
    
    toplevel = doc.GetElement(vr.GetLevelId(topclip))
    topoffset = vr.GetOffset(topclip)
    cutlevel = doc.GetElement(vr.GetLevelId(cutclip))
    cutoffset = vr.GetOffset(cutclip)
    
    try:
        topZ = toplevel.Elevation + topoffset - bpelevation[0]
    except:
        topZ = cutlevel.Elevation + cutoffset - bpelevation[0]
    
    bottomlevel = doc.GetElement(vr.GetLevelId(bottomclip))
    bottomoffset = vr.GetOffset(bottomclip)
    
    try:
        bottomZ = bottomlevel.Elevation + bottomoffset - bpelevation[0]
    except:
        bottomZ = cutlevel.Elevation - bpelevation[0]
    
    # Avoid shadowing Python built-ins min/max
    min_pt = bb.Min
    max_pt = bb.Max
    newmin = XYZ(min_pt.X, min_pt.Y, bottomZ)
    newmax = XYZ(max_pt.X, max_pt.Y, topZ)
    ol = Outline(newmin, newmax)
    
    # Combining boundingbox and category filters
    bbfilter = BoundingBoxIntersectsFilter(ol)
    andfilter = LogicalAndFilter(filter, bbfilter)
    
    # Collecting elements from linked document
    collector.append(FilteredElementCollector(linkdoc).WherePasses(andfilter).ToElements())

OUT = collector
# ----------------------------------------
elements = Output(python_script)
