# Dynamo custom node Grid.SetVerticalExtents.dyf (Dynamo 3.3.0.6316)
# category: Data-Shapes.Revit.Grids
# Set the vertical extents of all project grids

GridsToAdjust = Input(GridsToAdjust: var = true)  # Will take all grids if no input
BottomExtent = Input(BottomExtent: var[]..[])
TopExtent = Input(TopExtent: var[]..[])
python_script = Python(IN[0]=GridsToAdjust, IN[1]=BottomExtent, IN[2]=TopExtent)  # CPython3
# ---------- python_script.python (60 lines) ----------
# Copyright (c) mostafa el ayoubi
# Node-mode www.data-shapes.net 2016 elayoub.mostafa@gmail.com
# Ported to CPython + PythonNet 2.5

import clr

clr.AddReference('RevitAPI')
from Autodesk.Revit.DB import (
    Document,
    FilteredElementCollector,
    Grid,
    Transaction,
    UnitUtils
)

clr.AddReference('RevitServices')
from RevitServices.Persistence import DocumentManager

doc = DocumentManager.Instance.CurrentDBDocument

# Unit handling - support both pre-2021 and 2021+ API
try:
    from Autodesk.Revit.DB import UnitType
    UIunit = Document.GetUnits(doc).GetFormatOptions(UnitType.UT_Length).DisplayUnits
except:
    from Autodesk.Revit.DB import SpecTypeId
    UIunit = Document.GetUnits(doc).GetFormatOptions(SpecTypeId.Length).GetUnitTypeId()


def convunit(x):
    """Convert from display units to internal units."""
    return UnitUtils.ConvertToInternalUnits(x, UIunit)


def tolist(input):
    """Ensure input is a list."""
    if isinstance(input, list):
        return input
    return [input]


# Get grids - either from input or collect all from document
if IN[0] is True:
    grids = [UnwrapElement(i) for i in FilteredElementCollector(doc).OfClass(Grid)]
else:
    grids = [UnwrapElement(i) for i in tolist(IN[0])]

# Set vertical extents with proper transaction handling
t = Transaction(doc, 'Set Grid Vertical Extents')
t.Start()
try:
    for g in grids:
        g.SetVerticalExtents(convunit(IN[1]), convunit(IN[2]))
    t.Commit()
except Exception as ex:
    if t.HasStarted():
        t.RollBack()
    raise

OUT = grids
# ----------------------------------------
OUT = Output(python_script)
