# Dynamo custom node Image Data.dyf (Dynamo 3.3.0.6316)
# category: Data-Shapes.UI.Input
# Places an image on UI.MultipleInutForm ++ .

ImageTitle = Input(ImageTitle: string = "")
Image = Input(Image_: var[]..[])
ShowBorder_optional = Input(ShowBorder_optional: bool = true)
python_script = Python(IN[0]=ImageTitle, IN[1]=Image, IN[2]=ShowBorder_optional)  # CPython3
# ---------- python_script.python (71 lines) ----------
# Copyright (c) Data Shapes, 2025
# Data-Shapes www.data-shapes.io, elayoubi.mostafa@data-shapes.io @data_shapes

import clr

clr.AddReference('System')
clr.AddReference('System.Drawing')
clr.AddReference('System.Windows.Forms')
from System import Uri
from System.Drawing import Image, Size
from System.IO import MemoryStream
from System.Net import WebClient
from System.Windows.Forms import PictureBox, PictureBoxSizeMode, BorderStyle


class uiimage(object):

    def __init__(self, inputname="", image="", showborder=False):
        self.inputname = inputname if inputname is not None else ""
        self.image = image if image is not None else ""
        self.showborder = bool(showborder)
        self._input_type = "uiimage"

    def __repr__(self):
        return "UI.Image input"

    def _load_image(self):
        if not self.image:
            return None

        try:
            path = str(self.image)
            if path.startswith(("http://", "https://")):
                data = WebClient().DownloadData(Uri(path))
                return Image.FromStream(MemoryStream(data))
            return Image.FromFile(path)
        except Exception:
            return None

    def create_picture_box(self, max_width):
        pb = PictureBox()
        if self.showborder:
            pb.BorderStyle = BorderStyle.Fixed3D
        else:
            pb.BorderStyle = getattr(BorderStyle, "None")

        width = max(int(max_width), 1) if max_width is not None else 1

        pic = self._load_image()

        if pic is not None:
            try:
                ratio = float(pic.Height) / float(pic.Width) if pic.Width else 1.0
            except Exception:
                ratio = 1.0
            height = int(width * ratio) if width > 0 else 1
            pb.Size = Size(width, max(height, 1))
            pb.Image = pic
            pb.SizeMode = PictureBoxSizeMode.Zoom
        else:
            pb.Size = Size(width, width)
            pb.SizeMode = PictureBoxSizeMode.CenterImage

        return pb


inputname = IN[0] if len(IN) > 0 else ""
image = IN[1] if len(IN) > 1 else ""
showborder = IN[2] if len(IN) > 2 else False

OUT = uiimage(inputname, image, showborder)
# ----------------------------------------
Image_input = Output(python_script)
