# Dynamo custom node ImportInstance.IsLinked.dyf (Dynamo 3.3.0.6316)
# category: Data-Shapes.Revit.Elements
# Returns boolean info indicating wether an ImportInstance is linked or not (meaning it's imported).

ImportInstance = Input(ImportInstance_: var[]..[])
isLinked = Python(IN[0]=ImportInstance)  # CPython3
# ---------- isLinked.python (21 lines) ----------
# Copyright (c) Data Shapes - Mostafa El Ayoubi, 2018
# @data_shapes, www.data-shapes.io, contact@data-shapes.io
# Ported to CPython + PythonNet 2.5

import clr

clr.AddReference('RevitAPI')
from Autodesk.Revit.DB import ImportInstance


def tolist(input):
    """Ensure input is a list."""
    if isinstance(input, list):
        return input
    return [input]


importInstances = tolist(IN[0])
unwrapped = [UnwrapElement(i) for i in importInstances]

OUT = [importInstance.IsLinked for importInstance in unwrapped]
# ----------------------------------------
bool = Output(isLinked)
