# Dynamo custom node InputGroup Data.dyf (Dynamo 3.3.0.6316)
# category: Data-Shapes.UI.Input
# Creates a group of inputs for UI.MultipleInputForm ++ . Check out www.data-shapes.net for more infos !

GroupTitle = Input(GroupTitle: string = "")
Inputs = Input(Inputs: var[])
python_script = Python(IN[0]=GroupTitle, IN[1]=Inputs)  # CPython3
# ---------- python_script.python (26 lines) ----------
# Copyright (c) Data Shapes, 2025
# Data-Shapes www.data-shapes.io, elayoubi.mostafa@data-shapes.io @data_shapes


class uigroup(object):

    def __init__(self, inputname="", groupname="", inputgroup=None):
        self.inputname = inputname if inputname is not None else ""
        self.groupname = groupname if groupname is not None else ""
        if inputgroup is None:
            self.inputgroup = []
        elif isinstance(inputgroup, (list, tuple)):
            self.inputgroup = list(inputgroup)
        else:
            self.inputgroup = [inputgroup]
        self._input_type = "uigroup"

    def __repr__(self):
        return "UI.InputGroup"


groupname = IN[0] if len(IN) > 0 else ""
inputgroup = IN[1] if len(IN) > 1 else []
inputname = IN[2] if len(IN) > 2 else ""

OUT = uigroup(inputname, groupname, inputgroup)
# ----------------------------------------
Input_Group = Output(python_script)
