# Dynamo custom node Line LineStyle.dyf (Dynamo 3.3.0.6316)
# category: Data-Shapes.Revit.Lines
# Gives LineStyle name and element of Lines

Lines = Input(Lines: var[])
python_script = Python(IN[0]=Lines)  # CPython3
# ---------- python_script.python (34 lines) ----------
#Copyright (c) mostafa el ayoubi
#Data-Shapes 2016 elayoub.mostafa@gmail.com
# Ported to CPython + PythonNet 2.5

import clr

clr.AddReference('RevitServices')
from RevitServices.Persistence import DocumentManager

clr.AddReference('RevitAPI')
from Autodesk.Revit.DB import *

clr.AddReference('RevitNodes')
import Revit
clr.ImportExtensions(Revit.Elements)

doc = DocumentManager.Instance.CurrentDBDocument

def tolist(input):
    """Ensure input is a list."""
    if isinstance(input, list):
        return input
    return [input]

lines = [UnwrapElement(x) for x in tolist(IN[0])]

linestyles = []
linestyleids = []

for l in lines:
    linestyles.append(l.LineStyle.Name)
    linestyleids.append(l.LineStyle)

OUT = [linestyles, linestyleids]
# ----------------------------------------
code_block = CodeBlock(out=python_script) { out[0]; out[1]; }
LineStyle_name = Output(code_block.out0)
LineStyle_elemts = Output(code_block.out1)
