# Dynamo custom node Listview Data.dyf (Dynamo 3.3.0.6316)
# category: Data-Shapes.UI.Input
# Create data for ListView input in UI.MultiInputForm ++ . Check out www.data-shapes.net for more infos.

InputName = Input(InputName_: string = "")
Keys = Input(Keys_: var[])
Values = Input(Values_: var[]..[])
Height_optionnal = Input(Height_optionnal_: int = 200)
HilightInView_optionnal = Input(HilightInView_optionnal_: bool = false)  # If set to true, clicking elements of the listview will highlight them in a view like Dynamo's watch node
DisplayModeOnly_optionnal = Input(DisplayModeOnly_optionnal_: bool = false)  # Turns off ability to select elements. Form will not output any data for this element.
ShowElementCount_optionnal = Input(ShowElementCount_optionnal_: bool = false)  # Will display the number of elements underneath the input name
DefaultValueIndices_optionnal = Input(DefaultValueIndices_optionnal_: int[] = DSCore.List.Empty)
SortItems_optionnal = Input(SortItems_optionnal_: bool = true)  # Determines wether the ListView items are sorted or not
ShowId_optionnal = Input(ShowId_optionnal_: bool = true)  # Warning: disabling this will cause the listview input creation to fail in case there are elements with the same name
python_script = Python(IN[0]=InputName, IN[1]=Keys, IN[2]=Values, IN[3]=Height_optionnal, IN[4]=HilightInView_optionnal, IN[5]=DisplayModeOnly_optionnal, IN[6]=ShowElementCount_optionnal, IN[7]=DefaultValueIndices_optionnal, IN[8]=SortItems_optionnal, IN[9]=ShowId_optionnal)  # CPython3
# ---------- python_script.python (509 lines) ----------
# Copyright (c) Data Shapes, 2025
# Data-Shapes www.data-shapes.io, elayoubi.mostafa@data-shapes.io @data_shapes

import clr
import System
import unicodedata

try:
    clr.AddReference("System.Windows.Forms")
    clr.AddReference("System.Drawing")
    from System.Windows.Forms import (
        ListView,
        ColumnHeader,
        ColumnHeaderStyle,
        RadioButton,
        CheckState,
        Panel,
        FlowLayoutPanel,
        TableLayoutPanel,
        ColumnStyle,
        RowStyle,
        SizeType,
        FlowDirection,
        Padding,
        DockStyle,
        AnchorStyles,
        View as vi,
    )
    from System.Windows.Forms import SortOrder as _SortOrder
    from System.Drawing import Point, Color, SystemFonts, Size
except Exception:
    # Allow import in non-Dynamo environments; handlers will no-op if missing
    ListView = None
    ColumnHeader = None
    ColumnHeaderStyle = None
    RadioButton = None
    CheckState = None
    vi = None
    _SortOrder = None
    Point = None
    SystemFonts = None
    FlowLayoutPanel = None
    TableLayoutPanel = None
    ColumnStyle = None
    RowStyle = None
    SizeType = None
    FlowDirection = None
    Padding = None
    DockStyle = None
    AnchorStyles = None
    Size = None

try:
    clr.AddReference("RevitAPI")
    clr.AddReference("RevitAPIUI")
    clr.AddReference("RevitNodes")
    import Revit

    clr.ImportExtensions(Revit.Elements)
    clr.ImportExtensions(Revit.GeometryConversion)
    from Autodesk.Revit.DB import FilteredElementCollector, ElementId, FamilyInstance, ViewFamilyType, ViewFamily, View
    
    from Autodesk.Revit.UI import Selection
    from RevitServices.Persistence import DocumentManager
    from System.Collections.Generic import List as GenericList

    _DOC = DocumentManager.Instance.CurrentDBDocument
    _UIDOC = DocumentManager.Instance.CurrentUIApplication.ActiveUIDocument
    _DBVIEWS = [v for v in FilteredElementCollector(_DOC).OfClass(View) if hasattr(v, "IsTemplate") and (not v.IsTemplate)]
    ElementIdList = GenericList[ElementId]
except Exception:
    Revit = None
    _DOC = None
    _UIDOC = None
    _DBVIEWS = []
    Selection = None
    FamilyInstance = None
    ElementId = None
    ElementIdList = None


class listview(object):

    def __init__(
        self,
        inputname="",
        entries=None,
        values=None,
        height=150,
        highlight=False,
        display_mode=None,
        count_from_entries=False,
        default_values=None,
        sorted_items=False,
        show_id=False,
        element_count=None,
    ):
        # public metadata consumed by the form
        self.inputname = inputname if inputname is not None else ""
        self.height = height if isinstance(height, (int, float)) else 150
        self.highlight = bool(highlight)
        self.display_mode = display_mode
        self.showId = bool(show_id)
        self._sorted = bool(sorted_items)
        self.default_values = self._normalize_list(default_values)
        self._input_type = "listview"

        labels = self._normalize_list(entries)
        vals = self._normalize_list(values)
        if len(vals) < len(labels):
            vals += [None] * (len(labels) - len(vals))

        # Build a stable label -> value map (same contract as dropdown)
        options = {}
        for i, lbl in enumerate(labels):
            val = vals[i]
            label_text = self._stringify(lbl)
            if self.showId and val is not None:
                vid = self._get_element_id(val)
                if vid is not None:
                    label_text = "{0}  -  id: {1}".format(label_text, vid)
            options[label_text] = val
        self.options = options

        # Element count used only for label decoration in the form
        if element_count is not None:
            self.element_count = element_count
        elif count_from_entries:
            self.element_count = len(labels)
        else:
            self.element_count = 0

    def build_listview(self, lv, width, xRatio, yRatio, form=None):
        if ListView is None or TableLayoutPanel is None:
            return None

        # Create container using TableLayoutPanel for proper stretching
        container = TableLayoutPanel()
        container.Dock = DockStyle.Top
        container.AutoSize = True
        container.AutoSizeMode = System.Windows.Forms.AutoSizeMode.GrowAndShrink
        container.ColumnCount = 1
        container.ColumnStyles.Add(ColumnStyle(SizeType.Percent, 100))
        container.RowCount = 0
        container.Margin = Padding(0)
        container.Padding = Padding(0)

        # Configure ListView - use Dock.Top for horizontal stretching
        lv.Dock = DockStyle.Top
        lv.Height = int(self.height * yRatio)
        lv.Scrollable = True
        lv.Values = self.options
        
        # Column header
        col = ColumnHeader()
        col.Text = ""
        col.Width = -2  # Auto-size to content
        lv.Columns.Add(col)
        
        # Hide header
        header_none = getattr(ColumnHeaderStyle, "None", None)
        if header_none is not None:
            lv.HeaderStyle = header_none
        
        # View mode
        view_default = getattr(vi, "Details", None)
        if view_default is not None:
            lv.View = view_default
        
        lv.CheckBoxes = not bool(self.display_mode)
        lv.FullRowSelect = bool(self.highlight) or bool(self.display_mode)
        lv.Margin = Padding(0, 0, 0, int(5 * yRatio))

        # Populate items
        labels = list(self.options.keys())
        labels = self._sorted_labels(labels)
        for lbl in labels:
            lv.Items.Add(lbl)

        # Apply defaults
        self._apply_defaults(lv, labels)

        # Highlight behavior
        if self.display_mode:
            lv.HideSelection = False
            lv.ItemSelectionChanged += self._setviewforelement
            lv.MouseUp += self._zoomcenter
        elif self.highlight:
            lv.MouseDown += self._setviewforelement
            lv.MouseUp += self._zoomcenter
            # Alternate row colors
            items = list(lv.Items)
            try:
                for i, item in enumerate(items):
                    if i % 2 == 1:
                        item.BackColor = Color.FromArgb(230, 243, 255)
            except Exception:
                pass

        # Add listview as first row
        container.RowCount += 1
        container.RowStyles.Add(RowStyle(SizeType.AutoSize))
        container.Controls.Add(lv, 0, container.RowCount - 1)

        # Select all/none buttons (only for checkbox mode)
        if lv.CheckBoxes:
            btn_row = self._create_select_buttons(lv, xRatio, yRatio)
            if btn_row:
                container.RowCount += 1
                container.RowStyles.Add(RowStyle(SizeType.AutoSize))
                container.Controls.Add(btn_row, 0, container.RowCount - 1)

        return container

    def _create_select_buttons(self, lv, xRatio, yRatio):
        if FlowLayoutPanel is None:
            return None
            
        btn_row = FlowLayoutPanel()
        btn_row.Dock = DockStyle.Top
        btn_row.FlowDirection = FlowDirection.LeftToRight
        btn_row.WrapContents = False
        btn_row.AutoSize = True
        btn_row.AutoSizeMode = System.Windows.Forms.AutoSizeMode.GrowAndShrink
        btn_row.Margin = Padding(0)

        rball = RadioButton()
        rball.Text = "Select all"
        rball.AutoSize = True
        rball.Margin = Padding(0, 0, int(15 * xRatio), 0)
        rball.Font = SystemFonts.DefaultFont if SystemFonts else None
        rball.Click += lambda sender, event: self.selectall(lv)
        btn_row.Controls.Add(rball)

        rbnone = RadioButton()
        rbnone.Text = "Select none"
        rbnone.AutoSize = True
        rbnone.Margin = Padding(0)
        rbnone.Font = SystemFonts.DefaultFont if SystemFonts else None
        rbnone.Click += lambda sender, event: self.selectnone(lv)
        btn_row.Controls.Add(rbnone)

        # Keep radio buttons in sync with checkbox state
        lv.ItemCheck += lambda sender, event: self._update_radio_state(sender, event, rball, rbnone)

        return btn_row

    def _update_radio_state(self, sender, event, rball, rbnone):
        if not (rball and rbnone):
            return
        try:
            checked_count = sender.CheckedItems.Count
            total_count = sender.Items.Count
            is_checking = event.NewValue == CheckState.Checked
            
            if is_checking:
                # Item being checked
                if checked_count == total_count - 1:
                    # This will make all checked
                    rball.Checked = True
                    rbnone.Checked = False
                else:
                    rball.Checked = False
                    rbnone.Checked = False
            else:
                # Item being unchecked
                if checked_count == 1:
                    # This will make none checked
                    rball.Checked = False
                    rbnone.Checked = True
                else:
                    rball.Checked = False
                    rbnone.Checked = False
        except Exception:
            pass

    def build_listview_panel(self, lv, formbody, xlabel, xinput, y, xRatio, yRatio, form=None):
        width = formbody.Width - int(25 * xRatio)
        result = self.build_listview(lv, width, xRatio, yRatio, form)
        if result:
            # For legacy compatibility, return (panel, next_y)
            return result, y + result.PreferredSize.Height + int(25 * yRatio)
        return None, y

    def _sorted_labels(self, labels):
        if self._sorted:
            try:
                return sorted(labels, key=lambda s: self._remove_accents(s))
            except Exception:
                return sorted(labels)
        return labels

    def _apply_defaults(self, lv, labels):
        defaults = self.default_values or []
        if not isinstance(defaults, list):
            try:
                defaults = list(defaults)
            except Exception:
                defaults = [defaults]

        label_map = {i: lbl for i, lbl in enumerate(labels)}
        for d in defaults:
            try:
                if isinstance(d, int):
                    lbl = label_map.get(d)
                    if lbl:
                        lv.Items[labels.index(lbl)].Checked = True
                else:
                    if d in labels:
                        lv.Items[labels.index(d)].Checked = True
                    else:
                        for i, lbl in enumerate(labels):
                            if self.options.get(lbl) == d:
                                lv.Items[i].Checked = True
            except Exception:
                pass

    def selectall(self, lv):
        try:
            for i in lv.Items:
                i.Checked = True
        except Exception:
            pass

    def selectnone(self, lv):
        try:
            for i in lv.Items:
                i.Checked = False
        except Exception:
            pass

    def _setviewforelement(self, sender, event):
        if Revit is None or _DOC is None or _UIDOC is None:
            return
        try:
            txt = None
            if hasattr(event, "Item"):
                txt = getattr(event.Item, "Text", None)
            if txt is None and hasattr(event, "X"):
                itm = sender.GetItemAt(event.X, event.Y)
                if itm:
                    txt = getattr(itm, "Text", None)
            if txt is None:
                itm = getattr(sender, "FocusedItem", None)
                if itm:
                    txt = getattr(itm, "Text", None)

            if not txt:
                return
            element = self.options.get(txt)
            if element is None:
                return
            
            internal_element = getattr(element, "InternalElement", None) or element
            elem_id = getattr(internal_element, "Id", None)
            if elem_id is None:
                return
            
            viewsforelement = []
            elem_class = internal_element.__class__
            for v in _DBVIEWS:
                try:
                    if v.IsTemplate:
                        continue
                    collector = FilteredElementCollector(_DOC, v.Id)
                    try:
                        found_ids = [e.Id for e in collector.OfClass(elem_class).ToElements()]
                    except Exception:
                        if FamilyInstance is not None:
                            found_ids = [e.Id for e in FilteredElementCollector(_DOC, v.Id).OfClass(FamilyInstance).ToElements()]
                        else:
                            continue
                    if any(fid.IntegerValue == elem_id.IntegerValue for fid in found_ids):
                        viewsforelement.append(v)
                except Exception:
                    continue
            
            if not viewsforelement:
                return
            
            current_view = _UIDOC.ActiveView
            target_view = None
            if current_view and current_view.Id in [v.Id for v in viewsforelement]:
                target_view = current_view
            else:
                target_view = viewsforelement[0]
            
            if target_view and (current_view is None or target_view.Id.IntegerValue != current_view.Id.IntegerValue):
                try:
                    _UIDOC.RequestViewChange(target_view)
                except Exception:
                    try:
                        _UIDOC.ActiveView = target_view
                    except Exception:
                        pass
            
            if ElementIdList and ElementId:
                try:
                    id_collection = ElementIdList()
                    id_collection.Add(elem_id)
                    _UIDOC.Selection.SetElementIds(id_collection)
                except Exception:
                    pass
        except Exception:
            pass

    def _zoomcenter(self, sender, event):
        if Revit is None or _DOC is None or _UIDOC is None:
            return
        try:
            txt = None
            if hasattr(event, "X"):
                itm = sender.GetItemAt(event.X, event.Y)
                if itm:
                    txt = getattr(itm, "Text", None)
            if txt is None:
                itm = getattr(sender, "FocusedItem", None)
                if itm:
                    txt = getattr(itm, "Text", None)
            if not txt:
                return
            elem_val = self.options.get(txt)
            if elem_val is None:
                return
            elem = getattr(elem_val, "InternalElement", None) or elem_val
            if elem is None:
                return
            elem_id = getattr(elem, "Id", None)
            if elem_id is not None:
                try:
                    _UIDOC.ShowElements(elem)
                except Exception:
                    try:
                        _UIDOC.ShowElements(elem_id)
                    except Exception:
                        pass
        except Exception:
            pass

    def _normalize_list(self, obj):
        if obj is None:
            return []
        if isinstance(obj, (list, tuple)):
            return list(obj)
        if isinstance(obj, str):
            return [obj]
        try:
            return list(obj)
        except Exception:
            return [obj]

    def _stringify(self, obj):
        try:
            return str(obj)
        except Exception:
            try:
                return obj.encode("utf-8").decode("utf-8")
            except Exception:
                return ""

    def _remove_accents(self, input_str):
        nfkd_form = unicodedata.normalize("NFKD", str(input_str))
        only_ascii = nfkd_form.encode("ASCII", "ignore")
        return only_ascii.decode("ASCII")

    def _get_element_id(self, val):
        try:
            vid = getattr(val, "Id", None)
            if vid is not None:
                return vid
        except Exception:
            pass
        try:
            internal = getattr(val, "InternalElement", None)
            if internal is not None:
                vid = getattr(internal, "Id", None)
                if vid is not None:
                    return vid
        except Exception:
            pass
        return None

    def __repr__(self):
        return "UI.ListView input"


inputname = IN[0] if len(IN) > 0 else ""
entries = IN[1] if len(IN) > 1 else []
values = IN[2] if len(IN) > 2 else []
height = IN[3] if len(IN) > 3 else 150
highlight = IN[4] if len(IN) > 4 else False
display_mode = IN[5] if len(IN) > 5 else None
count_from_entries = IN[6] if len(IN) > 6 else False
default_values = IN[7] if len(IN) > 7 else []
sorted_items = IN[8] if len(IN) > 8 else False
show_id = IN[9] if len(IN) > 9 else False

OUT = listview(
    inputname,
    entries,
    values,
    height,
    highlight,
    display_mode,
    count_from_entries,
    default_values,
    sorted_items,
    show_id,
)
# ----------------------------------------
ListView_input = Output(python_script)
