# Dynamo custom node ModificationTracker.GeometryChanges.dyf (Dynamo 3.3.0.6316)
# category: Data-Shapes.ModificationTracker
# Takes ExistingElements Data as input and outputs elements with same geometry and elements with changed geometry . Check out www.Data-Shapes.net for more infos

ExistingElementsData = Input(ExistingElementsData: var[]..[])
SortByCategory = Input(SortByCategory: bool = false)
python_script = Python(IN[0]=ExistingElementsData, IN[1]=SortByCategory)  # CPython3
# ---------- python_script.python (117 lines) ----------
# Copyright (c) mostafa el ayoubi, 2016
# Data-Shapes www.data-shapes.net, elayoubi.mostafa@gmail.com
# This node was inspired by Jeremy Tammik @Jeremytammik
# Ported to CPython + PythonNet 2.5

import clr

clr.AddReference('RevitAPI')
from Autodesk.Revit.DB import Options


def tolist(input):
    """Ensure input is a list."""
    if isinstance(input, list):
        return input
    return [input]


def flatten(container):
    """Flatten nested lists/tuples."""
    for i in container:
        if isinstance(i, (list, tuple)):
            for j in flatten(i):
                yield j
        else:
            yield i


def tostring(x):
    """Convert object to string representation."""
    return x.ToString()


def getgeomlist(x):
    """Get geometry elements as list from element."""
    return list(x.get_Geometry(Options()))


def getvertices(x):
    """Extract and return sorted vertex string representation for geometry comparison."""
    # Getting geometry elements as list
    geomelems = getgeomlist(x)
    
    # Getting nested instance geometry for all geometry instances
    while any('GeometryInstance' in g for g in map(tostring, geomelems)):
        for index, i in enumerate(geomelems):
            if 'GeometryInstance' in i.ToString():
                geomelems[index] = i.GetInstanceGeometry()
            else:
                continue
        geomelems = list(flatten(geomelems))
    
    # Getting all faces, keeping meshes
    faces = []
    for i in geomelems:
        if 'Solid' in i.ToString():
            faces.append(list(i.Faces))
        elif 'Mesh' in i.ToString():
            faces.append(i)
        else:
            continue
    faces = list(flatten(faces))
    
    # Getting all meshes
    meshes = []
    for f in faces:
        if 'Mesh' in f.ToString():
            meshes.append(f)
        else:
            meshes.append(f.Triangulate())
    
    # Getting all vertices
    vertexlist = []
    for m in meshes:
        vertexlist.append(list(m.Vertices))
    vertexlist = list(flatten(vertexlist))
    
    # Creating sorted vertex string representation of object for comparison
    vertexstr = ', '.join(sorted(set(map(tostring, vertexlist))))
    return vertexstr


# Main execution
if isinstance(IN[0][0], list):
    elementsA = UnwrapElement(IN[0][0])
    elementsB = UnwrapElement(IN[0][1])
else:
    elementsA = [UnwrapElement(IN[0][0])]
    elementsB = [UnwrapElement(IN[0][1])]

# Compare geometry
geomtest = []
categories = set([e.Category.Name for e in elementsA])

for eA, eB in zip(elementsA, elementsB):
    geomtest.append(getvertices(eA) == getvertices(eB))

# Categorize results
samegeometry = [i for (i, gt) in zip(elementsA, geomtest) if gt]
differentgeometry = [i for (i, gt) in zip(elementsA, geomtest) if not gt]

# Group by category if requested
samegeometrybycat = []
differentgeometrybycat = []
for c in categories:
    samegeometrybycat.append([s for s in samegeometry if s.Category.Name == c])
    differentgeometrybycat.append([d for d in differentgeometry if d.Category.Name == c])

report = '%d element(s) tested, \n%d element(s) with same geometry, \n%d element(s) with geometry modifications' % (
    len(elementsA), len(samegeometry), len(differentgeometry)
)

# Output based on groupByCategory flag (IN[1])
if IN[1] == True:
    OUT = samegeometrybycat, differentgeometrybycat, report
else:
    OUT = samegeometry, differentgeometry, report
# ----------------------------------------
code_block = CodeBlock(x=python_script)
# ---------- code_block.designscript (6 lines) ----------
//same geometry
x[0];
//different geometry
x[1];
//report
x[2];
# ----------------------------------------
Report = Output(code_block.out2)
Elements_with_same_geometry = Output(code_block.out0)
Elements_with_changed_geometry = Output(code_block.out1)
