# Dynamo custom node ModificationTracker.ModelComparison.dyf (Dynamo 3.3.0.6316)
# category: Data-Shapes.ModificationTracker
# Compares elements from documents A and B (A is the current document by default) and returns existing elements data, new elements, deleted elements and a report. Check out www.Data-Shapes.net for more infos.

CurrentVersionDocument = Input(CurrentVersionDocument: var = false)  # Most recent version of the model, current document by default
PreviousVersionDocument = Input(PreviousVersionDocument: var[]..[])  # Previous version of the model
Categories = Input(Categories_: var[]..[])
python_script = Python(IN[0]=CurrentVersionDocument, IN[1]=PreviousVersionDocument, IN[2]=Categories)  # CPython3
# ---------- python_script.python (98 lines) ----------
# Copyright (c) mostafa el ayoubi, 2016
# Data-Shapes www.data-shapes.net, elayoubi.mostafa@gmail.com
# Ported to CPython + PythonNet 2.5

import clr
import System
from System.Collections.Generic import List

clr.AddReference('RevitAPI')
from Autodesk.Revit.DB import (
    FilteredElementCollector,
    ElementCategoryFilter,
    LogicalOrFilter,
    ElementFilter,
    BuiltInCategory
)

clr.AddReference('RevitServices')
from RevitServices.Persistence import DocumentManager


def tolist(input):
    """Ensure input is a list."""
    if isinstance(input, list):
        return input
    return [input]


def reportformat(elements):
    """Format a report string summarizing elements by category."""
    if not elements:
        return ''
    val = [UnwrapElement(e).Category.Name for e in elements]
    values = set(val)
    newlist = [len([y for y in val if y == x]) for x in values]
    strreport = []
    for i, j in zip(values, newlist):
        strreport.append('%d %s element(s)' % (j, i))
    return ', '.join(strreport)


# Main execution

# Document A - current document or provided document
if IN[0] == False:
    docA = DocumentManager.Instance.CurrentDBDocument
else:
    docA = IN[0]

# Document B - get document from link instance
linkInstance = UnwrapElement(IN[1])
docB = linkInstance.GetLinkDocument()

# Category set input
CategorySet = IN[2]

# Getting list of categories
categories = tolist(IN[2])

# Getting all elements of wanted category set using category filters
catfilters = []
for i in categories:
    # Convert category Id to BuiltInCategory enum
    bic = System.Enum.ToObject(BuiltInCategory, int(str(i.Id)))
    catfilters.append(ElementCategoryFilter(bic))

# Create logical OR filter from all category filters
catfilterlist = List[ElementFilter](catfilters)
filter = LogicalOrFilter(catfilterlist)

# Collect elements from both documents
docAcollector = FilteredElementCollector(docA).WherePasses(filter).WhereElementIsNotElementType().ToElements()
docBcollector = FilteredElementCollector(docB).WherePasses(filter).WhereElementIsNotElementType().ToElements()

# GUID lists
docAguid = [e.UniqueId for e in docAcollector]
docBguid = [e.UniqueId for e in docBcollector]

# Sorting existing elements, new elements and deleted elements
existingguid = [e for e in docAguid if e in docBguid]
newguid = [e for e in docAguid if e not in docBguid]
deletedguid = [e for e in docBguid if e not in docAguid]

# Get actual elements from GUIDs
existingA = [docA.GetElement(e) for e in existingguid]
existingB = [docB.GetElement(e) for e in existingguid]
new = [docA.GetElement(e) for e in newguid]
deleted = [docB.GetElement(e) for e in deletedguid]

# Generate reports
newreport = reportformat(new)
deletedreport = reportformat(deleted)

report = 'The model contains %d elements of the selected categories, there are %d new elements and %d deleted elements compared to the previous indice. \nNew elements : ' % (
    len(docAcollector), len(new), len(deleted)
) + newreport + '\nDeleted elements : ' + deletedreport

OUT = (existingA, existingB), new, deleted, report
# ----------------------------------------
code_block = CodeBlock(x=python_script)
# ---------- code_block.designscript (8 lines) ----------
//existing elements
x[0];
//new
x[1];
//deleted
x[2];
//report
x[3];
# ----------------------------------------
Report = Output(code_block.out3)
ExistingElements_Data = Output(code_block.out0)
New_elements = Output(code_block.out1)
Deleted_elements = Output(code_block.out2)
