# Dynamo custom node ModificationTracker.ParameterChanges.dyf (Dynamo 3.3.0.6316)
# category: Data-Shapes.ModificationTracker
# takes ExistingElements Data as input and outputs elements with same parameter values and elements with changed parameter values. Check out www.Data-Shapes.net for more infos.

ExistingElementsData = Input(ExistingElementsData: var[]..[])
python_script = Python(IN[0]=ExistingElementsData)  # CPython3
# ---------- python_script.python (63 lines) ----------
# Copyright (c) mostafa el ayoubi, 2016
# Data-Shapes www.data-shapes.net, elayoubi.mostafa@gmail.com
# This node was inspired by Jeremy Tammik @Jeremytammik
# Ported to CPython + PythonNet 2.5

import clr

clr.AddReference('RevitAPI')
from Autodesk.Revit.DB import *

clr.AddReference('RevitServices')
from RevitServices.Persistence import DocumentManager

doc = DocumentManager.Instance.CurrentDBDocument


def tolist(input):
    """Ensure input is a list."""
    if isinstance(input, list):
        return input
    return [input]


def parametersnapshot(x):
    """Create a sorted string snapshot of all parameter names and values."""
    parameters = x.Parameters
    paramnames = [p.Definition.Name for p in parameters]
    sortedindex = sorted(range(len(paramnames)), key=lambda k: paramnames[k])
    sortedparameters = [paramnames[i] for i in sortedindex]
    
    paramvalues = []
    for p in parameters:
        if p.AsString() is not None:
            paramvalues.append(p.AsString())
        else:
            paramvalues.append(p.AsValueString())
    
    sortedvalues = [paramvalues[i] for i in sortedindex]
    return ', '.join(['%s : %s' % (param, value) for param, value in zip(sortedparameters, sortedvalues)])


# Main execution
if isinstance(IN[0][0], list):
    elementsA = UnwrapElement(IN[0][0])
    elementsB = UnwrapElement(IN[0][1])
else:
    elementsA = [UnwrapElement(IN[0][0])]
    elementsB = [UnwrapElement(IN[0][1])]

# Compare parameters
paramtest = []
for a, b in zip(elementsA, elementsB):
    paramtest.append(parametersnapshot(a) == parametersnapshot(b))

# Categorize results
sameparameters = [i for (i, m) in zip(elementsA, paramtest) if m]
differentparameters = [i for (i, m) in zip(elementsA, paramtest) if not m]

report = '%d element(s) tested, \n%d element(s) with same parameters, \n%d element(s) with parameter modifications' % (
    len(elementsA), len(sameparameters), len(differentparameters)
)

OUT = sameparameters, differentparameters, report
# ----------------------------------------
code_block = CodeBlock(x=python_script)
# ---------- code_block.designscript (6 lines) ----------
//same parameters
x[0];
//different parameters
x[1];
//report
x[2];
# ----------------------------------------
Report = Output(code_block.out2)
Elements_with_same_parameter_values = Output(code_block.out0)
Elements_with_changed_parameter_values = Output(code_block.out1)
