# Dynamo custom node MultiLanguage IO.dyf (Dynamo 3.3.0.6316)
# category: Data-Shapes.Language
# Takes inputs in different languages and returns the version that corresponds to the active Revit application language settings.

ENU = Input(ENU: string = "")
FRA = Input(FRA: string = "")
DEU = Input(DEU: string = "")
ITA = Input(ITA: string = "")
python_script = Python(IN[0]=ENU, IN[1]=FRA, IN[2]=DEU, IN[3]=ITA)  # IronPython2
# ---------- python_script.python (28 lines) ----------
#Copyright (c) Data Shapes, 2019
#Data-Shapes www.data-shapes.net, elayoubi.mostafa@data-shapes.io @data_shapes
#Ported to CPython + PythonNet 2.5

import clr

clr.AddReference('RevitServices')
from RevitServices.Persistence import DocumentManager

clr.AddReference('RevitAPI')
from Autodesk.Revit.DB import LanguageType

# Get application instance
uiapp = DocumentManager.Instance.CurrentUIApplication
app = uiapp.Application

# Get current Revit language
lang = app.Language

# Return appropriate input based on language
if lang == LanguageType.French:
    OUT = IN[1]
elif lang == LanguageType.German:
    OUT = IN[2]
elif lang == LanguageType.Italian:
    OUT = IN[3]
else:
    OUT = IN[0]
# ----------------------------------------
InActiveRevitLanguage = Output(python_script)
