# Dynamo custom node MultiLineTextBox Data.dyf (Dynamo 3.3.0.6316)
# category: Data-Shapes.UI.Input
# Creates a multi line textbox input for UI.MultipleInputForm ++

InputName = Input(InputName: string = "")
InputName_2 = Input(InputName: string = "")
IsNumberEntry = Input(IsNumberEntry: bool = false)
Height_Optionnal = Input(Height_Optionnal: int = 100)
python_script = Python(IN[0]=InputName, IN[1]=InputName_2, IN[2]=IsNumberEntry, IN[3]=Height_Optionnal)  # CPython3
# ---------- python_script.python (23 lines) ----------
# Copyright (c) Data Shapes, 2025
# Data-Shapes www.data-shapes.io, elayoubi.mostafa@data-shapes.io @data_shapes


class uimultilinetext(object):

    def __init__(self, inputname="", defaultvalue="", isnum=False, height=100):
        self.inputname = inputname if inputname is not None else ""
        self.defaultvalue = defaultvalue if defaultvalue is not None else ""
        self._isnum = isnum if isnum is not None else False
        self._height = height if height is not None else 100
        self._input_type = 'uimultilinetext'

    def __repr__(self):
        return 'UI.MultiLineTextbox input'


inputname = IN[0] if len(IN) > 0 else ""
defaultvalue = IN[1] if len(IN) > 1 else ""
isnum = IN[2] if len(IN) > 2 else False
height = IN[3] if len(IN) > 3 else 100

OUT = uimultilinetext(inputname, defaultvalue, isnum, height)
# ----------------------------------------
MultiLineTextBox_input = Output(python_script)
