# Dynamo custom node MultipleInputForm ++.dyf (Dynamo 3.3.0.6316)
# category: Data-Shapes.UI
# Create a form with multiple inputs.
# see www.data-shapes.net for tutorials and infos!

Inputs = Input(Inputs_: var[])
ButtonText_optional = Input(ButtonText_optional_: string = "Set Values")
Toggle = Input(Toggle_: bool = false)
Description_optional = Input(Description_optional_: string = "")
Logo_optional = Input(Logo_optional_: var = "")
LinkToHelp_optional = Input(LinkToHelp_optional_: string = null)
CancelButtonText_optional = Input(CancelButtonText_optional_: string = null)  # Cancel button will only be displayed if a label text is entered here
MaxHeight_optional = Input(MaxHeight_optional_: int = 0)
Width_optional = Input(Width_optional_: int = 400)
LabelWidth_optional = Input(LabelWidth_optional_: int = 140)
python_script = Python(IN[0]=Inputs, IN[1]=ButtonText_optional, IN[2]=Toggle, IN[3]=Description_optional, IN[4]=Logo_optional, IN[5]=LinkToHelp_optional, IN[6]=CancelButtonText_optional, IN[7]=MaxHeight_optional, IN[8]=Width_optional, IN[9]=LabelWidth_optional)  # CPython3
# ---------- python_script.python (1432 lines) ----------
# Copyright (c) Data Shapes, 2025
# Data-Shapes www.data-shapes.io, elayoubi.mostafa@data-shapes.io @data_shapes

import clr
import sys
import os
import unicodedata
import System
import tempfile
import re

from System import Uri, IntPtr, Char, Array
from System.Diagnostics import ProcessStartInfo, Process
from System.Collections.Generic import List as iList

clr.AddReference('System.Xml')
clr.AddReference('System.IO')
from System.Xml import XmlDocument
from System.IO import Directory, Path

clr.AddReference('System.Windows.Forms')
clr.AddReference('System.Drawing')
from System.Drawing import (
    Point, Size, Graphics, Bitmap, Image, Font, FontStyle, Icon, Color, 
    Region, Rectangle, ContentAlignment, SystemFonts, FontFamily
)
from System.Windows.Forms import (
    Application, DockStyle, MouseButtons, Button, Form, Label, TrackBar, ToolTip, 
    ColumnHeader, TextBox, CheckBox, ComboBox, ComboBoxStyle, FormBorderStyle, 
    FormStartPosition, ListView, ListViewItem, SortOrder, Panel, ImageLayout, 
    GroupBox, RadioButton, BorderStyle, PictureBox, PictureBoxSizeMode, LinkLabel, 
    CheckState, ColumnHeaderStyle, ImageList, VScrollBar, DataGridView, 
    DataGridViewSelectionMode, FlowLayoutPanel, DataGridViewAutoSizeColumnsMode, 
    DataGridViewClipboardCopyMode, TreeView, TreeNode, TreeNodeCollection, 
    AutoScaleMode, Screen, Padding, NativeWindow, View as vi, FlowDirection, 
    ScrollBars, AnchorStyles, TableLayoutPanel, ColumnStyle, RowStyle, SizeType
)

try:
    clr.AddReference("PresentationCore")
    clr.AddReference("WindowsBase")
    from System.Windows.Input import Key, Keyboard
except:
    pass

try:
    clr.AddReference('RevitAPIUI')
    from Autodesk.Revit.UI import Selection, TaskDialog
    from Autodesk.Revit.UI.Selection import ISelectionFilter
    clr.AddReference('RevitNodes')
    import Revit
    clr.ImportExtensions(Revit.Elements)
    clr.ImportExtensions(Revit.GeometryConversion)

    clr.AddReference('RevitServices')
    from RevitServices.Persistence import DocumentManager
    doc = DocumentManager.Instance.CurrentDBDocument
    uidoc = DocumentManager.Instance.CurrentUIApplication.ActiveUIDocument

    clr.AddReference('RevitAPI')
    try:
        from Autodesk.Revit.DB import ImageImportOptions
    except:
        from Autodesk.Revit.DB import ImageTypeOptions, ImageType, ImagePlacementOptions, ImageInstance
    from Autodesk.Revit.DB import (
        FilteredElementCollector, Transaction, View, ViewType, ViewFamily, ViewDrafting,
        ViewFamilyType, Element, ElementId, FamilyInstance, Document, XYZ, BoxPlacement, UnitUtils
    )

    try:
        from Autodesk.Revit.DB import UnitType
    except:
        from Autodesk.Revit.DB import SpecTypeId

    dbviews = [v for v in FilteredElementCollector(doc).OfClass(View).ToElements()
               if v.ViewType in (ViewType.FloorPlan, ViewType.CeilingPlan, ViewType.Section, ViewType.Elevation, ViewType.ThreeD)]
    viewindex = 0
    try:
        UIunit = Document.GetUnits(doc).GetFormatOptions(UnitType.UT_Length).DisplayUnits
    except:
        UIunit = Document.GetUnits(doc).GetFormatOptions(SpecTypeId.Length).GetUnitTypeId()

except:  # Sandbox, Formit or Civil 3D
    pass

importcolorselection = 0
try:
    from Autodesk.Revit.UI import ColorSelectionDialog
except:
    importcolorselection = 1

try:
    from Autodesk.Revit.DB import ImageTypeSource
except:
    pass

clr.AddReference('ProtoGeometry')
from Autodesk.DesignScript.Geometry import Point as dsPoint, Curve as dsCurve

from System.Reflection import Assembly

# LOGO HELPERS

def load_logo_image(logo_input):

    if logo_input is None or logo_input == '':
        return None, None
    
    try:
        if isinstance(logo_input, Bitmap):
            return logo_input, logo_input
        if isinstance(logo_input, Image):
            return logo_input, Bitmap(logo_input)
        
        if isinstance(logo_input, str):
            if logo_input.startswith(('http://', 'https://')):
                from System.Net import WebClient
                from System.IO import MemoryStream
                data = WebClient().DownloadData(logo_input)
                ms = MemoryStream(data)
                img = Image.FromStream(ms)
                return img, Bitmap(img)
            elif os.path.isfile(logo_input):
                return Image.FromFile(logo_input), Bitmap.FromFile(logo_input)
    except:
        pass
    return None, None


def get_default_logo():
    #Tries to get default Data-Shapes logo from package folder.
    try:
        dynamo = Assembly.Load('DynamoCore')
        version = str(dynamo.GetName().Version)[:3]
        dynPath = os.getenv('APPDATA') + "\\Dynamo\\Dynamo Revit\\" + version
        xdoc = XmlDocument()
        xdoc.Load(dynPath + "\\DynamoSettings.xml")
        
        for child in xdoc.DocumentElement:
            if child.Name == "CustomPackageFolders":
                for pathNode in child:
                    basePath = pathNode.InnerText
                    for subpath in [
                        basePath + "\\packages\\Data-Shapes\\extra\\a.png",
                        basePath + "\\Data-Shapes\\extra\\a.png"
                    ]:
                        if os.path.isfile(subpath):
                            return Image.FromFile(subpath), Bitmap.FromFile(subpath)
    except:
        pass
    return None, None


def create_logo_control(logo_input, xRatio, yRatio, logo_size=80):

    logo_img, logo_bmp = load_logo_image(logo_input)
    if logo_img is None:
        logo_img, logo_bmp = get_default_logo()
    
    if logo_img is None:
        return None, None
    
    logo_pb = PictureBox()
    scaled_size = int(logo_size * xRatio)
    ratio = float(logo_img.Height) / float(logo_img.Width)
    logo_pb.Size = Size(scaled_size, int(scaled_size * ratio))
    logo_pb.Image = logo_img
    logo_pb.SizeMode = PictureBoxSizeMode.Zoom
    logo_pb.Margin = Padding(0)
    
    icon = None
    try:
        thumb = logo_bmp.GetThumbnailImage(64, 64, logo_bmp.GetThumbnailImageAbort, IntPtr.Zero)
        thumb.MakeTransparent()
        icon = Icon.FromHandle(thumb.GetHicon())
    except:
        pass
    
    return logo_pb, icon


# HELPERS

def regexEndNum(input):
    try:
        return re.search(r'(\d+)$', input).group(0)
    except:
        return ""


def iterateThroughNodes(collection, li):
    if hasattr(collection, 'Nodes'):
        ntest = collection.Nodes
        if len(ntest) > 0:
            for i in ntest:
                iterateThroughNodes(i, li)
        else:
            if collection.Checked:
                li.append(collection.Tag)
    return li


def remove_accents(input_str):
    nfkd_form = unicodedata.normalize('NFKD', str(input_str))
    only_ascii = nfkd_form.encode('ASCII', 'ignore')
    return only_ascii.decode('ASCII')

#CUSTOM MESSAGE LOOP

class CustomMessageLoop(NativeWindow):
    def __init__(self, form):
        super().__init__()
        self.form = form
        self.AssignHandle(form.Handle)
        self.run_loop()

    def run_loop(self):
        while self.form.Visible:
            Application.DoEvents()

# CUSTOM CONTROLS

class myTextBox(TextBox):
    def __init__(self):
        super().__init__()
        self._isNum = False


class mylistview(ListView):
    def __init__(self):
        super().__init__()
        self.Values = {}


class mytrackbar(TrackBar):
    def __init__(self, startval=0, step=1):
        super().__init__()
        self.Tag = (startval, step)


class myDataGridView(DataGridView):
    def __init__(self):
        super().__init__()
        self.startcell = {}
        self.endcell = {}


class mygroupbox(GroupBox):
    def __init__(self):
        super().__init__()
        self.Values = []


class myConditionalPanel(Panel):
    def __init__(self):
        super().__init__()
        self._selected_option = None
        self._conditions = []
        self._grouped_inputs = []
        self._option_panels = []
        self._combobox = None
        self._config = None


# MAIN FORM

class MultiInputForm(Form):

    def __init__(self):
        super().__init__()
        self.Text = 'Data-Shapes | Multi Input UI ++'
        self.output = []
        self.values = []
        self.cancelled = True
        
        self.FormBorderStyle = FormBorderStyle.Sizable
        self.AutoScaleMode = AutoScaleMode.Dpi
        self.StartPosition = FormStartPosition.CenterScreen
        
        # Main layout: Header, Body, Footer
        self._main_layout = TableLayoutPanel()
        self._main_layout.Dock = DockStyle.Fill
        self._main_layout.ColumnCount = 1
        self._main_layout.ColumnStyles.Add(ColumnStyle(SizeType.Percent, 100))
        self._main_layout.RowCount = 3
        self._main_layout.RowStyles.Add(RowStyle(SizeType.AutoSize))
        self._main_layout.RowStyles.Add(RowStyle(SizeType.Percent, 100))
        self._main_layout.RowStyles.Add(RowStyle(SizeType.AutoSize))
        self._main_layout.Padding = Padding(10)
        self.Controls.Add(self._main_layout)

    def DiableAll(self):
        for c in self.Controls:
            c.Enabled = False

    def EnableAll(self):
        for c in self.Controls:
            c.Enabled = True

    def setclose(self, sender, event):
        if sender.Name == "Cancel":
            self.values = None
            self.cancelled = True
        else:
            self.cancelled = False
            self.values = [self._extract_value(f) for f in self.output]
        
        try:
            self.Close()
        except:
            pass

    def _extract_value(self, f):
        ftype = type(f).__name__
        
        if ftype == 'myTextBox':
            return float(f.Text) if f._isNum else f.Text
        
        if ftype == 'CheckBox':
            return f.Checked
        
        if ftype == 'Button':
            tag = f.Tag
            if isinstance(tag, list):
                try:
                    return [e for e in tag if e.__class__.__name__ != "Category"]
                except:
                    return tag
            else:
                try:
                    return [] if tag.__class__.__name__ == "Category" else tag
                except:
                    return tag
        
        if ftype == 'ComboBox':
            try:
                return f.Tag[f.Text] if f.Tag else None
            except:
                return None
        
        if ftype == 'mylistview':
            return [f.Values[i.Text] for i in f.CheckedItems]
        
        if ftype == 'mytrackbar':
            startval, step = f.Tag
            return startval + f.Value * step
        
        if ftype == 'myConditionalPanel':
            return f._selected_option
        
        if ftype in ('mygroupbox', 'GroupBox'):
            try:
                for ctrl in f.Controls:
                    if isinstance(ctrl, RadioButton) and ctrl.Checked:
                        key = ctrl.Text
                        return f.Tag[key] if (f.Tag and key in f.Tag) else key
                    if isinstance(ctrl, TableLayoutPanel):
                        for nested in ctrl.Controls:
                            if isinstance(nested, RadioButton) and nested.Checked:
                                key = nested.Text
                                return f.Tag[key] if (f.Tag and key in f.Tag) else key
                return None
            except:
                return None
        
        if ftype == 'myDataGridView':
            f.EndEdit()
            dsrc = f.DataSource
            out = []
            colcount = f.ColumnCount
            rowcount = f.RowCount - 1
            if f.Tag:
                out.append([dsrc.Columns[i].ColumnName for i in range(colcount)])
            for r in range(rowcount):
                out.append([dsrc.DefaultView[r].Row[i] for i in range(colcount)])
            return out
        
        if ftype == 'TreeView':
            getter = None
            try:
                tagval = getattr(f, "Tag", None)
                if callable(tagval):
                    getter = tagval
                elif isinstance(tagval, dict) and callable(tagval.get("get_values")):
                    getter = tagval.get("get_values")
            except:
                pass
            
            if getter:
                try:
                    return getter()
                except:
                    return []
            else:
                ls = []
                try:
                    iterateThroughNodes(f.Nodes[0], ls)
                except:
                    pass
                return ls
        
        if ftype == 'Label':
            return f.Tag if hasattr(f, "Tag") and f.Tag is not None else f.Text
        
        if ftype == 'PictureBox':
            return f.Tag if hasattr(f, "Tag") and f.Tag is not None else None
        
        return None

    def reset(self, sender, event):
        pass

    def openurl(self, sender, event):
        psi = ProcessStartInfo()
        psi.UseShellExecute = True
        psi.FileName = sender.Tag
        Process.Start(psi)

    def showtooltip(self, sender, event):
        ttp = ToolTip()
        ttp.AutoPopDelay = 10000
        ttp.SetToolTip(sender, sender.Tag)

    def numsOnly(self, sender, event):
        if not Char.IsDigit(event.KeyChar) and event.KeyChar != "." and not Char.IsControl(event.KeyChar):
            event.Handled = True

    # --- AutoCAD Handlers ---

    def _pick_acad(self, sender, single=False):
        self.DiableAll()
        try:
            marshal = System.Runtime.InteropServices.Marshal
            acadDoc = marshal.GetActiveObject("Autocad.Application").ActiveDocument
            acadDoc.Activate()
            user_var = acadDoc.GetVariable("users5")

            if single:
                pickbox = acadDoc.GetVariable("pickbox")
                acadDoc.SetVariable("pickbox", 5)
                acadDoc.SendCommand("(setq obj(car(entsel\042" + sender.Text + "\042))) ")
                acadDoc.SendCommand("(and obj(setvar\042users5\042(cdr(assoc 5(entget obj))))(setq obj nil)) ")
                res = acadDoc.GetVariable("users5")
                acadDoc.SetVariable("pickbox", pickbox)
                sender.Tag = acadDoc.HandleToObject(res)
            else:
                acadDoc.SendCommand("(and(princ\042" + sender.Text + "\042)(setq ss(ssget))(setvar\042users5\042\042LinkDWGUIOK\042)(command\042_.Select\042ss\042\042)) ")
                sel = acadDoc.ActiveSelectionSet
                acadDoc.SendCommand("(setq ss nil) ")
                if acadDoc.GetVariable("users5") == "LinkDWGUIOK" and sel:
                    sender.Tag = list(sel)

            acadDoc.SetVariable("users5", user_var)
        except:
            pass
        self.EnableAll()

    def pickautocadobjects(self, sender, event):
        self._pick_acad(sender, single=False)

    def pickautocadobject(self, sender, event):
        self._pick_acad(sender, single=True)

    # --- Chart Handlers ---

    def chart_showLabels(self, sender, event):
        try:
            chart = sender.Parent.GetChildAtPoint(Point(0, 0))
            for s in chart.Series:
                if s.ChartType == SeriesChartType.Pie:
                    s["PieLabelStyle"] = "Inside" if sender.Checked else "Disabled"
                else:
                    s.IsValueShownAsLabel = sender.Checked
        except:
            pass

    def chart_showLegend(self, sender, event):
        try:
            chart = sender.Parent.GetChildAtPoint(Point(0, 0))
            if len(chart.Legends) > 0:
                target_leg = chart.Legends[1] if len(chart.Legends) > 1 else chart.Legends[0]
                target_leg.Enabled = sender.Checked
        except:
            pass

    def imageexport(self, sender, event):
        pass


# INPUT BUILDER

class InputBuilder:

    def __init__(self, form, parent, config):
        self.form = form
        self.config = config
        self.xRatio = config.get('xRatio', 1)
        self.yRatio = config.get('yRatio', 1)
        self.importcolorselection = config.get('importcolorselection', 0)
        self.margin = int(5 * self.yRatio)
        self.label_ratio = 0.35
        self.parent = parent

        self.table = TableLayoutPanel()
        self.table.Dock = DockStyle.Top
        self.table.AutoSize = True
        self.table.AutoSizeMode = System.Windows.Forms.AutoSizeMode.GrowOnly
        self.table.ColumnCount = 1
        self.table.ColumnStyles.Add(ColumnStyle(SizeType.Percent, 100))
        self.table.RowCount = 0
        self.table.Padding = Padding(0)
        self.table.Margin = Padding(0)

        parent.Controls.Add(self.table)

    def _add_row(self, control):
        self.table.RowCount += 1
        self.table.RowStyles.Add(RowStyle(SizeType.AutoSize))
        if not isinstance(control, (Label,)) or control.AutoSize == False:
            control.Dock = DockStyle.Top
        control.Margin = Padding(0, self.margin, 0, self.margin)
        self.table.Controls.Add(control, 0, self.table.RowCount - 1)

    def _create_labeled_row(self, label_text, control):
        row = TableLayoutPanel()
        row.Dock = DockStyle.Top
        row.AutoSize = True
        row.AutoSizeMode = System.Windows.Forms.AutoSizeMode.GrowAndShrink
        row.ColumnCount = 2
        row.RowCount = 1
        row.ColumnStyles.Add(ColumnStyle(SizeType.Percent, self.label_ratio * 100))
        row.ColumnStyles.Add(ColumnStyle(SizeType.Percent, (1 - self.label_ratio) * 100))
        row.RowStyles.Add(RowStyle(SizeType.AutoSize))
        row.Margin = Padding(0)
        row.Padding = Padding(0)

        lbl = Label()
        lbl.Text = label_text
        lbl.AutoSize = True
        lbl.Anchor = AnchorStyles.Left | AnchorStyles.Top
        lbl.Margin = Padding(0, int(4 * self.yRatio), int(5 * self.xRatio), 0)
        
        # Set MaximumSize to enable proper text wrapping with unlimited height growth for input labels
        def update_label_max_width(sender=None, args=None, label=lbl, row_panel=row, ratio=self.label_ratio, x_ratio=self.xRatio):
            try:
                row_width = row_panel.ClientSize.Width
                if row_width > 0:
                    label_width = int(row_width * ratio) - int(10 * x_ratio)
                    label.MaximumSize = Size(max(50, label_width), 0)
            except:
                pass
        
        row.Resize += update_label_max_width
        row.Layout += update_label_max_width
        
        # Set initial max width based on form size
        try:
            form_width = self.form.ClientSize.Width - int(40 * self.xRatio)
            initial_max_width = int(form_width * self.label_ratio) - int(10 * self.xRatio)
            lbl.MaximumSize = Size(max(50, initial_max_width), 0)
        except:
            lbl.MaximumSize = Size(int(120 * self.xRatio), 0)
        
        row.Controls.Add(lbl, 0, 0)

        control.Dock = DockStyle.Top
        control.Margin = Padding(0)
        row.Controls.Add(control, 1, 0)

        return row

    def _register(self, control):
        self.form.output.append(control)

    @property
    def content_height(self):
        return self.table.PreferredSize.Height

    # INPUT TYPE HANDLERS

    def handle_uitext(self, j):
        tb = myTextBox()
        tb.Text = str(j.defaultvalue) if j.defaultvalue is not None else ""
        tb.Height = int(22 * self.yRatio)
        
        if getattr(j, '_isnum', False):
            tb._isNum = True
            tb.KeyPress += self.form.numsOnly

        if j.inputname:
            row = self._create_labeled_row(j.inputname, tb)
            self._add_row(row)
        else:
            self._add_row(tb)

        self._register(tb)

    def handle_uimultilinetext(self, j):
        tb = myTextBox()
        tb.Text = str(j.defaultvalue) if j.defaultvalue is not None else ""
        tb.Multiline = True
        tb.ScrollBars = ScrollBars.Vertical
        tb.Height = int(getattr(j, '_height', 100) * self.yRatio)
        
        if getattr(j, '_isnum', False):
            tb._isNum = True
            tb.KeyPress += self.form.numsOnly

        if j.inputname:
            row = self._create_labeled_row(j.inputname, tb)
            self._add_row(row)
        else:
            self._add_row(tb)

        self._register(tb)

    def handle_dropdown(self, j):
        cb = ComboBox()
        cb.DropDownStyle = ComboBoxStyle.DropDownList
        cb.Sorted = getattr(j, '_sorted', False)
        cb.Height = int(22 * self.yRatio)
        
        options = getattr(j, 'options', {}) or {}
        cb.Tag = options
        for key in options.keys():
            cb.Items.Add(str(key))

        default = getattr(j, 'defaultvalue', None)
        if default is not None:
            try:
                if 0 <= default < cb.Items.Count:
                    cb.SelectedIndex = default
            except:
                pass

        if j.inputname:
            row = self._create_labeled_row(j.inputname, cb)
            self._add_row(row)
        else:
            self._add_row(cb)

        self._register(cb)

    def handle_uibool(self, j):
        cb = CheckBox()
        cb.Text = getattr(j, 'booltext', '')
        cb.Checked = getattr(j, 'defaultvalue', False)
        cb.AutoSize = True

        if j.inputname:
            row = self._create_labeled_row(j.inputname, cb)
            self._add_row(row)
        else:
            self._add_row(cb)

        self._register(cb)

    def handle_uislider(self, j):
        container = TableLayoutPanel()
        container.Dock = DockStyle.Top
        container.AutoSize = True
        container.ColumnCount = 2
        container.RowCount = 1
        container.ColumnStyles.Add(ColumnStyle(SizeType.Absolute, int(50 * self.xRatio)))
        container.ColumnStyles.Add(ColumnStyle(SizeType.Percent, 100))
        container.RowStyles.Add(RowStyle(SizeType.AutoSize))

        defval = j.defaultvalue if j.defaultvalue != '' else j.minimum

        val_label = Label()
        val_label.Text = str(defval)
        val_label.AutoSize = True
        val_label.Anchor = AnchorStyles.Left | AnchorStyles.Top
        val_label.Margin = Padding(0, int(8 * self.yRatio), int(5 * self.xRatio), 0)
        container.Controls.Add(val_label, 0, 0)

        sl = mytrackbar(j.minimum, j.step)
        sl.Minimum = 0
        sl.Maximum = int((j.maximum - j.minimum) / j.step)
        sl.Value = int((defval - j.minimum) / j.step)
        sl.TickFrequency = max(1, int((j.maximum - j.minimum) / j.step / 10))
        sl.Height = int(35 * self.yRatio)
        sl.Dock = DockStyle.Top

        def on_scroll(sender, args, lbl=val_label, minimum=j.minimum, step=j.step):
            lbl.Text = str(minimum + sender.Value * step)
        sl.Scroll += on_scroll

        container.Controls.Add(sl, 1, 0)

        if j.inputname:
            row = self._create_labeled_row(j.inputname, container)
            self._add_row(row)
        else:
            self._add_row(container)

        self._register(sl)

    def handle_uiradio(self, j):
        gb = mygroupbox()
        gb.Text = getattr(j, 'grouptitle', '') or ''
        gb.Dock = DockStyle.Top
        gb.AutoSize = True
        gb.AutoSizeMode = System.Windows.Forms.AutoSizeMode.GrowAndShrink
        gb.Padding = Padding(int(10 * self.xRatio), int(15 * self.yRatio), int(10 * self.xRatio), int(10 * self.yRatio))

        rb_table = TableLayoutPanel()
        rb_table.Dock = DockStyle.Fill
        rb_table.AutoSize = True
        rb_table.ColumnCount = 1
        rb_table.ColumnStyles.Add(ColumnStyle(SizeType.Percent, 100))
        rb_table.RowCount = 0
        gb.Controls.Add(rb_table)

        options = getattr(j, 'options', {}) or {}
        gb.Tag = options
        labels = list(options.keys())
        default_key = getattr(j, 'defaultvalue', None)

        for i, lbl in enumerate(labels):
            rb = RadioButton()
            rb.Text = str(lbl)
            rb.AutoSize = True
            rb.Margin = Padding(0, int(2 * self.yRatio), 0, int(2 * self.yRatio))
            
            if default_key is not None and str(lbl) == str(default_key):
                rb.Checked = True
            elif i == 0 and default_key is None:
                rb.Checked = True

            rb_table.RowCount += 1
            rb_table.RowStyles.Add(RowStyle(SizeType.AutoSize))
            rb_table.Controls.Add(rb, 0, rb_table.RowCount - 1)

        if j.inputname:
            row = self._create_labeled_row(j.inputname, gb)
            self._add_row(row)
        else:
            self._add_row(gb)

        self._register(gb)

    def handle_uigroup(self, j):
        gb = mygroupbox()
        gb.Text = getattr(j, 'groupname', '') or getattr(j, 'inputname', '') or ''
        gb.Dock = DockStyle.Top
        gb.AutoSize = True
        gb.AutoSizeMode = System.Windows.Forms.AutoSizeMode.GrowAndShrink
        gb.Padding = Padding(int(10 * self.xRatio), int(15 * self.yRatio), int(10 * self.xRatio), int(10 * self.yRatio))

        inner_inputs = getattr(j, 'inputgroup', []) or []
        if not isinstance(inner_inputs, (list, tuple)):
            inner_inputs = [inner_inputs]

        inner_builder = InputBuilder(self.form, gb, self.config)
        for inp in inner_inputs:
            inner_builder.build(inp)

        self._add_row(gb)

    def handle_uitextnote(self, j):
        gb = GroupBox()
        title = getattr(j, 'title', None)
        gb.Text = title if title is not None else (getattr(j, 'inputname', '') or '')
        gb.Dock = DockStyle.Top
        gb.AutoSize = True
        gb.AutoSizeMode = System.Windows.Forms.AutoSizeMode.GrowAndShrink
        gb.Padding = Padding(
            int(10 * self.xRatio),
            int(5 * self.yRatio),
            int(10 * self.xRatio),
            int(10 * self.yRatio)
        )
        
        text_val = getattr(j, 'textnote', None)
        text_content = str(text_val) if text_val is not None else ''

        note = Label()
        note.Text = text_content
        note.Tag = text_content
        note.AutoSize = True
        note.Dock = DockStyle.Top
        
        # Set MaximumSize to enable text wrapping - width will be constrained, height unlimited
        def update_label_max_width(sender=None, args=None, label=note, groupbox=gb, x_ratio=self.xRatio):
            try:
                available_width = groupbox.ClientSize.Width - int(20 * x_ratio)
                if available_width > 0:
                    label.MaximumSize = Size(available_width, 0)
            except:
                pass
        
        gb.Resize += update_label_max_width
        gb.Layout += update_label_max_width
        
        # Set initial max width based on form size
        try:
            form_width = self.form.ClientSize.Width - int(60 * self.xRatio)
            note.MaximumSize = Size(max(100, form_width), 0)
        except:
            note.MaximumSize = Size(int(300 * self.xRatio), 0)
        
        gb.Controls.Add(note)

        self._add_row(gb)

    def handle_uiimage(self, j):
        if j.inputname:
            lbl = Label()
            lbl.Text = j.inputname
            lbl.AutoSize = True
            lbl.Margin = Padding(0, self.margin, 0, int(5 * self.yRatio))
            self._add_row(lbl)
        
        try:
            initial_width = self.parent.ClientSize.Width - int(20 * self.xRatio)
            if initial_width <= 0:
                initial_width = int(400 * self.xRatio)
        except:
            initial_width = int(400 * self.xRatio)
        
        pb = j.create_picture_box(initial_width)
        pb.Tag = j.image
        
        self._add_row(pb)
        self._register(pb)

    def handle_listview(self, j):
        if j.inputname:
            lbl = Label()
            lbl.Text = j.inputname
            lbl.AutoSize = True
            lbl.Margin = Padding(0, self.margin, 0, int(5 * self.yRatio))
            self._add_row(lbl)

        element_count = getattr(j, 'element_count', 0)
        if element_count:
            count_lbl = Label()
            count_lbl.Text = f"({element_count} elements)"
            count_lbl.AutoSize = True
            count_lbl.Margin = Padding(0, 0, 0, int(5 * self.yRatio))
            self._add_row(count_lbl)

        lv = mylistview()

        build_method = getattr(j, 'build_listview', None)
        if callable(build_method):
            try:
                result = build_method(lv, 0, self.xRatio, self.yRatio, self.form)
                if result is not None:
                    self._add_row(result)
                    self._register(lv)
                    return
            except:
                pass

        # fallback
        lv.Height = int(getattr(j, 'height', 150) * self.yRatio)
        lv.CheckBoxes = True
        if vi:
            lv.View = vi.Details
        lv.FullRowSelect = True
        lv.Scrollable = True

        col = ColumnHeader()
        col.Text = ""
        col.Width = -2
        lv.Columns.Add(col)

        try:
            header_none = getattr(ColumnHeaderStyle, "None", None)
            if header_none is not None:
                lv.HeaderStyle = header_none
        except:
            pass

        options = getattr(j, 'options', {}) or {}
        lv.Values = options
        for key in options.keys():
            lv.Items.Add(str(key))

        default_values = getattr(j, 'default_values', None)
        if default_values:
            labels = list(options.keys())
            defaults = default_values if isinstance(default_values, list) else [default_values]
            for d in defaults:
                try:
                    if isinstance(d, int) and 0 <= d < len(labels):
                        lv.Items[d].Checked = True
                    elif d in labels:
                        lv.Items[labels.index(d)].Checked = True
                except:
                    pass

        self._add_row(lv)
        self._register(lv)

    def handle_uitreeview(self, j):
        build_tree = getattr(j, 'build_treeview', None)

        if callable(build_tree):
            try:
                container = Panel()
                container.Dock = DockStyle.Top
                container.AutoSize = True
                container.AutoSizeMode = System.Windows.Forms.AutoSizeMode.GrowAndShrink

                tv, _ = build_tree(container, 0, 0, 0, self.xRatio, self.yRatio)
                if tv:
                    self._add_row(container)
                    self._register(tv)
                    return
            except:
                pass

        # fallback
        tv = TreeView()
        tv.CheckBoxes = True
        tv.Height = int(150 * self.yRatio)

        if j.inputname:
            row = self._create_labeled_row(j.inputname, tv)
            self._add_row(row)
        else:
            self._add_row(tv)

        self._register(tv)

    def handle_uiconditional(self, j):
        """
        All inputs from ALL options are built upfront and registered.
        Only the selected option's panel is visible.        
        Output order: selected option name first, then all inputs from each option, because we want to have a fixed number of outputs to handled in the script.
        """
        container = myConditionalPanel()
        container.BorderStyle = BorderStyle.FixedSingle
        container.Dock = DockStyle.Top
        container.AutoSize = True
        container.AutoSizeMode = System.Windows.Forms.AutoSizeMode.GrowAndShrink
        container.Padding = Padding(int(8 * self.xRatio))

        container._conditions = j._Conditions
        container._grouped_inputs = j._GroupedInputs
        container._config = self.config
        container._option_panels = []

        # register first so selected option comes before child inputs
        self._register(container)

        layout = TableLayoutPanel()
        layout.Dock = DockStyle.Fill
        layout.AutoSize = True
        layout.AutoSizeMode = System.Windows.Forms.AutoSizeMode.GrowAndShrink
        layout.ColumnCount = 1
        layout.ColumnStyles.Add(ColumnStyle(SizeType.Percent, 100))
        layout.RowCount = 2
        layout.RowStyles.Add(RowStyle(SizeType.AutoSize))
        layout.RowStyles.Add(RowStyle(SizeType.AutoSize))
        layout.Padding = Padding(0)
        layout.Margin = Padding(0)
        container.Controls.Add(layout)

        cb = ComboBox()
        cb.DropDownStyle = ComboBoxStyle.DropDownList
        cb.Dock = DockStyle.Top
        cb.Height = int(22 * self.yRatio)
        cb.Margin = Padding(0, 0, 0, int(10 * self.yRatio))
        
        for cond in j._Conditions:
            cb.Items.Add(str(cond))

        container._combobox = cb
        layout.Controls.Add(cb, 0, 0)

        content_container = Panel()
        content_container.Dock = DockStyle.Top
        content_container.AutoSize = True
        content_container.AutoSizeMode = System.Windows.Forms.AutoSizeMode.GrowAndShrink
        content_container.Margin = Padding(0)
        layout.Controls.Add(content_container, 0, 1)

        # build all options upfront
        for opt_idx, inputs in enumerate(j._GroupedInputs):
            option_panel = Panel()
            option_panel.Dock = DockStyle.Top
            option_panel.AutoSize = True
            option_panel.AutoSizeMode = System.Windows.Forms.AutoSizeMode.GrowAndShrink
            option_panel.Margin = Padding(0)
            option_panel.Visible = False
            
            if not isinstance(inputs, (list, tuple)):
                inputs = [inputs]
            
            inner_builder = InputBuilder(self.form, option_panel, self.config)
            for inp in inputs:
                if inp is not None:
                    inner_builder.build(inp)
            
            content_container.Controls.Add(option_panel)
            container._option_panels.append(option_panel)

        default_idx = j._defaultOptionIndex if j._defaultOptionIndex is not None else 0
        if 0 <= default_idx < len(j._Conditions):
            cb.SelectedIndex = default_idx
            container._selected_option = j._Conditions[default_idx]
            if default_idx < len(container._option_panels):
                container._option_panels[default_idx].Visible = True
        elif len(j._Conditions) > 0:
            cb.SelectedIndex = 0
            container._selected_option = j._Conditions[0]
            if len(container._option_panels) > 0:
                container._option_panels[0].Visible = True

        def on_selection_change(sender, args, cont=container):
            idx = sender.SelectedIndex
            if 0 <= idx < len(cont._conditions):
                cont._selected_option = cont._conditions[idx]
                for i, panel in enumerate(cont._option_panels):
                    panel.Visible = (i == idx)
                cont.PerformLayout()
                if cont.Parent:
                    cont.Parent.PerformLayout()

        cb.SelectedIndexChanged += on_selection_change

        self._add_row(container)

    # BUTTON-BASED INPUTS

    def _handle_button(self, j, callback, enabled=True, tag=None):
        btn = Button()
        btn.Text = getattr(j, 'buttontext', 'Select')
        btn.Height = int(28 * self.yRatio)

        if tag is not None:
            btn.Tag = tag
        else:
            btn.Tag = getattr(j, 'defaultvalue', None) or getattr(j, 'category', None)

        if enabled and callback:
            form_ref = self.form

            def on_click(sender, args, cb=callback):
                form_ref.DiableAll()
                try:
                    cb(sender, args)
                finally:
                    form_ref.EnableAll()

            btn.Click += on_click

            def_val = getattr(j, 'defaultvalue', None)
            if def_val and isinstance(def_val, str) and 'Path' not in def_val:
                btn.Tag = def_val
                btn.MouseHover += form_ref.showtooltip
        else:
            btn.Enabled = False
            btn.Text += " (Unavailable)"

        if j.inputname:
            row = self._create_labeled_row(j.inputname, btn)
            self._add_row(row)
        else:
            self._add_row(btn)

        self._register(btn)

    def handle_uifilepath(self, j):
        callback = getattr(j, 'openfile', None)
        self._handle_button(j, callback, enabled=callback is not None)

    def handle_uidirectorypath(self, j):
        callback = getattr(j, 'opendirectory', None)
        self._handle_button(j, callback, enabled=callback is not None)

    def handle_uicolorpick(self, j):
        available = self.importcolorselection == 0 and getattr(j, 'color_picker_available', True)
        callback = getattr(j, 'pickcolor', None)
        self._handle_button(j, callback, enabled=available and callback is not None)

    def handle_uiselectelements(self, j):
        multi = getattr(j, 'multi', False)
        callback = getattr(j, 'pickobjects' if multi else 'pickobject', None)
        self._handle_button(j, callback, enabled=callback is not None)

    def handle_uiselectelementsofcat(self, j):
        multi = getattr(j, 'multi', False)
        callback = getattr(j, 'pickobjectsofcat' if multi else 'pickobjectofcat', None)
        self._handle_button(j, callback, enabled=callback is not None, tag=getattr(j, 'category', None))

    def handle_uiselectlinkedelements(self, j):
        multi = getattr(j, 'multi', False)
        callback = getattr(j, 'picklinkedobjects' if multi else 'picklinkedobject', None)
        self._handle_button(j, callback, enabled=callback is not None)

    def handle_uiselectlinkedelementsofcat(self, j):
        multi = getattr(j, 'multi', False)
        callback = getattr(j, 'picklinkedobjectsofcat' if multi else 'picklinkedobjectofcat', None)
        self._handle_button(j, callback, enabled=callback is not None, tag=getattr(j, 'category', None))

    def handle_uiselectOrderedelements(self, j):
        callback = getattr(j, 'pickobjectsordered', None)
        self._handle_button(j, callback, enabled=callback is not None)

    def handle_uiselectOrderedelementsofcat(self, j):
        callback = getattr(j, 'pickobjectsofcatordered', None)
        self._handle_button(j, callback, enabled=callback is not None, tag=getattr(j, 'category', None))

    def handle_uiselectedges(self, j):
        callback = getattr(j, 'pickedges', None)
        self._handle_button(j, callback, enabled=callback is not None)

    def handle_uiselectfaces(self, j):
        callback = getattr(j, 'pickfaces', None)
        self._handle_button(j, callback, enabled=callback is not None)

    def handle_uiselectpointsonface(self, j):
        callback = getattr(j, 'pickpointsonface', None)
        self._handle_button(j, callback, enabled=callback is not None)

    # CHARTS

    def _handle_chart(self, j, chart_type_name):
        build_method = getattr(j, 'build_chart', None)
        
        if callable(build_method):
            try:
                panel, _ = build_method(self.table, 0, 0, 0, self.xRatio, self.yRatio, self.form)
                if panel is not None:
                    panel.Tag = {"parent": self.parent, "builder": self}
                    self._add_row(panel)
                    self._register(panel)
                    return
            except:
                pass

        err = Label()
        err.AutoSize = True
        err.Text = f"{chart_type_name} rendering unavailable."
        self._add_row(err)
        self._register(err)

    def handle_uibarchart(self, j):
        self._handle_chart(j, "Bar chart")

    def handle_uilinechart(self, j):
        self._handle_chart(j, "Line chart")

    def handle_uipiechart(self, j):
        self._handle_chart(j, "Pie chart")

    def handle_uipointchart(self, j):
        self._handle_chart(j, "Point chart")

    def handle_uisplinechart(self, j):
        self._handle_chart(j, "Spline chart")

    # TABLE VIEW

    def handle_tableview(self, j):
        container = GroupBox()
        container.Text = getattr(j, '_tabletitle', '') or getattr(j, 'inputname', '') or ''
        container.Dock = DockStyle.Top
        container.AutoSize = True
        container.AutoSizeMode = System.Windows.Forms.AutoSizeMode.GrowAndShrink
        container.Padding = Padding(
            int(10 * self.xRatio),
            int(15 * self.yRatio),
            int(10 * self.xRatio),
            int(10 * self.yRatio)
        )

        inner = TableLayoutPanel()
        inner.Dock = DockStyle.Fill
        inner.AutoSize = True
        inner.AutoSizeMode = System.Windows.Forms.AutoSizeMode.GrowAndShrink
        inner.ColumnCount = 1
        inner.ColumnStyles.Add(ColumnStyle(SizeType.Percent, 100))
        inner.RowCount = 0
        container.Controls.Add(inner)

        dg = myDataGridView()
        dg.Dock = DockStyle.Top
        dg.AllowUserToAddRows = True
        dg.AllowUserToDeleteRows = True
        dg.SelectionMode = DataGridViewSelectionMode.CellSelect
        dg.AutoSizeColumnsMode = DataGridViewAutoSizeColumnsMode.Fill
        dg.ClipboardCopyMode = DataGridViewClipboardCopyMode.EnableWithAutoHeaderText
        
        row_count = 1
        if hasattr(j, 'get_display_row_count'):
            try:
                row_count = j.get_display_row_count()
            except:
                pass
        dg.Height = int(min(300, max(100, (row_count + 2) * 22)) * self.yRatio)
        
        dg.Tag = getattr(j, '_hasTitle', True)

        if hasattr(j, 'create_data_table'):
            try:
                data_table = j.create_data_table()
                dg.DataSource = data_table
            except:
                pass

        if hasattr(j, 'start_cell'):
            dg.CellMouseDown += j.start_cell
        if hasattr(j, 'end_cell'):
            dg.CellMouseUp += j.end_cell

        inner.RowCount += 1
        inner.RowStyles.Add(RowStyle(SizeType.AutoSize))
        inner.Controls.Add(dg, 0, inner.RowCount - 1)

        export_row = TableLayoutPanel()
        export_row.Dock = DockStyle.Top
        export_row.AutoSize = True
        export_row.ColumnCount = 2
        export_row.ColumnStyles.Add(ColumnStyle(SizeType.Percent, 70))
        export_row.ColumnStyles.Add(ColumnStyle(SizeType.Percent, 30))
        export_row.RowCount = 1
        export_row.RowStyles.Add(RowStyle(SizeType.AutoSize))
        export_row.Margin = Padding(0, int(5 * self.yRatio), 0, 0)

        file_tb = TextBox()
        file_tb.Dock = DockStyle.Top
        file_tb.Text = getattr(j, '_fileInfo', '') or 'ExportFileName'
        file_tb.Height = int(22 * self.yRatio)
        export_row.Controls.Add(file_tb, 0, 0)

        export_btn = Button()
        export_btn.Text = "Export to Excel"
        export_btn.Dock = DockStyle.Top
        export_btn.Height = int(28 * self.yRatio)
        
        title_label = Label()
        title_label.Text = container.Text
        title_label.Visible = False
        export_btn.Tag = (dg, file_tb, title_label)
        
        if hasattr(j, 'export_to_excel'):
            export_btn.Click += j.export_to_excel
        else:
            export_btn.Enabled = False
            export_btn.Text = "Export (Unavailable)"

        export_row.Controls.Add(export_btn, 1, 0)

        inner.RowCount += 1
        inner.RowStyles.Add(RowStyle(SizeType.AutoSize))
        inner.Controls.Add(export_row, 0, inner.RowCount - 1)

        self._add_row(container)
        self._register(dg)

    # DISPATCHER

    def build(self, j):
        typename = getattr(j, '_input_type', j.__class__.__name__)

        handler = getattr(self, f'handle_{typename}', None)
        if handler:
            handler(j)
        else:
            lbl = Label()
            lbl.Text = f"Unknown input type: {typename}"
            lbl.AutoSize = True
            lbl.ForeColor = Color.Red
            self._add_row(lbl)


# EXECUTION

try:
    IN
except NameError:
    IN = [[]] * 10

try:
    xRatio = Screen.PrimaryScreen.Bounds.Width / 1920.0 or 1
    yRatio = Screen.PrimaryScreen.Bounds.Height / 1080.0 or 1

    form = MultiInputForm()
    form.TopMost = True
    form.MinimumSize = Size(int(350 * xRatio), int(200 * yRatio))

    formwidth = int(max(350 * xRatio, (IN[8] or 0) * xRatio))
    form.Width = formwidth

    main_layout = form._main_layout

    # Header
    header_panel = Panel()
    header_panel.Dock = DockStyle.Fill
    header_panel.AutoSize = True
    header_panel.AutoSizeMode = System.Windows.Forms.AutoSizeMode.GrowAndShrink
    header_panel.Padding = Padding(0, 0, 0, int(10 * yRatio))
    main_layout.Controls.Add(header_panel, 0, 0)

    if IN[3]:
        desc = Label()
        desc.Text = IN[3]
        desc.Font = Font("Arial", 15, FontStyle.Bold)
        desc.AutoSize = True
        desc.MaximumSize = Size(int(formwidth - 40), 0)
        desc.Dock = DockStyle.Top
        header_panel.Controls.Add(desc)

    # Body 
    body_panel = Panel()
    body_panel.Dock = DockStyle.Fill
    body_panel.AutoScroll = True
    body_panel.Padding = Padding(0)
    main_layout.Controls.Add(body_panel, 0, 1)

    border_none = getattr(BorderStyle, "None")

    def update_body_border(sender, args):
        if sender.VerticalScroll.Visible:
            sender.BorderStyle = BorderStyle.FixedSingle
        else:
            sender.BorderStyle = border_none

    body_panel.Resize += update_body_border
    body_panel.Layout += update_body_border

    inputs = IN[0] if isinstance(IN[0], list) else [IN[0]]
    config = {
        'xRatio': xRatio,
        'yRatio': yRatio,
        'importcolorselection': importcolorselection
    }

    builder = InputBuilder(form, body_panel, config)
    for inp in inputs:
        if inp is not None:
            builder.build(inp)

    # Footer 
    footer_panel = TableLayoutPanel()
    footer_panel.Dock = DockStyle.Fill
    footer_panel.AutoSize = True
    footer_panel.AutoSizeMode = System.Windows.Forms.AutoSizeMode.GrowAndShrink
    footer_panel.ColumnCount = 2
    footer_panel.ColumnStyles.Add(ColumnStyle(SizeType.AutoSize))
    footer_panel.ColumnStyles.Add(ColumnStyle(SizeType.Percent, 100))
    footer_panel.RowCount = 1
    footer_panel.RowStyles.Add(RowStyle(SizeType.AutoSize))
    footer_panel.Padding = Padding(0, int(10 * yRatio), 0, 0)
    main_layout.Controls.Add(footer_panel, 0, 2)

    logo_pb, logo_icon = create_logo_control(IN[4], xRatio, yRatio, logo_size=80)
    if logo_pb:
        logo_pb.Anchor = AnchorStyles.Left | AnchorStyles.Bottom
        logo_pb.Margin = Padding(0, 0, int(15 * xRatio), 0)
        footer_panel.Controls.Add(logo_pb, 0, 0)
        
        if logo_icon:
            form.Icon = logo_icon

    button_panel = FlowLayoutPanel()
    button_panel.Dock = DockStyle.Fill
    button_panel.FlowDirection = FlowDirection.RightToLeft
    button_panel.AutoSize = True
    button_panel.AutoSizeMode = System.Windows.Forms.AutoSizeMode.GrowAndShrink
    button_panel.Anchor = AnchorStyles.Right | AnchorStyles.Bottom
    button_panel.Margin = Padding(0)
    footer_panel.Controls.Add(button_panel, 1, 0)

    btn_validate = Button()
    btn_validate.Text = IN[1] if IN[1] else "OK"
    btn_validate.Width = int(120 * xRatio)
    btn_validate.Height = int(28 * yRatio)
    btn_validate.Margin = Padding(int(5 * xRatio))
    btn_validate.Click += form.setclose
    button_panel.Controls.Add(btn_validate)

    if IN[6]:
        btn_cancel = Button()
        btn_cancel.Text = IN[6]
        btn_cancel.Width = int(100 * xRatio)
        btn_cancel.Height = int(28 * yRatio)
        btn_cancel.Name = "Cancel"
        btn_cancel.Margin = Padding(int(5 * xRatio))
        btn_cancel.Click += form.setclose
        button_panel.Controls.Add(btn_cancel)
        form.CancelButton = btn_cancel

    if IN[5]:
        help_link = LinkLabel()
        help_link.Text = "Help"
        help_link.Tag = IN[5]
        help_link.AutoSize = True
        help_link.Margin = Padding(int(10 * xRatio), int(8 * yRatio), int(5 * xRatio), 0)
        help_link.Click += form.openurl
        button_panel.Controls.Add(help_link)

    # Final sizing
    content_height = builder.content_height + int(40 * yRatio)
    header_height = header_panel.PreferredSize.Height
    footer_height = footer_panel.PreferredSize.Height + int(20 * yRatio)

    desired_height = header_height + content_height + footer_height + int(60 * yRatio)
    max_height = int(Screen.PrimaryScreen.WorkingArea.Height * 0.85)

    if desired_height > max_height:
        form.Height = max_height
    else:
        form.Height = int(desired_height)

    # Center on Revit window if available
    try:
        rect = uidoc.GetOpenUIViews()[0].GetWindowRectangle()
        form.StartPosition = FormStartPosition.Manual
        form.Location = Point(
            int(rect.Left + (rect.Right - rect.Left) / 2 - form.Width / 2),
            int(rect.Top + (rect.Bottom - rect.Top) / 2 - form.Height / 2)
        )
    except:
        pass

    if IN[2]:
        form.Show()
        CustomMessageLoop(form)
        OUT = form.values, True, form.cancelled
    else:
        OUT = ['Set toggle to true!'], False, False

except Exception as e:
    import traceback
    OUT = "{}\nStack Trace:\n{}".format(str(e), traceback.format_exc()), "error", "error"
# ----------------------------------------
code_block = CodeBlock(OUT=python_script) { OUT[0]; OUT[1]; OUT[2]; }
User_Inputs = Output(code_block.out0)
Was_Run = Output(code_block.out1)
Was_Cancelled = Output(code_block.out2)
