# Dynamo custom node Number to Rounded String .dyf "Number to Rounded String" (Dynamo 3.3.0.6316)
# category: Data-Shapes.Utilities
# Returns rounded number to specified number of decimals as string

Number = Input(Number: var[]..[])
Decimals = Input(Decimals: int = 2)
python_script = Python(IN[0]=Number, IN[1]=Decimals)  # CPython3
# ---------- python_script.python (20 lines) ----------
# CPython + PythonNet 2.5 compatible
# Rounds numbers to specified decimal places

from decimal import Decimal


def tolist(input):
    """Ensure input is a list."""
    if isinstance(input, list):
        return input
    return [input]


nums = tolist(IN[0])
decimal_places = IN[1]

if decimal_places != 0:
    OUT = [str(round(Decimal(n), decimal_places)) for n in nums]
else:
    OUT = [str(int(round(Decimal(n), decimal_places))) for n in nums]
# ----------------------------------------
string = Output(python_script)
