# Dynamo custom node ParameterGroup list.dyf (Dynamo 3.3.0.6316)
# category: Data-Shapes.Revit.SharedParameters
# List of all parameter groups

python_script = Python()  # CPython3; graph input
# ---------- python_script.python (59 lines) ----------
# Copyright (c) mostafa el ayoubi
# Data-Shapes www.data-shapes.net 2017 elayoub.mostafa@gmail.com
# Ported to CPython + PythonNet 2.5

import clr

clr.AddReference('RevitAPI')
from Autodesk.Revit.DB import ForgeTypeId

# Revit 2024+/2025: BuiltInParameterGroup is deprecated
# Use GroupTypeId (ForgeTypeId) instead
# GroupTypeId is a static class with ForgeTypeId properties for each parameter group

try:
    # Revit 2024+ uses GroupTypeId
    from Autodesk.Revit.DB import GroupTypeId
    
    # Get all parameter group ForgeTypeIds using dir() and getattr()
    # (PythonNet 2.5 quirk: System.Enum.GetValues() doesn't work)
    param_groups = []
    for name in dir(GroupTypeId):
        # Skip Python magic attributes and .NET method names
        if name.startswith('_'):
            continue
        if name in ('Equals', 'GetHashCode', 'GetType', 'ToString', 
                    'ReferenceEquals', 'MemberwiseClone'):
            continue
        try:
            val = getattr(GroupTypeId, name)
            # GroupTypeId properties return ForgeTypeId instances
            if isinstance(val, ForgeTypeId):
                param_groups.append(val)
        except:
            pass
    
    OUT = param_groups

except ImportError:
    # Fallback for older Revit versions (pre-2024)
    from Autodesk.Revit.DB import BuiltInParameterGroup
    
    # Use dir() + getattr() pattern for PythonNet 2.5 compatibility
    enum_values = []
    for name in dir(BuiltInParameterGroup):
        if name.startswith('_'):
            continue
        if name in ('value__', 'Equals', 'GetHashCode', 'GetType', 'ToString', 
                    'CompareTo', 'GetTypeCode', 'HasFlag', 'Format', 'Parse',
                    'TryParse', 'IsDefined', 'GetName', 'GetNames', 'GetValues',
                    'GetUnderlyingType', 'ToObject'):
            continue
        try:
            val = getattr(BuiltInParameterGroup, name)
            if isinstance(val, BuiltInParameterGroup):
                enum_values.append(val)
        except:
            pass
    
    OUT = enum_values
# ----------------------------------------
ParameterGroups = Output(python_script)
