# Dynamo custom node PerformanceAdviserRule Elements.dyf (Dynamo 3.3.0.6316)
# category: Data-Shapes.Revit.Elements
# Gets all elements relative to a performance adviser rule.

PerformanceAdviserRule = Input(PerformanceAdviserRule_: var[]..[])
Refresh = Input(Refresh: bool)
python_script = Python(IN[0]=PerformanceAdviserRule, IN[1]=Refresh)  # CPython3
# ---------- python_script.python (50 lines) ----------
# Copyright (c) mostafa el ayoubi, 2017
# Data-Shapes www.data-shapes.net, elayoubi.mostafa@gmail.com
# Ported to CPython + PythonNet 2.5

import clr
import System
from System.Collections.Generic import List

clr.AddReference('RevitAPI')
from Autodesk.Revit.DB import PerformanceAdviser, PerformanceAdviserRuleId

clr.AddReference('RevitServices')
from RevitServices.Persistence import DocumentManager

# Helper function
def tolist(input):
    """Ensure input is a list."""
    if isinstance(input, list):
        return input
    return [input]

doc = DocumentManager.Instance.CurrentDBDocument

# Get the PerformanceAdviser singleton
pa = PerformanceAdviser.GetPerformanceAdviser()
allrules = pa.GetAllRuleIds()

# Get input rule name
inputrule = IN[0].Name

# Find matching rules by name
r = [a for a in allrules if pa.GetRuleName(a) == inputrule]

# Create .NET List for ExecuteRules
rules = List[PerformanceAdviserRuleId]()
for i in r:
    rules.Add(i)

# Execute rules and get failing elements
failmess = pa.ExecuteRules(doc, rules)

# Extract failing elements from each failure message
elementids = [d.GetFailingElements() for d in failmess]

elements = []
for e in elementids:
    elems = [doc.GetElement(id) for id in e]
    elements.append(elems)

OUT = elements
# ----------------------------------------
Elements = Output(python_script)
