# Dynamo custom node PerspectiveView.ByEyePositionTarget.dyf (Dynamo 3.3.0.6316)
# category: Data-Shapes.Revit.View
# Create perspective view

ViewFamilyTypesName = Input(ViewFamilyTypesName: string)
EyePositions = Input(EyePositions: Autodesk.DesignScript.Geometry.Point)
TargetPositions = Input(TargetPositions: Autodesk.DesignScript.Geometry.Point)
ViewTemplates = Input(ViewTemplates_: var = null)
python_script = Python(IN[0]=ViewFamilyTypesName, IN[1]=EyePositions, IN[2]=TargetPositions, IN[3]=ViewTemplates)  # CPython3
# ---------- python_script.python (87 lines) ----------
import clr

clr.AddReference('RevitAPI')
from Autodesk.Revit.DB import (
    Document,
    FilteredElementCollector,
    View3D,
    ViewFamilyType,
    ViewOrientation3D,
    XYZ,
    UnitUtils,
    Transaction
)

clr.AddReference('RevitServices')
from RevitServices.Persistence import DocumentManager

clr.AddReference('RevitNodes')
import Revit
clr.ImportExtensions(Revit.Elements)

clr.AddReference('ProtoGeometry')
from Autodesk.DesignScript.Geometry import Vector, Line

doc = DocumentManager.Instance.CurrentDBDocument

# Unit handling - 2021+ vs older API compatibility
try:
    from Autodesk.Revit.DB import UnitType
    UIunit = Document.GetUnits(doc).GetFormatOptions(UnitType.UT_Length).DisplayUnits
except:
    from Autodesk.Revit.DB import SpecTypeId
    UIunit = Document.GetUnits(doc).GetFormatOptions(SpecTypeId.Length).GetUnitTypeId()


def convert(x):
    return UnitUtils.ConvertToInternalUnits(x, UIunit)


def tolist(input):
    """Ensure input is a list."""
    if isinstance(input, list):
        return input
    return [input]


ftypecollection = FilteredElementCollector(doc).OfClass(ViewFamilyType).ToElements()

viewfamilytypes = tolist(IN[0])
eyepositions = tolist(IN[1])
targets = tolist(IN[2])
templates = tolist(IN[3])

views = []

t = Transaction(doc, 'Create Perspective Views')
t.Start()
try:
    for vft, ep, tgt, temp in zip(viewfamilytypes, eyepositions, targets, templates):
        ftype = [f for f in ftypecollection if f.ToDSType(True).Name == vft][0]
        persview = View3D.CreatePerspective(doc, ftype.Id)
        
        eyeposition = XYZ(convert(ep.X), convert(ep.Y), convert(ep.Z))
        vforward = Vector.ByTwoPoints(ep, tgt)
        lforward = Line.ByStartPointEndPoint(ep, tgt)
        normal = lforward.NormalAtParameter(0)
        forwarddirection = XYZ(convert(vforward.X), convert(vforward.Y), convert(vforward.Z))
        up = normal.Cross(vforward)
        updirection = XYZ(convert(up.X), convert(up.Y), convert(up.Z))
        
        orientation = ViewOrientation3D(eyeposition, updirection, forwarddirection)
        persview.SetOrientation(orientation)
        persview.SaveOrientation()
        
        if temp is not None:
            template = UnwrapElement(temp)
            persview.ViewTemplateId = template.Id
        
        views.append(persview)
    
    t.Commit()
except Exception as ex:
    if t.HasStarted():
        t.RollBack()
    raise

OUT = views
# ----------------------------------------
OUT = Output(python_script)
