# Dynamo custom node PieChart.dyf (Dynamo 3.3.0.6316)
# category: Data-Shapes.UI.Charts
# PieChart

Chart_name = Input(Chart_name_: string = "Pie Chart")
series = Input(series_: var[]..[])
values = Input(values_: var[]..[])
Chart_colors_optionnal = Input(Chart_colors_optionnal_: var[] = null)
python_script = Python(IN[0]=Chart_name, IN[1]=series, IN[2]=values, IN[3]=Chart_colors_optionnal)  # CPython3
# ---------- python_script.python (433 lines) ----------
# Copyright (c) Data Shapes, 2025
# Data-Shapes www.data-shapes.io

import clr
import math

Panel = None
PictureBox = None
PictureBoxSizeMode = None
CheckBox = None
Button = None
SaveFileDialog = None
DialogResult = None
AnchorStyles = None
Point = None
Size = None
Bitmap = None
Graphics = None
Pen = None
SolidBrush = None
Color = None
Font = None
FontStyle = None
StringFormat = None
StringFormatFlags = None
StringAlignment = None
PointF = None
RectangleF = None
SmoothingMode = None
ImageFormat = None

_import_error = None

try:
    clr.AddReference("System.Windows.Forms")
    from System.Windows.Forms import (
        Panel,
        PictureBox,
        PictureBoxSizeMode,
        CheckBox,
        Button,
        SaveFileDialog,
        DialogResult,
        AnchorStyles,
    )
except Exception as ex:
    _import_error = "WinForms: " + str(ex)

try:
    clr.AddReference("System.Drawing")
    from System.Drawing import (
        Point,
        Size,
        Bitmap,
        Graphics,
        Pen,
        SolidBrush,
        Color,
        Font,
        FontStyle,
        StringFormat,
        StringFormatFlags,
        StringAlignment,
        PointF,
        RectangleF,
    )
except Exception as ex:
    _import_error = (_import_error or "") + " | Drawing: " + str(ex)

try:
    from System.Drawing.Drawing2D import SmoothingMode
except Exception as ex:
    _import_error = (_import_error or "") + " | Drawing2D: " + str(ex)

try:
    from System.Drawing.Imaging import ImageFormat
except Exception as ex:
    _import_error = (_import_error or "") + " | Imaging: " + str(ex)

try:
    from System.Windows.Forms import AutoSizeMode
except:
    AutoSizeMode = None


class uipiechart(object):

    def __init__(
        self,
        inputname="",
        chartname="",
        xseries=None,
        yseries=None,
        inputcolors=None,
    ):
        self._input_type = "uipiechart"
        self.inputname = inputname if inputname is not None else ""
        self.chartname = chartname if chartname is not None else ""
        self.xseries = xseries if xseries is not None else []
        self.yseries = yseries if yseries is not None else []
        self.inputcolors = inputcolors if inputcolors is not None else []

    def __repr__(self):
        return 'UI.PieChart input'

    def _to_list(self, obj):
        if obj is None:
            return []
        if isinstance(obj, list):
            return obj
        if isinstance(obj, str):
            return [obj]
        try:
            return [x for x in obj]
        except:
            return [obj]

    def _to_number(self, val):
        if val is None:
            return 0.0
        if isinstance(val, (int, float)):
            return float(val)
        try:
            return float(val)
        except:
            pass
        try:
            return float(str(val))
        except:
            pass
        return 0.0

    def _get_default_colors(self):
        if Color is None:
            return []
        return [
            Color.FromArgb(70, 130, 180),
            Color.FromArgb(205, 92, 92),
            Color.FromArgb(60, 179, 113),
            Color.FromArgb(255, 165, 0),
            Color.FromArgb(147, 112, 219),
            Color.FromArgb(64, 224, 208),
            Color.FromArgb(255, 105, 180),
            Color.FromArgb(154, 205, 50),
            Color.FromArgb(255, 99, 71),
            Color.FromArgb(100, 149, 237),
            Color.FromArgb(255, 215, 0),
            Color.FromArgb(50, 205, 50),
        ]

    def _to_color(self, c, idx=0):
        if Color is None:
            return None
        try:
            if c is None:
                colors = self._get_default_colors()
                return colors[idx % len(colors)] if colors else None
            if isinstance(c, Color):
                return c
            if hasattr(c, "Red") and hasattr(c, "Green") and hasattr(c, "Blue"):
                return Color.FromArgb(int(c.Red), int(c.Green), int(c.Blue))
            if hasattr(c, "R") and hasattr(c, "G") and hasattr(c, "B"):
                a = getattr(c, "A", 255)
                return Color.FromArgb(int(a), int(c.R), int(c.G), int(c.B))
        except:
            pass
        colors = self._get_default_colors()
        return colors[idx % len(colors)] if colors else None

    def _prepare_pie_data(self):
        labels = self._to_list(self.xseries)
        values_raw = self._to_list(self.yseries)
        
        values = [self._to_number(v) for v in values_raw]
        
        while len(labels) < len(values):
            labels.append("Slice {}".format(len(labels) + 1))
        
        while len(values) < len(labels):
            values.append(0)
        
        total = sum(values)
        if total <= 0:
            total = 1
            
        return labels, values, total

    def _render_pie_chart(self, width, height, state):
        if Bitmap is None or Graphics is None:
            return None, "Bitmap or Graphics is None"
        if Color is None or Pen is None or SolidBrush is None:
            return None, "Color, Pen, or SolidBrush is None"

        try:
            labels, values, total = self._prepare_pie_data()
            colors = self._to_list(self.inputcolors)
            
            if not labels or not values or all(v <= 0 for v in values):
                labels = ["No Data"]
                values = [1]
                total = 1
            
            margin = {"left": 20, "right": 150, "top": 50, "bottom": 20}
            
            bmp = Bitmap(width, height)
            g = Graphics.FromImage(bmp)
            
            if SmoothingMode is not None:
                try:
                    g.SmoothingMode = SmoothingMode.AntiAlias
                except:
                    pass
            g.Clear(Color.White)
            
            available_w = width - margin["left"] - margin["right"]
            available_h = height - margin["top"] - margin["bottom"]
            pie_size = min(available_w, available_h)
            
            pie_x = margin["left"] + (available_w - pie_size) / 2
            pie_y = margin["top"] + (available_h - pie_size) / 2
            
            if self.chartname:
                try:
                    title_font = Font("Segoe UI", 11, FontStyle.Bold)
                    g.DrawString(self.chartname, title_font, SolidBrush(Color.FromArgb(50, 50, 50)), 
                                PointF(margin["left"], 10))
                except:
                    pass
            
            start_angle = -90.0
            label_font = Font("Segoe UI", 8)
            
            for i, (label, value) in enumerate(zip(labels, values)):
                if value <= 0:
                    continue
                    
                sweep_angle = (value / total) * 360.0
                color = self._to_color(colors[i] if i < len(colors) else None, i)
                
                if color is not None:
                    brush = SolidBrush(color)
                    g.FillPie(brush, float(pie_x), float(pie_y), float(pie_size), float(pie_size), 
                             float(start_angle), float(sweep_angle))
                    g.DrawPie(Pen(Color.White, 2), float(pie_x), float(pie_y), float(pie_size), float(pie_size),
                             float(start_angle), float(sweep_angle))
                
                if state.get("labels", True) and sweep_angle > 10:
                    mid_angle = start_angle + sweep_angle / 2
                    mid_angle_rad = math.radians(mid_angle)
                    
                    label_radius = pie_size * 0.35
                    center_x = pie_x + pie_size / 2
                    center_y = pie_y + pie_size / 2
                    
                    label_x = center_x + label_radius * math.cos(mid_angle_rad)
                    label_y = center_y + label_radius * math.sin(mid_angle_rad)
                    
                    percent = (value / total) * 100
                    label_text = "{:.1f}%".format(percent)
                    
                    fmt_center = StringFormat()
                    fmt_center.Alignment = StringAlignment.Center
                    fmt_center.LineAlignment = StringAlignment.Center
                    
                    g.DrawString(label_text, label_font, SolidBrush(Color.White),
                                PointF(label_x, label_y), fmt_center)
                
                start_angle += sweep_angle
            
            if state.get("legend", True) and labels:
                legend_x = width - margin["right"] + 10
                legend_y = margin["top"] + 10
                legend_font = Font("Segoe UI", 9)
                
                for i, (label, value) in enumerate(zip(labels, values)):
                    if value <= 0:
                        continue
                    color = self._to_color(colors[i] if i < len(colors) else None, i)
                    if color is not None:
                        g.FillRectangle(SolidBrush(color), int(legend_x), int(legend_y + i * 22), 14, 14)
                    
                    percent = (value / total) * 100
                    legend_text = "{} ({:.1f}%)".format(label, percent)
                    g.DrawString(str(legend_text), legend_font, SolidBrush(Color.FromArgb(60, 60, 60)),
                                PointF(legend_x + 20, legend_y + i * 22 - 1))
            
            g.Dispose()
            return bmp, None
            
        except Exception as ex:
            import traceback
            return None, str(ex) + "\n" + traceback.format_exc()

    def build_chart(self, formbody, xlabel, xinput, y, xRatio, yRatio, form):
        if Panel is None or PictureBox is None or Bitmap is None:
            return None, int(y)

        panel = Panel()
        panel.Location = Point(int(xlabel), int(y))
        panel.Width = max(int(formbody.Width - 25 * xRatio - xlabel), int(200 * xRatio))
        panel.Height = max(int(340 * yRatio), 220)

        pb = PictureBox()
        pb.SizeMode = PictureBoxSizeMode.Normal
        pb.Location = Point(0, 0)
        pb.Width = panel.Width
        pb.Height = int(panel.Height - 40 * yRatio)

        if AnchorStyles is not None:
            pb.Anchor = AnchorStyles.Top | AnchorStyles.Left | AnchorStyles.Right

        panel.Controls.Add(pb)
        
        placeholder = None
        state = {"legend": True, "labels": True}

        def render():
            nonlocal placeholder
            bmp = None
            err_txt = None
            
            try:
                if pb.Width > 0 and pb.Height > 0:
                    bmp, render_err = self._render_pie_chart(pb.Width, pb.Height, state)
                    if render_err:
                        err_txt = render_err
                else:
                    err_txt = "Invalid size"
            except Exception as exc:
                import traceback
                err_txt = str(exc) + "\n" + traceback.format_exc()
            
            try:
                old_img = pb.Image
                pb.Image = bmp
                if old_img is not None and old_img is not bmp:
                    old_img.Dispose()
            except:
                pb.Image = bmp
            
            if bmp is None:
                pb.Visible = False
                if placeholder is None:
                    try:
                        from System.Windows.Forms import Label
                        placeholder = Label()
                        placeholder.AutoSize = True
                        placeholder.MaximumSize = Size(panel.Width - 20, 0)
                        placeholder.Location = Point(10, 10)
                        panel.Controls.Add(placeholder)
                    except:
                        pass
                if placeholder:
                    placeholder.Text = "Chart error: " + (err_txt or "Unknown")
            else:
                pb.Visible = True
                if placeholder:
                    try:
                        panel.Controls.Remove(placeholder)
                    except:
                        pass
                    placeholder = None

        pb.SizeChanged += lambda s, e: render()

        render()

        ctrl_y = pb.Bottom + int(4 * yRatio)

        cb_legend = CheckBox()
        cb_legend.Text = "Legend"
        cb_legend.AutoSize = True
        cb_legend.Checked = True
        cb_legend.Location = Point(int(10 * xRatio), ctrl_y)
        cb_legend.CheckedChanged += lambda s, e: (state.update({"legend": s.Checked}), render())
        panel.Controls.Add(cb_legend)

        cb_labels = CheckBox()
        cb_labels.Text = "Labels"
        cb_labels.AutoSize = True
        cb_labels.Checked = True
        cb_labels.Location = Point(int(80 * xRatio), ctrl_y)
        cb_labels.CheckedChanged += lambda s, e: (state.update({"labels": s.Checked}), render())
        panel.Controls.Add(cb_labels)

        btn_export = Button()
        btn_export.Text = "Export Image"
        btn_export.AutoSize = True
        btn_export.Location = Point(int(panel.Width - 100 * xRatio), ctrl_y)

        if AnchorStyles is not None:
            btn_export.Anchor = AnchorStyles.Top | AnchorStyles.Right
        
        def do_export(sender, args):
            try:
                if pb.Image is None:
                    return
                dlg = SaveFileDialog()
                dlg.Filter = "PNG|*.png|JPEG|*.jpg|BMP|*.bmp"
                dlg.FileName = (self.chartname or "chart") + ".png"
                if dlg.ShowDialog() == DialogResult.OK:
                    fmt = ImageFormat.Png if ImageFormat else None
                    path = dlg.FileName
                    if fmt:
                        if path.lower().endswith(".jpg") or path.lower().endswith(".jpeg"):
                            fmt = ImageFormat.Jpeg
                        elif path.lower().endswith(".bmp"):
                            fmt = ImageFormat.Bmp
                        pb.Image.Save(path, fmt)
                    else:
                        pb.Image.Save(path)
            except:
                pass
        
        btn_export.Click += do_export
        panel.Controls.Add(btn_export)

        next_y = int(y + panel.Height + 10 * yRatio)
        return panel, next_y


chartname = IN[0] if len(IN) > 0 else ""
xseries = IN[1] if len(IN) > 1 else []
yseries = IN[2] if len(IN) > 2 else []
inputcolors = IN[3] if len(IN) > 3 else []

OUT = uipiechart(
    "",
    chartname,
    xseries,
    yseries,
    inputcolors,
)
# ----------------------------------------
UI_PieChartData = Output(python_script)  # "UI.PieChartData"
