# Dynamo custom node RadioButtons Data.dyf (Dynamo 3.3.0.6316)
# category: Data-Shapes.UI.Input
# Create radio buttons input for UI.MultipleInputForm ++ .

InputName = Input(InputName_: string = "")
Keys = Input(Keys_: var[]..[])
Values = Input(Values_: var[]..[])
DefaultValueIndex = Input(DefaultValueIndex_: int = null)
GroupTitle = Input(GroupTitle_: string = "")
python_script = Python(IN[0]=InputName, IN[1]=Keys, IN[2]=Values, IN[3]=DefaultValueIndex, IN[4]=GroupTitle)  # CPython3
# ---------- python_script.python (41 lines) ----------
# Copyright (c) Data Shapes, 2025
# Data-Shapes www.data-shapes.io, elayoubi.mostafa@data-shapes.io @data_shapes


class uiradio(object):

    def __init__(self, inputname="", keys=None, values=None, defaultvalue=None, grouptitle=""):
        self.inputname = inputname if inputname is not None else ""
        self.grouptitle = grouptitle if grouptitle is not None else ""
        self.defaultvalue = defaultvalue
        self._input_type = 'uiradio'

        labels = self._normalize(keys)
        vals = self._normalize(values)
        if len(vals) < len(labels):
            vals += [None] * (len(labels) - len(vals))
        self.options = {str(lbl): vals[i] for i, lbl in enumerate(labels)}

    def _normalize(self, obj):
        if obj is None:
            return []
        if isinstance(obj, (list, tuple)):
            return list(obj)
        if isinstance(obj, str):
            return [obj]
        try:
            return list(obj)
        except Exception:
            return [obj]

    def __repr__(self):
        return 'UI.Radio input'


inputname = IN[0] if len(IN) > 0 else ""
keys = IN[1] if len(IN) > 1 else []
values = IN[2] if len(IN) > 2 else []
defaultvalue = IN[3] if len(IN) > 3 else None
grouptitle = IN[4] if len(IN) > 4 else ""

OUT = uiradio(inputname, keys, values, defaultvalue, grouptitle)
# ----------------------------------------
RadioButton_input = Output(python_script)
