# Dynamo custom node RayBounce On Link Category.dyf (Dynamo 3.3.0.6316)
# category: Data-Shapes.Revit.RayBounce
# Same functionality as raybounce but takes linked model elements into account

Points = Input(Points_: var[])
Direction = Input(Direction_: var[]..[])
ThreeDView = Input(ThreeDView_: Revit.Elements.Views.View)
Category = Input(Category_: var[])
BounceOnLinksOnly = Input(BounceOnLinksOnly: bool = true)
python_script = Python(IN[0]=Points, IN[1]=Direction, IN[2]=ThreeDView, IN[3]=Category, IN[4]=BounceOnLinksOnly)  # CPython3
# ---------- python_script.python (125 lines) ----------
# Copyright (c) mostafa el ayoubi
# Data-Shapes www.data-shapes.net 2016 elayoub.mostafa@gmail.com
# Ported to CPython + PythonNet 2.5

import clr

clr.AddReference('RevitAPI')
from Autodesk.Revit.DB import (
    Document,
    ElementCategoryFilter,
    ElementFilter,
    ElementId,
    FindReferenceTarget,
    LogicalOrFilter,
    ReferenceIntersector,
    UnitUtils,
    XYZ,
)

clr.AddReference('ProtoGeometry')
from Autodesk.DesignScript.Geometry import Point

clr.AddReference('RevitServices')
from RevitServices.Persistence import DocumentManager

import System
from System.Collections.Generic import List

doc = DocumentManager.Instance.CurrentDBDocument


def tolist(input):
    """Ensure input is a list."""
    if isinstance(input, list):
        return input
    return [input]


# Document UI Units - handle both pre-2021 and 2021+ API
try:
    from Autodesk.Revit.DB import UnitType
    UIunit = Document.GetUnits(doc).GetFormatOptions(UnitType.UT_Length).DisplayUnits
except:
    from Autodesk.Revit.DB import SpecTypeId
    UIunit = Document.GetUnits(doc).GetFormatOptions(SpecTypeId.Length).GetUnitTypeId()

# Inputs: Points, Direction, 3D View, Categories, IgnoreHostElements (bool)
if isinstance(IN[0], list):
    points = [
        XYZ(
            UnitUtils.ConvertToInternalUnits(i.X, UIunit),
            UnitUtils.ConvertToInternalUnits(i.Y, UIunit),
            UnitUtils.ConvertToInternalUnits(i.Z, UIunit)
        )
        for i in IN[0]
    ]
else:
    points = [
        XYZ(
            UnitUtils.ConvertToInternalUnits(IN[0].X, UIunit),
            UnitUtils.ConvertToInternalUnits(IN[0].Y, UIunit),
            UnitUtils.ConvertToInternalUnits(IN[0].Z, UIunit)
        )
    ]

direction = XYZ(IN[1].X, IN[1].Y, IN[1].Z)
view = UnwrapElement(IN[2])

pts = []
elems = []
categories = tolist(IN[3])
catfilters = []

# Build category filters using System.Enum.ToObject for enum conversion
from Autodesk.Revit.DB import BuiltInCategory
for cat in categories:
    bic = System.Enum.ToObject(BuiltInCategory, int(str(cat.Id)))
    catfilters.append(ElementCategoryFilter(bic))

catfilterlist = List[ElementFilter](catfilters)
filter = LogicalOrFilter(catfilterlist)

# Set up ReferenceIntersector
ri = ReferenceIntersector(filter, FindReferenceTarget.All, view)
ri.FindReferencesInRevitLinks = True

# Find nearest reference for each point
for p in points:
    ref = ri.FindNearest(p, direction)
    if ref is None:
        pts.append(None)
        elems.append(None)
    else:
        refel = ref.GetReference()
        linkinstance = doc.GetElement(refel.ElementId)
        try:
            # Try to get element from linked document
            elem = linkinstance.GetLinkDocument().GetElement(refel.LinkedElementId)
            elems.append(elem)
            refp = ref.GetReference().GlobalPoint
            pts.append(
                Point.ByCoordinates(
                    UnitUtils.ConvertFromInternalUnits(refp.X, UIunit),
                    UnitUtils.ConvertFromInternalUnits(refp.Y, UIunit),
                    UnitUtils.ConvertFromInternalUnits(refp.Z, UIunit)
                )
            )
        except:
            # Element is in host document, not a link
            if not IN[4]:
                elems.append(linkinstance)
                refp = ref.GetReference().GlobalPoint
                pts.append(
                    Point.ByCoordinates(
                        UnitUtils.ConvertFromInternalUnits(refp.X, UIunit),
                        UnitUtils.ConvertFromInternalUnits(refp.Y, UIunit),
                        UnitUtils.ConvertFromInternalUnits(refp.Z, UIunit)
                    )
                )
            else:
                # IN[4] is True - ignore host elements
                pts.append(None)
                elems.append(None)

OUT = pts, elems
# ----------------------------------------
code_block = CodeBlock(x=python_script) { x[0]; x[1]; }
Points_2 = Output(code_block.out0)  # "Points"
Elements = Output(code_block.out1)
