# Dynamo custom node Replace viewports by center.dyf (Dynamo 3.3.0.6316)
# category: Data-Shapes.Revit.Sheets
# Replaces vieports on sheets according to list of points. (0,0) is bottom left of sheets

Sheets = Input(Sheets_: var[]..[])
code_block = CodeBlock(x=Sheets) { DSCore.List.Flatten([x]); }
Points = Input(Points: var[])
python_script = Python(IN[0]=code_block, IN[1]=Points)  # CPython3
# ---------- python_script.python (65 lines) ----------
# Copyright (c) mostafa el ayoubi
# Data-Shapes 2016 elayoub.mostafa@gmail.com
# Ported to CPython + PythonNet 2.5

import clr

clr.AddReference('RevitAPI')
from Autodesk.Revit.DB import Document, XYZ, UnitUtils

clr.AddReference('RevitServices')
from RevitServices.Persistence import DocumentManager
from RevitServices.Transactions import TransactionManager

doc = DocumentManager.Instance.CurrentDBDocument

def tolist(input):
    """Ensure input is a list and unwrap elements."""
    if isinstance(input, list):
        return [UnwrapElement(x) for x in input]
    else:
        return [UnwrapElement(input)]

# Handle unit conversion for both pre-2021 and 2021+ APIs
try:
    from Autodesk.Revit.DB import UnitType
    UIunit = Document.GetUnits(doc).GetFormatOptions(UnitType.UT_Length).DisplayUnits
except:
    from Autodesk.Revit.DB import SpecTypeId
    UIunit = Document.GetUnits(doc).GetFormatOptions(SpecTypeId.Length).GetUnitTypeId()

def convunit(x):
    """Convert from display units to internal units."""
    return UnitUtils.ConvertToInternalUnits(x, UIunit)

def bbLength(bb):
    """Get half the width of a bounding box."""
    # Use .Subtract() method instead of - operator (PythonNet quirk)
    p = bb.Max.Subtract(bb.Min)
    return p.X / 2

pts = IN[1]
sheets = tolist(IN[0])
viewports = []
centers = []

TransactionManager.Instance.EnsureInTransaction(doc)

for s in sheets:
    vpid = s.GetAllViewports()
    for id in vpid:
        viewports.append(doc.GetElement(id))

for p in pts:
    centers.append(XYZ(convunit(p.X), convunit(p.Y), convunit(p.Z)))

for indice, vp in enumerate(viewports):
    sheet_view = doc.GetElement(vp.SheetId)
    bb = vp.get_BoundingBox(sheet_view)
    # Use .Add() method instead of + operator (PythonNet quirk)
    new_center = centers[indice].Add(XYZ(bbLength(bb), 0, 0))
    vp.SetBoxCenter(new_center)

TransactionManager.Instance.TransactionTaskDone()

OUT = 'You have successfully recentered %d viewports.' % len(viewports)
# ----------------------------------------
OUT = Output(python_script)
