# Dynamo custom node Room Status.dyf (Dynamo 3.3.0.6316)
# category: Data-Shapes.Revit.Rooms
# Sorts a list of room into three categories: unplaced, PlacedAndBounded and  unbounded

Rooms = Input(Rooms_: var[]..[])
python_script = Python(IN[0]=Rooms)  # CPython3
# ---------- python_script.python (36 lines) ----------
# Copyright (c) Data Shapes, 2025
# Data-Shapes www.data-shapes.io, elayoubi.mostafa@data-shapes.io @data_shapes

import clr

clr.AddReference('RevitAPI')
from Autodesk.Revit.DB import *

clr.AddReference('RevitServices')
from RevitServices.Persistence import DocumentManager

doc = DocumentManager.Instance.CurrentDBDocument


def tolist(input):
    if isinstance(input, list):
        return input
    return [input]


rooms = [UnwrapElement(r) for r in tolist(IN[0])]

unplaced = []
unbounded = []
placedAndBounded = []

for room in rooms:
    if room.Location is None:
        unplaced.append(room)
    else:
        if room.Area == 0:
            unbounded.append(room)
        else:
            placedAndBounded.append(room)

OUT = unplaced, unbounded, placedAndBounded
# ----------------------------------------
code_block = CodeBlock(x=python_script)
# ---------- code_block.designscript (6 lines) ----------
//Unplaced
x[0];
//Unbounded
x[1];
//PlacedAndBounded
x[2];
# ----------------------------------------
Unplaced = Output(code_block.out0)
Unbounded = Output(code_block.out1)
PlacedAndBounded = Output(code_block.out2)
