# Dynamo custom node Room.Height.dyf (Dynamo 2.3.0.5885)
# category: Data-Shapes.Revit.Rooms
# Returns room height.

Rooms = Input(Rooms_: var[])
room_height = Python(IN[0]=Rooms)
# ---------- room_height.python (25 lines) ----------
# Copyright (c) Data Shapes, 2025
# Data-Shapes www.data-shapes.io, elayoubi.mostafa@data-shapes.io @data_shapes

import clr
clr.AddReference('RevitAPI')
from Autodesk.Revit.DB import *
clr.AddReference('RevitServices')
from RevitServices.Transactions import TransactionManager
from RevitServices.Persistence import DocumentManager
clr.AddReference('RevitNodes')
import Revit
clr.ImportExtensions(Revit.GeometryConversion)

doc = DocumentManager.Instance.CurrentDBDocument


def ToList(input):
    if isinstance(input, list):
        return input
    else:
        return [input]


rooms = ToList(IN[0])
OUT = [(r.BoundingBox.MaxPoint.Z - r.BoundingBox.MinPoint.Z) for r in rooms]
# ----------------------------------------
Height_s = Output(room_height)  # "Height(s)"
