# Dynamo custom node Select Model Elements of Category.dyf (Dynamo 3.3.0.6316)
# category: Data-Shapes.Revit.Selection
# Allows to perform a manual selection with a category filter.

Categories = Input(Categories_: var[])
Toggle = Input(Toggle: bool = false)
python_script = Python(IN[0]=Categories, IN[1]=Toggle)  # CPython3
# ---------- python_script.python (41 lines) ----------
# Copyright (c) Data Shapes, 2025
# Data-Shapes www.data-shapes.io, elayoubi.mostafa@data-shapes.io @data_shapes

import clr
clr.AddReference('RevitAPI')
from Autodesk.Revit.DB import *
clr.AddReference('RevitAPIUI')
from Autodesk.Revit.UI import*
from Autodesk.Revit.UI.Selection import ObjectType, ISelectionFilter
clr.AddReference('RevitServices')
from RevitServices.Persistence import DocumentManager

doc = DocumentManager.Instance.CurrentDBDocument
uidoc = uidoc = DocumentManager.Instance.CurrentUIApplication.ActiveUIDocument


class selectionfilter(ISelectionFilter):
    def __init__(self,categories):
        self.categories = categories
    def AllowElement(self,element):
        if element.Category.Name in [c.Name for c in self.categories]:
            return True
        else:
            return False
    def AllowReference(reference,point):
        return False


if isinstance(IN[0],list):
    categories = UnwrapElement(IN[0])
else:
    categories = [UnwrapElement(IN[0])]
    
selfilt = selectionfilter(categories)
catnames = ', '.join([c.Name for c in categories])
if IN[1]:
    sel = uidoc.Selection.PickObjects(Selection.ObjectType.Element,selfilt,'Select %s' %(catnames))
    selelem = [doc.GetElement(s.ElementId) for s in sel]
    OUT = selelem
else:
    OUT = 'Set toggle to true!'
# ----------------------------------------
OUT = Output(python_script)
