# Dynamo custom node SelectAutoCadObjects_Data.dyf (Dynamo 2.5.2.7915)
# category: Data-Shapes.UI.AutocadCivil3D
# This input can be used in Civil 3D or in Autocad for object selection!

InputName = Input(InputName: string = "")
ButtonText = Input(ButtonText: string = "Select AutoCad Element(s)")
SelectSingleElement = Input(SelectSingleElement: bool = false)
python_script = Python(IN[0]=InputName, IN[1]=ButtonText, IN[2]=SelectSingleElement)
# ---------- python_script.python (18 lines) ----------
# Copyright (c) Data Shapes, 2025
# Data-Shapes www.data-shapes.io, elayoubi.mostafa@data-shapes.io @data_shapes


class uiselectautocadelements():

    def __init__(self, inputname, buttontext, multi):
        self.inputname = inputname
        self.buttontext = buttontext
        self.multi = multi

    def __repr__(self):
        return 'UI.SelectAutocadElements input'

    
x = uiselectautocadelements(IN[0], IN[1], IN[2])

OUT = x
# ----------------------------------------
SelectAutocadElements_input = Output(python_script)
