# Dynamo custom node SelectEdges Data.dyf (Dynamo 3.3.0.6316)
# category: Data-Shapes.UI.Selection
# Creates a Revit edge selection input for UI.MultipleInputForm++ . Check out www.data-shapes.net for more infos!

InputName = Input(InputName_: string = "")
ButtonText = Input(ButtonText_: string = "Select Edge(s)")
python_script = Python(IN[0]=InputName, IN[1]=ButtonText)  # CPython3
# ---------- python_script.python (56 lines) ----------
# Copyright (c) Data Shapes, 2025
# Data-Shapes www.data-shapes.io, elayoubi.mostafa@data-shapes.io @data_shapes

import clr
clr.AddReference('RevitAPIUI')
from Autodesk.Revit.UI import Selection
clr.AddReference('RevitAPI')
from Autodesk.Revit.DB import FamilyInstance

clr.AddReference('RevitNodes')
import Revit
clr.ImportExtensions(Revit.Elements)
clr.ImportExtensions(Revit.GeometryConversion)

clr.AddReference('RevitServices')
from RevitServices.Persistence import DocumentManager
doc = DocumentManager.Instance.CurrentDBDocument
uidoc = DocumentManager.Instance.CurrentUIApplication.ActiveUIDocument


class uiselectedges():

    def __init__(self, inputname, buttontext):
        self.inputname = inputname
        self.buttontext = buttontext
        self._input_type = 'uiselectedges'

    def __repr__(self):
        return 'UI.SelectEdges input'

    def pickedges(self, sender, event):
        edges = []
        try:
            seledge = uidoc.Selection.PickObjects(Selection.ObjectType.Edge, '')
            for s in seledge:
                elemid = s.ElementId
                elem = doc.GetElement(elemid)
                if isinstance(elem, FamilyInstance):
                    transf = elem.GetTransform().ToCoordinateSystem()
                    geom = elem.GetGeometryObjectFromReference(s)
                    convertedGeom = geom.Convert(s, transf)
                    convertedGeom.Tags.AddTag("RevitFaceReference", s)
                    edges.append(convertedGeom)
                else:
                    e = uidoc.Document.GetElement(s).GetGeometryObjectFromReference(s).AsCurve().ToProtoType(True)
                    e.Tags.AddTag("RevitFaceReference", s)
                    edges.append(e)
            sender.Tag = edges
        except:
            pass


inputname = IN[0] if len(IN) > 0 else ""
buttontext = IN[1] if len(IN) > 1 else "Select Edge(s)"

OUT = uiselectedges(inputname, buttontext)
# ----------------------------------------
SelectEdges_input = Output(python_script)
