# Dynamo custom node SelectFaces Data.dyf (Dynamo 3.3.0.6316)
# category: Data-Shapes.UI.Selection
# Creates a Revit face selection input for UI.MultipleInputForm++. Check out www.data-shapes.net for more infos!

InputName = Input(InputName_: string = "")
ButtonText = Input(ButtonText_: string = "Select face(s)")
python_script = Python(IN[0]=InputName, IN[1]=ButtonText)  # CPython3
# ---------- python_script.python (56 lines) ----------
# Copyright (c) Data Shapes, 2025
# Data-Shapes www.data-shapes.io, elayoubi.mostafa@data-shapes.io @data_shapes

import clr
clr.AddReference('RevitAPIUI')
from Autodesk.Revit.UI import Selection
clr.AddReference('RevitAPI')
from Autodesk.Revit.DB import FamilyInstance

clr.AddReference('RevitNodes')
import Revit
clr.ImportExtensions(Revit.Elements)
clr.ImportExtensions(Revit.GeometryConversion)

clr.AddReference('RevitServices')
from RevitServices.Persistence import DocumentManager
doc = DocumentManager.Instance.CurrentDBDocument
uidoc = DocumentManager.Instance.CurrentUIApplication.ActiveUIDocument


class uiselectfaces():

    def __init__(self, inputname, buttontext):
        self.inputname = inputname
        self.buttontext = buttontext
        self._input_type = 'uiselectfaces'

    def __repr__(self):
        return 'UI.SelectFaces input'

    def pickfaces(self, sender, event):
        faces = []
        try:
            selface = uidoc.Selection.PickObjects(Selection.ObjectType.Face, '')
            for s in selface:
                elemid = s.ElementId
                elem = doc.GetElement(elemid)
                if isinstance(elem, FamilyInstance):
                    transf = elem.GetTransform().ToCoordinateSystem()
                    geom = elem.GetGeometryObjectFromReference(s)
                    convertedGeom = geom.Convert(s, transf)
                    faces.append(convertedGeom)
                else:
                    f = uidoc.Document.GetElement(s).GetGeometryObjectFromReference(s).ToProtoType(True)
                    for i in f:
                        i.Tags.AddTag("RevitFaceReference", s)
                    faces.append(f)
            sender.Tag = [i for j in faces for i in j]
        except:
            pass


inputname = IN[0] if len(IN) > 0 else ""
buttontext = IN[1] if len(IN) > 1 else "Select Face(s)"

OUT = uiselectfaces(inputname, buttontext)
# ----------------------------------------
SelectFaces_input = Output(python_script)
