# Dynamo custom node SelectLinkedElement(s) Data.dyf (Dynamo 3.3.0.6316)
# category: Data-Shapes.UI.Selection
# Create a button input for UI.MultipleInputForm++ that allows to select elements in à linked document. See www.data-shapes.net for more infos!

InputName = Input(InputName_: string = "")
ButtonText = Input(ButtonText_: string = "Select Linked Element(s)")
SelectSingleElement = Input(SelectSingleElement_: bool = false)
CategoryFilter = Input(CategoryFilter_: var[] = "")
python_script = Python(IN[0]=InputName, IN[1]=ButtonText, IN[2]=SelectSingleElement, IN[3]=CategoryFilter)  # CPython3
# ---------- python_script.python (218 lines) ----------
# Copyright (c) Data Shapes, 2025
# Data-Shapes www.data-shapes.io, elayoubi.mostafa@data-shapes.io @data_shapes

import clr
import System

clr.AddReference('RevitAPIUI')
from Autodesk.Revit.UI import Selection, TaskDialog
from Autodesk.Revit.UI.Selection import ISelectionFilter

clr.AddReference('RevitAPI')
from Autodesk.Revit.DB import Element

clr.AddReference('RevitServices')
from RevitServices.Persistence import DocumentManager

doc = DocumentManager.Instance.CurrentDBDocument
uidoc = DocumentManager.Instance.CurrentUIApplication.ActiveUIDocument

_filter_link_doc = None
_filter_link_cat_names = []


class LinkedCategorySelectionFilter(object):
    def __new__(cls, *args, **kwargs):
        cls.args = args
        cls.__namespace__ = "LinkedCategorySelectionFilter_" + str(System.Guid.NewGuid()).replace('-', '_')
        try:
            module_type = __import__(cls.__namespace__)
            return module_type._LinkedCategorySelectionFilter(*cls.args)
        except ImportError:
            class _LinkedCategorySelectionFilter(ISelectionFilter):
                __namespace__ = cls.__namespace__
                def __init__(self, *a, **k):
                    super().__init__()
                def AllowElement(self, element):
                    return True
                def AllowReference(self, reference, point):
                    try:
                        link_instance = doc.GetElement(reference.ElementId)
                        if link_instance is None:
                            link_instance = doc.GetElement(reference)
                        if link_instance is None:
                            return False
                        linkdoc = _filter_link_doc or link_instance.GetLinkDocument()
                        if linkdoc is None:
                            return False
                        elem = linkdoc.GetElement(reference.LinkedElementId)
                        if elem is None:
                            return False
                        if _filter_link_cat_names:
                            cat = getattr(elem, 'Category', None)
                            return (cat is not None) and (cat.Name in _filter_link_cat_names)
                        return True
                    except:
                        return False
            return _LinkedCategorySelectionFilter(*cls.args)


class uiselectlinkedelements(object):

    def __init__(self, inputname, buttontext, multi, category=None):
        self.inputname = inputname
        self.buttontext = buttontext
        self.multi = multi
        self.category = category
        self._input_type = 'uiselectlinkedelements'

    def __repr__(self):
        return 'UI.SelectLinkedElements input'

    def _initial_prompt(self):
        if self.multi:
            return 'Select a link, then pick one linked element.'
        return 'Select a link, then pick linked elements and press Finish.'

    def _prompt_link_document(self):
        try:
            linkref = uidoc.Selection.PickObject(
                Selection.ObjectType.Element,
                'Select the link instance.'
            )
            return doc.GetElement(linkref.ElementId).GetLinkDocument()
        except:
            return None

    def _get_category_names(self):
        return []

    def _prepare_filter(self, linkdoc):
        global _filter_link_doc, _filter_link_cat_names
        _filter_link_doc = linkdoc
        _filter_link_cat_names = []

    def _collect_elements(self, linkdoc, references, allowed_names=None):
        elements = []
        for r in references:
            try:
                elem = linkdoc.GetElement(r.LinkedElementId)
                if isinstance(elem, Element):
                    if allowed_names:
                        cat = getattr(elem, 'Category', None)
                        if cat is None or cat.Name not in allowed_names:
                            continue
                    elements.append(elem)
            except:
                pass
        return elements

    def _multi_prompt(self):
        return 'Select the linked elements and press Finish.'

    def _single_prompt(self):
        return 'Select the linked element.'

    def picklinkedobjects(self, sender, event):
        try:
            TaskDialog.Show('Data-Shapes', self._initial_prompt())
            linkdoc = self._prompt_link_document()
            if linkdoc is None:
                return
            self._prepare_filter(linkdoc)
            selfilt = LinkedCategorySelectionFilter()
            references = uidoc.Selection.PickObjects(
                Selection.ObjectType.LinkedElement,
                selfilt,
                self._multi_prompt()
            )
            elements = self._collect_elements(linkdoc, references, self._get_category_names())
            sender.Tag = elements
        except:
            pass

    def picklinkedobject(self, sender, event):
        try:
            TaskDialog.Show('Data-Shapes', self._initial_prompt())
            linkdoc = self._prompt_link_document()
            if linkdoc is None:
                return
            self._prepare_filter(linkdoc)
            selfilt = LinkedCategorySelectionFilter()
            reference = uidoc.Selection.PickObject(
                Selection.ObjectType.LinkedElement,
                selfilt,
                self._single_prompt()
            )
            allowed = self._get_category_names()
            element = linkdoc.GetElement(reference.LinkedElementId)
            if not allowed or (element and element.Category and element.Category.Name in allowed):
                sender.Tag = element
        except:
            pass


class uiselectlinkedelementsofcat(uiselectlinkedelements):

    def __init__(self, inputname, buttontext, category, multi):
        super().__init__(inputname, buttontext, multi, category)
        if isinstance(category, list):
            self._raw_category = category
        else:
            self._raw_category = [category]
        self._input_type = 'uiselectlinkedelementsofcat'

    def __repr__(self):
        return 'UI.SelectLinkedElementsOfCategory input'

    def _get_category_names(self):
        names = []
        for c in self._raw_category:
            try:
                if hasattr(c, 'InternalElement'):
                    names.append(c.InternalElement.Name)
                elif hasattr(c, 'Name'):
                    names.append(c.Name)
                else:
                    names.append(str(c))
            except:
                try:
                    names.append(str(c))
                except:
                    pass
        return names

    def _prepare_filter(self, linkdoc):
        global _filter_link_doc, _filter_link_cat_names
        _filter_link_doc = linkdoc
        _filter_link_cat_names = self._get_category_names()

    def _multi_prompt(self):
        names = ', '.join(self._get_category_names())
        return 'Select the linked %s and press Finish.' % names

    def _single_prompt(self):
        names = ', '.join(self._get_category_names())
        return 'Select the linked %s.' % names


inputname = IN[0] if len(IN) > 0 else ""
buttontext = IN[1] if len(IN) > 1 else "Select Linked Element(s)"
multi = IN[2] if len(IN) > 2 else False
category = IN[3] if len(IN) > 3 else None

if category is None or category == "" or category == [] or category == [""]:
    x = uiselectlinkedelements(inputname, buttontext, multi)
else:
    if buttontext == "Select Linked Element(s)":
        try:
            if isinstance(category, list):
                catnames = ', '.join([UnwrapElement(i).Name for i in category])
            else:
                catnames = UnwrapElement(category).Name
            buttontext = 'Select %s' % catnames
        except:
            pass
    x = uiselectlinkedelementsofcat(inputname, buttontext, category, multi)

OUT = x
# ----------------------------------------
SelectLinkedElements_input = Output(python_script)
