# Dynamo custom node SelectModelElements Data (ordered).dyf (Dynamo 3.3.0.6316)
# category: Data-Shapes.UI.Selection
# Creates a Revit element selection input for UI.MultipleInputForm++ . Check out www.data-shapes.net for more infos!

InputName = Input(InputName_: string = "")
ButtonText = Input(ButtonText_: string = "Select Model Element(s)")
CategoryFilter = Input(CategoryFilter_: var[] = "")
python_script = Python(IN[0]=InputName, IN[1]=ButtonText, IN[2]=CategoryFilter)  # CPython3
# ---------- python_script.python (150 lines) ----------
# Copyright (c) Data Shapes, 2025
# Data-Shapes www.data-shapes.io, elayoubi.mostafa@data-shapes.io @data_shapes

import clr
import System

clr.AddReference('RevitAPIUI')
from Autodesk.Revit.UI import Selection, TaskDialog
from Autodesk.Revit.UI.Selection import ISelectionFilter

clr.AddReference('RevitAPI')
from Autodesk.Revit.DB import Element

clr.AddReference('RevitNodes')
import Revit
clr.ImportExtensions(Revit.Elements)

clr.AddReference('RevitServices')
from RevitServices.Persistence import DocumentManager

doc = DocumentManager.Instance.CurrentDBDocument
uidoc = DocumentManager.Instance.CurrentUIApplication.ActiveUIDocument

_filter_cat_names = []


class CategorySelectionFilter(object):
    def __new__(cls, *args, **kwargs):
        cls.args = args
        cls.__namespace__ = "OrderedCategorySelectionFilter_" + str(System.Guid.NewGuid()).replace('-', '_')
        try:
            module_type = __import__(cls.__namespace__)
            return module_type._OrderedCategorySelectionFilter(*cls.args)
        except ImportError:
            class _OrderedCategorySelectionFilter(ISelectionFilter):
                __namespace__ = cls.__namespace__
                def __init__(self, *a, **k):
                    super().__init__()
                def AllowElement(self, element):
                    try:
                        cat = element.Category
                        return (cat is not None) and (cat.Name in _filter_cat_names)
                    except:
                        return False
                def AllowReference(self, reference, point):
                    return False
            return _OrderedCategorySelectionFilter(*cls.args)


class uiselectOrderedelements(object):

    def __init__(self, inputname, buttontext):
        self.inputname = inputname
        self.buttontext = buttontext
        self._input_type = 'uiselectOrderedelements'

    def __repr__(self):
        return 'UI.SelectOrderedElements input'

    def pickobjectsordered(self, sender, event):
        output = []
        try:
            TaskDialog.Show("Data|Shapes", 'Pick elements in order, then hit ESC to exit.')
            collecting = True
            while collecting:
                try:
                    sel = uidoc.Selection.PickObject(Selection.ObjectType.Element, 'Pick elements in order')
                    elem = doc.GetElement(sel.ElementId)
                    output.append(elem.ToDSType(True))
                except:
                    collecting = False
            sender.Tag = output
        except:
            pass


class uiselectOrderedelementsofcat(object):

    def __init__(self, inputname, buttontext, category):
        self.inputname = inputname
        self.buttontext = buttontext
        self.category = category
        self._input_type = 'uiselectOrderedelementsofcat'
        if isinstance(category, list):
            self._raw_category = category
        else:
            self._raw_category = [category]

    def __repr__(self):
        return 'UI.SelectOrderedElementsOfCategory input'

    def _get_unwrapped_categories(self):
        unwrapped = []
        for c in self._raw_category:
            try:
                if hasattr(c, 'InternalElement'):
                    unwrapped.append(c.InternalElement)
                elif hasattr(c, 'Id'):
                    unwrapped.append(c)
                else:
                    unwrapped.append(c)
            except:
                try:
                    unwrapped.append(c)
                except:
                    pass
        return unwrapped

    def pickobjectsofcatordered(self, sender, event):
        global _filter_cat_names
        output = []
        try:
            category = self._get_unwrapped_categories()
            _filter_cat_names = [c.Name for c in category]
            names = ', '.join(_filter_cat_names)
            selfilt = CategorySelectionFilter()
            TaskDialog.Show("Data|Shapes", 'Select %s in order, then press ESC to exit.' % names)
            collecting = True
            while collecting:
                try:
                    sel = uidoc.Selection.PickObject(Selection.ObjectType.Element, selfilt, 'Select %s' % names)
                    elem = doc.GetElement(sel.ElementId)
                    output.append(elem.ToDSType(True))
                except:
                    collecting = False
            sender.Tag = output
        except:
            pass


inputname = IN[0] if len(IN) > 0 else ""
buttontext = IN[1] if len(IN) > 1 else "Select Model Element(s)"
category = IN[2] if len(IN) > 2 else [""]

if category == [""] or category == "" or category == []:
    x = uiselectOrderedelements(inputname, buttontext)
else:
    if isinstance(category, list):
        catnames = ', '.join([UnwrapElement(i).Name for i in category])
        if buttontext == "Select Model Element(s)":
            buttontext = 'Select %s' % catnames
    else:
        if buttontext == "Select Model Element(s)":
            try:
                buttontext = 'Select %s' % UnwrapElement(category).Name
            except:
                pass
    x = uiselectOrderedelementsofcat(inputname, buttontext, category)

OUT = x
# ----------------------------------------
SelectOrderedModelElements_input = Output(python_script)
