# Dynamo custom node SelectPointsOnFace data.dyf (Dynamo 3.3.0.6316)
# category: Data-Shapes.UI.Selection
# Creates a UI.MultipleInputForm++ input that allows point on face selection

InputName = Input(InputName_: string = "")
ButtonText = Input(ButtonText_: string = "Select point(s) on face")
python_script = Python(IN[0]=InputName, IN[1]=ButtonText)  # CPython3
# ---------- python_script.python (62 lines) ----------
# Copyright (c) Data Shapes, 2025
# Data-Shapes www.data-shapes.io, elayoubi.mostafa@data-shapes.io @data_shapes

import clr
clr.AddReference('RevitAPIUI')
from Autodesk.Revit.UI import Selection
clr.AddReference('RevitAPI')
from Autodesk.Revit.DB import UnitUtils
try:
    from Autodesk.Revit.DB import UnitType
except:
    from Autodesk.Revit.DB import SpecTypeId

clr.AddReference('RevitServices')
from RevitServices.Persistence import DocumentManager
doc = DocumentManager.Instance.CurrentDBDocument
uidoc = DocumentManager.Instance.CurrentUIApplication.ActiveUIDocument

clr.AddReference('ProtoGeometry')
from Autodesk.DesignScript.Geometry import Point as dsPoint


def _get_ui_length_unit():
    try:
        return doc.GetUnits().GetFormatOptions(UnitType.UT_Length).DisplayUnits
    except:
        return doc.GetUnits().GetFormatOptions(SpecTypeId.Length).GetUnitTypeId()


_UI_LENGTH_UNIT = _get_ui_length_unit()


class uiselectpointsonface():

    def __init__(self, inputname, buttontext):
        self.inputname = inputname
        self.buttontext = buttontext
        self._input_type = 'uiselectpointsonface'

    def __repr__(self):
        return 'UI.SelectPointsOnFace input'

    def pickpointsonface(self, sender, event):
        points = []
        try:
            selpoints = uidoc.Selection.PickObjects(Selection.ObjectType.PointOnElement, '')
            for s in selpoints:
                pt = s.GlobalPoint
                points.append(dsPoint.ByCoordinates(
                    UnitUtils.ConvertFromInternalUnits(pt.X, _UI_LENGTH_UNIT),
                    UnitUtils.ConvertFromInternalUnits(pt.Y, _UI_LENGTH_UNIT),
                    UnitUtils.ConvertFromInternalUnits(pt.Z, _UI_LENGTH_UNIT)
                ))
            sender.Tag = points
        except:
            pass


inputname = IN[0] if len(IN) > 0 else ""
buttontext = IN[1] if len(IN) > 1 else "Select Point(s) on Face"

OUT = uiselectpointsonface(inputname, buttontext)
# ----------------------------------------
SelectPointOnFace_input = Output(python_script)
