# Dynamo custom node Set Active Family Parameter By Name.dyf (Dynamo 3.3.0.6316)
# category: Data-Shapes.Revit.Family
# Set a parameter inside an active family document

ParameterName = Input(ParameterName: string)
ParameterValue = Input(ParameterValue: var[]..[])
python_script = Python(IN[0]=ParameterName, IN[1]=ParameterValue)  # CPython3
# ---------- python_script.python (40 lines) ----------
#All the credit for this node goes to Dimitar Venkov @5devene
#Thanks for all the usefull stuff you share Dimitar!

import clr
clr.AddReference('RevitAPI')
from Autodesk.Revit.DB import*

clr.AddReference('RevitServices')
from RevitServices.Persistence import DocumentManager
from RevitServices.Transactions import TransactionManager

doc = DocumentManager.Instance.CurrentDBDocument
UIunit = Document.GetUnits(doc).GetFormatOptions(UnitType.UT_Length).DisplayUnits

def convunit(x):
	return UnitUtils.ConvertToInternalUnits(x,UIunit)

param_name = IN[0]
param_value = IN[1]

param_list = doc.FamilyManager.GetParameters()
names = [p.Definition.Name for p in param_list]
par1 = None
if param_name in names:
	par1 = param_list[names.index(param_name)]
if par1 != None:
	TransactionManager.Instance.EnsureInTransaction(doc)
	try :
		try:
			doc.FamilyManager.Set(par1,convunit(param_value))
			OUT = 'Success'
		except:
			doc.FamilyManager.Set(par1,param_value)		
			OUT = 'Success'
	except:
		OUT = 'Check parameter type'
		
	TransactionManager.Instance.TransactionTaskDone()
else :
	OUT = 'No parameter found by that name'
# ----------------------------------------
OUT = Output(python_script)
