# Dynamo custom node SetCropRegion.dyf (Dynamo 3.3.0.6316)
# category: Data-Shapes.Revit.View
# Sets the crop region of a view to a closed polycurve.

view = Input(view_: var[]..[])
CurvesAsList = Input(CurvesAsList: var[]..[])
python_script = Python(IN[0]=view, IN[1]=CurvesAsList)  # CPython3
# ---------- python_script.python (50 lines) ----------
# Copyright (c) Data Shapes, 2025
# Data-Shapes www.data-shapes.io, elayoubi.mostafa@data-shapes.io

import clr

clr.AddReference('RevitNodes')
import Revit
clr.ImportExtensions(Revit.GeometryConversion)
clr.ImportExtensions(Revit.Elements)

clr.AddReference('RevitAPI')
from Autodesk.Revit.DB import CurveLoop

clr.AddReference('RevitServices')
from RevitServices.Persistence import DocumentManager
from RevitServices.Transactions import TransactionManager

doc = DocumentManager.Instance.CurrentDBDocument


def tolist(input):
    if isinstance(input, list):
        return input
    return [input]


views = UnwrapElement(tolist(IN[0]))
curveslist = tolist(IN[1])


def cropView(view, curves):
    loop = CurveLoop()
    for c in curves:
        loop.Append(c.ToRevitType())

    TransactionManager.Instance.EnsureInTransaction(doc)
    view.CropBoxActive = True
    view.GetCropRegionShapeManager().SetCropShape(loop)
    TransactionManager.Instance.TransactionTaskDone()


failed = []

for v, c in zip(views, curveslist):
    try:
        cropView(v, c)
    except:
        failed.append(c)

OUT = views, failed
# ----------------------------------------
Outlines = Output(python_script)  # "Outlines_"
