# Dynamo custom node SharedParameters from txt file.dyf (Dynamo 3.3.0.6316)
# category: Data-Shapes.Revit.SharedParameters
# Gets parameters from SharedParameter .txt file

FilePath = Input(FilePath: var[]..[])
python_script = Python(IN[0]=FilePath)  # CPython3
# ---------- python_script.python (47 lines) ----------
# Copyright (c) mostafa el ayoubi
# Data-Shapes www.data-shapes.net 2016 elayoub.mostafa@gmail.com
# Ported to CPython + PythonNet 2.5
# Compatible with Revit pre-2025 and 2025+

import clr

clr.AddReference('RevitAPI')
from Autodesk.Revit.DB import *

clr.AddReference('RevitServices')
from RevitServices.Persistence import DocumentManager

clr.AddReference('RevitAPIUI')
from Autodesk.Revit.UI import *

doc = DocumentManager.Instance.CurrentDBDocument
uidoc = DocumentManager.Instance.CurrentUIDocument
app = doc.Application

# Input: path to shared parameters file (.txt)
shared_param_file_path = IN[0]

# Set the shared parameters file path
app.SharedParametersFilename = shared_param_file_path

# Open the shared parameter file
spfile = app.OpenSharedParameterFile()

if spfile is None:
    OUT = [], []
else:
    # Get all definition groups
    groups = spfile.Groups
    
    # Get all definitions from all groups
    definitions = []
    definition_names = []
    
    for group in groups:
        for definition in group.Definitions:
            definitions.append(definition)
            definition_names.append(definition.Name)
    
    # Output: definitions (for use with ds_add_shared_parameters_to_project_v2)
    #         definition_names (for display/filtering)
    OUT = definitions, definition_names
# ----------------------------------------
code_block = CodeBlock(x=python_script) { x[0]; x[1]; }
Revit_Parameters = Output(code_block.out0)
Parameter_Names = Output(code_block.out1)
