# Dynamo custom node SheetTitleblock.dyf (Dynamo 3.3.0.6316)
# category: Data-Shapes.Revit.Sheets
# Get the TitleBlock family type from a sheet

sheet = Input(sheet_: var[]..[])
python_script = Python(IN[0]=sheet)  # CPython3
# ---------- python_script.python (31 lines) ----------
# Copyright (c) Data Shapes, 2025
# Data-Shapes www.data-shapes.io, elayoubi.mostafa@data-shapes.io

import clr

clr.AddReference('RevitAPI')
from Autodesk.Revit.DB import FilteredElementCollector, BuiltInCategory

clr.AddReference('RevitServices')
from RevitServices.Persistence import DocumentManager

doc = DocumentManager.Instance.CurrentDBDocument


def tolist(input):
    if isinstance(input, list):
        return input
    return [input]


viewsheets = tolist(IN[0])
output = []

tblocks = FilteredElementCollector(doc).OfCategory(BuiltInCategory.OST_TitleBlocks).ToElements()

for v in viewsheets:
    view = UnwrapElement(v)
    viewtb = [tb.Symbol for tb in tblocks if tb.OwnerViewId.IntegerValue == view.Id.IntegerValue]
    output.append(viewtb)

OUT = output
# ----------------------------------------
TitleBlockFamilyType = Output(python_script)
