# Dynamo custom node Sheet_Titleblock.dyf (Dynamo 3.3.0.6316)
# category: Data-Shapes.Revit.Sheets
# Gets the titleblock used in a Sheet

Sheet = Input(Sheet_: var[]..[])
python_script = Python(IN[0]=Sheet)  # CPython3
# ---------- python_script.python (41 lines) ----------
# Copyright (c) Data Shapes, 2025
# Data-Shapes www.data-shapes.io, elayoubi.mostafa@data-shapes.io

import clr

clr.AddReference('RevitAPI')
from Autodesk.Revit.DB import FilteredElementCollector, BuiltInCategory

clr.AddReference('RevitServices')
from RevitServices.Persistence import DocumentManager

doc = DocumentManager.Instance.CurrentDBDocument


def tolist(input):
    if isinstance(input, list):
        return input
    return [input]


viewsheets = tolist(IN[0])
instance = []
familyTypes = []
families = []

titleblocks = FilteredElementCollector(doc).OfCategory(BuiltInCategory.OST_TitleBlocks).ToElements()

for v in viewsheets:
    try:
        view = UnwrapElement(v)
        viewtb = [tb for tb in titleblocks if tb.OwnerViewId.IntegerValue == view.Id.IntegerValue][0]
        famSymbol = viewtb.Symbol
        instance.append(viewtb)
        familyTypes.append(famSymbol)
        families.append(famSymbol.Family)
    except:
        instance.append(None)
        familyTypes.append(None)
        families.append(None)

OUT = instance, familyTypes, families
# ----------------------------------------
code_block = CodeBlock(x=python_script) { x[0]; x[1]; x[2]; }
TitleBlock_FamilyInstance = Output(code_block.out0)
TitleBlock_FamilyType = Output(code_block.out1)
TitleBlock_Family = Output(code_block.out2)
