# Dynamo custom node SlabShape.AddPoints.dyf (Dynamo 3.3.0.6316)
# category: Data-Shapes.Revit.Floors
# Add points to slab shape

FloorElement = Input(FloorElement: var[]..[])
Points = Input(Points_: var[]..[])
ResetSlabShape = Input(ResetSlabShape: bool = false)
python_script = Python(IN[0]=FloorElement, IN[1]=Points, IN[2]=ResetSlabShape)  # CPython3
# ---------- python_script.python (41 lines) ----------
# Copyright (c) Data Shapes, 2025
# Data-Shapes www.data-shapes.io, elayoubi.mostafa@data-shapes.io

import clr

clr.AddReference('RevitAPI')
from Autodesk.Revit.DB import *

clr.AddReference('RevitServices')
from RevitServices.Persistence import DocumentManager
from RevitServices.Transactions import TransactionManager

doc = DocumentManager.Instance.CurrentDBDocument

slab = UnwrapElement(IN[0])
sshape = slab.SlabShapeEditor
pts = IN[1]
_reset = IN[2]

try:
    from Autodesk.Revit.DB import UnitType
    UIunit = Document.GetUnits(doc).GetFormatOptions(UnitType.UT_Length).DisplayUnits
except:
    from Autodesk.Revit.DB import SpecTypeId
    UIunit = Document.GetUnits(doc).GetFormatOptions(SpecTypeId.Length).GetUnitTypeId()

TransactionManager.Instance.EnsureInTransaction(doc)
watch = []
if _reset:
    sshape.ResetSlabShape()

for i in pts:
    watch.append(sshape.DrawPoint(XYZ(
        UnitUtils.ConvertToInternalUnits(i.X, UIunit),
        UnitUtils.ConvertToInternalUnits(i.Y, UIunit),
        UnitUtils.ConvertToInternalUnits(i.Z, UIunit)
    )))

TransactionManager.Instance.TransactionTaskDone()

OUT = slab
# ----------------------------------------
OUT = Output(python_script)
