# Dynamo custom node SlabShape.AddSplitLine.dyf (Dynamo 3.3.0.6316)
# category: Data-Shapes.Revit.Floors
# Adds split lines to Revit Floors

FloorElement = Input(FloorElement: var[])
Curves = Input(Curves_: var[])
ResetSlabShape = Input(ResetSlabShape: bool = true)
python_script = Python(IN[0]=FloorElement, IN[1]=Curves, IN[2]=ResetSlabShape)  # CPython3
# ---------- python_script.python (59 lines) ----------
# Copyright (c) Data Shapes, 2025
# Data-Shapes www.data-shapes.io, elayoubi.mostafa@data-shapes.io

import clr

clr.AddReference('RevitAPI')
from Autodesk.Revit.DB import *

clr.AddReference('RevitServices')
from RevitServices.Persistence import DocumentManager
from RevitServices.Transactions import TransactionManager

clr.AddReference('RevitNodes')
import Revit
clr.ImportExtensions(Revit.Elements)
clr.ImportExtensions(Revit.GeometryConversion)

doc = DocumentManager.Instance.CurrentDBDocument
floor = UnwrapElement(IN[0])
sshpe = floor.SlabShapeEditor


def tolist(input):
    if isinstance(input, list):
        return UnwrapElement(input)
    else:
        return [UnwrapElement(input)]


def dscurvevertices(curve):
    try:
        rvtline = list(curve.get_Geometry(Options()))[0]
    except:
        rvtline = UnwrapElement(curve).ToRevitType()
    return rvtline.GetEndPoint(0), rvtline.GetEndPoint(1)


def drawline(slabshape, line):
    sp = slabshape.DrawPoint(dscurvevertices(line)[0])
    ep = slabshape.DrawPoint(dscurvevertices(line)[1])
    slabshape.DrawSplitLine(sp, ep)
    return slabshape


curves = tolist(IN[1])
resetSlabShape = IN[2]

TransactionManager.Instance.EnsureInTransaction(doc)

if resetSlabShape:
    sshpe.ResetSlabShape
else:
    pass
for c in curves:
    drawline(sshpe, c)

TransactionManager.Instance.TransactionTaskDone()

OUT = floor
# ----------------------------------------
Floor = Output(python_script)
