# Dynamo custom node Slider Data.dyf "Slider" (Dynamo 3.3.0.6316)
# category: Data-Shapes.UI.Input
# Creates slider input for UI.MultipleInputForm ++ . Set the step to decimal value if you want a double slider, or to a integer value if you want an integer slider.

InputName = Input(InputName_: string = "")
Minimum = Input(Minimum_: var[]..[])
Maximum = Input(Maximum_: var[]..[])
Default_Value = Input(Default_Value_: var = "")
Step = Input(Step_: var = 1)
python_script = Python(IN[0]=InputName, IN[1]=Minimum, IN[2]=Maximum, IN[3]=Default_Value, IN[4]=Step)  # CPython3
# ---------- python_script.python (21 lines) ----------
# Copyright (c) Data Shapes, 2025
# Data-Shapes www.data-shapes.io, elayoubi.mostafa@data-shapes.io @data_shapes


class uislider():
    
    def __init__(self, inputname, minimum, maximum, defaultvalue, step):
        self._input_type = 'uislider'
        self.inputname = inputname
        self.minimum = minimum
        self.maximum = maximum
        self.defaultvalue = defaultvalue
        self.step = step
    
    def __repr__(self):
        return 'UI.Slider input'


x = uislider(IN[0], IN[1], IN[2], IN[3], IN[4])

OUT = x
# ----------------------------------------
Slider_input = Output(python_script)
