# Dynamo custom node TextBox Data.dyf (Dynamo 3.3.0.6316)
# category: Data-Shapes.UI.Input
# Create Data for TextBox input in UI.MultipleInputForm ++ . Check out www.data-shapes.net for more informations

InputName = Input(InputName: string = "")
DefaultText = Input(DefaultText: string = "")
IsNumberEntry = Input(IsNumberEntry: bool = false)
python_script = Python(IN[0]=InputName, IN[1]=DefaultText, IN[2]=IsNumberEntry)  # CPython3
# ---------- python_script.python (24 lines) ----------
# Copyright (c) Data Shapes, 2025
# Data-Shapes www.data-shapes.io, elayoubi.mostafa@data-shapes.io @data_shapes


class uitext(object):

    def __init__(self, inputname="", defaultvalue="", isnum=False):
        self.inputname = inputname if inputname is not None else ""
        if isnum and defaultvalue:
            self.defaultvalue = str(defaultvalue).replace(',', '.')
        else:
            self.defaultvalue = defaultvalue if defaultvalue is not None else ""
        self._isnum = isnum if isnum is not None else False
        self._input_type = 'uitext'

    def __repr__(self):
        return 'UI.Textbox input'


inputname = IN[0] if len(IN) > 0 else ""
defaultvalue = IN[1] if len(IN) > 1 else ""
isnum = IN[2] if len(IN) > 2 else False

OUT = uitext(inputname, defaultvalue, isnum)
# ----------------------------------------
TextBox_input = Output(python_script)
