# Dynamo custom node TextNote Data.dyf (Dynamo 3.3.0.6316)
# category: Data-Shapes.UI.Input
# Create Data for TextNote input in UI.MultipleInputForm ++ . Check out www.data-shapes.net for more informations

Title = Input(Title: string = "")
TextNote = Input(TextNote_: string)
python_script = Python(IN[0]=Title, IN[1]=TextNote)  # CPython3
# ---------- python_script.python (20 lines) ----------
# Copyright (c) Data Shapes, 2025
# Data-Shapes www.data-shapes.io, elayoubi.mostafa@data-shapes.io @data_shapes


class uitextnote(object):

    def __init__(self, inputname="", title="", textnote=""):
        self.inputname = inputname if inputname is not None else ""
        self.title = title if title is not None else ""
        self.textnote = textnote if textnote is not None else ""
        self._input_type = "uitextnote"

    def __repr__(self):
        return "UI.TextNote input"


title = IN[0] if len(IN) > 0 else ""
textnote = IN[1] if len(IN) > 1 else ""
inputname = IN[2] if len(IN) > 2 else ""
OUT = uitextnote(inputname, title, textnote)
# ----------------------------------------
TextBox_input = Output(python_script)
