# Dynamo custom node Transform.OriginAndVectors.dyf (Dynamo 3.3.0.6316)
# category: Data-Shapes.Revit.Transform
# Gets origin and vetorx of Autodesk.Revit.DB.Transform objects

Transform = Input(Transform: var[]..[])
python_script = Python(IN[0]=Transform)  # CPython3
# ---------- python_script.python (28 lines) ----------
# Copyright (c) Data Shapes, 2025
# Data-Shapes www.data-shapes.io, elayoubi.mostafa@data-shapes.io

import clr

clr.AddReference('RevitAPI')
from Autodesk.Revit.DB import Transform

clr.AddReference('RevitNodes')
import Revit
clr.ImportExtensions(Revit.Elements)
clr.ImportExtensions(Revit.GeometryConversion)


def tolist(input):
    if isinstance(input, list):
        return input
    return [input]


transforms = tolist(IN[0])

o = [t.Origin.ToPoint() for t in transforms]
x = [t.BasisX.ToVector() for t in transforms]
y = [t.BasisY.ToVector() for t in transforms]
z = [t.BasisZ.ToVector() for t in transforms]

OUT = o, x, y, z
# ----------------------------------------
code_block = CodeBlock(x=python_script) { x[0]; x[1]; x[2]; x[3]; }
Origin = Output(code_block.out0)
BasisX = Output(code_block.out1)
BasisY = Output(code_block.out2)
BasisZ = Output(code_block.out3)
