# Dynamo custom node View.ViewRange.dyf (Dynamo 3.3.0.6316)
# category: Data-Shapes.Revit.View
# Returns the view range data of a view

Views = Input(Views_: var[])
python_script = Python(IN[0]=Views)  # CPython3
# ---------- python_script.python (57 lines) ----------
# Copyright (c) Data Shapes, 2025
# Data-Shapes www.data-shapes.io, elayoubi.mostafa@data-shapes.io @data_shapes

import clr

clr.AddReference('RevitAPI')
from Autodesk.Revit.DB import (
    Document,
    ElementCategoryFilter,
    FilteredElementCollector,
    BuiltInCategory,
    BuiltInParameter,
    PlanViewPlane,
    UnitUtils
)

clr.AddReference('RevitServices')
from RevitServices.Persistence import DocumentManager

doc = DocumentManager.Instance.CurrentDBDocument


def tolist(input):
    if isinstance(input, list):
        return input
    return [input]


try:
    from Autodesk.Revit.DB import UnitType
    UIunit = Document.GetUnits(doc).GetFormatOptions(UnitType.UT_Length).DisplayUnits
except:
    from Autodesk.Revit.DB import SpecTypeId
    UIunit = Document.GetUnits(doc).GetFormatOptions(SpecTypeId.Length).GetUnitTypeId()


def ViewRangeInfos(v):
    vr = v.GetViewRange()
    topclip = PlanViewPlane.TopClipPlane
    bottomclip = PlanViewPlane.BottomClipPlane
    cutclip = PlanViewPlane.CutPlane
    
    toplevel = doc.GetElement(vr.GetLevelId(topclip))
    topoffset = UnitUtils.ConvertFromInternalUnits(vr.GetOffset(topclip), UIunit)
    
    botlevel = doc.GetElement(vr.GetLevelId(bottomclip))
    botoffset = UnitUtils.ConvertFromInternalUnits(vr.GetOffset(bottomclip), UIunit)
    
    cutlevel = doc.GetElement(vr.GetLevelId(cutclip))
    cutoffset = UnitUtils.ConvertFromInternalUnits(vr.GetOffset(cutclip), UIunit)
    
    return toplevel, topoffset, cutlevel, cutoffset, botlevel, botoffset


views = tolist(UnwrapElement(IN[0]))

OUT = [ViewRangeInfos(view) for view in views]
# ----------------------------------------
transpose = List.Transpose(lists=python_script)
code_block = CodeBlock(x=transpose) { x[0]; x[1]; x[2]; x[3]; x[4]; x[5]; }
Top_Clip_Level = Output(code_block.out0)
Top_Clip_Offset = Output(code_block.out1)
Clip_Plane_Level = Output(code_block.out2)
Clip_Plane_Offset = Output(code_block.out3)
Bottom_Plane_Level = Output(code_block.out4)
Bottom_Plane_Offset = Output(code_block.out5)
