# Dynamo custom node ViewLevel.dyf (Dynamo 3.3.0.6316)
# category: Data-Shapes.Revit.View
# gets the level that a view is associated to

View = Input(View_: var[]..[])
python_script = Python(IN[0]=View)  # CPython3
# ---------- python_script.python (27 lines) ----------
# Copyright (c) Data Shapes, 2025
# Data-Shapes www.data-shapes.io, elayoubi.mostafa@data-shapes.io @data_shapes

import clr

clr.AddReference('RevitAPI')
from Autodesk.Revit.DB import *

clr.AddReference('RevitServices')
from RevitServices.Persistence import DocumentManager

doc = DocumentManager.Instance.CurrentDBDocument


def tolist(input):
    if isinstance(input, list):
        return input
    return [input]


views = [UnwrapElement(v) for v in tolist(IN[0])]

out = []
for v in views:
    out.append(v.GenLevel)

OUT = out
# ----------------------------------------
OUT = Output(python_script)
