# Dynamo custom node ViewSection.ByLine.dyf (Dynamo 3.3.0.6316)
# category: Data-Shapes.Revit.View
# Create ViewSections in current document from DS Lines.

Curves = Input(Curves: var[])
ViewFamilyType = Input(ViewFamilyType: var[]..[])
ViewSectionHeight = Input(ViewSectionHeight: var[]..[])
OffsetFromLine = Input(OffsetFromLine: var[]..[])
Depth = Input(Depth_: double = 10)
python_script = Python(IN[0]=Curves, IN[1]=ViewFamilyType, IN[2]=ViewSectionHeight, IN[3]=OffsetFromLine, IN[4]=Depth)  # CPython3
# ---------- python_script.python (113 lines) ----------
# Copyright (c) Data Shapes, 2025
# Data-Shapes www.data-shapes.io, elayoubi.mostafa@data-shapes.io @data_shapes

import clr

clr.AddReference('RevitAPI')
from Autodesk.Revit.DB import (
    Document,
    ElementId,
    ViewSection,
    BoundingBoxXYZ,
    Transform,
    XYZ,
    UnitUtils,
    Transaction
)

clr.AddReference('RevitServices')
from RevitServices.Persistence import DocumentManager

clr.AddReference('RevitNodes')
import Revit
clr.ImportExtensions(Revit.GeometryConversion)

doc = DocumentManager.Instance.CurrentDBDocument

try:
    from Autodesk.Revit.DB import UnitType
    UIunit = Document.GetUnits(doc).GetFormatOptions(UnitType.UT_Length).DisplayUnits
except:
    from Autodesk.Revit.DB import SpecTypeId
    UIunit = Document.GetUnits(doc).GetFormatOptions(SpecTypeId.Length).GetUnitTypeId()


def tolist(input):
    if isinstance(input, list):
        return input
    return [input]


def convert_to_internal(value):
    return UnitUtils.ConvertToInternalUnits(value, UIunit)


def create_section_from_curve(curve, view_family_type, offset, height, depth, doc):
    revit_curve = curve.ToRevitType()
    start_point = revit_curve.GetEndPoint(0)
    end_point = revit_curve.GetEndPoint(1)
    
    direction = end_point - start_point
    width = direction.GetLength()
    
    bb_min = XYZ(-width / 2, 0, -offset)
    bb_max = XYZ(width / 2, height, depth)
    
    midpoint = start_point + 0.5 * direction
    line_direction = direction.Normalize()
    up = XYZ.BasisZ
    view_direction = line_direction.CrossProduct(up).Normalize()
    
    transform = Transform.Identity
    transform.Origin = midpoint
    transform.BasisX = line_direction
    transform.BasisY = up
    transform.BasisZ = view_direction
    
    section_bb = BoundingBoxXYZ()
    section_bb.Enabled = True
    section_bb.Transform = transform
    section_bb.Min = bb_min
    section_bb.Max = bb_max
    
    section_bb.set_MinEnabled(0, True)
    section_bb.set_MinEnabled(1, True)
    section_bb.set_MinEnabled(2, True)
    section_bb.set_MaxEnabled(0, True)
    section_bb.set_MaxEnabled(1, True)
    section_bb.set_MaxEnabled(2, True)
    
    section = ViewSection.CreateSection(doc, ElementId(view_family_type.Id), section_bb)
    
    return section


curves = tolist(IN[0])
view_family_type = IN[1]
height = convert_to_internal(IN[2])
offset_from_wall = convert_to_internal(IN[3])
depth = convert_to_internal(IN[4])

sections = []

t = Transaction(doc, 'Create Section Views from Curves')
t.Start()
try:
    for curve in curves:
        section = create_section_from_curve(
            curve,
            view_family_type,
            offset_from_wall,
            height,
            depth,
            doc
        )
        sections.append(section)
    
    t.Commit()
except Exception as ex:
    if t.HasStarted():
        t.RollBack()
    raise

OUT = sections
# ----------------------------------------
ViewSection_s = Output(python_script)  # "ViewSection(s)"
