# Dynamo custom node ViewTemplate.IsApplied.dyf (Dynamo 3.3.0.6316)
# category: Data-Shapes.Revit.Elements
# Returns a boolean value indicating wether a ViewTemplate is applied to any view in the project or not. This won't work for 3D templates.

ViewTemplate = Input(ViewTemplate_: var[]..[])
isApplied = Python(IN[0]=ViewTemplate)  # "ViewTemplate.IsApplied"; CPython3
# ---------- isApplied.python (43 lines) ----------
# Copyright (c) Data Shapes, 2025
# Data-Shapes www.data-shapes.io, elayoubi.mostafa@data-shapes.io @data_shapes

import clr

clr.AddReference('RevitAPI')
from Autodesk.Revit.DB import FilteredElementCollector, View

clr.AddReference('RevitServices')
from RevitServices.Persistence import DocumentManager

doc = DocumentManager.Instance.CurrentDBDocument


def tolist(input):
    if isinstance(input, list):
        return input
    return [input]


allViews = [v for v in FilteredElementCollector(doc).OfClass(View).ToElements() if v.IsValidObject]

ViewTemplates = [UnwrapElement(vt) for vt in tolist(IN[0])]

appliedTemplates = []

for view in allViews:
    try:
        viewTemplateId = view.ViewTemplateId
        if viewTemplateId not in appliedTemplates:
            appliedTemplates.append(viewTemplateId)
    except:
        pass

isApplied = []

for vt in ViewTemplates:
    try:
        isApplied.append(vt.Id in appliedTemplates)
    except:
        isApplied.append(False)

OUT = isApplied
# ----------------------------------------
bool = Output(isApplied)
