# Dynamo custom node ViewportLocation++.dyf (Dynamo 3.3.0.6316)
# category: Data-Shapes.Revit.Sheets
# Gets the location point of a viewport or a ScheduleSheetInstance

Viewport_Or_ScheduleSheetIndtance = Input(Viewport_Or_ScheduleSheetIndtance: var[]..[])
python_script = Python(IN[0]=Viewport_Or_ScheduleSheetIndtance)  # CPython3
# ---------- python_script.python (40 lines) ----------
# Copyright (c) Data Shapes, 2025
# Data-Shapes www.data-shapes.io, elayoubi.mostafa@data-shapes.io @data_shapes

import clr
clr.AddReference('RevitAPI')
from Autodesk.Revit.DB import *
clr.AddReference('ProtoGeometry')
from Autodesk.DesignScript.Geometry import Point as dspt
clr.AddReference('RevitServices')
from RevitServices.Persistence import DocumentManager
doc = DocumentManager.Instance.CurrentDBDocument
output = []

clr.AddReference('RevitNodes')
import Revit
clr.ImportExtensions(Revit.GeometryConversion)

from RevitServices.Transactions import TransactionManager
TransactionManager.Instance.ForceCloseTransaction


def toList(input):
    if isinstance(input, list):
        return UnwrapElement(input)
    else:
        return [UnwrapElement(input)]


locs = []

vps = toList(IN[0])

for v in vps:
    try:
        locs.append(v.GetBoxCenter().ToPoint())
    except:
        locs.append(v.Point.ToPoint())
        

OUT = locs
# ----------------------------------------
Point = Output(python_script)
