# Dynamo custom node WallSweepOnWall.dyf (Dynamo 3.3.0.6316)
# category: Data-Shapes.Revit.Walls
# Creates a wallsweep or reveal on a wall

Walls = Input(Walls: var[])
SweepOrRevealType = Input(SweepOrRevealType: var[]..[])
IsReveal = Input(IsReveal: bool = true)
IsVertical = Input(IsVertical: bool = false)
Distance = Input(Distance: var[]..[])
python_script = Python(IN[0]=Walls, IN[1]=SweepOrRevealType, IN[2]=IsReveal, IN[3]=IsVertical, IN[4]=Distance)  # CPython3
# ---------- python_script.python (66 lines) ----------
# Copyright (c) Data Shapes, 2025
# Data-Shapes www.data-shapes.io, elayoubi.mostafa@data-shapes.io

import clr

clr.AddReference('RevitAPI')
from Autodesk.Revit.DB import (
    Document,
    ElementId,
    Transaction,
    UnitUtils,
    WallSweep,
    WallSweepInfo,
    WallSweepType
)

clr.AddReference('RevitServices')
from RevitServices.Persistence import DocumentManager

try:
    from Autodesk.Revit.DB import UnitType
except:
    from Autodesk.Revit.DB import SpecTypeId

doc = DocumentManager.Instance.CurrentDBDocument


def tolist(input):
    if isinstance(input, list):
        return input
    return [input]


walls = [UnwrapElement(i) for i in tolist(IN[0])]

wstype = ElementId(IN[1].Id)
sr = IN[2]
vertical = IN[3]

try:
    UIunit = Document.GetUnits(doc).GetFormatOptions(UnitType.UT_Length).DisplayUnits
except:
    UIunit = Document.GetUnits(doc).GetFormatOptions(SpecTypeId.Length).GetUnitTypeId()

dist = UnitUtils.ConvertToInternalUnits(IN[4], UIunit)

if not sr:
    wsi = WallSweepInfo(WallSweepType.Sweep, vertical)
else:
    wsi = WallSweepInfo(WallSweepType.Reveal, vertical)

wsi.Distance = dist

ws = []
t = Transaction(doc, 'Create Wall Sweeps')
t.Start()
try:
    for w in walls:
        ws.append(WallSweep.Create(w, wstype, wsi))
    t.Commit()
except Exception as ex:
    if t.HasStarted():
        t.RollBack()
    raise

OUT = ws
# ----------------------------------------
WallSweep_s = Output(python_script)  # "WallSweep(s)"
