# Dynamo graph Etiquettes - Aligner les étiquettes de pièces au point de référence.dyn (Dynamo 2.3.0.5885)
# packages: Data-Shapes 2019.2.42

code_block = CodeBlock { "Room Tags"; }
categorie_s_by_enu_name_s = Custom[Categorie(s) by ENU Name(s)](CategoryNameInEnglish=code_block)  # package Data-Shapes
all_elements_of_category = ElementsOfCategory(Category=categorie_s_by_enu_name_s.Categorie_s)

# group: Filtering Room Tags
python_script = Python(IN[0]=all_elements_of_category)
# ---------- python_script.python (15 lines) ----------
import clr
clr.AddReference('RevitAPI')
from Autodesk.Revit.DB import*

if isinstance(IN[0],list):
    tags = UnwrapElement(IN[0])
else:
    tags = [UnwrapElement(IN[0])]
tagview = []
for t in tags:
    try:
        tagview.append(t.View)
    except:
        tagview.append('')
OUT = tagview
# ----------------------------------------
groupByKey = List.GroupByKey(list=all_elements_of_category, keys=python_script)

# group: Data-Shape
code_block_2 = CodeBlock { "Section des vues"; }
code_block_3 = CodeBlock { "Alligner"; 170; 900; }
code_block_4 = CodeBlock { "Vues contenant des étiquettes de pièces"; }
name = Element.Name(element=python_script)
boolean = BoolSelector(true)
code_block_5 = CodeBlock { "Annuler"; }

code_block_6 = CodeBlock(Keys_=name) { Keys_: var[]; }
code_block_7 = CodeBlock { Height_optionnal: int = 200; }
code_block_8 = CodeBlock()
# ---------- code_block_8.designscript (2 lines) ----------
/* If set to true, clicking elements of the listview will highlight them in a view like Dynamo's watch node*/
HilightInView_optionnal: bool = false;
# ----------------------------------------
code_block_9 = CodeBlock()
# ---------- code_block_9.designscript (2 lines) ----------
/* Turns off ability to select elements. Form will not output any data for this element.*/
DisplayModeOnly_optionnal: bool = false;
# ----------------------------------------
code_block_10 = CodeBlock()
# ---------- code_block_10.designscript (2 lines) ----------
/* Will display the number of elements underneath the input name*/
ShowElementCount_optionnal: bool = false;
# ----------------------------------------
code_block_11 = CodeBlock { DefaultValueIndices_optionnal: int[] = DSCore.List.Empty; }
code_block_12 = CodeBlock()
# ---------- code_block_12.designscript (2 lines) ----------
/* Determines wether the ListView items are sorted or not*/
SortItems_optionnal: bool = true;
# ----------------------------------------
code_block_13 = CodeBlock()
# ---------- code_block_13.designscript (2 lines) ----------
/* Warning: disabling this will cause the listview input creation to fail in case there are elements with the same name*/
ShowId_optionnal: bool = true;
# ----------------------------------------
python_script_2 = Python(IN[0]=code_block_4, IN[1]=code_block_6, IN[2]=groupByKey.groups, IN[3]=code_block_7, IN[4]=code_block_8, IN[5]=code_block_9, IN[6]=code_block_10, IN[7]=code_block_11, IN[8]=code_block_12, IN[9]=code_block_13)
# ---------- python_script_2.python (74 lines) ----------
#Copyright (c) mostafa el ayoubi ,  2016
#Data-Shapes www.data-shapes.net , elayoubi.mostafa@gmail.com

class listview():

    def __init__(self,inputname,height,highlight,display_mode,element_count,default_values,sorted,showId):
        self.inputname = inputname
        self.height = height
        self.highlight = highlight
        self.display_mode = display_mode
        self.element_count = element_count
        self.default_values = default_values
        self.sorted = sorted
        self.showId = showId

    def __setitem__(self, key, item):
        self.__dict__[key] = item

    def __getitem__(self, key):
        return self.__dict__[key]

    def __iter__(self):
        return iter(self.__dict__)

    def values(self):
        return self.__dict__.values()

    def keys(self):
        return self.__dict__.keys()

    def __repr__(self):
        return 'UI.ListView input'

if isinstance(IN[1],list):
	in1 = IN[1]
else:
	in1 = [IN[1]]

if isinstance(IN[2],list):
	in2 = IN[2]
else:
	in2 = [IN[2]]

if IN[6]:
	element_count = len(in1)
else:
	element_count = 0

x = listview(IN[0],IN[3],IN[4],IN[5],element_count,IN[7],IN[8],IN[9])

for k,v in zip(in1,in2):
	if x.showId :
		try:
			try:
				x[str(k)+ '  -  id: ' + str(v.Id)] = v
			except:
				x[k.encode('utf-8').decode('utf-8') + '  -  id: ' + str(v.Id)] = v
		except:
			try:
				x[str(k)] = v
			except:
				x[k.encode('utf-8').decode('utf-8')] = v
	else:
		try:
			try:
				x[str(k)] = v
			except:
				x[k.encode('utf-8').decode('utf-8')] = v
		except:
			try:
				x[str(k)] = v
			except:
				x[k.encode('utf-8').decode('utf-8')] = v
OUT = x
# ----------------------------------------

# group (continued): Data-Shape
ui_multipleinputform = Custom[UI.MultipleInputForm ++](Description_optional=code_block_2, ButtonText_optional=code_block_3.out0, Inputs=python_script_2, Toggle=boolean, CancelButtonText_optional=code_block_5, Width_optional=code_block_3.out2, LabelWidth_optional=code_block_3.out1)  # package Data-Shapes

code_block_14 = CodeBlock(x=ui_multipleinputform.User_Inputs) { x; }
flatten = List.Flatten(list=code_block_14)
python_script_3 = Python(IN[0]=flatten)
# ---------- python_script_3.python (38 lines) ----------
#Custom Python node created by Sol Amour @solamour
#http://designtech.io
#Inspired by BVN Package and Paul Wintour

import clr
clr.AddReference('ProtoGeometry')
from Autodesk.DesignScript.Geometry import *

import clr
clr.AddReference('RevitAPI') 
clr.AddReference('RevitAPIUI') 
from Autodesk.Revit.DB import *

clr.AddReference("RevitServices")
import RevitServices
from RevitServices.Persistence import DocumentManager
from RevitServices.Transactions import TransactionManager

clr.AddReference("RevitNodes")
import Revit
clr.ImportExtensions(Revit.GeometryConversion)

doc = DocumentManager.Instance.CurrentDBDocument
 
#The inputs to this node will be stored as a list in the IN variables.
roomTags = UnwrapElement(IN[0])

TransactionManager.Instance.EnsureInTransaction(doc)
	
for r in roomTags:
	if r.Room != None:
		r.Location.Move(r.Room.Location.Point - r.Location.Point)

# End Transaction
TransactionManager.Instance.TransactionTaskDone()

#Assign your output to the OUT variable.
OUT = roomTags
# ----------------------------------------
code_block_15 = CodeBlock(x=python_script_3) { x; }
code_block_16 = CodeBlock(x=code_block_15) { x; }
code_block_17 = CodeBlock(x=python_script_3) { x; }
