# Dynamo graph spécial charaçter.dyn "Generation plans de vente 2.3_Choix d'appartement" (Dynamo 2.3.0.5885)
# packages: archi-lab.net 2020.23.13, Data-Shapes 2021.2.9, Data-Shapes 2022.2.96

code_block = CodeBlock { "Génération automatique de plans de vente"; }
code_block_2 = CodeBlock { "Valider"; }
code_block_3 = CodeBlock { "Rooms"; }
categorie_s_by_enu_name_s = Custom[Categorie(s) by ENU Name(s)](CategoryNameInEnglish=code_block_3)  # package Data-Shapes; Gets categorie(s) in the current UI language by it's english name
boolean = BoolSelector(true)

# group: UI DS
code_block_4 = CodeBlock { "Choix de la feuille de référence"; }
python_script = Python()  # graph input
# ---------- python_script.python (17 lines) ----------
#Copyright (c) mostafa el ayoubi
#Data-Shapes 2019 mostafa.elayoubi@data-shapes.io


import clr
clr.AddReference('RevitApi')
from Autodesk.Revit.DB import*
clr.AddReference('RevitServices')
from RevitServices.Persistence import DocumentManager
from RevitServices.Transactions import TransactionManager

doc = DocumentManager.Instance.CurrentDBDocument


sheets = FilteredElementCollector(doc).OfClass(ViewSheet).ToElements()

OUT = sheets
# ----------------------------------------
sheetName = Sheet.SheetName(sheet=python_script)
ui_dropdown_data = Custom[UI.DropDown Data](InputName=code_block_4, Keys=sheetName, Values=python_script)  # package Data-Shapes; Create data for DropDown input in UI.MultiInputForm ++ . Check out www.data-shapes.net for more infos.
code_block_5 = CodeBlock { "Choix du type de zone de remplissage"; }
python_script_2 = Python()  # graph input
# ---------- python_script_2.python (17 lines) ----------
#Copyright (c) mostafa el ayoubi
#Data-Shapes 2019 mostafa.elayoubi@data-shapes.io


import clr
clr.AddReference('RevitApi')
from Autodesk.Revit.DB import*
clr.AddReference('RevitServices')
from RevitServices.Persistence import DocumentManager
from RevitServices.Transactions import TransactionManager

doc = DocumentManager.Instance.CurrentDBDocument


frt = FilteredElementCollector(doc).OfClass(FilledRegionType).WhereElementIsElementType().ToElements()

OUT = frt
# ----------------------------------------
name = Element.Name(element=python_script_2)
ui_dropdown_data_2 = Custom[UI.DropDown Data](InputName=code_block_5, Keys=name, Values=name)
code_block_6 = CodeBlock { "Choix du paramètre contenant le numéro d'appt"; }
all_elements_of_category = ElementsOfCategory(Category=categorie_s_by_enu_name_s.Categorie_s)
firstItem = List.FirstItem(list=all_elements_of_category)
parameters = Element.Parameters(element=firstItem)
name_2 = Parameter.Name(parameter=parameters)
ui_dropdown_data_3 = Custom[UI.DropDown Data](InputName=code_block_6, Keys=name_2, Values=name_2)
create = List.Create(item0=ui_dropdown_data, item1=ui_dropdown_data_2, item2=ui_dropdown_data_3)
ui_multipleinputform = Custom[UI.MultipleInputForm ++](Description_optional=code_block, ButtonText_optional=code_block_2, Inputs=create, Toggle=boolean)  # package Data-Shapes; Create a form with multiple inputs. see www.data-shapes.net for tutorials and infos!

# group: UI 2 - choix des appartements
code_block_7 = CodeBlock(x=ui_multipleinputform.User_Inputs) { x[0]; x[1]; x[2]; }
code_block_8 = CodeBlock { "Choix des appartements à exporter"; }
getParameterValueByName = Element.GetParameterValueByName(element=all_elements_of_category, parameterName=code_block_7.out2)
uniqueItems = List.UniqueItems(list=getParameterValueByName)
code_block_9 = CodeBlock { ""; }
eq = uniqueItems == code_block_9
filterByBoolMask = List.FilterByBoolMask(list=uniqueItems, mask=eq)
ui_listview_data = Custom[UI.Listview Data](InputName=code_block_8, Keys=filterByBoolMask.out, Values=filterByBoolMask.out)  # package Data-Shapes; Create data for ListView input in UI.MultiInputForm ++ . Check out www.data-shapes.net for more infos.
ui_multipleinputform_2 = Custom[UI.MultipleInputForm ++](Description_optional=code_block, ButtonText_optional=code_block_2, Inputs=ui_listview_data, Toggle=ui_multipleinputform.Was_Run)
code_block_10 = CodeBlock(x=ui_multipleinputform_2.User_Inputs) { x[0]; }
contains = List.Contains(list=code_block_10@L2, item=getParameterValueByName@L1, lacing=Longest)
filterByBoolMask_2 = List.FilterByBoolMask(list=all_elements_of_category, mask=contains)

# group: Elements de la feuille originale
python_script_3 = Python(IN[0]=code_block_7.out0)
# ---------- python_script_3.python (16 lines) ----------
# Activer la prise en charge de Python et charger la bibliothèque DesignScript
import clr
clr.AddReference('RevitAPI')
from Autodesk.Revit.DB import *
clr.AddReference('RevitServices')
from RevitServices.Persistence import DocumentManager

doc = DocumentManager.Instance.CurrentDBDocument

sh = UnwrapElement(IN[0])
vp = FilteredElementCollector(doc,sh.Id).OfClass(Viewport).ToElements()
schI = FilteredElementCollector(doc,sh.Id).OfClass(ScheduleSheetInstance).ToElements()
vs = [doc.GetElement(v.ViewId) for v in vp]
sch = [doc.GetElement(s.ScheduleId) for s in schI]

OUT = vp , schI , vs , sch
# ----------------------------------------
code_block_11 = CodeBlock(x=python_script_3)
# ---------- code_block_11.designscript (8 lines) ----------
//ViewPort
x[0];
//ScheduleSheetInstance
x[1];
//Views
x[2];
//Schedules
x[3];
# ----------------------------------------

code_block_12 = CodeBlock(x=code_block_11.out2) { x[0]; x[1]; }
code_block_13 = CodeBlock()
# ---------- code_block_13.designscript (2 lines) ----------
//Décalage
0.1;
# ----------------------------------------

# group: Refresh
boolean_2 = BoolSelector(false)  # graph input

# group: Briques fonctionnelles - contour appart
python_script_4 = Python(IN[0]=code_block_7.out2, IN[1]=code_block_13, IN[2]=boolean_2, IN[3]=filterByBoolMask_2.in)
# ---------- python_script_4.python (135 lines) ----------
# Enable Python support and load DesignScript library
import clr
clr.AddReference('RevitAPI')
from Autodesk.Revit.DB import *
from Autodesk.Revit.DB import UV as AUV

clr.AddReference('ProtoGeometry')
from Autodesk.DesignScript.Geometry import *

clr.AddReference('RevitServices')
from RevitServices.Persistence import DocumentManager
from RevitServices.Transactions import TransactionManager

import System
from System.Collections.Generic import*

clr.AddReference('RevitNodes')
import Revit
clr.ImportExtensions(Revit.Elements)
clr.ImportExtensions(Revit.GeometryConversion)

doc = DocumentManager.Instance.CurrentDBDocument
def toList(input):
	if isinstance(input,list):
		return UnwrapElement(input)
	else:
		return [UnwrapElement(input)]
		
rooms = toList(IN[3])
#names = [r.get_Parameter(BuiltInParameter.ROOM_NAME).AsString() for r in rooms]

Arooms = [r.LookupParameter(IN[0]).AsString() for r in rooms]
uniqueVals = list(set(Arooms))
try:
	uniqueVals.remove(None)
except:
	pass
try:
	uniqueVals.remove("")
except:
	pass
try:
	uniqueVals.remove("0")
except:
	pass

UIunit = Document.GetUnits(doc).GetFormatOptions(UnitType.UT_Length).DisplayUnits
offsetV = IN[1]

offV = UnitUtils.ConvertToInternalUnits(offsetV,UIunit)


def roomSolidOffset(room):
	bop = SpatialElementBoundaryOptions()
	bop.SpatialElementBoundaryLocation = SpatialElementBoundaryLocation.Center
	bounds = room.GetBoundarySegments(bop) 
	l = List[CurveLoop]()
	outlist = []
	for boundList in bounds:
		try:
			vcLoop = CurveLoop()
			watch = []
			for boundary in boundList:
				vcLoop.Append(boundary.GetCurve())
				#watch.append(boundary.GetCurve().ToProtoType())
			#_offCV = CurveLoop.CreateViaOffset(vcLoop,offV,XYZ.BasisZ)
			offCV = CurveLoop.CreateViaOffset(vcLoop,0,XYZ.BasisZ)
			l.Add(offCV)
			rsol = GeometryCreationUtilities.CreateExtrusionGeometry(l, XYZ(0, 0.2, 1),1)
			outlist.append(watch)
			return rsol
		except:
			pass
	
	

def solidBottomFaces(solid):
	faces = solid.Faces
	bottomFaces = [face  for face in faces if face.ComputeNormal(AUV(0.5,0.5)).Z < -0.5]
	return bottomFaces

def unionSolids(solids):
	union = solids[0]
	for solid in solids:
		try:
			union = BooleanOperationsUtils.ExecuteBooleanOperation(union, solid, BooleanOperationsType.Union)
		except:
			pass
	return union
	
def counterOffsetCvLoop(face):
	botCvLoops = face.GetEdgesAsCurveLoops()
	minOffset = []
	for CvLoop in botCvLoops:
		unoffCvLoop = CurveLoop.CreateViaOffset(CvLoop,0,XYZ.BasisZ)
		for cv in unoffCvLoop:
			minOffset.append(cv)
	return minOffset
	

#for val in uniqueVals:
def apptBound(numappart):
	grouped = [r for r in rooms if r.LookupParameter(IN[0]).AsString() == numappart]
	lev = grouped[0].Level	
	offsetRooms = [ roomSolidOffset(r) for r in grouped]
	globalSolid = unionSolids(offsetRooms)
	botFaces = solidBottomFaces(globalSolid)
	cvloops = [counterOffsetCvLoop(f) for f in botFaces]
	dsCurves = []	
	cvArray = CurveArray()
	for cvl in cvloops:
		for cv in cvl:
			cvArray.Append(cv)

	for loop in cvloops:
		for cv in loop:
			dsCurves.append(cv.ToProtoType())
	return dsCurves , lev


		

out = []
workingVals = [] 
failingvals = []
for num in uniqueVals:
	try:
		out.append(apptBound(num))
		workingVals.append(num)
	except:
		failingvals.append(num)


	
OUT =  out , workingVals , failingvals
# ----------------------------------------

# group: nettoyage contours
code_block_14 = CodeBlock(x=python_script_4) { x[0]; x[1]; }
firstItem_2 = List.FirstItem(list=code_block_14.out0, lacing=Longest)
python_script_5 = Python(IN[0]=firstItem_2, IN[1]=code_block_14.out1)
# ---------- python_script_5.python (33 lines) ----------
# Activer la prise en charge de Python et charger la bibliothèque DesignScript
import clr
clr.AddReference('ProtoGeometry')
from Autodesk.DesignScript.Geometry import *


def biggestLoop(cvs,matchval):
	loops = []
	loop = []
	for e,cv in enumerate(cvs):
		try:
			if cv.DoesIntersect(cvs[e+1]):
				loop.append(cv)
			else:
				loop.append(cv)
				loops.append(loop)
				loop = []
		except:
				loop.append(cv)
				loops.append(loop)
				loop = []		
	polys = []
	try:
		for loop in loops:
			poly = PolyCurve.ByJoinedCurves(loop)
			polys.append(poly)
		sortedpoly = sorted(polys,key = lambda x : x.Length)
		return sortedpoly[-1] , matchval
	except:
		pass
	
	
OUT = [biggestLoop(l,v) for l,v in zip(IN[0],IN[1])]
# ----------------------------------------
code_block_15 = CodeBlock { false; }
clean = List.Clean(list=python_script_5, preserveIndices=code_block_15)

# group: Niveaux
lastItem = List.LastItem(list=code_block_14.out0, lacing=Longest)

transpose = List.Transpose(lists=clean)
code_block_16 = CodeBlock(x=transpose) { x[0]; x[1]; }

# group: Creation + nommage repérage par appartement
python_script_6 = Python(IN[0]=code_block_12.out1, IN[1]=lastItem, IN[2]=code_block_16.out1)
# ---------- python_script_6.python (45 lines) ----------
import clr

clr.AddReference('RevitAPI')
from Autodesk.Revit.DB import *

clr.AddReference('ProtoGeometry')
from Autodesk.DesignScript.Geometry import *

clr.AddReference('RevitServices')
from RevitServices.Persistence import DocumentManager
from RevitServices.Transactions import TransactionManager

import System
from System.Collections.Generic import*

clr.AddReference('RevitNodes')
import Revit
clr.ImportExtensions(Revit.Elements)
clr.ImportExtensions(Revit.GeometryConversion)

doc = DocumentManager.Instance.CurrentDBDocument
rooms = FilteredElementCollector(doc).OfCategory(BuiltInCategory.OST_Rooms).ToElements()

originalView = UnwrapElement(IN[0])
originalViewType = originalView.GetTypeId()
originalTemplate = originalView.ViewTemplateId

levelList = UnwrapElement(IN[1])

namelist = IN[2]


newViews = []
TransactionManager.Instance.EnsureInTransaction(doc)

for level,name in zip(levelList,namelist):
	v = ViewPlan.Create(doc,originalViewType,level.Id)
	v.ViewTemplateId = originalTemplate
	v.Name = "repérage " + name + "__"
	newViews.append(v)
	
TransactionManager.Instance.TransactionTaskDone

OUT = newViews
	
# ----------------------------------------

closeWithLine = PolyCurve.CloseWithLine(polyCurve=code_block_16.out0)
code_block_17 = CodeBlock(p=closeWithLine) { cleanDedentsOffset(p,0.1); }
code_block_18 = CodeBlock { 1; }
flatten = List.Flatten(list=code_block_17, amt=code_block_18)
python_script_7 = Python(IN[0]=flatten)
# ---------- python_script_7.python (39 lines) ----------
# Activer la prise en charge de Python et charger la bibliothèque DesignScript
import clr
clr.AddReference('ProtoGeometry')
from Autodesk.DesignScript.Geometry import *


def biggestLoop(cvs):
	loops = []
	loop = []
	for e,cv in enumerate(cvs):
		try:
			if cv.DoesIntersect(cvs[e+1]):
				loop.append(cv)
			else:
				loop.append(cv)
				loops.append(loop)
				loop = []
		except:
				loop.append(cv)
				loops.append(loop)
				loop = []		
	polys = []
	try:
		for loop in loops:
			poly = PolyCurve.ByJoinedCurves(loop)
			polys.append(poly)
		sortedpoly = sorted(polys,key = lambda x : Surface.ByPatch(x).Area)
		return sortedpoly[-1] 
	except:
		pass
	

output = []
for l in IN[0]:
	try:
		output.append(biggestLoop(l))
	except:
		pass
OUT = output
# ----------------------------------------
curves = PolyCurve.Curves(polyCurve=python_script_7)
byName = FilledRegionType.ByName(name=code_block_7.out1)

# group: Zone de remplissage
byCurves = FilledRegion.ByCurves(view=python_script_6, boundary=curves, regionType=byName)

code_block_19 = CodeBlock()
# ---------- code_block_19.designscript (10 lines) ----------
def cleanDedentsOffset(pc,off)
{
	e = pc.Extrude(1);
	th = e.Thicken(off*2,true);
	sfs = th.Explode();
	test = sfs.NormalAtParameter(0.5,0.5).Z>0.5;
	filter = DSCore.List.FilterByBoolMask(sfs,test)["in"];
	pcs = filter.PerimeterCurves();
	return = pcs;
};
# ----------------------------------------
code_block_20 = CodeBlock { "Ok"; }
code_block_21 = CodeBlock { "Rapport"; }
code_block_22 = CodeBlock { "; "; }
code_block_23 = CodeBlock(x=python_script_4) { x[2]; }
join = String.Join(separator=code_block_22, string0=code_block_23)
code_block_24 = CodeBlock(b=join)
# ---------- code_block_24.designscript (2 lines) ----------
"Les plans de vente n'ont pas pu être générés pour les appartements suivants :
" + b;
# ----------------------------------------
code_block_25 = CodeBlock(x=code_block_24) { x[0]; }
ui_textnote_data = Custom[UI.TextNote Data](Title=code_block_21, TextNote=code_block_25)  # package Data-Shapes; Create Data for TextNote input in UI.MultipleInputForm ++ . Check out www.data-shapes.net for more informations
code_block_26 = CodeBlock { true; }

# group: Creation + nommage vue par appartement
python_script_8 = Python(IN[0]=code_block_12.out0, IN[1]=lastItem, IN[2]=code_block_16.out1)
# ---------- python_script_8.python (45 lines) ----------
import clr

clr.AddReference('RevitAPI')
from Autodesk.Revit.DB import *

clr.AddReference('ProtoGeometry')
from Autodesk.DesignScript.Geometry import *

clr.AddReference('RevitServices')
from RevitServices.Persistence import DocumentManager
from RevitServices.Transactions import TransactionManager

import System
from System.Collections.Generic import*

clr.AddReference('RevitNodes')
import Revit
clr.ImportExtensions(Revit.Elements)
clr.ImportExtensions(Revit.GeometryConversion)

doc = DocumentManager.Instance.CurrentDBDocument
rooms = FilteredElementCollector(doc).OfCategory(BuiltInCategory.OST_Rooms).ToElements()

originalView = UnwrapElement(IN[0])
originalViewType = originalView.GetTypeId()
originalTemplate = originalView.ViewTemplateId

levelList = UnwrapElement(IN[1])

namelist = IN[2]


newViews = []
TransactionManager.Instance.EnsureInTransaction(doc)

for level,name in zip(levelList,namelist):
	v = ViewPlan.Create(doc,originalViewType,level.Id)
	v.ViewTemplateId = originalTemplate
	v.Name = "PDV " + name +"___"
	newViews.append(v)
	
TransactionManager.Instance.TransactionTaskDone

OUT = newViews
	
# ----------------------------------------

# group: Contour par appartement
python_script_9 = Python(IN[0]=python_script_8, IN[1]=curves)
# ---------- python_script_9.python (53 lines) ----------
import clr

clr.AddReference('RevitNodes')
import Revit
clr.ImportExtensions(Revit.GeometryConversion)
clr.ImportExtensions(Revit.Elements)

clr.AddReference('RevitAPI')
import Autodesk
from Autodesk.Revit.DB import *

clr.AddReference('RevitServices')
import RevitServices
from RevitServices.Persistence import DocumentManager
from RevitServices.Transactions import TransactionManager

doc = DocumentManager.Instance.CurrentDBDocument

#prepare input

def tolist(input):
	if isinstance(input,list):
		return input
	else:
		return [input]
		
		
views = UnwrapElement(tolist(IN[0]))
curveslist = tolist(IN[1])


def cropView(view,curves):
	#Create curveloop
	loop = CurveLoop()
	for c in curves:
		loop.Append(c.ToRevitType())
		
	#Set cropregion in Transaction
	TransactionManager.Instance.EnsureInTransaction(doc)
	view.CropBoxActive = True
	view.GetCropRegionShapeManager().SetCropShape(loop)
	TransactionManager.Instance.TransactionTaskDone()
	
failed = []

for v,c in zip(views,curveslist):
	try:
		cropView(v,c)
	except:
		failed.append(c)
		

OUT = views , failed
# ----------------------------------------

code_block_27 = CodeBlock(x=python_script_9) { x[0]; }

# group: Cartouche par feuille
python_script_10 = Python(IN[0]=code_block_7.out0)
# ---------- python_script_10.python (26 lines) ----------
# Activer la prise en charge de Python et charger la bibliothèque DesignScript
import clr
clr.AddReference('RevitAPI')
from Autodesk.Revit.DB import *
clr.AddReference('RevitServices')
from RevitServices.Persistence import DocumentManager
doc = DocumentManager.Instance.CurrentDBDocument
output = []

from RevitServices.Transactions import TransactionManager
TransactionManager.Instance.ForceCloseTransaction

def toList(input):
	if isinstance(input,list):
		return input
	else:
		return [input]

viewsheets = toList(IN[0])
tblocks = FilteredElementCollector(doc).OfCategory(BuiltInCategory.OST_TitleBlocks).ToElements()

for v in viewsheets:
	viewtb = [tb for tb in tblocks if tb.OwnerViewId.IntegerValue == v.Id]	
	output.append(viewtb)

OUT = output
# ----------------------------------------

firstItem_3 = List.FirstItem(list=python_script_10)
type = archilab.Revit.Elements.Elements.Type(element=firstItem_3)

# group: Création de feuilles
code_block_28 = CodeBlock(x=code_block_14.out1) { x + "-PDV"; }
create_2 = List.Create(item0=code_block_27, item1=python_script_6)
transpose_2 = List.Transpose(lists=create_2)
python_script_11 = Python(IN[0]=code_block_28, IN[1]=transpose_2, IN[2]=type)
# ---------- python_script_11.python (34 lines) ----------
#Copyright (c) mostafa el ayoubi
#Data-Shapes 2019 mostafa.elayoubi@data-shapes.io


import clr
clr.AddReference('RevitApi')
from Autodesk.Revit.DB import*
clr.AddReference('RevitServices')
from RevitServices.Persistence import DocumentManager
from RevitServices.Transactions import TransactionManager

doc = DocumentManager.Instance.CurrentDBDocument

sheetNames = IN[0]
viewLists = UnwrapElement(IN[1])
ttblockTypeId = UnwrapElement(IN[2])[0].Id

error = []
success = []

TransactionManager.Instance.EnsureInTransaction(doc)

for sheetname,viewList in zip(sheetNames,viewLists):

	vs = ViewSheet.Create(doc,ttblockTypeId)
	vs.SheetNumber = sheetname
	vs.Name = sheetname
	Viewport.Create(doc,vs.Id,viewList[0].Id,XYZ(0,0,0))
	Viewport.Create(doc,vs.Id,viewList[1].Id,XYZ(0,0,0))
	success.append(vs)

TransactionManager.Instance.TransactionTaskDone

OUT = success
# ----------------------------------------

# group: Création tableau de surfaces par appartement
python_script_12 = Python(IN[0]=code_block_11.out3, IN[1]=code_block_14.out1)
# ---------- python_script_12.python (66 lines) ----------
# Activer la prise en charge de Python et charger la bibliothèque DesignScript
import clr
clr.AddReference('RevitAPI')
from Autodesk.Revit.DB import *
clr.AddReference('RevitServices')
from RevitServices.Persistence import DocumentManager
from RevitServices.Transactions import TransactionManager

doc = DocumentManager.Instance.CurrentDBDocument

def toList(input):
	if isinstance(input,list):
		return UnwrapElement(input)
	else:
		return [UnwrapElement(input)]
		
schedules = toList(IN[0])
levels = toList(IN[1])

dOptions = ViewDuplicateOption.Duplicate

def ChangeLevelInName(name,apptn):
	return name.Split("-")[0] + "- "+ apptn + "__"

def DuplicateChange(viewSchedule,apptn):
	duplicatedSch = doc.GetElement(viewSchedule.Duplicate(dOptions))
	duplicatedSch.Name = ChangeLevelInName(viewSchedule.Name,apptn)
	schDef = duplicatedSch.Definition
	schFilter = schDef.GetFilters()[0]
	schFilter.SetValue(apptn)
	schDef.SetFilter(0,schFilter)
	return 	duplicatedSch


TransactionManager.Instance.ForceCloseTransaction()


#Nettoyage des nomenclatures:
"""
CleanTr = Transaction(doc,"d|s - Nettoyage")
CleanTr.Start()
for schedule in schedules:
	prefix = schedule.Name.Split("-")[0]
	Allchedules = FilteredElementCollector(doc).OfClass(ViewSchedule).ToElements()
	for sch in Allchedules:
		if sch.Name.StartsWith(prefix) and sch.Name != schedule.Name and csh.Name:
			doc.Delete(sch.Id)			
		else:
			continue
CleanTr.Commit()

"""

#Création de toutes les nomenclatures filtrées par niveau
creatTr = Transaction(doc, "d|s - Nomenclatures filtrées")
creatTr.Start()
output = []
for level in levels:
	levelSch = []
	for schedule in schedules:
		levelSch.append(DuplicateChange(schedule,level))
	output.append(levelSch)
creatTr.Commit()


OUT = output
# ----------------------------------------

flatten_2 = List.Flatten(list=python_script_12)

# group: Localisation du tableau
python_script_13 = Python(IN[0]=code_block_11.out1)
# ---------- python_script_13.python (12 lines) ----------
# Activer la prise en charge de Python et charger la bibliothèque DesignScript
import clr
clr.AddReference('RevitAPI')
from Autodesk.Revit.DB import *
clr.AddReference('RevitServices')
from RevitServices.Persistence import DocumentManager
from RevitServices.Transactions import TransactionManager

doc = DocumentManager.Instance.CurrentDBDocument


OUT = [UnwrapElement(s).Point for s in IN[0]][0]
# ----------------------------------------

# group: Ajout du tableau de surface aux feuilles
python_script_14 = Python(IN[0]=python_script_11, IN[1]=flatten_2, IN[2]=python_script_13)
# ---------- python_script_14.python (30 lines) ----------
# Activer la prise en charge de Python et charger la bibliothèque DesignScript
import clr
clr.AddReference('RevitAPI')
from Autodesk.Revit.DB import *
clr.AddReference('RevitServices')
from RevitServices.Persistence import DocumentManager
from RevitServices.Transactions import TransactionManager
clr.AddReference('RevitNodes')
import Revit
clr.ImportExtensions(Revit.Elements)

doc = DocumentManager.Instance.CurrentDBDocument




TransactionManager.Instance.EnsureInTransaction(doc)


for sheet,schedule in zip(IN[0],IN[1]):
	try:
		ScheduleSheetInstance.Create(doc,UnwrapElement(sheet).Id,UnwrapElement(schedule).Id,IN[2])
	except:
		pass

	
TransactionManager.Instance.TransactionTaskDone


OUT = IN[0]
# ----------------------------------------

code_block_29 = CodeBlock { false; }
clean_2 = List.Clean(list=python_script_14, preserveIndices=code_block_29)
end = Revit.Transaction.Transaction.End(input=clean_2)
start = Revit.Transaction.Transaction.Start(input=end)

# group: Localisation des vues
python_script_15 = Python(IN[0]=code_block_11.out0)
# ---------- python_script_15.python (12 lines) ----------
# Activer la prise en charge de Python et charger la bibliothèque DesignScript
import clr
clr.AddReference('RevitAPI')
from Autodesk.Revit.DB import *
clr.AddReference('RevitServices')
from RevitServices.Persistence import DocumentManager
from RevitServices.Transactions import TransactionManager

doc = DocumentManager.Instance.CurrentDBDocument


OUT = [UnwrapElement(s).GetBoxCenter() for s in IN[0]]
# ----------------------------------------

# group: Repositionnement des vues
python_script_16 = Python(IN[0]=start, IN[1]=python_script_15, IN[2]=code_block_11.out0)
# ---------- python_script_16.python (53 lines) ----------
#Copyright (c) mostafa el ayoubi
#Data-Shapes 2019 mostafa.elayoubi@data-shapes.io


import clr
clr.AddReference('RevitApi')
from Autodesk.Revit.DB import*
clr.AddReference('RevitServices')
from RevitServices.Persistence import DocumentManager
from RevitServices.Transactions import TransactionManager

doc = DocumentManager.Instance.CurrentDBDocument

def toList(input):
	if isinstance(input,list) : return UnwrapElement(input)
	else: return [UnwrapElement(input)]
UIunit = Document.GetUnits(doc).GetFormatOptions(UnitType.UT_Length).DisplayUnits
def convunit(x):
	return UnitUtils.ConvertToInternalUnits(x,UIunit)
def bbLength(bb):
	p = bb.Max-bb.Min
	return p.X/2
	
pts = IN[1]
sheets = toList(IN[0])

centers = []

TransactionManager.Instance.EnsureInTransaction(doc)
listvp = []
listvpTypes = [vp.GetTypeId() for vp in UnwrapElement(IN[2])]


for s in sheets:
	viewports = []
	vpid = s.GetAllViewports()
	for id in vpid:
		vpp = doc.GetElement(id)
		viewports.append(doc.GetElement(id))
	listvp.append(viewports)

	

for vp in listvp:
	vp[0].SetBoxCenter(pts[0])
	vp[0].ChangeTypeId(listvpTypes[0])
	vp[1].SetBoxCenter(pts[1])
	vp[1].ChangeTypeId(listvpTypes[1])


TransactionManager.Instance.TransactionTaskDone

OUT = sheets , listvpTypes
# ----------------------------------------

code_block_30 = CodeBlock(a=code_block_26, b=python_script_16) { [a,b][0]; }
ui_multipleinputform_3 = Custom[UI.MultipleInputForm ++](Description_optional=code_block, ButtonText_optional=code_block_20, Inputs=ui_textnote_data, Toggle=code_block_30)

# group: watch
code_block_31 = CodeBlock(x=python_script_9) { x[1]; }

code_block_32 = CodeBlock(x=firstItem_2) { x[0]; }
